# Grasshopper definition Column Mid.gh (Grasshopper 1.0.7)
# plug-ins: Bifocals, Pufferfish, Human

# ----
# House Column Centre
# Beam
W = Slider(200, range=0..1000)
L = Slider(2650, range=0..4880)
construct_point = ConstructPoint(XCoordinate=0, YCoordinate=0, ZCoordinate=0)
construct_point_2 = ConstructPoint(XCoordinate=0, YCoordinate=W, ZCoordinate=0)
construct_point_3 = ConstructPoint(XCoordinate=W, YCoordinate=W, ZCoordinate=0)
construct_point_4 = ConstructPoint(XCoordinate=W, YCoordinate=0, ZCoordinate=0)
unit_z = UnitZ(Factor=L)
_4point_surface = _4PointSurface(CornerA=construct_point, CornerB=construct_point_2, CornerC=construct_point_3, CornerD=construct_point_4)
extrude = Extrude(Base=_4point_surface, Direction=unit_z)
deconstruct_brep = DeconstructBrep(Brep=extrude)  # -> Faces, Edges, Vertices

# ----
# Sub Beam
number_slider = Slider(1086, range=0..1200)
number_slider_2 = Slider(127, range=0..1520)
# House Column Centre
# Beam
# Beam
# Pin
# Sub Beam
W_2 = Slider(120, range=0..1000)
construct_point_5 = ConstructPoint(XCoordinate=0, YCoordinate=0, ZCoordinate=0)
construct_point_6 = ConstructPoint(XCoordinate=number_slider, YCoordinate=0, ZCoordinate=0)
construct_point_7 = ConstructPoint(XCoordinate=number_slider, YCoordinate=0, ZCoordinate=number_slider_2)
construct_point_8 = ConstructPoint(XCoordinate=0, YCoordinate=0, ZCoordinate=number_slider_2)
unit_y = UnitY(Factor=W_2)
_4point_surface_2 = _4PointSurface(CornerA=construct_point_5, CornerB=construct_point_6, CornerC=construct_point_7, CornerD=construct_point_8)
extrude_2 = Extrude(Base=_4point_surface_2, Direction=unit_y)
deconstruct_brep_2 = DeconstructBrep(Brep=extrude_2)  # -> Faces, Edges, Vertices

list_item = ListItem(List=deconstruct_brep.Vertices, Index=Slider(3, range=0..10), Wrap=True)
unit_z_2 = UnitZ(Factor=Slider(2390, range=0..3000))
unit_z_3 = UnitZ(Factor=Slider(900, range=0..1000))
unit_z_4 = UnitZ(Factor=Slider(950, range=0..3000))
unit_z_5 = UnitZ(Factor=Slider(457.68, range=0..1000))
construct_point_9 = ConstructPoint(XCoordinate=Slider(770, range=0..1000), YCoordinate=0, ZCoordinate=expr("-x", Slider(200, range=0..1000)))
move = Move(Geometry=list_item, Motion=unit_z_2)  # -> Geometry, Transform
move_2 = Move(Geometry=list_item, Motion=unit_z_3)  # -> Geometry, Transform
list_item_2 = ListItem(List=deconstruct_brep.Faces, Index=Slider(5, range=0..10), Wrap=True)
list_item_3 = ListItem(List=deconstruct_brep.Faces, Index=Slider(0, range=0..10), Wrap=True)
number_slider_3 = Slider(100, range=0..100)
number_slider_4 = Slider(100, range=0..100)
number_slider_5 = Slider(750, range=0..1000)
area = Area(Geometry=list_item_2)  # -> Area, Centroid
area_2 = Area(Geometry=list_item_3)  # -> Area, Centroid
move_3 = Move(Geometry=move.Geometry, Motion=expr("-x", unit_z_4))  # -> Geometry, Transform
area_3 = Area(Geometry=list_item_2)  # -> Area, Centroid
move_4 = Move(Geometry=move.Geometry, Motion=construct_point_9)  # -> Geometry, Transform
unit_y_2 = UnitY(Factor=Slider(25, range=0..100))
move_5 = Move(Geometry=move_3.Geometry, Motion=unit_z_5)  # -> Geometry, Transform
center_box = CenterBox(Base=area.Centroid, X=number_slider_3, Y=Slider(25, range=0..100), Z=number_slider_3)
center_box_2 = CenterBox(Base=area_2.Centroid, X=Slider(50, range=0..100), Y=Slider(25, range=0..100), Z=Slider(100, range=0..100))
move_6 = Move(Geometry=move_4.Geometry, Motion=unit_z_5)  # -> Geometry, Transform
center_box_3 = CenterBox(Base=area_3.Centroid, X=Slider(1500, range=0..2000), Y=number_slider_4, Z=number_slider_4)
construct_point_10 = ConstructPoint(XCoordinate=0, YCoordinate=0, ZCoordinate=Slider(90, range=0..100))
list_item_4 = ListItem(List=deconstruct_brep_2.Vertices, Index=Slider(3, range=0..10), Wrap=True)
unit_x = UnitX(Factor=Slider(88.61, range=0..1000))
line = Line(StartPoint=move_5.Geometry, EndPoint=move_6.Geometry)
move_7 = Move(Geometry=center_box, Motion=expr("-x", unit_y_2))  # -> Geometry, Transform
move_8 = Move(Geometry=center_box_3, Motion=construct_point_10)  # -> Geometry, Transform
xz_plane = XZPlane(Origin=Point(0, 0, 0))
deconstruct_brep_3 = DeconstructBrep(Brep=list_item_2)  # -> Faces, Edges, Vertices
move_to_point = MoveToPoint(Geometry=extrude_2, PointA=list_item_4, PointB=move_2.Geometry)  # -> Moved, Vector, Transform
move_9 = Move(Geometry=move_5.Geometry, Motion=expr("-x", unit_x))  # -> Geometry, Transform
list_item_5 = ListItem(List=deconstruct_brep_3.Edges, Index=Slider(2, range=0..10), Wrap=True)
offset_curve = OffsetCurve(Curve=line, Plane=xz_plane, Distance=expr("-x", Slider(127, range=0..1000)), BothSides=0, Kinks=0, CapType=1)
center_box_4 = CenterBox(Base=PlaneXY(0, 0, 0), X=Slider(20, range=0..100), Y=Slider(100, range=0..100), Z=Slider(10, range=0..10))
deconstruct_brep_4 = DeconstructBrep(Brep=move_to_point.Moved)  # -> Faces, Edges, Vertices
curve_middle = CurveMiddle(Curve=list_item_5)
deconstruct_brep_5 = DeconstructBrep(Brep=center_box_4)  # -> Faces, Edges, Vertices
deconstruct_brep_6 = DeconstructBrep(Brep=offset_curve)  # -> Faces, Edges, Vertices
panel = Panel("""0
1""")
unit_z_6 = UnitZ(Factor=Slider(40, range=0..100))
center_box_5 = CenterBox(Base=curve_middle, X=Slider(10, range=0..10), Y=Slider(100, range=0..100), Z=Slider(60, range=0..100))
list_item_6 = ListItem(List=deconstruct_brep_4.Vertices, Index=0, Wrap=True)
list_item_7 = ListItem(List=deconstruct_brep_5.Vertices, Index=0, Wrap=True)
list_item_8 = ListItem(List=deconstruct_brep_6.Vertices, Index=panel, Wrap=True)  # -> graft(Item)
move_10 = Move(Geometry=center_box_5, Motion=unit_z_6)  # -> Geometry, Transform
explode_tree = ExplodeTree(Data=list_item_8)  # -> _00000, _00001
move_to_point_2 = MoveToPoint(Geometry=center_box_4, PointA=list_item_7, PointB=list_item_6)  # -> Moved, Vector, Transform
number_slider_6 = Slider(180, range=0..1000)
area_4 = Area(Geometry=deconstruct_brep_6.Faces)  # -> Area, Centroid
_4point_surface_3 = _4PointSurface(CornerA=move_9.Geometry, CornerB=explode_tree._00000, CornerC=explode_tree._00001)
xz_plane_2 = XZPlane(Origin=area_4.Centroid)
rotate_3d = Rotate3D(Geometry=_4point_surface_3, Angle=degrees(number_slider_6), Center=xz_plane_2, Axis=xz_plane_2)  # -> Geometry, Transform
solid_difference = SolidDifference(BrepsA=move_to_point.Moved, BrepsB=flatten(move_to_point_2.Moved))
unit_y_3 = UnitY(Factor=Slider(100, range=0..1000))
brep_join = BrepJoin(Breps=flatten([_4point_surface_3, deconstruct_brep_6.Faces, rotate_3d.Geometry]))  # -> Breps, Closed
extrude_3 = Extrude(Base=brep_join.Breps, Direction=unit_y_3)
deconstruct_brep_7 = DeconstructBrep(Brep=solid_difference)  # -> Faces, Edges, Vertices
unit_x_2 = UnitX(Factor=Slider(10, range=0..10))
deconstruct_brep_8 = DeconstructBrep(Brep=extrude_3)  # -> Faces, Edges, Vertices
list_item_9 = ListItem(List=deconstruct_brep_7.Edges, Index=Slider(2, range=0..10), Wrap=True)
list_item_10 = ListItem(List=deconstruct_brep_7.Faces, Index=Slider(4, range=0..10), Wrap=True)
list_item_11 = ListItem(List=deconstruct_brep_8.Vertices, Index=Slider(1, range=0..100), Wrap=True)
list_item_12 = ListItem(List=deconstruct_brep_8.Edges, Index=Slider(14, range=0..100), Wrap=True)
unit_x_3 = UnitX(Factor=Slider(10, range=0..10))
extrude_4 = Extrude(Base=list_item_10, Direction=expr("-x", unit_x_2))
list_item_13 = ListItem(List=deconstruct_brep_8.Vertices, Index=Slider(11, range=0..100), Wrap=True)
list_item_14 = ListItem(List=deconstruct_brep_8.Edges, Index=Slider(17, range=0..100), Wrap=True)
number_slider_7 = Slider(44.33, range=0..100)
move_11 = Move(Geometry=list_item_11, Motion=expr("-x", unit_x_3))  # -> Geometry, Transform
curve_middle_2 = CurveMiddle(Curve=list_item_14)
curve_middle_3 = CurveMiddle(Curve=list_item_12)
series = Series(Start=0, Step=Slider(25, range=0..100), Count=Slider(4, range=0..10))
center_box_6 = CenterBox(Base=curve_middle_3, X=number_slider_7, Y=Slider(25, range=0..100), Z=Slider(100, range=0..100))
center_box_7 = CenterBox(Base=curve_middle_3, X=number_slider_7, Y=Slider(50, range=0..100), Z=Slider(89, range=0..1000))
deconstruct_brep_9 = DeconstructBrep(Brep=center_box_6)  # -> Faces, Edges, Vertices
deconstruct_brep_10 = DeconstructBrep(Brep=center_box_7)  # -> Faces, Edges, Vertices
unit_y_4 = UnitY(Factor=series)
list_item_15 = ListItem(List=deconstruct_brep_9.Vertices, Index=Slider(1, range=0..10), Wrap=True)
list_item_16 = ListItem(List=deconstruct_brep_10.Vertices, Index=Slider(1, range=0..10), Wrap=True)
move_12 = Move(Geometry=list_item_9, Motion=unit_y_4)  # -> graft(Geometry), Transform
move_to_point_3 = MoveToPoint(Geometry=center_box_6, PointA=list_item_15, PointB=move_11.Geometry)  # -> Moved, Vector, Transform
explode_tree_2 = ExplodeTree(Data=move_12.Geometry)  # -> _0000, _0001, _0002, _0003
move_to_point_4 = MoveToPoint(Geometry=center_box_7, PointA=list_item_16, PointB=list_item_11)  # -> Moved, Vector, Transform
unit_x_4 = UnitX(Factor=Slider(100, range=0..100))
edge_surface = EdgeSurface(CurveA=explode_tree_2._0001, CurveB=explode_tree_2._0003)
number_slider_8 = Slider(90, range=0..100)
extrude_5 = Extrude(Base=edge_surface, Direction=expr("-x", unit_x_4))
solid_difference_2 = SolidDifference(BrepsA=move_to_point_4.Moved, BrepsB=move_to_point_3.Moved)
xz_plane_3 = XZPlane(Origin=Point(0, 0, 0))
rotate_3d_2 = Rotate3D(Geometry=move_to_point_3.Moved, Angle=expr("-x", degrees(number_slider_8)), Center=Point(0, 0, 0), Axis=xz_plane_3)  # -> Geometry, Transform
rotate_3d_3 = Rotate3D(Geometry=solid_difference_2, Angle=expr("-x", degrees(number_slider_8)), Center=Point(0, 0, 0), Axis=xz_plane_3)  # -> Geometry, Transform
deconstruct_brep_11 = DeconstructBrep(Brep=rotate_3d_2.Geometry)  # -> Faces, Edges, Vertices
deconstruct_brep_12 = DeconstructBrep(Brep=rotate_3d_3.Geometry)  # -> Faces, Edges, Vertices
solid_union = SolidUnion(Breps=flatten([solid_difference, extrude_4, extrude_5]))
list_item_17 = ListItem(List=deconstruct_brep_11.Vertices, Index=Slider(7, range=0..10), Wrap=True)
list_item_18 = ListItem(List=deconstruct_brep_12.Vertices, Index=Slider(5, range=0..10), Wrap=True)
move_to_point_5 = MoveToPoint(Geometry=rotate_3d_2.Geometry, PointA=list_item_17, PointB=curve_middle_2)  # -> Moved, Vector, Transform
move_to_point_6 = MoveToPoint(Geometry=rotate_3d_3.Geometry, PointA=list_item_18, PointB=list_item_13)  # -> Moved, Vector, Transform
deconstruct_brep_13 = DeconstructBrep(Brep=solid_union)  # -> Faces, Edges, Vertices
xz_plane_4 = XZPlane(Origin=Point(0, 0, 0))
list_item_19 = ListItem(List=deconstruct_brep_13.Edges, Index=Slider(32, range=0..100), Wrap=True)
deconstruct_brep_14 = DeconstructBrep(Brep=move_to_point_6.Moved)  # -> Faces, Edges, Vertices
unit_z_7 = UnitZ(Factor=Slider(10, range=0..10))
offset_curve_2 = OffsetCurve(Curve=list_item_19, Distance=Slider(30, range=0..100), Plane=xz_plane_4, Corners=1)
list_item_20 = ListItem(List=deconstruct_brep_14.Faces, Index=0, Wrap=True)
curve_middle_4 = CurveMiddle(Curve=offset_curve_2)
extrude_6 = Extrude(Base=list_item_20, Direction=expr("-x", unit_z_7))
xz_plane_5 = XZPlane(Origin=curve_middle_4)
unit_y_5 = UnitY(Factor=Slider(75, range=0..200))
circle = Circle(Plane=xz_plane_5, Radius=Slider(15, range=0..100))
extrude_7 = Extrude(Base=circle, Direction=expr("-x", unit_y_5))
solid_difference_3 = SolidDifference(BrepsA=extrude_3, BrepsB=flatten([move_to_point_3.Moved, move_to_point_5.Moved]))
solid_union_2 = SolidUnion(Breps=flatten([move_to_point_6.Moved, extrude_6]))
cap_holes_ex = CapHolesEx(Brep=extrude_7)  # -> Brep, Caps, Solid
deconstruct_brep_15 = DeconstructBrep(Brep=solid_difference_3)  # -> Faces, Edges, Vertices
list_item_21 = ListItem(List=deconstruct_brep_15.Edges, Index=Slider(12, range=0..100), Wrap=True)
curve_middle_5 = CurveMiddle(Curve=list_item_21)
xz_plane_6 = XZPlane(Origin=curve_middle_5)
unit_y_6 = UnitY(Factor=Slider(100, range=0..200))
circle_2 = Circle(Plane=xz_plane_6, Radius=Slider(15, range=0..100))
extrude_8 = Extrude(Base=circle_2, Direction=expr("-x", unit_y_6))
cap_holes_ex_2 = CapHolesEx(Brep=extrude_8)  # -> Brep, Caps, Solid
merge = Merge(Data2=cap_holes_ex.Brep)
rotate_3d_4 = Rotate3D(Geometry=cap_holes_ex_2.Brep, Angle=degrees(number_slider_6), Center=xz_plane_2, Axis=xz_plane_2)  # -> Geometry, Transform
solid_difference_4 = SolidDifference(BrepsA=solid_union, BrepsB=flatten(merge))
area_5 = Area(Geometry=extrude)  # -> Area, Centroid
merge_2 = Merge(Data1=solid_difference_2, Data2=solid_union_2)
merge_3 = Merge(Data1=cap_holes_ex_2.Brep, Data2=rotate_3d_4.Geometry)
solid_difference_5 = SolidDifference(BrepsA=solid_difference_3, BrepsB=flatten(merge_3))
yz_plane = YZPlane(Origin=area_5.Centroid)
merge_4 = Merge(Data1=solid_difference_5, Data2=rotate_3d_4.Geometry, Data3=cap_holes_ex_2.Brep, Data4=merge)
mirror = Mirror(Geometry=merge_2, Plane=yz_plane)  # -> Geometry, Transform
mirror_2 = Mirror(Geometry=solid_difference_4, Plane=yz_plane)  # -> Geometry, Transform
mirror_3 = Mirror(Geometry=merge_4, Plane=yz_plane)  # -> Geometry, Transform
explode_tree_3 = ExplodeTree(Data=simplify(mirror_3.Geometry))  # -> Branch0, Branch1, Branch2, _0000
solid_union_3 = SolidUnion(Breps=flatten([extrude, center_box_2, move_7.Geometry]))
merge_5 = Merge(Data1=merge_2, Data2=mirror.Geometry)
merge_6 = Merge(Data1=solid_difference_4, Data2=mirror_2.Geometry)
merge_7 = Merge(Data1=solid_difference_5, Data2=explode_tree_3.Branch0)
merge_8 = Merge(
    Data1=rotate_3d_4.Geometry,
    Data2=cap_holes_ex_2.Brep,
    Data3=merge,
    Data4=explode_tree_3.Branch1,
    Data5=explode_tree_3.Branch2,
    Data6=explode_tree_3._0000)
solid_difference_6 = SolidDifference(BrepsA=solid_union_3, BrepsB=flatten([merge_8, move_10.Geometry, merge_6, merge_5]))
solid_difference_7 = SolidDifference(BrepsA=move_8.Geometry, BrepsB=flatten([solid_difference_6, merge_8, merge_5]))

deconstruct_brep_16 = DeconstructBrep(Brep=[solid_difference_6, solid_difference_7, merge_6, merge_7, merge_8])  # -> Faces, Edges, Vertices
custom_preview_lineweights = CustomPreviewLineweights(
    Geometry=deconstruct_brep_16.Edges,
    Shader=ColourSwatch(SwatchColor=RGB(0, 0, 0)),
    Thickness=Slider(5, range=0..5),
    Absolute=False)
custom_preview = CustomPreview(Geometry=solid_difference_6, Material=ColourSwatch(SwatchColor=RGBA(255, 112, 112, 200)))
custom_preview_2 = CustomPreview(Geometry=solid_difference_7, Material=ColourSwatch(SwatchColor=RGBA(112, 193, 255, 200)))
custom_preview_3 = CustomPreview(Geometry=merge_6, Material=ColourSwatch(SwatchColor=RGBA(136, 255, 112, 200)))
custom_preview_4 = CustomPreview(Geometry=merge_7, Material=ColourSwatch(SwatchColor=RGBA(200, 112, 255, 200)))
custom_preview_5 = CustomPreview(Geometry=merge_8, Material=ColourSwatch(SwatchColor=RGBA(255, 255, 112, 200)))
custom_preview_6 = CustomPreview(Material=ColourSwatch(SwatchColor=RGB(135, 68, 42)))
