# Grasshopper definition corner joint.gh (Grasshopper 1.0.7)
# plug-ins: Human, Pufferfish

# ----
# Beam
W = Slider(200, range=0..1000)
L = Slider(1000, range=0..1000)
construct_point = ConstructPoint(XCoordinate=0, YCoordinate=0, ZCoordinate=0)
construct_point_2 = ConstructPoint(XCoordinate=W, YCoordinate=0, ZCoordinate=0)
construct_point_3 = ConstructPoint(XCoordinate=W, YCoordinate=L, ZCoordinate=0)
construct_point_4 = ConstructPoint(XCoordinate=0, YCoordinate=L, ZCoordinate=0)
unit_z = UnitZ(Factor=W)
_4point_surface = _4PointSurface(CornerA=construct_point, CornerB=construct_point_2, CornerC=construct_point_3, CornerD=construct_point_4)
extrude = Extrude(Base=_4point_surface, Direction=unit_z)
deconstruct_brep = DeconstructBrep(Brep=extrude)  # -> Faces, Edges, Vertices

# ----
# House Corner
# Beam
W_2 = Slider(200, range=0..1000)
L_2 = Slider(1000, range=0..1000)
# 90 deg
construct_point_5 = ConstructPoint(XCoordinate=0, YCoordinate=0, ZCoordinate=0)
construct_point_6 = ConstructPoint(XCoordinate=0, YCoordinate=W_2, ZCoordinate=0)
construct_point_7 = ConstructPoint(XCoordinate=L_2, YCoordinate=W_2, ZCoordinate=0)
construct_point_8 = ConstructPoint(XCoordinate=L_2, YCoordinate=0, ZCoordinate=0)
unit_z_2 = UnitZ(Factor=W_2)
_4point_surface_2 = _4PointSurface(CornerA=construct_point_5, CornerB=construct_point_6, CornerC=construct_point_7, CornerD=construct_point_8)
extrude_2 = Extrude(Base=_4point_surface_2, Direction=unit_z_2)
deconstruct_brep_2 = DeconstructBrep(Brep=extrude_2)  # -> Faces, Edges, Vertices

center_box = CenterBox(Base=PlaneXY(0, 0, 0), X=Slider(5, range=0..100), Y=Slider(34.7, range=0..100), Z=Slider(100, range=0..100))
unit_y = UnitY(Factor=1)
unit_z_3 = UnitZ(Factor=1)
deconstruct_brep_3 = DeconstructBrep(Brep=center_box)  # -> Faces, Edges, Vertices
rotate = Rotate(Vector=unit_y, Axis=unit_z_3, Angle=degrees("45"))
list_item = ListItem(List=deconstruct_brep_3.Vertices, Index=0, Wrap=True)
unit_z_4 = UnitZ(Factor=Slider(200, range=0..1000))
line_sdl = LineSDL(Start=list_item, Direction=rotate, Length=expr("-x", Slider(100, range=0..100)))
list_item_2 = ListItem(List=deconstruct_brep_2.Edges, Index=Slider(4, range=0..10), Wrap=True)
extrude_3 = Extrude(Base=line_sdl, Direction=unit_z_4)
offset_curve = OffsetCurve(Curve=list_item_2, Distance=Slider(10, range=0..10), Corners=1)
xz_plane = XZPlane(Origin=Point(0, 0, 0))
unit_y_2 = UnitY(Factor=Slider(50, range=0..100))
offset_curve_2 = OffsetCurve(Curve=offset_curve, Plane=xz_plane, Distance=Slider(190, range=0..1000), BothSides=0, Kinks=0, CapType=1)
offset_surface = OffsetSurface(Surface=extrude_3, Distance=Slider(34, range=0..100), Retrim=True)
list_item_3 = ListItem(List=deconstruct_brep.Vertices, Index=Slider(6, range=0..10), Wrap=True)
extrude_4 = Extrude(Base=offset_curve_2, Direction=expr("-x", unit_y_2))
loft = Loft(
    Curves=[extrude_3, offset_surface],
    Options={Adjust=False, Closed=False, LoftEnds=0, LoftSimp=0, LoftType=0, Rebuild=10, Refit=0.01})
cap_holes_ex = CapHolesEx(Brep=extrude_4)  # -> Brep, Caps, Solid
cap_holes_ex_2 = CapHolesEx(Brep=loft)  # -> Brep, Caps, Solid
solid_union = SolidUnion(Breps=flatten([center_box, cap_holes_ex_2.Brep]))
solid_difference = SolidDifference(BrepsA=extrude_2, BrepsB=cap_holes_ex.Brep)
deconstruct_brep_4 = DeconstructBrep(Brep=solid_difference)  # -> Faces, Edges, Vertices
deconstruct_brep_5 = DeconstructBrep(Brep=solid_union)  # -> Faces, Edges, Vertices
list_item_4 = ListItem(List=deconstruct_brep_4.Vertices, Index=Slider(8, range=0..20), Wrap=True)
list_item_5 = ListItem(List=deconstruct_brep_4.Vertices, Index=Slider(3, range=0..20), Wrap=True)
list_item_6 = ListItem(List=deconstruct_brep_5.Vertices, Index=Slider(10, range=0..10), Wrap=True)
move_to_point = MoveToPoint(Geometry=solid_union, PointA=list_item_6, PointB=list_item_3)  # -> Moved, Vector, Transform
solid_difference_2 = SolidDifference(BrepsA=extrude, BrepsB=move_to_point.Moved)
deconstruct_brep_6 = DeconstructBrep(Brep=solid_difference_2)  # -> Faces, Edges, Vertices
center_box_2 = CenterBox(Base=PlaneXY(0, 0, 0), X=Slider(70, range=0..100), Y=Slider(57.5, range=0..100), Z=Slider(25, range=0..100))
center_box_3 = CenterBox(Base=PlaneXY(0, 0, 0), X=Slider(70, range=0..100), Y=Slider(62.5, range=0..100), Z=Slider(25, range=0..100))
solid_difference_3 = SolidDifference(BrepsA=extrude, BrepsB=move_to_point.Moved)
deconstruct_brep_7 = DeconstructBrep(Brep=center_box_3)  # -> Faces, Edges, Vertices
list_item_7 = ListItem(List=deconstruct_brep_6.Edges, Index=Slider(13, range=0..100), Wrap=True)
unit_z_5 = UnitZ(Factor=Slider(50, range=0..100))
curve_middle = CurveMiddle(Curve=list_item_7)
deconstruct_brep_8 = DeconstructBrep(Brep=solid_difference_3)  # -> Faces, Edges, Vertices
deconstruct_brep_9 = DeconstructBrep(Brep=center_box_2)  # -> Faces, Edges, Vertices
list_item_8 = ListItem(List=deconstruct_brep_7.Edges, Index=Slider(9, range=0..10), Wrap=True)
move = Move(Geometry=curve_middle, Motion=unit_z_5)  # -> Geometry, Transform
curve_middle_2 = CurveMiddle(Curve=list_item_8)
list_item_9 = ListItem(List=deconstruct_brep_8.Edges, Index=Slider(13, range=0..100), Wrap=True)
list_item_10 = ListItem(List=deconstruct_brep_9.Edges, Index=Slider(9, range=0..10), Wrap=True)
move_to_point_2 = MoveToPoint(Geometry=center_box_3, PointA=curve_middle_2, PointB=move.Geometry)  # -> Moved, Vector, Transform
curve_middle_3 = CurveMiddle(Curve=list_item_9)
curve_middle_4 = CurveMiddle(Curve=list_item_10)
move_to_point_3 = MoveToPoint(Geometry=center_box_2, PointA=curve_middle_4, PointB=curve_middle_3)  # -> Moved, Vector, Transform
solid_union_2 = SolidUnion(Breps=flatten([solid_difference_2, move_to_point_2.Moved]))
yz_plane = YZPlane(Origin=Point(0, 0, 0))
rotate_2 = Rotate(Geometry=solid_union_2, Angle=expr("-x", 1.570796327), Plane=yz_plane)  # -> Geometry, Transform
solid_union_3 = SolidUnion(Breps=flatten([solid_difference_3, move_to_point_3.Moved]))
deconstruct_brep_10 = DeconstructBrep(Brep=solid_union_3)  # -> Faces, Edges, Vertices
deconstruct_brep_11 = DeconstructBrep(Brep=rotate_2.Geometry)  # -> Faces, Edges, Vertices
list_item_11 = ListItem(List=deconstruct_brep_11.Vertices, Index=Slider(13, range=0..100), Wrap=True)
list_item_12 = ListItem(List=deconstruct_brep_10.Vertices, Index=Slider(10, range=0..20), Wrap=True)
move_to_point_4 = MoveToPoint(Geometry=solid_union_3, PointA=list_item_12, PointB=list_item_4)  # -> Moved, Vector, Transform
move_to_point_5 = MoveToPoint(Geometry=rotate_2.Geometry, PointA=list_item_11, PointB=list_item_5)  # -> Moved, Vector, Transform
deconstruct_brep_12 = DeconstructBrep(Brep=move_to_point_4.Moved)  # -> Faces, Edges, Vertices
deconstruct_brep_13 = DeconstructBrep(Brep=move_to_point_5.Moved)  # -> Faces, Edges, Vertices
xz_plane_2 = XZPlane(Origin=Point(0, 0, 0))
list_item_13 = ListItem(List=deconstruct_brep_12.Edges, Index=Slider(4, range=0..10), Wrap=True)
list_item_14 = ListItem(List=deconstruct_brep_13.Edges, Index=Slider(0, range=0..10), Wrap=True)
offset_curve_3 = OffsetCurve(Curve=list_item_13, Distance=expr("-x", Slider(40, range=0..100)), Corners=1)
offset_curve_4 = OffsetCurve(Curve=list_item_14, Distance=expr("-x", Slider(40, range=0..100)), Plane=xz_plane_2, Corners=1)
curve_middle_5 = CurveMiddle(Curve=offset_curve_4)
number_slider = Slider(15, range=0..100)
number_slider_2 = Slider(75, range=0..150)
curve_middle_6 = CurveMiddle(Curve=offset_curve_3)
xz_plane_3 = XZPlane(Origin=curve_middle_5)
unit_z_6 = UnitZ(Factor=number_slider_2)
unit_z_7 = UnitZ(Factor=Slider(200, range=0..200))
unit_y_3 = UnitY(Factor=number_slider_2)
circle = Circle(Plane=curve_middle_6, Radius=number_slider)
circle_2 = Circle(Plane=xz_plane_3, Radius=number_slider)
move_2 = Move(Geometry=circle, Motion=unit_z_6)  # -> Geometry, Transform
move_3 = Move(Geometry=circle_2, Motion=unit_y_3)  # -> Geometry, Transform
unit_y_4 = UnitY(Factor=Slider(190, range=0..200))
extrude_5 = Extrude(Base=move_2.Geometry, Direction=expr("-x", unit_z_7))
extrude_6 = Extrude(Base=move_3.Geometry, Direction=expr("-x", unit_y_4))
cap_holes_ex_3 = CapHolesEx(Brep=extrude_5)  # -> Brep, Caps, Solid
cap_holes_ex_4 = CapHolesEx(Brep=extrude_6)  # -> Brep, Caps, Solid
solid_difference_4 = SolidDifference(BrepsA=move_to_point_4.Moved, BrepsB=cap_holes_ex_3.Brep)
solid_difference_5 = SolidDifference(BrepsA=solid_difference, BrepsB=flatten([cap_holes_ex_3.Brep, solid_difference_4, cap_holes_ex_4.Brep]))
solid_difference_6 = SolidDifference(BrepsA=move_to_point_5.Moved, BrepsB=cap_holes_ex_4.Brep)
brep = Brep(cap_holes_ex_3.Brep)
brep_2 = Brep(cap_holes_ex_4.Brep)
merge = Merge(Data1=brep, Data2=brep_2)

deconstruct_brep_14 = DeconstructBrep(Brep=[solid_difference_4, solid_difference_5, merge, solid_difference_6])  # -> Faces, Edges, Vertices
custom_preview_lineweights = CustomPreviewLineweights(
    Geometry=deconstruct_brep_14.Edges,
    Shader=ColourSwatch(SwatchColor=RGB(0, 0, 0)),
    Thickness=Slider(5, range=0..5),
    Absolute=False)
custom_preview = CustomPreview(Geometry=solid_difference_5, Material=ColourSwatch(SwatchColor=RGBA(255, 112, 112, 200)))
custom_preview_2 = CustomPreview(Geometry=solid_difference_4, Material=ColourSwatch(SwatchColor=RGBA(112, 193, 255, 200)))
custom_preview_3 = CustomPreview(Geometry=solid_difference_6, Material=ColourSwatch(SwatchColor=RGBA(136, 255, 112, 200)))
custom_preview_4 = CustomPreview(Geometry=merge, Material=ColourSwatch(SwatchColor=RGBA(200, 112, 255, 200)))
custom_preview_5 = CustomPreview(Material=ColourSwatch(SwatchColor=RGBA(255, 255, 112, 200)))
custom_preview_6 = CustomPreview(Material=ColourSwatch(SwatchColor=RGB(135, 68, 42)))
