# Grasshopper definition Floor frame.gh (Grasshopper 1.0.7)
# plug-ins: Human, Pufferfish

center_box = CenterBox(Base=PlaneXY(0, 0, 0), X=Slider(5, range=0..100), Y=Slider(34.7, range=0..100), Z=Slider(100, range=0..100))
unit_y = UnitY(Factor=1)
unit_z = UnitZ(Factor=1)

# ----
# Sub-Beam
W = Slider(200, range=0..1000)
L = Slider(3280, range=0..3400)
construct_point = ConstructPoint(XCoordinate=0, YCoordinate=0, ZCoordinate=0)
construct_point_2 = ConstructPoint(XCoordinate=W, YCoordinate=0, ZCoordinate=0)
construct_point_3 = ConstructPoint(XCoordinate=W, YCoordinate=L, ZCoordinate=0)
construct_point_4 = ConstructPoint(XCoordinate=0, YCoordinate=L, ZCoordinate=0)
unit_z_2 = UnitZ(Factor=W)
_4point_surface = _4PointSurface(CornerA=construct_point, CornerB=construct_point_2, CornerC=construct_point_3, CornerD=construct_point_4)
extrude = Extrude(Base=_4point_surface, Direction=unit_z_2)
deconstruct_brep = DeconstructBrep(Brep=extrude)  # -> Faces, Edges, Vertices

# ----
# House Corner
# Beam
W_2 = Slider(200, range=0..1000)
L_2 = Slider(4880, range=0..4880)
# 90 deg
construct_point_5 = ConstructPoint(XCoordinate=0, YCoordinate=0, ZCoordinate=0)
construct_point_6 = ConstructPoint(XCoordinate=0, YCoordinate=W_2, ZCoordinate=0)
construct_point_7 = ConstructPoint(XCoordinate=L_2, YCoordinate=W_2, ZCoordinate=0)
construct_point_8 = ConstructPoint(XCoordinate=L_2, YCoordinate=0, ZCoordinate=0)
unit_z_3 = UnitZ(Factor=W_2)
_4point_surface_2 = _4PointSurface(CornerA=construct_point_5, CornerB=construct_point_6, CornerC=construct_point_7, CornerD=construct_point_8)
extrude_2 = Extrude(Base=_4point_surface_2, Direction=unit_z_3)
deconstruct_brep_2 = DeconstructBrep(Brep=extrude_2)  # -> Faces, Edges, Vertices

deconstruct_brep_3 = DeconstructBrep(Brep=center_box)  # -> Faces, Edges, Vertices

# ----
# Sub-Beam
W_3 = Slider(127, range=0..1000)
L_3 = Slider(2600, range=0..3000)
construct_point_9 = ConstructPoint(XCoordinate=0, YCoordinate=0, ZCoordinate=0)
construct_point_10 = ConstructPoint(XCoordinate=W_3, YCoordinate=0, ZCoordinate=0)
construct_point_11 = ConstructPoint(XCoordinate=W_3, YCoordinate=L_3, ZCoordinate=0)
construct_point_12 = ConstructPoint(XCoordinate=0, YCoordinate=L_3, ZCoordinate=0)
unit_z_4 = UnitZ(Factor=Slider(65, range=0..100))
_4point_surface_3 = _4PointSurface(CornerA=construct_point_9, CornerB=construct_point_10, CornerC=construct_point_11, CornerD=construct_point_12)
extrude_3 = Extrude(Base=_4point_surface_3, Direction=unit_z_4)
deconstruct_brep_4 = DeconstructBrep(Brep=extrude_3)  # -> Faces, Edges, Vertices

W_4 = Slider(115, range=0..1000)

# ----
# Sub-Beam
W_5 = Slider(127, range=0..1000)
L_4 = Slider(3412, range=0..3500)
construct_point_13 = ConstructPoint(XCoordinate=0, YCoordinate=0, ZCoordinate=0)
construct_point_14 = ConstructPoint(XCoordinate=W_5, YCoordinate=0, ZCoordinate=0)
construct_point_15 = ConstructPoint(XCoordinate=W_5, YCoordinate=L_4, ZCoordinate=0)
construct_point_16 = ConstructPoint(XCoordinate=0, YCoordinate=L_4, ZCoordinate=0)
unit_z_5 = UnitZ(Factor=W_4)
_4point_surface_4 = _4PointSurface(CornerA=construct_point_13, CornerB=construct_point_14, CornerC=construct_point_15, CornerD=construct_point_16)
extrude_4 = Extrude(Base=_4point_surface_4, Direction=unit_z_5)
deconstruct_brep_5 = DeconstructBrep(Brep=extrude_4)  # -> Faces, Edges, Vertices

rotate = Rotate(Vector=unit_y, Axis=unit_z, Angle=degrees("45"))
list_item = ListItem(List=deconstruct_brep_3.Vertices, Index=0, Wrap=True)
unit_z_6 = UnitZ(Factor=Slider(200, range=0..1000))
line_sdl = LineSDL(Start=list_item, Direction=rotate, Length=expr("-x", Slider(100, range=0..100)))
center_box_2 = CenterBox(Base=PlaneXY(0, 0, 0), X=Slider(70, range=0..100), Y=Slider(30, range=0..100), Z=Slider(25, range=0..100))
deconstruct_brep_6 = DeconstructBrep(Brep=center_box_2)  # -> Faces, Edges, Vertices
extrude_5 = Extrude(Base=line_sdl, Direction=unit_z_6)
list_item_2 = ListItem(List=deconstruct_brep_6.Faces, Index=Slider(8, range=0..10), Wrap=True)
offset_surface = OffsetSurface(Surface=extrude_5, Distance=Slider(34, range=0..100), Retrim=True)
area = Area(Geometry=list_item_2)  # -> Area, Centroid
area_2 = Area(Geometry=extrude)  # -> Area, Centroid
list_item_3 = ListItem(List=deconstruct_brep.Vertices, Index=Slider(2, range=0..10), Wrap=True)
list_item_4 = ListItem(List=deconstruct_brep_4.Faces, Index=Slider(5, range=0..10), Wrap=True)
loft = Loft(
    Curves=[extrude_5, offset_surface],
    Options={Adjust=False, Closed=False, LoftEnds=0, LoftSimp=0, LoftType=0, Rebuild=10, Refit=0.01})
list_item_5 = ListItem(List=deconstruct_brep_5.Faces, Index=Slider(6, range=0..10), Wrap=True)
xz_plane = XZPlane(Origin=area_2.Centroid)
area_3 = Area(Geometry=list_item_4)  # -> Area, Centroid
area_4 = Area(Geometry=list_item_5)  # -> Area, Centroid
cap_holes_ex = CapHolesEx(Brep=loft)  # -> Brep, Caps, Solid
solid_union = SolidUnion(Breps=flatten([center_box, cap_holes_ex.Brep]))
move_to_point = MoveToPoint(Geometry=extrude_3, PointA=area_3.Centroid, PointB=area_4.Centroid)  # -> Moved, Vector, Transform
deconstruct_brep_7 = DeconstructBrep(Brep=solid_union)  # -> Faces, Edges, Vertices
unit_y_2 = UnitY(Factor=1)
deconstruct_brep_8 = DeconstructBrep(Brep=move_to_point.Moved)  # -> Faces, Edges, Vertices
unit_x = UnitX(Factor=1)
list_item_6 = ListItem(List=deconstruct_brep_7.Vertices, Index=Slider(8, range=0..10), Wrap=True)
move_to_point_2 = MoveToPoint(Geometry=solid_union, PointA=list_item_6, PointB=list_item_3)  # -> Moved, Vector, Transform
rotate_2 = Rotate(Vector=unit_y_2, Axis=unit_x, Angle=degrees("15"))
area_5 = Area(Geometry=move_to_point.Moved)  # -> Area, Centroid
list_item_7 = ListItem(List=deconstruct_brep_8.Vertices, Index=Slider(7, range=0..10), Wrap=True)
list_item_8 = ListItem(List=deconstruct_brep_8.Vertices, Index=Slider(3, range=0..10), Wrap=True)
line_sdl_2 = LineSDL(Start=list_item_8, Direction=rotate_2, Length=Slider(280, range=0..500))
mirror = Mirror(Geometry=move_to_point_2.Moved, Plane=xz_plane)  # -> Geometry, Transform
end_points = EndPoints(Curve=line_sdl_2)  # -> Start, End
unit_x_2 = UnitX(Factor=W_3)
_4point_surface_5 = _4PointSurface(CornerA=end_points.Start, CornerB=end_points.End, CornerC=list_item_7)
xz_plane_2 = XZPlane(Origin=area_5.Centroid)
solid_difference = SolidDifference(BrepsA=extrude, BrepsB=[mirror.Geometry, move_to_point_2.Moved])
extrude_6 = Extrude(Base=_4point_surface_5, Direction=unit_x_2)
deconstruct_brep_9 = DeconstructBrep(Brep=solid_difference)  # -> Faces, Edges, Vertices
mirror_2 = Mirror(Geometry=extrude_6, Plane=xz_plane_2)  # -> Geometry, Transform
list_item_9 = ListItem(List=deconstruct_brep_9.Faces, Index=Slider(3, range=0..10), Wrap=True)
area_6 = Area(Geometry=list_item_9)  # -> Area, Centroid
solid_union_2 = SolidUnion(Breps=flatten([move_to_point.Moved, mirror_2.Geometry, extrude_6, extrude_4]))
move_to_point_3 = MoveToPoint(Geometry=center_box_2, PointA=area.Centroid, PointB=area_6.Centroid)  # -> Moved, Vector, Transform
deconstruct_brep_10 = DeconstructBrep(Brep=solid_union_2)  # -> Faces, Edges, Vertices
mirror_3 = Mirror(Geometry=move_to_point_3.Moved, Plane=xz_plane)  # -> Geometry, Transform
list_item_10 = ListItem(List=deconstruct_brep_10.Edges, Index=Slider(19, range=0..100), Wrap=True)
solid_union_3 = SolidUnion(Breps=flatten([solid_difference, mirror_3.Geometry, move_to_point_3.Moved]))
offset_curve = OffsetCurve(Curve=list_item_10, Distance=Slider(76, range=0..100), Corners=1)
curve_middle = CurveMiddle(Curve=offset_curve)
deconstruct_brep_11 = DeconstructBrep(Brep=solid_union_3)  # -> Faces, Edges, Vertices
number_slider = Slider(63.5, range=0..100)
number_slider_2 = Slider(30, range=0..1000)
list_item_11 = ListItem(List=deconstruct_brep_2.Edges, Index=Slider(7, range=0..10), Wrap=True)
list_item_12 = ListItem(List=deconstruct_brep_2.Edges, Index=Slider(7, range=0..10), Wrap=True)
list_item_13 = ListItem(List=deconstruct_brep_11.Vertices, Index=Slider(18, range=0..100), Wrap=True)
list_item_14 = ListItem(List=deconstruct_brep_11.Edges, Index=Slider(29, range=0..100), Wrap=True)
divide_curve = DivideCurve(Curve=list_item_11, Count="6", Kinks=False)  # -> Points, Tangents, Parameters
divide_curve_2 = DivideCurve(Curve=list_item_12, Count="6", Kinks=False)  # -> Points, Tangents, Parameters
panel = Panel("""1
2
4
5""")
curve_middle_2 = CurveMiddle(Curve=list_item_14)
center_box_3 = CenterBox(Base=PlaneXY(0, 0, 0), X=number_slider, Y=number_slider_2, Z=Slider(40, range=0..100))
center_box_4 = CenterBox(Base=PlaneXY(0, 0, 0), X=number_slider, Y=number_slider_2, Z=Slider(17.5, range=0..100))
list_item_15 = ListItem(List=divide_curve.Points, Index=panel, Wrap=True)
list_item_16 = ListItem(List=divide_curve_2.Points, Index="3", Wrap=True)
deconstruct_brep_12 = DeconstructBrep(Brep=center_box_3)  # -> Faces, Edges, Vertices
list_item_17 = ListItem(List=divide_curve.Points, Index="0", Wrap=True)
move_to_point_4 = MoveToPoint(Geometry=solid_union_2, PointA=curve_middle, PointB=list_item_15)  # -> Moved, Vector, Transform
move_to_point_5 = MoveToPoint(Geometry=solid_union_2, PointA=curve_middle, PointB=list_item_16)  # -> Moved, Vector, Transform
list_item_18 = ListItem(List=deconstruct_brep_12.Edges, Index=Slider(4, range=0..10), Wrap=True)
deconstruct_brep_13 = DeconstructBrep(Brep=center_box_4)  # -> Faces, Edges, Vertices
deconstruct_brep_14 = DeconstructBrep(Brep=move_to_point_5.Moved)  # -> Faces, Edges, Vertices
curve_middle_3 = CurveMiddle(Curve=list_item_18)
list_item_19 = ListItem(List=deconstruct_brep_13.Vertices, Index=Slider(2, range=0..100), Wrap=True)
list_item_20 = ListItem(List=deconstruct_brep_14.Edges, Index=Slider(19, range=0..20), Wrap=True)
curve_middle_4 = CurveMiddle(Curve=list_item_20)
move_to_point_6 = MoveToPoint(Geometry=center_box_3, PointA=curve_middle_3, PointB=curve_middle_4)  # -> Moved, Vector, Transform
area_7 = Area(Geometry=move_to_point_5.Moved)  # -> Area, Centroid
xz_plane_3 = XZPlane(Origin=area_7.Centroid)
yz_plane = YZPlane(Origin=area_7.Centroid)
mirror_4 = Mirror(Geometry=move_to_point_6.Moved, Plane=xz_plane_3)  # -> Geometry, Transform
solid_difference_2 = SolidDifference(BrepsA=move_to_point_5.Moved, BrepsB=flatten([mirror_4.Geometry, move_to_point_6.Moved]))
deconstruct_brep_15 = DeconstructBrep(Brep=solid_difference_2)  # -> Faces, Edges, Vertices
list_item_21 = ListItem(List=deconstruct_brep_15.Vertices, Index=Slider(9, range=0..100), Wrap=True)
list_item_22 = ListItem(List=deconstruct_brep_15.Edges, Index=Slider(14, range=0..100), Wrap=True)
offset_curve_2 = OffsetCurve(Curve=list_item_22, Distance=Slider(25, range=0..100), Corners=1)
move_to_point_7 = MoveToPoint(Geometry=center_box_4, PointA=list_item_19, PointB=list_item_21)  # -> Moved, Vector, Transform
curve_middle_5 = CurveMiddle(Curve=offset_curve_2)
mirror_5 = Mirror(Geometry=move_to_point_7.Moved, Plane=xz_plane_3)  # -> Geometry, Transform
unit_z_7 = UnitZ(Factor=Slider(115, range=0..200))
circle = Circle(Plane=curve_middle_5, Radius=Slider(15, range=0..100))
solid_union_4 = SolidUnion(Breps=flatten([solid_difference_2, move_to_point_7.Moved, mirror_5.Geometry]))
solid_difference_3 = SolidDifference(BrepsA=extrude_2, BrepsB=flatten([move_to_point_4.Moved, solid_union_4]))
extrude_7 = Extrude(Base=circle, Direction=unit_z_7)
cap_holes_ex_2 = CapHolesEx(Brep=extrude_7)  # -> Brep, Caps, Solid
area_8 = Area(Geometry=flatten(solid_difference_2))  # -> Area, Centroid
solid_difference_4 = SolidDifference(BrepsA=solid_union_4, BrepsB=cap_holes_ex_2.Brep)
xz_plane_4 = XZPlane(Origin=area_8.Centroid)
solid_difference_5 = SolidDifference(BrepsA=solid_difference_3, BrepsB=flatten(cap_holes_ex_2.Brep))
mirror_6 = Mirror(Geometry=solid_difference_3, Plane=xz_plane_4)  # -> Geometry, Transform
list_item_23 = ListItem(List=divide_curve.Points, Index=0, Wrap=True)
deconstruct_brep_16 = DeconstructBrep(Brep=mirror_6.Geometry)  # -> Faces, Edges, Vertices
list_item_24 = ListItem(List=deconstruct_brep_16.Vertices, Index=Slider(5, range=0..100), Wrap=True)
merge = Merge(Data1=mirror_6.Geometry, Data2=solid_difference_3)
line = Line(StartPoint=list_item_23, EndPoint=list_item_24)
curve_middle_6 = CurveMiddle(Curve=line)
move_to_point_8 = MoveToPoint(Geometry=solid_union_3, PointA=curve_middle_2, PointB=curve_middle_6)  # -> Moved, Vector, Transform
mirror_7 = Mirror(Geometry=move_to_point_8.Moved, Plane=yz_plane)  # -> Geometry, Transform
merge_2 = Merge(Data1=move_to_point_8.Moved, Data2=mirror_7.Geometry)
solid_difference_6 = SolidDifference(BrepsA=merge, BrepsB=flatten(merge_2))
merge_3 = Merge(Data2=solid_difference_6)

deconstruct_brep_17 = DeconstructBrep(Brep=[merge_3, merge_2, solid_difference_4, move_to_point_4.Moved])  # -> Faces, Edges, Vertices
custom_preview_lineweights = CustomPreviewLineweights(
    Geometry=deconstruct_brep_17.Edges,
    Shader=ColourSwatch(SwatchColor=RGB(0, 0, 0)),
    Thickness=Slider(5, range=0..5),
    Absolute=False)
custom_preview = CustomPreview(Geometry=merge_3, Material=ColourSwatch(SwatchColor=RGBA(255, 112, 112, 200)))
custom_preview_2 = CustomPreview(Geometry=merge_2, Material=ColourSwatch(SwatchColor=RGBA(112, 193, 255, 200)))
custom_preview_3 = CustomPreview(Geometry=solid_difference_4, Material=ColourSwatch(SwatchColor=RGBA(136, 255, 112, 200)))
custom_preview_4 = CustomPreview(Geometry=move_to_point_4.Moved, Material=ColourSwatch(SwatchColor=RGBA(200, 112, 255, 200)))
custom_preview_5 = CustomPreview(Geometry=cap_holes_ex_2.Brep, Material=ColourSwatch(SwatchColor=RGBA(255, 255, 112, 200)))
custom_preview_6 = CustomPreview(Material=ColourSwatch(SwatchColor=RGB(135, 68, 42)))
