# Grasshopper definition Timber frame.gh (Grasshopper 1.0.7)
# plug-ins: Pufferfish, Bifocals, Human

center_box = CenterBox(Base=PlaneXY(0, 0, 0), X=Slider(5, range=0..100), Y=Slider(34.7, range=0..100), Z=Slider(100, range=0..100))
unit_y = UnitY(Factor=1)
unit_z = UnitZ(Factor=1)

# ----
# Sub-Beam
W = Slider(200, range=0..1000)
L = Slider(3280, range=0..3400)
construct_point = ConstructPoint(XCoordinate=0, YCoordinate=0, ZCoordinate=0)
construct_point_2 = ConstructPoint(XCoordinate=W, YCoordinate=0, ZCoordinate=0)
construct_point_3 = ConstructPoint(XCoordinate=W, YCoordinate=L, ZCoordinate=0)
construct_point_4 = ConstructPoint(XCoordinate=0, YCoordinate=L, ZCoordinate=0)
unit_z_2 = UnitZ(Factor=W)
_4point_surface = _4PointSurface(CornerA=construct_point, CornerB=construct_point_2, CornerC=construct_point_3, CornerD=construct_point_4)
extrude = Extrude(Base=_4point_surface, Direction=unit_z_2)
deconstruct_brep = DeconstructBrep(Brep=extrude)  # -> Faces, Edges, Vertices

# ----
# House Corner
# Beam
W_2 = Slider(200, range=0..1000)
L_2 = Slider(4880, range=0..4880)
# Base
construct_point_5 = ConstructPoint(XCoordinate=0, YCoordinate=0, ZCoordinate=0)
construct_point_6 = ConstructPoint(XCoordinate=0, YCoordinate=W_2, ZCoordinate=0)
construct_point_7 = ConstructPoint(XCoordinate=L_2, YCoordinate=W_2, ZCoordinate=0)
construct_point_8 = ConstructPoint(XCoordinate=L_2, YCoordinate=0, ZCoordinate=0)
unit_z_3 = UnitZ(Factor=W_2)
_4point_surface_2 = _4PointSurface(CornerA=construct_point_5, CornerB=construct_point_6, CornerC=construct_point_7, CornerD=construct_point_8)
extrude_2 = Extrude(Base=_4point_surface_2, Direction=unit_z_3)
deconstruct_brep_2 = DeconstructBrep(Brep=extrude_2)  # -> Faces, Edges, Vertices

deconstruct_brep_3 = DeconstructBrep(Brep=center_box)  # -> Faces, Edges, Vertices

# ----
# Sub-Beam
W_3 = Slider(127, range=0..1000)
L_3 = Slider(2600, range=0..3000)
construct_point_9 = ConstructPoint(XCoordinate=0, YCoordinate=0, ZCoordinate=0)
construct_point_10 = ConstructPoint(XCoordinate=W_3, YCoordinate=0, ZCoordinate=0)
construct_point_11 = ConstructPoint(XCoordinate=W_3, YCoordinate=L_3, ZCoordinate=0)
construct_point_12 = ConstructPoint(XCoordinate=0, YCoordinate=L_3, ZCoordinate=0)
unit_z_4 = UnitZ(Factor=Slider(65, range=0..100))
_4point_surface_3 = _4PointSurface(CornerA=construct_point_9, CornerB=construct_point_10, CornerC=construct_point_11, CornerD=construct_point_12)
extrude_3 = Extrude(Base=_4point_surface_3, Direction=unit_z_4)
deconstruct_brep_4 = DeconstructBrep(Brep=extrude_3)  # -> Faces, Edges, Vertices

W_4 = Slider(115, range=0..1000)

# ----
# Sub-Beam
W_5 = Slider(127, range=0..1000)
L_4 = Slider(3412, range=0..3500)
construct_point_13 = ConstructPoint(XCoordinate=0, YCoordinate=0, ZCoordinate=0)
construct_point_14 = ConstructPoint(XCoordinate=W_5, YCoordinate=0, ZCoordinate=0)
construct_point_15 = ConstructPoint(XCoordinate=W_5, YCoordinate=L_4, ZCoordinate=0)
construct_point_16 = ConstructPoint(XCoordinate=0, YCoordinate=L_4, ZCoordinate=0)
unit_z_5 = UnitZ(Factor=W_4)
_4point_surface_4 = _4PointSurface(CornerA=construct_point_13, CornerB=construct_point_14, CornerC=construct_point_15, CornerD=construct_point_16)
extrude_4 = Extrude(Base=_4point_surface_4, Direction=unit_z_5)
deconstruct_brep_5 = DeconstructBrep(Brep=extrude_4)  # -> Faces, Edges, Vertices

# ----
# House Column Centre
# Column
W_6 = Slider(200, range=0..1000)
L_5 = Slider(2650, range=0..4880)
construct_point_17 = ConstructPoint(XCoordinate=0, YCoordinate=0, ZCoordinate=W_6)
construct_point_18 = ConstructPoint(XCoordinate=0, YCoordinate=W_6, ZCoordinate=W_6)
construct_point_19 = ConstructPoint(XCoordinate=W_6, YCoordinate=W_6, ZCoordinate=W_6)
construct_point_20 = ConstructPoint(XCoordinate=W_6, YCoordinate=0, ZCoordinate=W_6)
unit_z_6 = UnitZ(Factor=L_5)
_4point_surface_5 = _4PointSurface(CornerA=construct_point_17, CornerB=construct_point_18, CornerC=construct_point_19, CornerD=construct_point_20)
extrude_5 = Extrude(Base=_4point_surface_5, Direction=unit_z_6)
deconstruct_brep_6 = DeconstructBrep(Brep=extrude_5)  # -> Faces, Edges, Vertices

rotate = Rotate(Vector=unit_y, Axis=unit_z, Angle=degrees("45"))
list_item = ListItem(List=deconstruct_brep_3.Vertices, Index=0, Wrap=True)

# ----
# Beam
W_7 = Slider(200, range=0..1000)
L_6 = Slider(3260, range=0..4880)
construct_point_21 = ConstructPoint(XCoordinate=0, YCoordinate=0, ZCoordinate=0)
construct_point_22 = ConstructPoint(XCoordinate=0, YCoordinate=L_6, ZCoordinate=0)
construct_point_23 = ConstructPoint(XCoordinate=W_7, YCoordinate=L_6, ZCoordinate=0)
construct_point_24 = ConstructPoint(XCoordinate=W_7, YCoordinate=0, ZCoordinate=0)
unit_z_7 = UnitZ(Factor=W_7)
_4point_surface_6 = _4PointSurface(CornerA=construct_point_21, CornerB=construct_point_22, CornerC=construct_point_23, CornerD=construct_point_24)
extrude_6 = Extrude(Base=_4point_surface_6, Direction=unit_z_7)
deconstruct_brep_7 = DeconstructBrep(Brep=extrude_6)  # -> Faces, Edges, Vertices

# ----
# Column
W_8 = Slider(120, range=0..1000)
L_7 = Slider(2190, range=0..4880)
construct_point_25 = ConstructPoint(XCoordinate=0, YCoordinate=0, ZCoordinate=W_8)
construct_point_26 = ConstructPoint(XCoordinate=0, YCoordinate=W_8, ZCoordinate=W_8)
construct_point_27 = ConstructPoint(XCoordinate=W_8, YCoordinate=W_8, ZCoordinate=W_8)
construct_point_28 = ConstructPoint(XCoordinate=W_8, YCoordinate=0, ZCoordinate=W_8)
unit_z_8 = UnitZ(Factor=L_7)
_4point_surface_7 = _4PointSurface(CornerA=construct_point_25, CornerB=construct_point_26, CornerC=construct_point_27, CornerD=construct_point_28)
extrude_7 = Extrude(Base=_4point_surface_7, Direction=unit_z_8)
deconstruct_brep_8 = DeconstructBrep(Brep=extrude_7)  # -> Faces, Edges, Vertices

unit_z_9 = UnitZ(Factor=Slider(200, range=0..1000))
line_sdl = LineSDL(Start=list_item, Direction=rotate, Length=expr("-x", Slider(100, range=0..100)))
center_box_2 = CenterBox(Base=PlaneXY(0, 0, 0), X=Slider(70, range=0..100), Y=Slider(30, range=0..100), Z=Slider(25, range=0..100))
deconstruct_brep_9 = DeconstructBrep(Brep=center_box_2)  # -> Faces, Edges, Vertices
extrude_8 = Extrude(Base=line_sdl, Direction=unit_z_9)
list_item_2 = ListItem(List=deconstruct_brep_9.Faces, Index=Slider(8, range=0..10), Wrap=True)
offset_surface = OffsetSurface(Surface=extrude_8, Distance=Slider(34, range=0..100), Retrim=True)
area = Area(Geometry=list_item_2)  # -> Area, Centroid
area_2 = Area(Geometry=extrude)  # -> Area, Centroid
list_item_3 = ListItem(List=deconstruct_brep.Vertices, Index=Slider(2, range=0..10), Wrap=True)
center_box_3 = CenterBox(Base=PlaneXY(0, 0, 0), X=Slider(100, range=0..100), Y=Slider(20, range=0..100), Z=Slider(10, range=0..10))
list_item_4 = ListItem(List=deconstruct_brep_4.Faces, Index=Slider(5, range=0..10), Wrap=True)
number_slider = Slider(100, range=0..100)
loft = Loft(
    Curves=[extrude_8, offset_surface],
    Options={Adjust=False, Closed=False, LoftEnds=0, LoftSimp=0, LoftType=0, Rebuild=10, Refit=0.01})
list_item_5 = ListItem(List=deconstruct_brep_5.Faces, Index=Slider(6, range=0..10), Wrap=True)
area_3 = Area(Geometry=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)  # -> Area, Centroid
# House Column Centre
# Beam
# Beam
# Pin
# Sub Beam
number_slider_2 = Slider(10, range=0..100)
number_slider_3 = Slider(100, range=0..100)
xz_plane = XZPlane(Origin=area_2.Centroid)
area_4 = Area(Geometry=list_item_4)  # -> Area, Centroid
deconstruct_brep_10 = DeconstructBrep(Brep=center_box_3)  # -> Faces, Edges, Vertices
area_5 = Area(Geometry=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)  # -> Area, Centroid
area_6 = Area(Geometry=list_item_5)  # -> Area, Centroid
cap_holes_ex = CapHolesEx(Brep=loft)  # -> Brep, Caps, Solid
list_item_6 = ListItem(List=deconstruct_brep_6.Vertices, Index=Slider(1, range=0..10), Wrap=True)
unit_z_10 = UnitZ(Factor=Slider(2390, range=0..3000))
center_box_4 = CenterBox(Base=PlaneXY(0, 0, 0), X=Slider(20, range=0..100), Y=Slider(100, range=0..100), Z=Slider(10, range=0..10))
construct_point_29 = ConstructPoint(XCoordinate=0, YCoordinate=Slider(1730, range=0..10000), ZCoordinate=Slider(2835, range=0..10000))
list_item_7 = ListItem(List=deconstruct_brep_7.Vertices, Index=Slider(4, range=0..10), Wrap=True)
list_item_8 = ListItem(List=deconstruct_brep_10.Vertices, Index=0, Wrap=True)
center_box_5 = CenterBox(Base=area_3.Centroid, X=Slider(2900, range=0..5000), Y=number_slider, Z=number_slider)
xz_plane_2 = XZPlane(Origin=area_3.Centroid)
unit_z_11 = UnitZ(Factor=Slider(950, range=0..3000))
solid_union = SolidUnion(Breps=flatten([center_box, cap_holes_ex.Brep]))
construct_point_30 = ConstructPoint(XCoordinate=0, YCoordinate=Slider(770, range=0..1000), ZCoordinate=expr("-x", Slider(200, range=0..1000)))
center_box_6 = CenterBox(Base=area_5.Centroid, X=Slider(25, range=0..100), Y=Slider(100, range=0..100), Z=Slider(100, range=0..100))
center_box_7 = CenterBox(Base=area_5.Centroid, X=Slider(100, range=0..100), Y=Slider(110, range=0..110), Z=number_slider_2)
move = Move(Geometry=list_item_6, Motion=unit_z_10)  # -> Geometry, Transform
deconstruct_brep_11 = DeconstructBrep(Brep=center_box_4)  # -> Faces, Edges, Vertices
center_box_8 = CenterBox(Base=area_5.Centroid, X=Slider(100, range=0..100), Y=Slider(500, range=0..5000), Z=Slider(50, range=0..100))
center_box_9 = CenterBox(Base=area_5.Centroid, X=number_slider_3, Y=Slider(1565.722, range=0..10000), Z=number_slider_3)
area_7 = Area(Geometry=extrude_7)  # -> Area, Centroid
list_item_9 = ListItem(List=deconstruct_brep_8.Faces, Index=Slider(5, range=0..10), Wrap=True)
move_to_point = MoveToPoint(Geometry=extrude_3, PointA=area_4.Centroid, PointB=area_6.Centroid)  # -> Moved, Vector, Transform
move_to_point_2 = MoveToPoint(Geometry=extrude_6, PointA=list_item_7, PointB=Point(0, 200, 2590))  # -> Moved, Vector, Transform
move_2 = Move(Geometry=center_box_5, Motion=construct_point_29)  # -> Geometry, Transform
list_item_10 = ListItem(List=deconstruct_brep_6.Faces, Index=Slider(5, range=0..10), Wrap=True)
list_item_11 = ListItem(List=deconstruct_brep_6.Faces, Index=Slider(0, range=0..10), Wrap=True)
deconstruct_brep_12 = DeconstructBrep(Brep=center_box_6)  # -> Faces, Edges, Vertices
deconstruct_brep_13 = DeconstructBrep(Brep=center_box_7)  # -> Faces, Edges, Vertices
panel = Panel("""3
7""")
number_slider_4 = Slider(50, range=0..100)
list_item_12 = ListItem(List=deconstruct_brep_11.Vertices, Index=0, Wrap=True)
deconstruct_brep_14 = DeconstructBrep(Brep=center_box_9)  # -> Faces, Edges, Vertices
deconstruct_brep_15 = DeconstructBrep(Brep=center_box_8)  # -> Faces, Edges, Vertices
number_slider_5 = Slider(100, range=0..100)
area_8 = Area(Geometry=list_item_9)  # -> Area, Centroid
deconstruct_brep_16 = DeconstructBrep(Brep=solid_union)  # -> Faces, Edges, Vertices
area_9 = Area(Geometry=list_item_10)  # -> Area, Centroid
area_10 = Area(Geometry=list_item_11)  # -> Area, Centroid
move_3 = Move(Geometry=move.Geometry, Motion=expr("-x", unit_z_11))  # -> Geometry, Transform
move_4 = Move(Geometry=move.Geometry, Motion=construct_point_30)  # -> Geometry, Transform
deconstruct_brep_17 = DeconstructBrep(Brep=move_to_point_2.Moved)  # -> Faces, Edges, Vertices
unit_y_2 = UnitY(Factor=1)
mirror = Mirror(Geometry=move_2.Geometry, Plane=xz_plane_2)  # -> Geometry, Transform
list_item_13 = ListItem(List=deconstruct_brep_12.Vertices, Index=Slider(3, range=0..10), Wrap=True)
deconstruct_brep_18 = DeconstructBrep(Brep=move_to_point.Moved)  # -> Faces, Edges, Vertices
list_item_14 = ListItem(List=deconstruct_brep_12.Vertices, Index=Slider(2, range=0..10), Wrap=True)
list_item_15 = ListItem(List=deconstruct_brep_13.Vertices, Index=Slider(3, range=0..10), Wrap=True)
unit_x = UnitX(Factor=1)
list_item_16 = ListItem(List=deconstruct_brep_14.Vertices, Index=0, Wrap=True)
list_item_17 = ListItem(List=deconstruct_brep_15.Vertices, Index=panel, Wrap=True)
list_item_18 = ListItem(List=deconstruct_brep_15.Edges, Index=Slider(7, range=0..10), Wrap=True)
list_item_19 = ListItem(List=deconstruct_brep_15.Vertices, Index=0, Wrap=True)
unit_y_3 = UnitY(Factor=Slider(20, range=0..100))
unit_y_4 = UnitY(Factor=Slider(25, range=0..100))
center_box_10 = CenterBox(Base=area_8.Centroid, X=Slider(25, range=0..100), Y=number_slider_4, Z=number_slider_4)
list_item_20 = ListItem(List=deconstruct_brep_17.Edges, Index=Slider(11, range=0..20), Wrap=True)
list_item_21 = ListItem(List=deconstruct_brep_16.Vertices, Index=Slider(8, range=0..10), Wrap=True)
center_box_11 = CenterBox(Base=area_9.Centroid, X=number_slider_5, Y=Slider(25, range=0..100), Z=number_slider_5)
center_box_12 = CenterBox(Base=area_10.Centroid, X=Slider(50, range=0..100), Y=Slider(25, range=0..100), Z=Slider(50, range=0..100))
list_item_22 = ListItem(List=deconstruct_brep_17.Vertices, Index=Slider(0, range=0..10), Wrap=True)
list_item_23 = ListItem(List=deconstruct_brep_17.Vertices, Index=Slider(4, range=0..10), Wrap=True)
unit_z_12 = UnitZ(Factor=Slider(40, range=0..100))
explode_tree = ExplodeTree(Data=simplify(graft(list_item_17)))  # -> Branch0, Branch1
curve_middle = CurveMiddle(Curve=list_item_18)
deconstruct_brep_19 = DeconstructBrep(Brep=mirror.Geometry)  # -> Faces, Edges, Vertices
merge = Merge(Data1=move_2.Geometry, Data2=mirror.Geometry)
number_slider_6 = Slider(200, range=0..1000)
mirror_2 = Mirror(Geometry=center_box_10, Plane=area_7.Centroid)  # -> Geometry, Transform
unit_y_5 = UnitY(Factor=Slider(88.61, range=0..1000))
line = Line(StartPoint=move_3.Geometry, EndPoint=move_4.Geometry)
divide_curve = DivideCurve(Curve=list_item_20, Count=Slider(4, range=0..10), Kinks=False)  # -> Points, Tangents, Parameters
yz_plane = YZPlane(Origin=Point(0, 0, 0))
move_5 = Move(Geometry=list_item_22, Motion=expr("-x", unit_y_3))  # -> Geometry, Transform
move_6 = Move(Geometry=center_box_11, Motion=expr("-x", unit_y_4))  # -> Geometry, Transform
move_7 = Move(Geometry=curve_middle, Motion=expr("-x", unit_z_12))  # -> Geometry, Transform
move_to_point_3 = MoveToPoint(Geometry=solid_union, PointA=list_item_21, PointB=list_item_3)  # -> Moved, Vector, Transform
deconstruct_brep_20 = DeconstructBrep(Brep=list_item_10)  # -> Faces, Edges, Vertices
rotate_2 = Rotate(Vector=unit_y_2, Axis=unit_x, Angle=degrees("15"))
unit_x_2 = UnitX(Factor=Slider(560, range=0..1000))
list_item_24 = ListItem(List=deconstruct_brep_19.Vertices, Index=Slider(2, range=0..10), Wrap=True)
area_11 = Area(Geometry=move_to_point.Moved)  # -> Area, Centroid
list_item_25 = ListItem(List=deconstruct_brep_18.Vertices, Index=Slider(7, range=0..10), Wrap=True)
list_item_26 = ListItem(List=deconstruct_brep_18.Vertices, Index=Slider(3, range=0..10), Wrap=True)
move_8 = Move(Geometry=move_3.Geometry, Motion=expr("-x", unit_y_5))  # -> Geometry, Transform
construct_point_31 = ConstructPoint(XCoordinate=0, YCoordinate=number_slider_6, ZCoordinate=number_slider_6)
list_item_27 = ListItem(List=divide_curve.Points, Index="3", Wrap=True)  # -> graft(Item)
unit_z_13 = UnitZ(Factor=Slider(152, range=0..1000))
unit_y_6 = UnitY(Factor=number_slider_6)
unit_x_3 = UnitX(Factor=Slider(200, range=0..1000))
offset_curve = OffsetCurve(Curve=line, Plane=yz_plane, Distance=expr("-x", Slider(127, range=0..1000)), BothSides=0, Kinks=0, CapType=1)
list_item_28 = ListItem(List=deconstruct_brep_20.Edges, Index=Slider(2, range=0..10), Wrap=True)
_4point_surface_8 = _4PointSurface(CornerA=curve_middle, CornerB=move_7.Geometry, CornerC=explode_tree.Branch0, CornerD=explode_tree.Branch1)
_4point_surface_9 = _4PointSurface(CornerA=list_item_22, CornerB=list_item_23, CornerC=move_5.Geometry)
center_box_13 = CenterBox(Base=PlaneXY(0, 0, 0), X=Slider(100, range=0..100), Y=Slider(20, range=0..100), Z=Slider(10, range=0..10))
move_9 = Move(Geometry=list_item_24, Motion=expr("-x", unit_x_2))  # -> Geometry, Transform
line_sdl_2 = LineSDL(Start=list_item_26, Direction=rotate_2, Length=Slider(280, range=0..500))
unit_x_4 = UnitX(Factor=Slider(200, range=0..1000))
solid_union_2 = SolidUnion(Breps=flatten([extrude_7, center_box_10, mirror_2.Geometry]))
curve_middle_2 = CurveMiddle(Curve=list_item_28)
deconstruct_brep_21 = DeconstructBrep(Brep=center_box_13)  # -> Faces, Edges, Vertices
mirror_3 = Mirror(Geometry=move_to_point_3.Moved, Plane=xz_plane)  # -> Geometry, Transform
extrude_9 = Extrude(Base=_4point_surface_8, Direction=unit_x_3)
deconstruct_brep_22 = DeconstructBrep(Brep=offset_curve)  # -> Faces, Edges, Vertices
end_points = EndPoints(Curve=line_sdl_2)  # -> Start, End
panel_2 = Panel("""0
1""")
series = Series(Start=0, Step=Slider(780, range=0..1000), Count=Slider(7, range=0..10))
move_10 = Move(Geometry=list_item_27, Motion=expr("-x", unit_z_13))  # -> Geometry, Transform
move_11 = Move(Geometry=list_item_27, Motion=expr("-x", construct_point_31))  # -> Geometry, Transform
move_12 = Move(Geometry=list_item_27, Motion=expr("-x", unit_y_6))  # -> Geometry, Transform
extrude_10 = Extrude(Base=_4point_surface_9, Direction=unit_x_4)
unit_x_5 = UnitX(Factor=Slider(10, range=0..100))
construct_point_32 = ConstructPoint(XCoordinate=0, YCoordinate=Slider(1286, range=0..10000), ZCoordinate=Slider(80, range=0..1000))
center_box_14 = CenterBox(Base=curve_middle_2, X=Slider(10, range=0..10), Y=Slider(100, range=0..100), Z=Slider(60, range=0..100))
move_to_point_4 = MoveToPoint(Geometry=center_box_8, PointA=list_item_19, PointB=list_item_16)  # -> Moved, Vector, Transform
list_item_29 = ListItem(List=deconstruct_brep_21.Vertices, Index=0, Wrap=True)
move_to_point_5 = MoveToPoint(Geometry=extrude_9, PointA=list_item_19, PointB=list_item_16)  # -> Moved, Vector, Transform
list_item_30 = ListItem(List=deconstruct_brep_22.Vertices, Index=panel_2, Wrap=True)  # -> graft(Item)
unit_x_6 = UnitX(Factor=W_3)
_4point_surface_10 = _4PointSurface(CornerA=end_points.Start, CornerB=end_points.End, CornerC=list_item_25)
unit_x_7 = UnitX(Factor=series)
xz_plane_3 = XZPlane(Origin=area_11.Centroid)
deconstruct_brep_23 = DeconstructBrep(Brep=extrude_10)  # -> Faces, Edges, Vertices
move_13 = Move(Geometry=center_box_14, Motion=expr("-x", unit_x_5))  # -> Geometry, Transform
solid_difference = SolidDifference(BrepsA=extrude, BrepsB=[mirror_3.Geometry, move_to_point_3.Moved])
move_14 = Move(Geometry=solid_union_2, Motion=construct_point_32)  # -> Geometry, Transform
explode_tree_2 = ExplodeTree(Data=list_item_30)  # -> _00000, _00001
solid_difference_2 = SolidDifference(BrepsA=center_box_9, BrepsB=move_to_point_4.Moved)
line_2 = Line(StartPoint=move_10.Geometry, EndPoint=move_11.Geometry)
line_3 = Line(StartPoint=list_item_27, EndPoint=move_12.Geometry)
move_15 = Move(Geometry=move_9.Geometry, Motion=expr("-x", unit_x_7))  # -> Geometry, Transform
list_item_31 = ListItem(List=deconstruct_brep_23.Vertices, Index=Slider(2, range=0..10), Wrap=True)
extrude_11 = Extrude(Base=_4point_surface_10, Direction=unit_x_6)
deconstruct_brep_24 = DeconstructBrep(Brep=solid_difference)  # -> Faces, Edges, Vertices
number_slider_7 = Slider(180, range=0..1000)
area_12 = Area(Geometry=deconstruct_brep_22.Faces)  # -> Area, Centroid
_4point_surface_11 = _4PointSurface(CornerA=move_8.Geometry, CornerB=explode_tree_2._00000, CornerC=explode_tree_2._00001)
edge_surface = EdgeSurface(CurveA=line_3, CurveB=line_2)
solid_union_3 = SolidUnion(Breps=[solid_difference_2, move_to_point_5.Moved])
yz_plane_2 = YZPlane(Origin=area_12.Centroid)
mirror_4 = Mirror(Geometry=extrude_11, Plane=xz_plane_3)  # -> Geometry, Transform
list_item_32 = ListItem(List=deconstruct_brep_24.Faces, Index=Slider(3, range=0..10), Wrap=True)
deconstruct_brep_25 = DeconstructBrep(Brep=solid_union_3)  # -> Faces, Edges, Vertices
unit_y_7 = UnitY(Factor=Slider(10, range=0..10))
rotate_3d = Rotate3D(Geometry=_4point_surface_11, Angle=degrees(number_slider_7), Center=yz_plane_2, Axis=yz_plane_2)  # -> Geometry, Transform
move_to_point_6 = MoveToPoint(Geometry=center_box_13, PointA=list_item_29, PointB=list_item_31)  # -> Moved, Vector, Transform
area_13 = Area(Geometry=list_item_32)  # -> Area, Centroid
area_14 = Area(Geometry=move_to_point_2.Moved)  # -> Area, Centroid
solid_union_4 = SolidUnion(Breps=flatten([move_to_point.Moved, mirror_4.Geometry, extrude_11, extrude_4]))
list_item_33 = ListItem(List=deconstruct_brep_25.Vertices, Index=Slider(8, range=0..10), Wrap=True)
list_item_34 = ListItem(List=deconstruct_brep_25.Vertices, Index=Slider(9, range=0..10), Wrap=True)
unit_x_8 = UnitX(Factor=Slider(50, range=0..100))
move_to_point_7 = MoveToPoint(Geometry=center_box_2, PointA=area.Centroid, PointB=area_13.Centroid)  # -> Moved, Vector, Transform
unit_x_9 = UnitX(Factor=Slider(10, range=0..10))
unit_x_10 = UnitX(Factor=Slider(100, range=0..1000))
brep_join = BrepJoin(Breps=flatten([_4point_surface_11, deconstruct_brep_22.Faces, rotate_3d.Geometry]))  # -> Breps, Closed
deconstruct_brep_26 = DeconstructBrep(Brep=solid_union_4)  # -> Faces, Edges, Vertices
extrude_12 = Extrude(Base=edge_surface, Direction=unit_x_8)
series_2 = Series(Start=0, Step=Slider(25, range=0..100), Count=Slider(4, range=0..10))
extrude_13 = Extrude(Base=brep_join.Breps, Direction=unit_x_10)
merge_2 = Merge(Data1=extrude_10, Data2=extrude_12)
mirror_5 = Mirror(Geometry=move_to_point_7.Moved, Plane=xz_plane)  # -> Geometry, Transform
xz_plane_4 = XZPlane(Origin=area_14.Centroid)
move_to_point_8 = MoveToPoint(Geometry=center_box_6, PointA=list_item_14, PointB=list_item_33)  # -> Moved, Vector, Transform
move_to_point_9 = MoveToPoint(Geometry=center_box_6, PointA=list_item_13, PointB=list_item_34)  # -> Moved, Vector, Transform
move_to_point_10 = MoveToPoint(Geometry=center_box_7, PointA=list_item_15, PointB=list_item_34)  # -> Moved, Vector, Transform
list_item_35 = ListItem(List=deconstruct_brep_26.Edges, Index=Slider(19, range=0..100), Wrap=True)
deconstruct_brep_27 = DeconstructBrep(Brep=extrude_13)  # -> Faces, Edges, Vertices
series_3 = Series(Start=0, Step=Slider(25, range=0..100), Count=Slider(4, range=0..10))
solid_union_5 = SolidUnion(Breps=flatten([solid_difference, mirror_5.Geometry, move_to_point_7.Moved]))
offset_curve_2 = OffsetCurve(Curve=list_item_35, Distance=Slider(76, range=0..100), Corners=1)
list_item_36 = ListItem(List=deconstruct_brep_27.Vertices, Index=Slider(16, range=0..100), Wrap=True)
unit_y_8 = UnitY(Factor=Slider(10, range=0..10))
list_item_37 = ListItem(List=deconstruct_brep_27.Edges, Index=Slider(14, range=0..100), Wrap=True)
mirror_6 = Mirror(Geometry=move_to_point_6.Moved, Plane=xz_plane_4)  # -> Geometry, Transform
mirror_7 = Mirror(Geometry=merge_2, Plane=xz_plane_4)  # -> Geometry, Transform
list_item_38 = ListItem(List=deconstruct_brep_27.Vertices, Index=Slider(11, range=0..100), Wrap=True)
list_item_39 = ListItem(List=deconstruct_brep_27.Edges, Index=Slider(17, range=0..100), Wrap=True)
unit_x_11 = UnitX(Factor=series_2)
curve_middle_3 = CurveMiddle(Curve=offset_curve_2)
deconstruct_brep_28 = DeconstructBrep(Brep=solid_union_5)  # -> Faces, Edges, Vertices
number_slider_8 = Slider(44.33, range=0..100)
number_slider_9 = Slider(63.5, range=0..100)
solid_difference_3 = SolidDifference(BrepsA=solid_union_3, BrepsB=flatten([move_to_point_8.Moved, move_to_point_9.Moved]))
number_slider_10 = Slider(30, range=0..1000)
list_item_40 = ListItem(List=deconstruct_brep_2.Edges, Index=Slider(7, range=0..10), Wrap=True)
list_item_41 = ListItem(List=deconstruct_brep_2.Edges, Index=Slider(7, range=0..10), Wrap=True)
move_16 = Move(Geometry=list_item_36, Motion=expr("-x", unit_y_8))  # -> Geometry, Transform
curve_middle_4 = CurveMiddle(Curve=list_item_39)
curve_middle_5 = CurveMiddle(Curve=list_item_37)
list_item_42 = ListItem(List=deconstruct_brep_28.Vertices, Index=Slider(18, range=0..100), Wrap=True)
list_item_43 = ListItem(List=deconstruct_brep_28.Edges, Index=Slider(29, range=0..100), Wrap=True)
unit_y_9 = UnitY(Factor=series_3)
solid_union_6 = SolidUnion(Breps=flatten([move_to_point_2.Moved, extrude_10, extrude_12, mirror_7.Geometry]))
divide_curve_2 = DivideCurve(Curve=list_item_40, Count="6", Kinks=False)  # -> Points, Tangents, Parameters
divide_curve_3 = DivideCurve(Curve=list_item_41, Count="6", Kinks=False)  # -> Points, Tangents, Parameters
panel_3 = Panel("""1
2
4
5""")
solid_difference_4 = SolidDifference(BrepsA=solid_difference_3, BrepsB=flatten(move_to_point_10.Moved))
curve_middle_6 = CurveMiddle(Curve=list_item_43)
center_box_15 = CenterBox(Base=PlaneXY(0, 0, 0), X=number_slider_9, Y=number_slider_10, Z=Slider(40, range=0..100))
center_box_16 = CenterBox(Base=curve_middle_5, X=Slider(25, range=0..100), Y=number_slider_8, Z=Slider(100, range=0..100))
center_box_17 = CenterBox(Base=curve_middle_5, X=Slider(50, range=0..100), Y=number_slider_8, Z=Slider(89, range=0..1000))
center_box_18 = CenterBox(Base=PlaneXY(0, 0, 0), X=number_slider_9, Y=number_slider_10, Z=Slider(17.5, range=0..100))
solid_difference_5 = SolidDifference(BrepsA=solid_union_3, BrepsB=flatten(move_to_point_10.Moved))
solid_difference_6 = SolidDifference(BrepsA=solid_union_6, BrepsB=flatten([move_to_point_6.Moved, mirror_6.Geometry]))
deconstruct_brep_29 = DeconstructBrep(Brep=center_box_16)  # -> Faces, Edges, Vertices
deconstruct_brep_30 = DeconstructBrep(Brep=solid_difference_4)  # -> Faces, Edges, Vertices
list_item_44 = ListItem(List=divide_curve_2.Points, Index=panel_3, Wrap=True)
list_item_45 = ListItem(List=divide_curve_3.Points, Index="3", Wrap=True)
deconstruct_brep_31 = DeconstructBrep(Brep=center_box_15)  # -> Faces, Edges, Vertices
deconstruct_brep_32 = DeconstructBrep(Brep=center_box_17)  # -> Faces, Edges, Vertices
unit_y_10 = UnitY(Factor=Slider(75, range=0..100))
list_item_46 = ListItem(List=divide_curve_2.Points, Index="0", Wrap=True)
area_15 = Area(Geometry=extrude_13)  # -> Area, Centroid
list_item_47 = ListItem(List=deconstruct_brep_29.Vertices, Index=Slider(0, range=0..10), Wrap=True)
move_to_point_11 = MoveToPoint(Geometry=solid_union_4, PointA=curve_middle_3, PointB=list_item_44)  # -> Moved, Vector, Transform
move_to_point_12 = MoveToPoint(Geometry=solid_union_4, PointA=curve_middle_3, PointB=list_item_45)  # -> Moved, Vector, Transform
deconstruct_brep_33 = DeconstructBrep(Brep=solid_difference_6)  # -> Faces, Edges, Vertices
list_item_48 = ListItem(List=deconstruct_brep_30.Vertices, Index=Slider(41, range=0..100), Wrap=True)
list_item_49 = ListItem(List=deconstruct_brep_32.Vertices, Index=Slider(0, range=0..10), Wrap=True)
list_item_50 = ListItem(List=deconstruct_brep_30.Edges, Index=Slider(37, range=0..100), Wrap=True)
unit_x_12 = UnitX(Factor=Slider(100, range=0..100))
list_item_51 = ListItem(List=deconstruct_brep_31.Edges, Index=Slider(4, range=0..10), Wrap=True)
deconstruct_brep_34 = DeconstructBrep(Brep=center_box_18)  # -> Faces, Edges, Vertices
move_to_point_13 = MoveToPoint(Geometry=center_box_16, PointA=list_item_47, PointB=move_16.Geometry)  # -> Moved, Vector, Transform
yz_plane_3 = YZPlane(Origin=list_item_48)
list_item_52 = ListItem(List=deconstruct_brep_33.Vertices, Index=Slider(8, range=0..100), Wrap=True)
yz_plane_4 = YZPlane(Origin=Point(0, 0, 0))
deconstruct_brep_35 = DeconstructBrep(Brep=move_to_point_12.Moved)  # -> Faces, Edges, Vertices
curve_middle_7 = CurveMiddle(Curve=list_item_51)
list_item_53 = ListItem(List=deconstruct_brep_34.Vertices, Index=Slider(2, range=0..100), Wrap=True)
offset_curve_3 = OffsetCurve(Curve=list_item_50, Distance=Slider(100, range=0..100), Plane=yz_plane_4, Corners=1)
rotate_3 = Rotate(Geometry=solid_difference_5, Angle=1.570796327, Plane=yz_plane_3)  # -> Geometry, Transform
move_to_point_14 = MoveToPoint(Geometry=center_box_17, PointA=list_item_49, PointB=list_item_36)  # -> Moved, Vector, Transform
area_16 = Area(Geometry=rotate_3.Geometry)  # -> Area, Centroid
curve_middle_8 = CurveMiddle(Curve=offset_curve_3)

solid_difference_7 = SolidDifference(BrepsA=move_to_point_14.Moved, BrepsB=move_to_point_13.Moved)

xz_plane_5 = XZPlane(Origin=list_item_48)
number_slider_11 = Slider(90, range=0..100)
yz_plane_5 = YZPlane(Origin=area_15.Centroid)
yz_plane_6 = YZPlane(Origin=curve_middle_8)
mirror_8 = Mirror(Geometry=rotate_3.Geometry, Plane=xz_plane_5)  # -> Geometry, Transform
unit_x_13 = UnitX(Factor=Slider(200, range=0..200))
circle = Circle(Plane=yz_plane_6, Radius=Slider(15, range=0..100))
rotate_3d_2 = Rotate3D(Geometry=move_to_point_13.Moved, Angle=expr("-x", degrees(number_slider_11)), Center=area_15.Centroid, Axis=yz_plane_5)  # -> Geometry, Transform
rotate_3d_3 = Rotate3D(Geometry=solid_difference_7, Angle=expr("-x", degrees(number_slider_11)), Center=area_15.Centroid, Axis=yz_plane_5)  # -> Geometry, Transform
solid_difference_8 = SolidDifference(BrepsA=mirror_8.Geometry, BrepsB=solid_difference_4)
extrude_14 = Extrude(Base=circle, Direction=expr("-x", unit_x_13))
deconstruct_brep_36 = DeconstructBrep(Brep=rotate_3d_2.Geometry)  # -> Faces, Edges, Vertices
deconstruct_brep_37 = DeconstructBrep(Brep=rotate_3d_3.Geometry)  # -> Faces, Edges, Vertices
cap_holes_ex_2 = CapHolesEx(Brep=extrude_14)  # -> Brep, Caps, Solid
list_item_54 = ListItem(List=deconstruct_brep_36.Vertices, Index=Slider(5, range=0..10), Wrap=True)
list_item_55 = ListItem(List=deconstruct_brep_37.Vertices, Index=Slider(3, range=0..10), Wrap=True)
solid_union_7 = SolidUnion(Breps=flatten([solid_difference_4, solid_difference_8]))
yz_plane_7 = YZPlane(Origin=Point(0, 0, 0))

area_17 = Area(Geometry=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)  # -> Area, Centroid
xz_plane_6 = XZPlane(Origin=area_17.Centroid)
yz_plane_8 = YZPlane(Origin=area_17.Centroid)

merge_3 = Merge(Data1=solid_difference_8, Data2=solid_difference_4, Data3=cap_holes_ex_2.Brep)
list_item_56 = ListItem(List=deconstruct_brep_35.Edges, Index=Slider(19, range=0..20), Wrap=True)
area_18 = Area(Geometry=flatten(solid_union_7))  # -> Area, Centroid
move_to_point_15 = MoveToPoint(Geometry=rotate_3d_2.Geometry, PointA=list_item_54, PointB=curve_middle_4)  # -> Moved, Vector, Transform
move_to_point_16 = MoveToPoint(Geometry=rotate_3d_3.Geometry, PointA=list_item_55, PointB=list_item_38)  # -> Moved, Vector, Transform
xz_plane_7 = XZPlane(Origin=Point(0, 0, 0))
curve_middle_9 = CurveMiddle(Curve=list_item_56)
deconstruct_brep_38 = DeconstructBrep(Brep=move_to_point_16.Moved)  # -> Faces, Edges, Vertices
move_to_point_17 = MoveToPoint(Geometry=center_box_15, PointA=curve_middle_7, PointB=curve_middle_9)  # -> Moved, Vector, Transform
unit_z_14 = UnitZ(Factor=Slider(10, range=0..10))
list_item_57 = ListItem(List=deconstruct_brep_38.Faces, Index=Slider(10, range=0..10), Wrap=True)
yz_plane_9 = YZPlane(Origin=area_18.Centroid)
mirror_9 = Mirror(Geometry=move_to_point_17.Moved, Plane=xz_plane_6)  # -> Geometry, Transform
unit_x_14 = UnitX(Factor=Slider(75, range=0..200))
extrude_15 = Extrude(Base=list_item_57, Direction=expr("-x", unit_z_14))
rotate_4 = Rotate(Geometry=merge_3, Angle=degrees(Slider(45, range=0..100)), Plane=yz_plane_9)  # -> Geometry, Transform
solid_difference_9 = SolidDifference(BrepsA=move_to_point_12.Moved, BrepsB=flatten([mirror_9.Geometry, move_to_point_17.Moved]))

solid_union_8 = SolidUnion(Breps=flatten([move_to_point_16.Moved, extrude_15]))

solid_difference_10 = SolidDifference(BrepsA=extrude_13, BrepsB=flatten([move_to_point_13.Moved, move_to_point_15.Moved]))
unit_y_11 = UnitY(Factor=Slider(75, range=0..200))
explode_tree_3 = ExplodeTree(Data=simplify(graft(rotate_4.Geometry)))  # -> Branch0, Branch1, Branch2
deconstruct_brep_39 = DeconstructBrep(Brep=solid_difference_9)  # -> Faces, Edges, Vertices
deconstruct_brep_40 = DeconstructBrep(Brep=flatten(explode_tree_3.Branch0))  # -> Faces, Edges, Vertices
list_item_58 = ListItem(List=deconstruct_brep_39.Vertices, Index=Slider(9, range=0..100), Wrap=True)
list_item_59 = ListItem(List=deconstruct_brep_39.Edges, Index=Slider(14, range=0..100), Wrap=True)
list_item_60 = ListItem(List=deconstruct_brep_40.Edges, Index=Slider(4, range=0..100), Wrap=True)
offset_curve_4 = OffsetCurve(Curve=list_item_59, Distance=Slider(25, range=0..100), Corners=1)
move_to_point_18 = MoveToPoint(Geometry=center_box_18, PointA=list_item_53, PointB=list_item_58)  # -> Moved, Vector, Transform
curve_middle_10 = CurveMiddle(Curve=list_item_60)
unit_y_12 = UnitY(Factor=Slider(40, range=0..100))
deconstruct_brep_41 = DeconstructBrep(Brep=solid_difference_6)  # -> Faces, Edges, Vertices
deconstruct_brep_42 = DeconstructBrep(Brep=solid_difference_10)  # -> Faces, Edges, Vertices
curve_middle_11 = CurveMiddle(Curve=offset_curve_4)
yz_plane_10 = YZPlane(Origin=Point(0, 0, 0))
move_17 = Move(Geometry=curve_middle_10, Motion=expr("-x", unit_y_12))  # -> Geometry, Transform
mirror_10 = Mirror(Geometry=move_to_point_18.Moved, Plane=xz_plane_6)  # -> Geometry, Transform
list_item_61 = ListItem(List=deconstruct_brep_41.Edges, Index=Slider(27, range=0..100), Wrap=True)
list_item_62 = ListItem(List=deconstruct_brep_42.Edges, Index=Slider(12, range=0..100), Wrap=True)
unit_z_15 = UnitZ(Factor=Slider(115, range=0..200))
circle_2 = Circle(Plane=curve_middle_11, Radius=Slider(15, range=0..100))
offset_curve_5 = OffsetCurve(Curve=list_item_61, Distance=Slider(30, range=0..100), Plane=yz_plane_10, Corners=1)
curve_middle_12 = CurveMiddle(Curve=list_item_62)

area_19 = Area(Geometry=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)  # -> Area, Centroid
xz_plane_8 = XZPlane(Origin=area_19.Centroid)
yz_plane_11 = YZPlane(Origin=area_19.Centroid)

solid_union_9 = SolidUnion(Breps=flatten([solid_difference_9, move_to_point_18.Moved, mirror_10.Geometry]))
extrude_16 = Extrude(Base=circle_2, Direction=unit_z_15)
curve_middle_13 = CurveMiddle(Curve=offset_curve_5)
yz_plane_12 = YZPlane(Origin=curve_middle_12)
cap_holes_ex_3 = CapHolesEx(Brep=extrude_16)  # -> Brep, Caps, Solid

move_to_point_19 = MoveToPoint(Geometry=graft(rotate_4.Geometry), PointA=move_17.Geometry, PointB=move_15.Geometry)  # -> Moved, Vector, Transform

unit_x_15 = UnitX(Factor=Slider(100, range=0..200))
yz_plane_13 = YZPlane(Origin=curve_middle_13)
circle_3 = Circle(Plane=yz_plane_12, Radius=Slider(15, range=0..100))
extrude_17 = Extrude(Base=circle_3, Direction=expr("-x", unit_x_15))
unit_x_16 = UnitX(Factor=Slider(100, range=0..200))
circle_4 = Circle(Plane=yz_plane_13, Radius=Slider(15, range=0..100))
mirror_11 = Mirror(Geometry=cap_holes_ex_3.Brep, Plane=xz_plane_6)  # -> Geometry, Transform

area_20 = Area(Geometry=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)  # -> Area, Centroid
xz_plane_9 = XZPlane(Origin=area_20.Centroid)
yz_plane_14 = YZPlane(Origin=area_20.Centroid)

list_item_63 = ListItem(List=move_to_point_19.Moved, Index=0, Wrap=True)
list_item_64 = ListItem(List=move_to_point_19.Moved, Index="-1", Wrap=True)
extrude_18 = Extrude(Base=circle_4, Direction=expr("-x", unit_x_16))
cap_holes_ex_4 = CapHolesEx(Brep=extrude_17)  # -> Brep, Caps, Solid
unit_x_17 = UnitX(Factor=Slider(460, range=0..1000))
explode_tree_4 = ExplodeTree(Data=simplify(list_item_63))  # -> Branch0, Branch1, Branch2

solid_difference_11 = SolidDifference(BrepsA=merge, BrepsB=flatten(move_to_point_19.Moved))

xz_plane_10 = XZPlane(Origin=Point(100, 1830, 2490))
cap_holes_ex_5 = CapHolesEx(Brep=extrude_18)  # -> Brep, Caps, Solid
merge_4 = Merge(Data1=cap_holes_ex_3.Brep, Data2=mirror_11.Geometry)
solid_difference_12 = SolidDifference(BrepsA=extrude_2, BrepsB=flatten([move_to_point_11.Moved, solid_union_9, merge_4]))
deconstruct_brep_43 = DeconstructBrep(Brep=explode_tree_4.Branch0)  # -> Faces, Edges, Vertices
deconstruct_brep_44 = DeconstructBrep(Brep=explode_tree_4.Branch1)  # -> Faces, Edges, Vertices
move_18 = Move(Geometry=list_item_64, Motion=expr("-x", unit_x_17))  # -> Geometry, Transform
move_19 = Move(Geometry=list_item_63, Motion=unit_x_17)  # -> Geometry, Transform
rotate_3d_4 = Rotate3D(Geometry=cap_holes_ex_4.Brep, Angle=degrees(number_slider_7), Center=yz_plane_2, Axis=yz_plane_2)  # -> Geometry, Transform
mirror_12 = Mirror(Geometry=cap_holes_ex_5.Brep, Plane=xz_plane_10)  # -> Geometry, Transform

area_21 = Area(Geometry=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)  # -> Area, Centroid
xz_plane_11 = XZPlane(Origin=area_21.Centroid)
yz_plane_15 = YZPlane(Origin=area_21.Centroid)

area_22 = Area(Geometry=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)  # -> Area, Centroid
solid_difference_13 = SolidDifference(BrepsA=solid_union_9, BrepsB=merge_4)
mirror_13 = Mirror(Geometry=solid_difference_12, Plane=xz_plane_6)  # -> Geometry, Transform
list_item_65 = ListItem(List=deconstruct_brep_43.Edges, Index=Slider(15, range=0..100), Wrap=True)
list_item_66 = ListItem(List=deconstruct_brep_44.Edges, Index=Slider(17, range=0..100), Wrap=True)
number_slider_12 = Slider(1500, range=0..10000)
solid_union_10 = SolidUnion(Breps=flatten([extrude_5, center_box_12, move_6.Geometry]))
merge_5 = Merge(
    Data1=solid_difference_10,
    Data2=solid_difference_7,
    Data3=solid_union_8,
    Data4=cap_holes_ex_4.Brep,
    Data5=rotate_3d_4.Geometry)
merge_6 = Merge(Data1=solid_difference_7, Data2=solid_union_8)
merge_7 = Merge(Data1=cap_holes_ex_5.Brep, Data2=mirror_12.Geometry)
flip_curve = FlipCurve(Curve=list_item_65)  # -> Curve, Flag
merge_8 = Merge(Data1=move_to_point_19.Moved, Data2=move_19.Geometry, Data3=move_18.Geometry)
merge_9 = Merge(Data1=mirror_13.Geometry, Data2=solid_difference_12)
list_item_67 = ListItem(List=divide_curve_2.Points, Index=0, Wrap=True)
merge_10 = Merge(Data1=cap_holes_ex_4.Brep, Data2=rotate_3d_4.Geometry)
deconstruct_brep_45 = DeconstructBrep(Brep=mirror_13.Geometry)  # -> Faces, Edges, Vertices
divide_length = DivideLength(Curve=flip_curve.Curve, Length=number_slider_12)  # -> Points, Tangents, Parameters
divide_length_2 = DivideLength(Curve=list_item_66, Length=number_slider_12)  # -> Points, Tangents, Parameters
rotate_5 = Rotate(Geometry=merge_5, Angle=expr("-x", 1.570796327), Plane=area_22.Centroid)  # -> Geometry, Transform
unit_z_16 = UnitZ(Factor=Slider(467.6, range=0..1000))
mirror_14 = Mirror(Geometry=merge_6, Plane=xz_plane_11)  # -> Geometry, Transform
list_item_68 = ListItem(List=deconstruct_brep_45.Vertices, Index=Slider(5, range=0..100), Wrap=True)
mirror_15 = Mirror(Geometry=[merge_10, solid_union_8], Plane=xz_plane_11)  # -> Geometry, Transform
line_4 = Line(StartPoint=list_item_67, EndPoint=list_item_68)
merge_11 = Merge(Data1=merge_6, Data2=mirror_14.Geometry)
xz_plane_12 = XZPlane(Origin=area_22.Centroid)
move_20 = Move(Geometry=rotate_5.Geometry, Motion=unit_z_16)  # -> Geometry, Transform
solid_difference_14 = SolidDifference(BrepsA=solid_difference_10, BrepsB=flatten(merge_10))
mirror_16 = Mirror(Geometry=merge_11, Plane=yz_plane_15)  # -> Geometry, Transform
curve_middle_14 = CurveMiddle(Curve=line_4)
mirror_17 = Mirror(Geometry=solid_difference_14, Plane=xz_plane_11)  # -> Geometry, Transform
mirror_18 = Mirror(Geometry=move_20.Geometry, Plane=xz_plane_12)  # -> Geometry, Transform
explode_tree_5 = ExplodeTree(Data=simplify(graft(mirror_15.Geometry)))  # -> Branch0, Branch1, _0000
line_5 = Line(StartPoint=divide_length.Points, EndPoint=divide_length_2.Points)
yz_plane_16 = YZPlane(Origin=Point(0, 0, 0))
merge_12 = Merge(Data1=merge_11, Data2=mirror_16.Geometry)
unit_x_18 = UnitX(Factor=Slider(2339.95, range=0..3000))
move_21 = Move(Geometry=mirror_18.Geometry, Motion=unit_x_18)  # -> Geometry, Transform
offset_curve_6 = OffsetCurve(Curve=line_5, Plane=yz_plane_16, Distance=expr("-x", Slider(127, range=0..1000)), BothSides=0, Kinks=0, CapType=1)
merge_13 = Merge(Data1=solid_difference_14, Data2=mirror_17.Geometry)
merge_14 = Merge(Data1=merge_10, Data2=explode_tree_5.Branch1, Data3=explode_tree_5._0000)
move_to_point_20 = MoveToPoint(Geometry=solid_union_5, PointA=curve_middle_6, PointB=curve_middle_14)  # -> Moved, Vector, Transform
list_item_69 = ListItem(List=flatten(offset_curve_6), Index=Slider(1, range=0..1), Wrap=True)
mirror_19 = Mirror(Geometry=move_21.Geometry, Plane=yz_plane_15)  # -> Geometry, Transform
mirror_20 = Mirror(Geometry=merge_13, Plane=yz_plane_15)  # -> Geometry, Transform
mirror_21 = Mirror(Geometry=merge_14, Plane=yz_plane_15)  # -> Geometry, Transform
deconstruct_brep_46 = DeconstructBrep(Brep=list_item_69)  # -> Faces, Edges, Vertices
move_22 = Move(Geometry=mirror_19.Geometry, Motion=unit_x_18)  # -> Geometry, Transform
panel_4 = Panel("""0
1""")
merge_15 = Merge(Data1=merge_13, Data2=mirror_20.Geometry)
panel_5 = Panel("""0
2
4
6""")
mirror_22 = Mirror(Geometry=merge_7, Plane=yz_plane_15)  # -> Geometry, Transform
number_slider_13 = Slider(19, range=0..100)
list_item_70 = ListItem(List=deconstruct_brep_46.Edges, Index=0, Wrap=True)
list_item_71 = ListItem(List=deconstruct_brep_46.Vertices, Index=panel_4, Wrap=True)  # -> graft(Item)
merge_16 = Merge(Data1=mirror_18.Geometry, Data2=move_21.Geometry, Data3=mirror_19.Geometry, Data4=move_22.Geometry)
panel_6 = Panel("""8
9
10
11
16
17
18
19""")
curve_middle_15 = CurveMiddle(Curve=list_item_70)
unit_y_13 = UnitY(Factor=Slider(63, range=0..1000))
explode_tree_6 = ExplodeTree(Data=list_item_71)  # -> Branch0, Branch1
yz_plane_17 = YZPlane(Origin=curve_middle_15)
cull_index = CullIndex(List=flatten(merge_16), Indices=panel_5, Wrap=True)
list_item_72 = ListItem(List=flatten(merge_16), Index=panel_5, Wrap=True)
list_item_73 = ListItem(List=flatten(merge_16), Index=panel_6, Wrap=True)
move_23 = Move(Geometry=curve_middle_15, Motion=expr("-x", unit_y_13))  # -> Geometry, Transform
merge_17 = Merge(Data1=merge_7, Data2=mirror_22.Geometry)
unit_x_19 = UnitX(Factor=Slider(100, range=0..100))
circle_5 = Circle(Plane=yz_plane_17, Radius=Slider(15, range=0..100))
mirror_23 = Mirror(Geometry=list_item_73, Plane=xz_plane_11)  # -> Geometry, Transform
area_23 = Area(Geometry=deconstruct_brep_46.Faces)  # -> Area, Centroid
_4point_surface_12 = _4PointSurface(CornerA=move_23.Geometry, CornerB=explode_tree_6.Branch0, CornerC=explode_tree_6.Branch1)
mirror_24 = Mirror(Geometry=cull_index, Plane=xz_plane_11)  # -> Geometry, Transform
extrude_19 = Extrude(Base=circle_5, Direction=expr("-x", unit_x_19))
yz_plane_18 = YZPlane(Origin=area_23.Centroid)
xz_plane_13 = XZPlane(Origin=area_23.Centroid)
mirror_25 = Mirror(Geometry=list_item_72, Plane=xz_plane_11)  # -> Geometry, Transform
cap_holes_ex_6 = CapHolesEx(Brep=extrude_19)  # -> Brep, Caps, Solid
rotate_3d_5 = Rotate3D(Geometry=_4point_surface_12, Angle=degrees(Slider(180, range=0..1000)), Center=yz_plane_18, Axis=yz_plane_18)  # -> Geometry, Transform
merge_18 = Merge(Data1=list_item_73, Data2=mirror_23.Geometry)
mirror_26 = Mirror(Geometry=cap_holes_ex_6.Brep, Plane=xz_plane_13)  # -> Geometry, Transform

merge_19 = Merge(Data1=list_item_72, Data2=mirror_25.Geometry)

merge_20 = Merge(Data1=cap_holes_ex_6.Brep, Data2=mirror_26.Geometry)
unit_x_20 = UnitX(Factor=Slider(100, range=0..1000))
brep_join_2 = BrepJoin(Breps=flatten([_4point_surface_12, deconstruct_brep_46.Faces, rotate_3d_5.Geometry]))  # -> Breps, Closed
extrude_20 = Extrude(Base=brep_join_2.Breps, Direction=expr("-x", unit_x_20))
solid_difference_15 = SolidDifference(BrepsA=merge_19, BrepsB=flatten(merge_18))
solid_intersection = SolidIntersection(BrepsA=extrude_20, BrepsB=explode_tree_4.Branch0)
deconstruct_brep_47 = DeconstructBrep(Brep=solid_intersection)  # -> Faces, Edges, Vertices
unit_x_21 = UnitX(Factor=Slider(50, range=0..100))
list_item_74 = ListItem(List=deconstruct_brep_47.Faces, Index=Slider(3, range=0..10), Wrap=True)
list_item_75 = ListItem(List=deconstruct_brep_47.Faces, Index=Slider(6, range=0..10), Wrap=True)
explode = Explode(Curve=list_item_74, Recursive=True)  # -> Segments, Vertices
extrude_21 = Extrude(Base=list_item_75, Direction=expr("-x", unit_x_21))
area_24 = Area(Geometry=list_item_74)  # -> Area, Centroid
list_item_76 = ListItem(List=explode.Segments, Index=0, Wrap=True)  # -> Item, Item1
construct_plane = ConstructPlane(Origin=area_24.Centroid, XAxis=list_item_76.Item, YAxis=list_item_76.Item1)
amplitude = Amplitude(Vector=construct_plane, Amplitude=Slider(10, range=0..10))
extrude_22 = Extrude(Base=list_item_74, Direction=amplitude)
solid_intersection_2 = SolidIntersection(BrepsA=extrude_22, BrepsB=extrude_21)
mirror_27 = Mirror(Geometry=extrude_21, Plane=xz_plane_13)  # -> Geometry, Transform
mirror_28 = Mirror(Geometry=solid_intersection_2, Plane=xz_plane_13)  # -> Geometry, Transform

area_25 = Area(Geometry=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)  # -> Area, Centroid
xz_plane_14 = XZPlane(Origin=area_25.Centroid)
yz_plane_19 = YZPlane(Origin=area_25.Centroid)

merge_21 = Merge(Data1=mirror_27.Geometry, Data2=extrude_21, Data3=merge_20)
merge_22 = Merge(Data1=solid_intersection_2, Data2=mirror_28.Geometry)
solid_difference_16 = SolidDifference(BrepsA=extrude_20, BrepsB=flatten(merge_21))
solid_union_11 = SolidUnion(Breps=flatten([solid_difference_16, merge_22]))
mirror_29 = Mirror(Geometry=solid_union_11, Plane=yz_plane_19)  # -> Geometry, Transform
mirror_30 = Mirror(Geometry=merge_20, Plane=yz_plane_19)  # -> Geometry, Transform
merge_23 = Merge(Data1=merge_20, Data2=mirror_30.Geometry)
merge_24 = Merge(Data1=solid_union_11, Data2=mirror_29.Geometry, Data3=merge_20, Data4=mirror_30.Geometry)
solid_difference_17 = SolidDifference(BrepsA=merge_8, BrepsB=flatten(merge_24))
mirror_31 = Mirror(Geometry=solid_union_10, Plane=xz_plane_11)  # -> Geometry, Transform
unit_x_22 = UnitX(Factor=Slider(2340, range=0..10000))
merge_25 = Merge(Data1=solid_union_10, Data2=mirror_31.Geometry)
move_24 = Move(Geometry=merge_25, Motion=unit_x_22)  # -> Geometry, Transform
mirror_32 = Mirror(Geometry=merge_25, Plane=PlaneYZ(2440, 1830, 114.9324034))  # -> Geometry, Transform
merge_26 = Merge(Data1=merge_25, Data2=move_24.Geometry, Data3=mirror_32.Geometry)
merge_27 = Merge(Data1=cull_index, Data2=mirror_24.Geometry, Data3=merge_12)

# ----
# Support
merge_28 = Merge(Data1=solid_difference_15, Data2=merge_15)

# ----
# Roof Sub-Beam
merge_29 = Merge(Data1=solid_union_11, Data2=mirror_29.Geometry)

# ----
# Roof Frame
brep = Brep(solid_difference_17)

# ----
# Pin
number_slider_14 = Slider(230, range=0..1000)
L_8 = Slider(64, range=0..4880)
W_9 = Slider(50, range=0..1000)
construct_point_33 = ConstructPoint(XCoordinate=0, YCoordinate=0, ZCoordinate=0)
construct_point_34 = ConstructPoint(XCoordinate=0, YCoordinate=number_slider_14, ZCoordinate=0)
construct_point_35 = ConstructPoint(XCoordinate=0, YCoordinate=number_slider_14, ZCoordinate=Slider(45, range=0..100))
construct_point_36 = ConstructPoint(XCoordinate=0, YCoordinate=0, ZCoordinate=L_8)
_4point_surface_13 = _4PointSurface(CornerA=construct_point_33, CornerB=construct_point_34, CornerC=construct_point_35, CornerD=construct_point_36)

unit_x_23 = UnitX(Factor=W_9)

extrude_23 = Extrude(Base=_4point_surface_13, Direction=unit_x_23)
deconstruct_brep_48 = DeconstructBrep(Brep=extrude_23)  # -> Faces, Edges, Vertices

list_item_77 = ListItem(List=deconstruct_brep_48.Vertices, Index=Slider(1, range=0..10), Wrap=True)
move_to_point_21 = MoveToPoint(Geometry=extrude_23, PointA=list_item_77, PointB=list_item_52)  # -> Moved, Vector, Transform
mirror_33 = Mirror(Geometry=move_to_point_21.Moved, Plane=xz_plane_4)  # -> Geometry, Transform
merge_30 = Merge(Data1=move_to_point_21.Moved, Data2=mirror_33.Geometry)
mirror_34 = Mirror(Geometry=merge_30, Plane=yz_plane_14)  # -> Geometry, Transform
merge_31 = Merge(Data1=merge_30, Data2=mirror_34.Geometry)

# ----
# Sub Beam
number_slider_15 = Slider(1086, range=0..1200)
number_slider_16 = Slider(127, range=0..1520)
W_10 = Slider(120, range=0..1000)
construct_point_37 = ConstructPoint(XCoordinate=0, YCoordinate=0, ZCoordinate=0)
construct_point_38 = ConstructPoint(XCoordinate=0, YCoordinate=number_slider_15, ZCoordinate=0)
construct_point_39 = ConstructPoint(XCoordinate=0, YCoordinate=number_slider_15, ZCoordinate=number_slider_16)
construct_point_40 = ConstructPoint(XCoordinate=0, YCoordinate=0, ZCoordinate=number_slider_16)
_4point_surface_14 = _4PointSurface(CornerA=construct_point_37, CornerB=construct_point_38, CornerC=construct_point_39, CornerD=construct_point_40)

unit_x_24 = UnitX(Factor=W_10)

extrude_24 = Extrude(Base=_4point_surface_14, Direction=unit_x_24)
deconstruct_brep_49 = DeconstructBrep(Brep=extrude_24)  # -> Faces, Edges, Vertices

list_item_78 = ListItem(List=deconstruct_brep_49.Vertices, Index=Slider(3, range=0..10), Wrap=True)
move_to_point_22 = MoveToPoint(Geometry=extrude_24, PointA=list_item_78, PointB=Point(0, 200, 1100))  # -> Moved, Vector, Transform
deconstruct_brep_50 = DeconstructBrep(Brep=move_to_point_22.Moved)  # -> Faces, Edges, Vertices
list_item_79 = ListItem(List=deconstruct_brep_50.Vertices, Index=0, Wrap=True)
area_26 = Area(Geometry=move_to_point_22.Moved)  # -> Area, Centroid
move_to_point_23 = MoveToPoint(Geometry=center_box_3, PointA=list_item_8, PointB=list_item_79)  # -> Moved, Vector, Transform
xz_plane_15 = XZPlane(Origin=area_26.Centroid)
mirror_35 = Mirror(Geometry=move_to_point_23.Moved, Plane=xz_plane_15)  # -> Geometry, Transform
solid_difference_18 = SolidDifference(BrepsA=move_to_point_22.Moved, BrepsB=flatten([move_to_point_23.Moved, mirror_35.Geometry]))
deconstruct_brep_51 = DeconstructBrep(Brep=solid_difference_18)  # -> Faces, Edges, Vertices
list_item_80 = ListItem(List=deconstruct_brep_51.Edges, Index=Slider(1, range=0..10), Wrap=True)
list_item_81 = ListItem(List=deconstruct_brep_51.Faces, Index=Slider(6, range=0..10), Wrap=True)
extrude_25 = Extrude(Base=list_item_81, Direction=expr("-x", unit_y_7))
move_25 = Move(Geometry=list_item_80, Motion=unit_x_11)  # -> graft(Geometry), Transform
explode_tree_7 = ExplodeTree(Data=move_25.Geometry)  # -> _0000, _0001, _0002, _0003
edge_surface_2 = EdgeSurface(CurveA=explode_tree_7._0001, CurveB=explode_tree_7._0003)
extrude_26 = Extrude(Base=edge_surface_2, Direction=expr("-x", unit_y_10))
mirror_36 = Mirror(Geometry=[extrude_26, extrude_25], Plane=xz_plane_15)  # -> Geometry, Transform
solid_union_12 = SolidUnion(Breps=flatten([solid_difference_18, extrude_25, extrude_26, mirror_36.Geometry]))
deconstruct_brep_52 = DeconstructBrep(Brep=solid_union_12)  # -> Faces, Edges, Vertices
list_item_82 = ListItem(List=deconstruct_brep_52.Edges, Index=Slider(51, range=0..100), Wrap=True)
offset_curve_7 = OffsetCurve(Curve=list_item_82, Distance=expr("-x", Slider(30, range=0..100)), Plane=yz_plane_7, Corners=1)
curve_middle_16 = CurveMiddle(Curve=offset_curve_7)
yz_plane_20 = YZPlane(Origin=curve_middle_16)
circle_6 = Circle(Plane=yz_plane_20, Radius=Slider(15, range=0..100))
extrude_27 = Extrude(Base=circle_6, Direction=expr("-x", unit_x_14))
cap_holes_ex_7 = CapHolesEx(Brep=extrude_27)  # -> Brep, Caps, Solid
mirror_37 = Mirror(Geometry=cap_holes_ex_7.Brep, Plane=xz_plane_15)  # -> Geometry, Transform
merge_32 = Merge(Data1=mirror_37.Geometry, Data2=cap_holes_ex_7.Brep)
solid_difference_19 = SolidDifference(BrepsA=solid_union_12, BrepsB=flatten(merge_32))
mirror_38 = Mirror(Geometry=merge_32, Plane=xz_plane_9)  # -> Geometry, Transform
mirror_39 = Mirror(Geometry=solid_difference_19, Plane=xz_plane_9)  # -> Geometry, Transform
merge_33 = Merge(Data1=solid_difference_19, Data2=mirror_39.Geometry)

merge_34 = Merge(Data1=merge_32, Data2=mirror_38.Geometry)

mirror_40 = Mirror(Geometry=merge_34, Plane=yz_plane_14)  # -> Geometry, Transform
mirror_41 = Mirror(Geometry=merge_33, Plane=yz_plane_14)  # -> Geometry, Transform
solid_difference_20 = SolidDifference(BrepsA=move_14.Geometry, BrepsB=flatten([merge_33, merge_34]))
mirror_42 = Mirror(Geometry=solid_difference_20, Plane=xz_plane_9)  # -> Geometry, Transform
merge_35 = Merge(Data1=solid_difference_20, Data2=mirror_42.Geometry)
solid_difference_21 = SolidDifference(BrepsA=move_to_point_20.Moved, BrepsB=flatten(merge_35))

solid_difference_22 = SolidDifference(BrepsA=solid_difference_6, BrepsB=flatten([solid_union_8, rotate_3d_4.Geometry, merge_7, mirror_15.Geometry, merge_35]))

mirror_43 = Mirror(Geometry=solid_difference_21, Plane=yz_plane_8)  # -> Geometry, Transform
mirror_44 = Mirror(Geometry=solid_difference_22, Plane=yz_plane_15)  # -> Geometry, Transform
merge_36 = Merge(Data1=solid_difference_22, Data2=mirror_44.Geometry)
merge_37 = Merge(Data1=solid_difference_21, Data2=mirror_43.Geometry)
mirror_45 = Mirror(Geometry=merge_35, Plane=yz_plane_14)  # -> Geometry, Transform

solid_difference_23 = SolidDifference(BrepsA=merge_9, BrepsB=flatten(merge_37))

merge_38 = Merge(Data1=merge_35, Data2=mirror_45.Geometry)
merge_39 = Merge(Data1=merge_36, Data2=solid_difference_11)

# ----
# Floor
merge_40 = Merge(Data1=move_to_point_11.Moved, Data2=solid_difference_23, Data3=merge_37, Data4=solid_difference_13)

# ----
# Sub Beam
number_slider_17 = Slider(2143.5, range=0..10000)
number_slider_18 = Slider(127, range=0..1520)
W_11 = Slider(120, range=0..1000)
construct_point_41 = ConstructPoint(XCoordinate=0, YCoordinate=0, ZCoordinate=0)
construct_point_42 = ConstructPoint(XCoordinate=number_slider_17, YCoordinate=0, ZCoordinate=0)
construct_point_43 = ConstructPoint(XCoordinate=number_slider_17, YCoordinate=0, ZCoordinate=number_slider_18)
construct_point_44 = ConstructPoint(XCoordinate=0, YCoordinate=0, ZCoordinate=number_slider_18)
_4point_surface_15 = _4PointSurface(CornerA=construct_point_41, CornerB=construct_point_42, CornerC=construct_point_43, CornerD=construct_point_44)

unit_y_14 = UnitY(Factor=W_11)

extrude_28 = Extrude(Base=_4point_surface_15, Direction=unit_y_14)
deconstruct_brep_53 = DeconstructBrep(Brep=extrude_28)  # -> Faces, Edges, Vertices

list_item_83 = ListItem(List=deconstruct_brep_53.Vertices, Index=Slider(0, range=0..10), Wrap=True)
move_to_point_24 = MoveToPoint(Geometry=extrude_28, PointA=list_item_83, PointB=Point(200, 0, 1100))  # -> Moved, Vector, Transform
deconstruct_brep_54 = DeconstructBrep(Brep=move_to_point_24.Moved)  # -> Faces, Edges, Vertices
list_item_84 = ListItem(List=deconstruct_brep_54.Vertices, Index=0, Wrap=True)
area_27 = Area(Geometry=move_to_point_24.Moved)  # -> Area, Centroid
move_to_point_25 = MoveToPoint(Geometry=center_box_4, PointA=list_item_12, PointB=list_item_84)  # -> Moved, Vector, Transform
yz_plane_21 = YZPlane(Origin=area_27.Centroid)
mirror_46 = Mirror(Geometry=move_to_point_25.Moved, Plane=yz_plane_21)  # -> Geometry, Transform
solid_difference_24 = SolidDifference(BrepsA=move_to_point_24.Moved, BrepsB=flatten([move_to_point_25.Moved, mirror_46.Geometry]))
deconstruct_brep_55 = DeconstructBrep(Brep=solid_difference_24)  # -> Faces, Edges, Vertices
list_item_85 = ListItem(List=deconstruct_brep_55.Edges, Index=Slider(1, range=0..10), Wrap=True)
list_item_86 = ListItem(List=deconstruct_brep_55.Faces, Index=Slider(7, range=0..10), Wrap=True)
extrude_29 = Extrude(Base=list_item_86, Direction=unit_x_9)
move_26 = Move(Geometry=list_item_85, Motion=unit_y_9)  # -> graft(Geometry), Transform
explode_tree_8 = ExplodeTree(Data=move_26.Geometry)  # -> _0000, _0001, _0002, _0003
edge_surface_3 = EdgeSurface(CurveA=explode_tree_8._0001, CurveB=explode_tree_8._0003)
extrude_30 = Extrude(Base=edge_surface_3, Direction=expr("-x", unit_x_12))
mirror_47 = Mirror(Geometry=[extrude_30, extrude_29], Plane=yz_plane_21)  # -> Geometry, Transform
solid_union_13 = SolidUnion(Breps=flatten([solid_difference_24, extrude_29, extrude_30, mirror_47.Geometry]))
deconstruct_brep_56 = DeconstructBrep(Brep=solid_union_13)  # -> Faces, Edges, Vertices
list_item_87 = ListItem(List=deconstruct_brep_56.Edges, Index=Slider(51, range=0..100), Wrap=True)
offset_curve_8 = OffsetCurve(Curve=list_item_87, Distance=Slider(30, range=0..100), Plane=xz_plane_7, Corners=1)
curve_middle_17 = CurveMiddle(Curve=offset_curve_8)
xz_plane_16 = XZPlane(Origin=curve_middle_17)
circle_7 = Circle(Plane=xz_plane_16, Radius=Slider(15, range=0..100))
extrude_31 = Extrude(Base=circle_7, Direction=expr("-x", unit_y_11))
cap_holes_ex_8 = CapHolesEx(Brep=extrude_31)  # -> Brep, Caps, Solid
mirror_48 = Mirror(Geometry=cap_holes_ex_8.Brep, Plane=yz_plane_21)  # -> Geometry, Transform
merge_41 = Merge(Data1=mirror_48.Geometry, Data2=cap_holes_ex_8.Brep)
solid_difference_25 = SolidDifference(BrepsA=solid_union_13, BrepsB=flatten(merge_41))
mirror_49 = Mirror(Geometry=merge_41, Plane=yz_plane_11)  # -> Geometry, Transform
mirror_50 = Mirror(Geometry=solid_difference_25, Plane=yz_plane_11)  # -> Geometry, Transform
merge_42 = Merge(Data1=solid_difference_25, Data2=mirror_50.Geometry)
merge_43 = Merge(Data1=merge_41, Data2=mirror_49.Geometry)
mirror_51 = Mirror(Geometry=merge_42, Plane=xz_plane_8)  # -> Geometry, Transform
mirror_52 = Mirror(Geometry=merge_43, Plane=xz_plane_8)  # -> Geometry, Transform
merge_44 = Merge(Data1=merge_42, Data2=mirror_51.Geometry)
merge_45 = Merge(Data1=merge_43, Data2=mirror_52.Geometry)

# ----
# ALL PINS
merge_46 = Merge(
    Data1=merge_4,
    Data2=merge_14,
    Data3=merge_34,
    Data4=merge_45,
    Data5=merge_23,
    Data6=mirror_21.Geometry,
    Data7=mirror_40.Geometry,
    Data8=merge_18,
    Data9=merge_31,
    Data10=merge_17)

# ----
# Sub-Beam
merge_47 = Merge(Data1=merge_33, Data2=mirror_41.Geometry, Data3=merge_44)

# ----
# Column
solid_difference_26 = SolidDifference(BrepsA=merge_26, BrepsB=flatten([merge_27, merge_46, merge_47, merge_39]))

# ----
# Sub-Column
solid_difference_27 = SolidDifference(BrepsA=merge_38, BrepsB=flatten([merge_47, merge_46]))

# ----
# Roof Beam
solid_difference_28 = SolidDifference(BrepsA=merge_39, BrepsB=flatten([merge_27, merge_46, merge_47, merge_39]))

deconstruct_brep_57 = DeconstructBrep()  # -> Faces, Edges, Vertices
custom_preview_lineweights = CustomPreviewLineweights(
    Geometry=deconstruct_brep_57.Edges,
    Shader=ColourSwatch(SwatchColor=RGB(0, 0, 0)),
    Thickness=Slider(5, range=0..5),
    Absolute=False)
custom_preview = CustomPreview(Geometry=merge_40, Material=ColourSwatch(SwatchColor=RGBA(255, 112, 112, 200)))
custom_preview_2 = CustomPreview(Geometry=merge_28, Material=ColourSwatch(SwatchColor=RGBA(112, 193, 255, 200)))
custom_preview_3 = CustomPreview(Geometry=solid_difference_26, Material=ColourSwatch(SwatchColor=RGBA(136, 255, 112, 200)))
custom_preview_4 = CustomPreview(Geometry=merge_47, Material=ColourSwatch(SwatchColor=RGBA(200, 112, 255, 200)))
custom_preview_5 = CustomPreview(Geometry=solid_difference_27, Material=ColourSwatch(SwatchColor=RGBA(255, 255, 112, 200)))
custom_preview_6 = CustomPreview(Geometry=merge_46, Material=ColourSwatch(SwatchColor=RGB(135, 68, 42)))
custom_preview_7 = CustomPreview(Geometry=solid_difference_28, Material=ColourSwatch(SwatchColor=RGBA(56, 112, 102, 200)))
custom_preview_8 = CustomPreview(Geometry=brep, Material=ColourSwatch(SwatchColor=RGBA(128, 128, 56, 200)))
custom_preview_9 = CustomPreview(Geometry=merge_29, Material=ColourSwatch(SwatchColor=RGB(143, 29, 124)))
