# Grasshopper definition column.gh (Grasshopper 1.0.7)
# plug-ins: Pufferfish, Human

# ----
# House Column Centre
# Beam
W = Slider(200, range=0..1000)
L = Slider(2650, range=0..4880)
construct_point = ConstructPoint(XCoordinate=0, YCoordinate=0, ZCoordinate=0)
construct_point_2 = ConstructPoint(XCoordinate=0, YCoordinate=W, ZCoordinate=0)
construct_point_3 = ConstructPoint(XCoordinate=W, YCoordinate=W, ZCoordinate=0)
construct_point_4 = ConstructPoint(XCoordinate=W, YCoordinate=0, ZCoordinate=0)
unit_z = UnitZ(Factor=L)
_4point_surface = _4PointSurface(CornerA=construct_point, CornerB=construct_point_2, CornerC=construct_point_3, CornerD=construct_point_4)
extrude = Extrude(Base=_4point_surface, Direction=unit_z)
deconstruct_brep = DeconstructBrep(Brep=extrude)  # -> Faces, Edges, Vertices

# ----
# Pin
number_slider = Slider(230, range=0..1000)
L_2 = Slider(64, range=0..4880)
W_2 = Slider(50, range=0..1000)
construct_point_5 = ConstructPoint(XCoordinate=0, YCoordinate=0, ZCoordinate=0)
construct_point_6 = ConstructPoint(XCoordinate=number_slider, YCoordinate=0, ZCoordinate=0)
construct_point_7 = ConstructPoint(XCoordinate=number_slider, YCoordinate=0, ZCoordinate=Slider(45, range=0..100))
construct_point_8 = ConstructPoint(XCoordinate=0, YCoordinate=0, ZCoordinate=L_2)
unit_y = UnitY(Factor=W_2)
_4point_surface_2 = _4PointSurface(CornerA=construct_point_5, CornerB=construct_point_6, CornerC=construct_point_7, CornerD=construct_point_8)
extrude_2 = Extrude(Base=_4point_surface_2, Direction=unit_y)
deconstruct_brep_2 = DeconstructBrep(Brep=extrude_2)  # -> Faces, Edges, Vertices

# ----
# Sub Beam
number_slider_2 = Slider(1086, range=0..1200)
number_slider_3 = Slider(127, range=0..1520)
W_3 = Slider(120, range=0..1000)
construct_point_9 = ConstructPoint(XCoordinate=0, YCoordinate=0, ZCoordinate=0)
construct_point_10 = ConstructPoint(XCoordinate=number_slider_2, YCoordinate=0, ZCoordinate=0)
construct_point_11 = ConstructPoint(XCoordinate=number_slider_2, YCoordinate=0, ZCoordinate=number_slider_3)
construct_point_12 = ConstructPoint(XCoordinate=0, YCoordinate=0, ZCoordinate=number_slider_3)
unit_y_2 = UnitY(Factor=W_3)
_4point_surface_3 = _4PointSurface(CornerA=construct_point_9, CornerB=construct_point_10, CornerC=construct_point_11, CornerD=construct_point_12)
extrude_3 = Extrude(Base=_4point_surface_3, Direction=unit_y_2)
deconstruct_brep_3 = DeconstructBrep(Brep=extrude_3)  # -> Faces, Edges, Vertices

# ----
# Beam
W_4 = Slider(200, range=0..1000)
L_3 = Slider(1630, range=0..4880)
construct_point_13 = ConstructPoint(XCoordinate=0, YCoordinate=0, ZCoordinate=0)
construct_point_14 = ConstructPoint(XCoordinate=0, YCoordinate=W_4, ZCoordinate=0)
construct_point_15 = ConstructPoint(XCoordinate=L_3, YCoordinate=W_4, ZCoordinate=0)
construct_point_16 = ConstructPoint(XCoordinate=L_3, YCoordinate=0, ZCoordinate=0)
unit_z_2 = UnitZ(Factor=W_4)
_4point_surface_4 = _4PointSurface(CornerA=construct_point_13, CornerB=construct_point_14, CornerC=construct_point_15, CornerD=construct_point_16)
extrude_4 = Extrude(Base=_4point_surface_4, Direction=unit_z_2)
deconstruct_brep_4 = DeconstructBrep(Brep=extrude_4)  # -> Faces, Edges, Vertices

list_item = ListItem(List=deconstruct_brep.Vertices, Index=Slider(3, range=0..10), Wrap=True)
unit_z_3 = UnitZ(Factor=Slider(2390, range=0..3000))
unit_z_4 = UnitZ(Factor=Slider(900, range=0..1000))
list_item_2 = ListItem(List=deconstruct_brep_4.Vertices, Index=Slider(4, range=0..10), Wrap=True)
list_item_3 = ListItem(List=deconstruct_brep_2.Vertices, Index=Slider(1, range=0..10), Wrap=True)
list_item_4 = ListItem(List=deconstruct_brep_3.Vertices, Index=Slider(3, range=0..10), Wrap=True)
unit_z_5 = UnitZ(Factor=Slider(950, range=0..3000))
construct_point_17 = ConstructPoint(XCoordinate=Slider(770, range=0..1000), YCoordinate=0, ZCoordinate=expr("-x", Slider(200, range=0..1000)))
move = Move(Geometry=list_item, Motion=unit_z_3)  # -> Geometry, Transform
move_2 = Move(Geometry=list_item, Motion=unit_z_4)  # -> Geometry, Transform
move_to_point = MoveToPoint(Geometry=extrude_4, PointA=list_item_2, PointB=move.Geometry)  # -> Moved, Vector, Transform
list_item_5 = ListItem(List=deconstruct_brep.Faces, Index=Slider(5, range=0..10), Wrap=True)
list_item_6 = ListItem(List=deconstruct_brep.Faces, Index=Slider(0, range=0..10), Wrap=True)
move_to_point_2 = MoveToPoint(Geometry=extrude_3, PointA=list_item_4, PointB=move_2.Geometry)  # -> Moved, Vector, Transform
number_slider_4 = Slider(100, range=0..100)
number_slider_5 = Slider(100, range=0..100)
area = Area(Geometry=list_item_5)  # -> Area, Centroid
area_2 = Area(Geometry=list_item_6)  # -> Area, Centroid
move_3 = Move(Geometry=move.Geometry, Motion=expr("-x", unit_z_5))  # -> Geometry, Transform
area_3 = Area(Geometry=list_item_5)  # -> Area, Centroid
move_4 = Move(Geometry=move.Geometry, Motion=construct_point_17)  # -> Geometry, Transform
deconstruct_brep_5 = DeconstructBrep(Brep=move_to_point.Moved)  # -> Faces, Edges, Vertices
deconstruct_brep_6 = DeconstructBrep(Brep=move_to_point_2.Moved)  # -> Faces, Edges, Vertices
unit_x = UnitX(Factor=Slider(20, range=0..100))
list_item_7 = ListItem(List=deconstruct_brep_5.Edges, Index=Slider(5, range=0..10), Wrap=True)
unit_x_2 = UnitX(Factor=Slider(25, range=0..100))
center_box = CenterBox(Base=area.Centroid, X=Slider(25, range=0..100), Y=number_slider_4, Z=number_slider_4)
center_box_2 = CenterBox(Base=area_2.Centroid, X=Slider(25, range=0..100), Y=Slider(50, range=0..100), Z=Slider(100, range=0..100))
list_item_8 = ListItem(List=deconstruct_brep_5.Vertices, Index=Slider(0, range=0..10), Wrap=True)
list_item_9 = ListItem(List=deconstruct_brep_5.Vertices, Index=Slider(4, range=0..10), Wrap=True)
center_box_3 = CenterBox(Base=area_3.Centroid, X=number_slider_5, Y=Slider(1500, range=0..2000), Z=number_slider_5)
construct_point_18 = ConstructPoint(XCoordinate=0, YCoordinate=Slider(750, range=0..1000), ZCoordinate=Slider(90, range=0..100))
number_slider_6 = Slider(200, range=0..1000)
unit_x_3 = UnitX(Factor=Slider(88.61, range=0..1000))
line = Line(StartPoint=move_3.Geometry, EndPoint=move_4.Geometry)
divide_curve = DivideCurve(Curve=list_item_7, Count=Slider(4, range=0..10), Kinks=False)  # -> Points, Tangents, Parameters
xz_plane = XZPlane(Origin=Point(0, 0, 0))
list_item_10 = ListItem(List=deconstruct_brep_6.Vertices, Index=0, Wrap=True)
move_5 = Move(Geometry=list_item_8, Motion=expr("-x", unit_x))  # -> Geometry, Transform
move_6 = Move(Geometry=center_box, Motion=expr("-x", unit_x_2))  # -> Geometry, Transform
move_7 = Move(Geometry=center_box_3, Motion=construct_point_18)  # -> Geometry, Transform
deconstruct_brep_7 = DeconstructBrep(Brep=list_item_5)  # -> Faces, Edges, Vertices
area_4 = Area(Geometry=move_to_point_2.Moved)  # -> Area, Centroid
move_8 = Move(Geometry=move_3.Geometry, Motion=expr("-x", unit_x_3))  # -> Geometry, Transform
construct_point_19 = ConstructPoint(XCoordinate=number_slider_6, YCoordinate=0, ZCoordinate=number_slider_6)
list_item_11 = ListItem(List=divide_curve.Points, Index="1", Wrap=True)  # -> graft(Item)
unit_z_6 = UnitZ(Factor=Slider(152, range=0..1000))
unit_x_4 = UnitX(Factor=number_slider_6)
offset_curve = OffsetCurve(Curve=line, Plane=xz_plane, Distance=expr("-x", Slider(127, range=0..1000)), BothSides=0, Kinks=0, CapType=1)
list_item_12 = ListItem(List=deconstruct_brep_7.Edges, Index=Slider(1, range=0..10), Wrap=True)
_4point_surface_5 = _4PointSurface(CornerA=list_item_8, CornerB=list_item_9, CornerC=move_5.Geometry)
center_box_4 = CenterBox(Base=PlaneXY(0, 0, 0), X=Slider(20, range=0..100), Y=Slider(100, range=0..100), Z=Slider(10, range=0..10))
unit_y_3 = UnitY(Factor=Slider(200, range=0..1000))
yz_plane = YZPlane(Origin=area_4.Centroid)
curve_middle = CurveMiddle(Curve=list_item_12)
deconstruct_brep_8 = DeconstructBrep(Brep=center_box_4)  # -> Faces, Edges, Vertices
deconstruct_brep_9 = DeconstructBrep(Brep=offset_curve)  # -> Faces, Edges, Vertices
panel = Panel("""0
1""")
move_9 = Move(Geometry=list_item_11, Motion=expr("-x", unit_z_6))  # -> Geometry, Transform
move_10 = Move(Geometry=list_item_11, Motion=expr("-x", construct_point_19))  # -> Geometry, Transform
move_11 = Move(Geometry=list_item_11, Motion=expr("-x", unit_x_4))  # -> Geometry, Transform
extrude_5 = Extrude(Base=_4point_surface_5, Direction=unit_y_3)
unit_z_7 = UnitZ(Factor=Slider(40, range=0..100))
center_box_5 = CenterBox(Base=curve_middle, X=Slider(100, range=0..100), Y=Slider(10, range=0..10), Z=Slider(60, range=0..100))
list_item_13 = ListItem(List=deconstruct_brep_8.Vertices, Index=0, Wrap=True)
move_to_point_3 = MoveToPoint(Geometry=center_box_4, PointA=list_item_13, PointB=list_item_10)  # -> Moved, Vector, Transform
mirror = Mirror(Geometry=move_to_point_3.Moved, Plane=yz_plane)  # -> Geometry, Transform
list_item_14 = ListItem(List=deconstruct_brep_9.Vertices, Index=panel, Wrap=True)  # -> graft(Item)
solid_difference = SolidDifference(BrepsA=move_to_point_2.Moved, BrepsB=flatten([move_to_point_3.Moved, mirror.Geometry]))
deconstruct_brep_10 = DeconstructBrep(Brep=extrude_5)  # -> Faces, Edges, Vertices
move_12 = Move(Geometry=center_box_5, Motion=unit_z_7)  # -> Geometry, Transform
explode_tree = ExplodeTree(Data=list_item_14)  # -> _00000, _00001
line_2 = Line(StartPoint=move_9.Geometry, EndPoint=move_10.Geometry)
line_3 = Line(StartPoint=list_item_11, EndPoint=move_11.Geometry)
list_item_15 = ListItem(List=deconstruct_brep_10.Vertices, Index=Slider(2, range=0..10), Wrap=True)
number_slider_7 = Slider(180, range=0..1000)
area_5 = Area(Geometry=deconstruct_brep_9.Faces)  # -> Area, Centroid
_4point_surface_6 = _4PointSurface(CornerA=move_8.Geometry, CornerB=explode_tree._00000, CornerC=explode_tree._00001)
edge_surface = EdgeSurface(CurveA=line_3, CurveB=line_2)
deconstruct_brep_11 = DeconstructBrep(Brep=solid_difference)  # -> Faces, Edges, Vertices
xz_plane_2 = XZPlane(Origin=area_5.Centroid)
unit_x_5 = UnitX(Factor=Slider(10, range=0..10))
rotate_3d = Rotate3D(Geometry=_4point_surface_6, Angle=degrees(number_slider_7), Center=xz_plane_2, Axis=xz_plane_2)  # -> Geometry, Transform
move_to_point_4 = MoveToPoint(Geometry=center_box_4, PointA=list_item_13, PointB=list_item_15)  # -> Moved, Vector, Transform
list_item_16 = ListItem(List=deconstruct_brep_11.Edges, Index=Slider(1, range=0..10), Wrap=True)
list_item_17 = ListItem(List=deconstruct_brep_11.Faces, Index=Slider(1, range=0..10), Wrap=True)
extrude_6 = Extrude(Base=list_item_17, Direction=expr("-x", unit_x_5))
unit_y_4 = UnitY(Factor=Slider(50, range=0..100))
unit_y_5 = UnitY(Factor=Slider(100, range=0..1000))
brep_join = BrepJoin(Breps=flatten([_4point_surface_6, deconstruct_brep_9.Faces, rotate_3d.Geometry]))  # -> Breps, Closed
extrude_7 = Extrude(Base=edge_surface, Direction=unit_y_4)
series = Series(Start=0, Step=Slider(25, range=0..100), Count=Slider(4, range=0..10))
extrude_8 = Extrude(Base=brep_join.Breps, Direction=unit_y_5)
deconstruct_brep_12 = DeconstructBrep(Brep=extrude_8)  # -> Faces, Edges, Vertices
list_item_18 = ListItem(List=deconstruct_brep_12.Vertices, Index=Slider(1, range=0..100), Wrap=True)
list_item_19 = ListItem(List=deconstruct_brep_12.Edges, Index=Slider(14, range=0..100), Wrap=True)
unit_x_6 = UnitX(Factor=Slider(10, range=0..10))
list_item_20 = ListItem(List=deconstruct_brep_12.Vertices, Index=Slider(11, range=0..100), Wrap=True)
list_item_21 = ListItem(List=deconstruct_brep_12.Edges, Index=Slider(17, range=0..100), Wrap=True)
unit_y_6 = UnitY(Factor=series)
number_slider_8 = Slider(44.33, range=0..100)
move_13 = Move(Geometry=list_item_18, Motion=expr("-x", unit_x_6))  # -> Geometry, Transform
curve_middle_2 = CurveMiddle(Curve=list_item_21)
curve_middle_3 = CurveMiddle(Curve=list_item_19)
move_14 = Move(Geometry=list_item_16, Motion=unit_y_6)  # -> graft(Geometry), Transform
solid_union = SolidUnion(Breps=flatten([move_to_point.Moved, extrude_5, extrude_7]))
center_box_6 = CenterBox(Base=curve_middle_3, X=number_slider_8, Y=Slider(25, range=0..100), Z=Slider(100, range=0..100))
center_box_7 = CenterBox(Base=curve_middle_3, X=number_slider_8, Y=Slider(50, range=0..100), Z=Slider(89, range=0..1000))
explode_tree_2 = ExplodeTree(Data=move_14.Geometry)  # -> _0000, _0001, _0002, _0003
deconstruct_brep_13 = DeconstructBrep(Brep=center_box_6)  # -> Faces, Edges, Vertices
solid_difference_2 = SolidDifference(BrepsA=solid_union, BrepsB=move_to_point_4.Moved)
unit_x_7 = UnitX(Factor=Slider(100, range=0..100))
deconstruct_brep_14 = DeconstructBrep(Brep=center_box_7)  # -> Faces, Edges, Vertices
edge_surface_2 = EdgeSurface(CurveA=explode_tree_2._0001, CurveB=explode_tree_2._0003)
list_item_22 = ListItem(List=deconstruct_brep_13.Vertices, Index=Slider(1, range=0..10), Wrap=True)
deconstruct_brep_15 = DeconstructBrep(Brep=solid_difference_2)  # -> Faces, Edges, Vertices
list_item_23 = ListItem(List=deconstruct_brep_14.Vertices, Index=Slider(1, range=0..10), Wrap=True)
extrude_9 = Extrude(Base=edge_surface_2, Direction=expr("-x", unit_x_7))
move_to_point_5 = MoveToPoint(Geometry=center_box_6, PointA=list_item_22, PointB=move_13.Geometry)  # -> Moved, Vector, Transform
list_item_24 = ListItem(List=deconstruct_brep_15.Vertices, Index=Slider(2, range=0..100), Wrap=True)
mirror_2 = Mirror(Geometry=[extrude_9, extrude_6], Plane=yz_plane)  # -> Geometry, Transform
move_to_point_6 = MoveToPoint(Geometry=extrude_2, PointA=list_item_3, PointB=list_item_24)  # -> Moved, Vector, Transform
move_to_point_7 = MoveToPoint(Geometry=center_box_7, PointA=list_item_23, PointB=list_item_18)  # -> Moved, Vector, Transform
solid_difference_3 = SolidDifference(BrepsA=move_to_point_7.Moved, BrepsB=move_to_point_5.Moved)
solid_union_2 = SolidUnion(Breps=flatten([solid_difference, extrude_6, extrude_9, mirror_2.Geometry]))
number_slider_9 = Slider(90, range=0..100)
xz_plane_3 = XZPlane(Origin=Point(0, 0, 0))
rotate_3d_2 = Rotate3D(Geometry=move_to_point_5.Moved, Angle=expr("-x", degrees(number_slider_9)), Center=Point(0, 0, 0), Axis=xz_plane_3)  # -> Geometry, Transform
rotate_3d_3 = Rotate3D(Geometry=solid_difference_3, Angle=expr("-x", degrees(number_slider_9)), Center=Point(0, 0, 0), Axis=xz_plane_3)  # -> Geometry, Transform
deconstruct_brep_16 = DeconstructBrep(Brep=rotate_3d_2.Geometry)  # -> Faces, Edges, Vertices
deconstruct_brep_17 = DeconstructBrep(Brep=rotate_3d_3.Geometry)  # -> Faces, Edges, Vertices
deconstruct_brep_18 = DeconstructBrep(Brep=solid_union_2)  # -> Faces, Edges, Vertices
list_item_25 = ListItem(List=deconstruct_brep_16.Vertices, Index=Slider(7, range=0..10), Wrap=True)
list_item_26 = ListItem(List=deconstruct_brep_17.Vertices, Index=Slider(5, range=0..10), Wrap=True)
xz_plane_4 = XZPlane(Origin=Point(0, 0, 0))
list_item_27 = ListItem(List=deconstruct_brep_18.Edges, Index=Slider(51, range=0..100), Wrap=True)
offset_curve_2 = OffsetCurve(Curve=list_item_27, Distance=Slider(30, range=0..100), Plane=xz_plane_4, Corners=1)
move_to_point_8 = MoveToPoint(Geometry=rotate_3d_2.Geometry, PointA=list_item_25, PointB=curve_middle_2)  # -> Moved, Vector, Transform
move_to_point_9 = MoveToPoint(Geometry=rotate_3d_3.Geometry, PointA=list_item_26, PointB=list_item_20)  # -> Moved, Vector, Transform
curve_middle_4 = CurveMiddle(Curve=offset_curve_2)
xz_plane_5 = XZPlane(Origin=curve_middle_4)
unit_y_7 = UnitY(Factor=Slider(75, range=0..200))
circle = Circle(Plane=xz_plane_5, Radius=Slider(15, range=0..100))
extrude_10 = Extrude(Base=circle, Direction=expr("-x", unit_y_7))
solid_difference_4 = SolidDifference(BrepsA=extrude_8, BrepsB=flatten([move_to_point_5.Moved, move_to_point_8.Moved]))
cap_holes_ex = CapHolesEx(Brep=extrude_10)  # -> Brep, Caps, Solid
mirror_3 = Mirror(Geometry=cap_holes_ex.Brep, Plane=yz_plane)  # -> Geometry, Transform
deconstruct_brep_19 = DeconstructBrep(Brep=solid_difference_2)  # -> Faces, Edges, Vertices
deconstruct_brep_20 = DeconstructBrep(Brep=solid_difference_4)  # -> Faces, Edges, Vertices
xz_plane_6 = XZPlane(Origin=Point(0, 0, 0))
list_item_28 = ListItem(List=deconstruct_brep_19.Edges, Index=Slider(20, range=0..100), Wrap=True)
list_item_29 = ListItem(List=deconstruct_brep_20.Edges, Index=Slider(12, range=0..100), Wrap=True)
offset_curve_3 = OffsetCurve(Curve=list_item_28, Distance=expr("-x", Slider(30, range=0..100)), Plane=xz_plane_6, Corners=1)
curve_middle_5 = CurveMiddle(Curve=list_item_29)
curve_middle_6 = CurveMiddle(Curve=offset_curve_3)
solid_difference_5 = SolidDifference(BrepsA=solid_union_2, BrepsB=flatten([cap_holes_ex.Brep, mirror_3.Geometry]))
xz_plane_7 = XZPlane(Origin=curve_middle_5)
unit_y_8 = UnitY(Factor=Slider(100, range=0..200))
xz_plane_8 = XZPlane(Origin=curve_middle_6)
circle_2 = Circle(Plane=xz_plane_7, Radius=Slider(15, range=0..100))
extrude_11 = Extrude(Base=circle_2, Direction=expr("-x", unit_y_8))
unit_y_9 = UnitY(Factor=Slider(100, range=0..200))
circle_3 = Circle(Plane=xz_plane_8, Radius=Slider(15, range=0..100))
extrude_12 = Extrude(Base=circle_3, Direction=expr("-x", unit_y_9))
cap_holes_ex_2 = CapHolesEx(Brep=extrude_11)  # -> Brep, Caps, Solid
cap_holes_ex_3 = CapHolesEx(Brep=extrude_12)  # -> Brep, Caps, Solid
rotate_3d_4 = Rotate3D(Geometry=cap_holes_ex_2.Brep, Angle=degrees(number_slider_7), Center=xz_plane_2, Axis=xz_plane_2)  # -> Geometry, Transform
solid_union_3 = SolidUnion(Breps=flatten([extrude, center_box_2, move_6.Geometry]))
solid_difference_6 = SolidDifference(BrepsA=solid_difference_2, BrepsB=flatten([move_to_point_9.Moved, rotate_3d_4.Geometry, cap_holes_ex_3.Brep]))
number_slider_10 = Slider(90, range=0..100)
area_6 = Area(Geometry=extrude)  # -> Area, Centroid
unit_z_8 = UnitZ(Factor=Slider(457.68, range=0..1000))
rotate = Rotate(Geometry=solid_difference_5, Angle=degrees(number_slider_10), Plane=area_6.Centroid)  # -> Geometry, Transform
rotate_2 = Rotate(Geometry=cap_holes_ex.Brep, Angle=degrees(number_slider_10), Plane=area_6.Centroid)  # -> Geometry, Transform
rotate_3 = Rotate(Geometry=cap_holes_ex_2.Brep, Angle=degrees(number_slider_10), Plane=area_6.Centroid)  # -> Geometry, Transform
rotate_4 = Rotate(Geometry=solid_difference_3, Angle=degrees(number_slider_10), Plane=area_6.Centroid)  # -> Geometry, Transform
rotate_5 = Rotate(Geometry=rotate_3d_4.Geometry, Angle=degrees(number_slider_10), Plane=area_6.Centroid)  # -> Geometry, Transform
move_15 = Move(Geometry=rotate_3.Geometry, Motion=unit_z_8)  # -> Geometry, Transform
move_16 = Move(Geometry=rotate_4.Geometry, Motion=unit_z_8)  # -> Geometry, Transform
yz_plane_2 = YZPlane(Origin=area_6.Centroid)
move_17 = Move(Geometry=rotate_5.Geometry, Motion=unit_z_8)  # -> Geometry, Transform
mirror_4 = Mirror(Geometry=move_17.Geometry, Plane=yz_plane_2)  # -> Geometry, Transform
mirror_5 = Mirror(Geometry=rotate.Geometry, Plane=yz_plane_2)  # -> Geometry, Transform
mirror_6 = Mirror(Geometry=rotate_2.Geometry, Plane=yz_plane_2)  # -> Geometry, Transform
mirror_7 = Mirror(Geometry=move_16.Geometry, Plane=yz_plane_2)  # -> Geometry, Transform
mirror_8 = Mirror(Geometry=move_15.Geometry, Plane=yz_plane_2)  # -> Geometry, Transform
merge = Merge(
    Data1=rotate_3d_4.Geometry,
    Data2=cap_holes_ex_2.Brep,
    Data3=cap_holes_ex_3.Brep,
    Data4=cap_holes_ex.Brep,
    Data5=mirror_3.Geometry,
    Data6=move_to_point_6.Moved,
    Data7=mirror_8.Geometry,
    Data8=mirror_4.Geometry,
    Data9=mirror_6.Geometry)
solid_difference_7 = SolidDifference(BrepsA=solid_difference_4, BrepsB=flatten(merge))
rotate_6 = Rotate(Geometry=solid_difference_7, Angle=degrees(number_slider_10), Plane=area_6.Centroid)  # -> Geometry, Transform
move_18 = Move(Geometry=rotate_6.Geometry, Motion=unit_z_8)  # -> Geometry, Transform
mirror_9 = Mirror(Geometry=move_18.Geometry, Plane=yz_plane_2)  # -> Geometry, Transform
solid_difference_8 = SolidDifference(
    BrepsA=solid_union_3,
    BrepsB=flatten([solid_difference_3, merge, solid_difference_2, move_to_point_6.Moved, move_12.Geometry, mirror_7.Geometry, mirror_8.Geometry, mirror_4.Geometry, mirror_5.Geometry, mirror_6.Geometry]))
merge_2 = Merge(Data1=solid_difference_7, Data2=mirror_9.Geometry)
solid_difference_9 = SolidDifference(BrepsA=move_7.Geometry, BrepsB=flatten([mirror_9.Geometry, mirror_4.Geometry, solid_difference_8]))

deconstruct_brep_21 = DeconstructBrep(Brep=[solid_difference_8, merge_2, merge, solid_difference_6, solid_difference_5, mirror_4.Geometry, solid_difference_9, mirror_5.Geometry])  # -> Faces, Edges, Vertices
custom_preview_lineweights = CustomPreviewLineweights(
    Geometry=deconstruct_brep_21.Edges,
    Shader=ColourSwatch(SwatchColor=RGB(0, 0, 0)),
    Thickness=Slider(5, range=0..5),
    Absolute=False)
custom_preview = CustomPreview(Geometry=solid_difference_8, Material=ColourSwatch(SwatchColor=RGBA(255, 112, 112, 200)))
custom_preview_2 = CustomPreview(Geometry=merge_2, Material=ColourSwatch(SwatchColor=RGBA(112, 193, 255, 200)))
custom_preview_3 = CustomPreview(Geometry=solid_difference_6, Material=ColourSwatch(SwatchColor=RGBA(136, 255, 112, 200)))
custom_preview_4 = CustomPreview(Geometry=merge, Material=ColourSwatch(SwatchColor=RGBA(200, 112, 255, 200)))
custom_preview_5 = CustomPreview(Geometry=[solid_difference_5, mirror_5.Geometry], Material=ColourSwatch(SwatchColor=RGBA(255, 255, 112, 200)))
custom_preview_6 = CustomPreview(Geometry=solid_difference_9, Material=ColourSwatch(SwatchColor=RGB(135, 68, 42)))
