# Grasshopper definition Base Tenon (Ver. 1).gh (Grasshopper 1.0.7)
# plug-ins: Human

# China
# 工程做法则例
# 榫
# Base Tenon (Ver. 1)
number_slider = Slider(60, range=0..100)
number_slider_2 = Slider(50, range=0..100)
unit_z = UnitZ(Factor=Slider(12, range=8..12))
circle = Circle(Plane=PlaneXY(0, 0, 0), Radius=number_slider_2)
center_box = CenterBox(Base=PlaneXY(0, 0, 0), X=number_slider, Y=number_slider, Z=Slider(10, range=0..10))
subtraction = Subtraction(A=number_slider_2, B=Slider(10, range=0..100))
circle_2 = Circle(Plane=PlaneXY(0, 0, 0), Radius=subtraction)
L = Slider(200, range=0..1000)
move = Move(Geometry=circle_2, Motion=unit_z)  # -> Geometry, Transform
cylinder = Cylinder(Base=PlaneXY(0, 0, 0), Radius=subtraction, Length=L)
loft = Loft(
    Curves=[circle, move.Geometry],
    Options={Adjust=False, Closed=False, LoftEnds=0, LoftSimp=0, LoftType=0, Rebuild=10, Refit=0.01})
cap_holes_ex = CapHolesEx(Brep=loft)  # -> Brep, Caps, Solid
cap_holes_ex_2 = CapHolesEx(Brep=cylinder)  # -> Brep, Caps, Solid
deconstruct_brep = DeconstructBrep(Brep=center_box)  # -> Faces, Edges, Vertices
deconstruct_brep_2 = DeconstructBrep(Brep=cap_holes_ex.Brep)  # -> Faces, Edges, Vertices
construct_point = ConstructPoint(XCoordinate="0.5", YCoordinate="0.5", ZCoordinate=0)
construct_point_2 = ConstructPoint(XCoordinate="0.5", YCoordinate="0.5", ZCoordinate=0)
list_item = ListItem(List=deconstruct_brep.Faces, Index=Slider(5, range=0..10), Wrap=True)
list_item_2 = ListItem(List=deconstruct_brep_2.Faces, Index=Slider(5, range=0..20), Wrap=True)
evaluate_surface = EvaluateSurface(Surface=reparameterize(list_item), Point=construct_point)  # -> Point, Normal, UDirection, VDirection, Frame
evaluate_surface_2 = EvaluateSurface(Surface=reparameterize(list_item_2), Point=construct_point_2)  # -> Point, Normal, UDirection, VDirection, Frame
orient = Orient(Geometry=cap_holes_ex.Brep, Source=evaluate_surface_2.Point, Target=evaluate_surface.Point)  # -> Geometry, Transform
solid_union = SolidUnion(Breps=flatten([center_box, orient.Geometry]))
deconstruct_brep_3 = DeconstructBrep(Brep=solid_union)  # -> Faces, Edges, Vertices
deconstruct_brep_4 = DeconstructBrep(Brep=cap_holes_ex_2.Brep)  # -> Faces, Edges, Vertices
construct_point_3 = ConstructPoint(XCoordinate="0.5", YCoordinate="0.5", ZCoordinate=0)
construct_point_4 = ConstructPoint(XCoordinate="0.5", YCoordinate="0.5", ZCoordinate=0)
list_item_3 = ListItem(List=deconstruct_brep_3.Faces, Index=Slider(1, range=0..10), Wrap=True)
list_item_4 = ListItem(List=deconstruct_brep_4.Faces, Index=Slider(1, range=0..20), Wrap=True)
evaluate_surface_3 = EvaluateSurface(Surface=reparameterize(list_item_3), Point=construct_point_3)  # -> Point, Normal, UDirection, VDirection, Frame
evaluate_surface_4 = EvaluateSurface(Surface=reparameterize(list_item_4), Point=construct_point_4)  # -> Point, Normal, UDirection, VDirection, Frame
orient_2 = Orient(Geometry=cap_holes_ex_2.Brep, Source=evaluate_surface_4.Point, Target=evaluate_surface_3.Point)  # -> Geometry, Transform
solid_difference = SolidDifference(BrepsA=solid_union, BrepsB=orient_2.Geometry)

deconstruct_brep_5 = DeconstructBrep(Brep=[solid_difference, orient_2.Geometry])  # -> Faces, Edges, Vertices
custom_preview_lineweights = CustomPreviewLineweights(
    Geometry=deconstruct_brep_5.Edges,
    Shader=ColourSwatch(SwatchColor=RGB(0, 0, 0)),
    Thickness=Slider(5, range=0..5),
    Absolute=False)
custom_preview = CustomPreview(Geometry=solid_difference, Material=ColourSwatch(SwatchColor=RGBA(255, 112, 112, 200)))
custom_preview_2 = CustomPreview(Geometry=orient_2.Geometry, Material=ColourSwatch(SwatchColor=RGBA(112, 193, 255, 200)))
custom_preview_3 = CustomPreview(Material=ColourSwatch(SwatchColor=RGBA(136, 255, 112, 200)))
custom_preview_4 = CustomPreview(Material=ColourSwatch(SwatchColor=RGBA(200, 112, 255, 200)))
custom_preview_5 = CustomPreview(Material=ColourSwatch(SwatchColor=RGBA(255, 255, 112, 200)))
custom_preview_6 = CustomPreview(Material=ColourSwatch(SwatchColor=RGB(135, 68, 42)))
