# Grasshopper definition Base Tenon (Ver. 2).gh (Grasshopper 1.0.7)
# plug-ins: Human

W = Slider(20, range=20..25)
# 管腳榫
# Base Tenon (Ver. 2)
number_slider = Slider(60, range=0..100)
number_slider_2 = Slider(50, range=0..100)
construct_point = ConstructPoint(XCoordinate=0, YCoordinate=0, ZCoordinate=0)
construct_point_2 = ConstructPoint(XCoordinate=0, YCoordinate=W, ZCoordinate=0)
construct_point_3 = ConstructPoint(XCoordinate=W, YCoordinate=W, ZCoordinate=0)
construct_point_4 = ConstructPoint(XCoordinate=W, YCoordinate=0, ZCoordinate=0)
unit_z = UnitZ(Factor=Slider(12, range=8..12))
circle = Circle(Plane=PlaneXY(0, 0, 0), Radius=number_slider_2)
center_box = CenterBox(Base=PlaneXY(0, 0, 0), X=number_slider, Y=number_slider, Z=Slider(10, range=0..10))
subtraction = Subtraction(A=number_slider_2, B=Slider(10, range=0..100))
_4point_surface = _4PointSurface(CornerA=construct_point, CornerB=construct_point_2, CornerC=construct_point_3, CornerD=construct_point_4)
circle_2 = Circle(Plane=PlaneXY(0, 0, 0), Radius=subtraction)
area = Area(Geometry=_4point_surface)  # -> Area, Centroid
scale = Scale(Geometry=_4point_surface, Center=area.Centroid, Factor=Slider(1.5, range=0..10))  # -> Geometry, Transform
L = Slider(200, range=0..1000)
move = Move(Geometry=circle_2, Motion=unit_z)  # -> Geometry, Transform
move_2 = Move(Geometry=scale.Geometry, Motion=unit_z)  # -> Geometry, Transform
cylinder = Cylinder(Base=PlaneXY(0, 0, 0), Radius=subtraction, Length=L)
loft = Loft(
    Curves=[circle, move.Geometry],
    Options={Adjust=False, Closed=False, LoftEnds=0, LoftSimp=0, LoftType=0, Rebuild=10, Refit=0.01})
loft_2 = Loft(
    Curves=[_4point_surface, move_2.Geometry],
    Options={Adjust=False, Closed=False, LoftEnds=0, LoftSimp=0, LoftType=0, Rebuild=10, Refit=0.01})
cap_holes_ex = CapHolesEx(Brep=loft)  # -> Brep, Caps, Solid
cap_holes_ex_2 = CapHolesEx(Brep=cylinder)  # -> Brep, Caps, Solid
cap_holes_ex_3 = CapHolesEx(Brep=loft_2)  # -> Brep, Caps, Solid
deconstruct_brep = DeconstructBrep(Brep=center_box)  # -> Faces, Edges, Vertices
deconstruct_brep_2 = DeconstructBrep(Brep=cap_holes_ex.Brep)  # -> Faces, Edges, Vertices
deconstruct_brep_3 = DeconstructBrep(Brep=cap_holes_ex_2.Brep)  # -> Faces, Edges, Vertices
deconstruct_brep_4 = DeconstructBrep(Brep=cap_holes_ex_3.Brep)  # -> Faces, Edges, Vertices
construct_point_5 = ConstructPoint(XCoordinate="0.5", YCoordinate="0.5", ZCoordinate=0)
construct_point_6 = ConstructPoint(XCoordinate="0.5", YCoordinate="0.5", ZCoordinate=0)
construct_point_7 = ConstructPoint(XCoordinate="0.5", YCoordinate="0.5", ZCoordinate=0)
construct_point_8 = ConstructPoint(XCoordinate="0.5", YCoordinate="0.5", ZCoordinate=0)
list_item = ListItem(List=deconstruct_brep.Faces, Index=Slider(5, range=0..10), Wrap=True)
list_item_2 = ListItem(List=deconstruct_brep_2.Faces, Index=Slider(5, range=0..20), Wrap=True)
list_item_3 = ListItem(List=deconstruct_brep_3.Faces, Index=Slider(1, range=0..10), Wrap=True)
list_item_4 = ListItem(List=deconstruct_brep_4.Faces, Index=Slider(4, range=0..20), Wrap=True)
evaluate_surface = EvaluateSurface(Surface=reparameterize(list_item), Point=construct_point_5)  # -> Point, Normal, UDirection, VDirection, Frame
evaluate_surface_2 = EvaluateSurface(Surface=reparameterize(list_item_2), Point=construct_point_6)  # -> Point, Normal, UDirection, VDirection, Frame
evaluate_surface_3 = EvaluateSurface(Surface=reparameterize(list_item_3), Point=construct_point_7)  # -> Point, Normal, UDirection, VDirection, Frame
evaluate_surface_4 = EvaluateSurface(Surface=reparameterize(list_item_4), Point=construct_point_8)  # -> Point, Normal, UDirection, VDirection, Frame
orient = Orient(Geometry=cap_holes_ex.Brep, Source=evaluate_surface_2.Point, Target=evaluate_surface.Point)  # -> Geometry, Transform
orient_2 = Orient(Geometry=cap_holes_ex_3.Brep, Source=evaluate_surface_4.Point, Target=evaluate_surface_3.Point)  # -> Geometry, Transform
solid_union = SolidUnion(Breps=flatten([center_box, orient.Geometry]))
solid_union_2 = SolidUnion(Breps=flatten([cap_holes_ex_2.Brep, orient_2.Geometry]))
deconstruct_brep_5 = DeconstructBrep(Brep=solid_union)  # -> Faces, Edges, Vertices
deconstruct_brep_6 = DeconstructBrep(Brep=solid_union_2)  # -> Faces, Edges, Vertices
construct_point_9 = ConstructPoint(XCoordinate="0.5", YCoordinate="0.5", ZCoordinate=0)
construct_point_10 = ConstructPoint(XCoordinate="0.5", YCoordinate="0.5", ZCoordinate=0)
list_item_5 = ListItem(List=deconstruct_brep_5.Faces, Index=Slider(1, range=0..10), Wrap=True)
list_item_6 = ListItem(List=deconstruct_brep_6.Faces, Index=Slider(6, range=0..20), Wrap=True)
evaluate_surface_5 = EvaluateSurface(Surface=reparameterize(list_item_5), Point=construct_point_9)  # -> Point, Normal, UDirection, VDirection, Frame
evaluate_surface_6 = EvaluateSurface(Surface=reparameterize(list_item_6), Point=construct_point_10)  # -> Point, Normal, UDirection, VDirection, Frame
orient_3 = Orient(Geometry=solid_union_2, Source=evaluate_surface_6.Point, Target=evaluate_surface_5.Point)  # -> Geometry, Transform
solid_difference = SolidDifference(BrepsA=solid_union, BrepsB=orient_3.Geometry)

deconstruct_brep_7 = DeconstructBrep(Brep=[solid_difference, orient_3.Geometry])  # -> Faces, Edges, Vertices
custom_preview_lineweights = CustomPreviewLineweights(
    Geometry=deconstruct_brep_7.Edges,
    Shader=ColourSwatch(SwatchColor=RGB(0, 0, 0)),
    Thickness=Slider(5, range=0..5),
    Absolute=False)
custom_preview = CustomPreview(Geometry=solid_difference, Material=ColourSwatch(SwatchColor=RGBA(255, 112, 112, 200)))
custom_preview_2 = CustomPreview(Geometry=orient_3.Geometry, Material=ColourSwatch(SwatchColor=RGBA(112, 193, 255, 200)))
custom_preview_3 = CustomPreview(Material=ColourSwatch(SwatchColor=RGBA(136, 255, 112, 200)))
custom_preview_4 = CustomPreview(Material=ColourSwatch(SwatchColor=RGBA(200, 112, 255, 200)))
custom_preview_5 = CustomPreview(Material=ColourSwatch(SwatchColor=RGBA(255, 255, 112, 200)))
custom_preview_6 = CustomPreview(Material=ColourSwatch(SwatchColor=RGB(135, 68, 42)))
