# Grasshopper definition CN - Base Tenon (Ver. 3).gh (Grasshopper 1.0.7)
# plug-ins: Pufferfish, Human

subtraction = Subtraction(A=Slider(50, range=0..100), B=Slider(10, range=0..100))
W = Slider(20, range=20..25)
# 套顶榫
# Base Tenon (Ver. 3)
number_slider = Slider(60, range=0..100)
multiplication = Multiplication(A=subtraction, B=Slider(2, range=0..10))
construct_point = ConstructPoint(XCoordinate=0, YCoordinate=0, ZCoordinate=0)
construct_point_2 = ConstructPoint(XCoordinate=0, YCoordinate=multiplication, ZCoordinate=0)
construct_point_3 = ConstructPoint(XCoordinate=multiplication, YCoordinate=multiplication, ZCoordinate=0)
construct_point_4 = ConstructPoint(XCoordinate=multiplication, YCoordinate=0, ZCoordinate=0)
construct_point_5 = ConstructPoint(XCoordinate=0, YCoordinate=0, ZCoordinate=0)
construct_point_6 = ConstructPoint(XCoordinate=0, YCoordinate=W, ZCoordinate=0)
construct_point_7 = ConstructPoint(XCoordinate=W, YCoordinate=W, ZCoordinate=0)
construct_point_8 = ConstructPoint(XCoordinate=W, YCoordinate=0, ZCoordinate=0)
center_box = CenterBox(Base=PlaneXY(0, 0, 0), X=number_slider, Y=number_slider, Z=Slider(10, range=0..10))
center_box_2 = CenterBox(Base=PlaneXY(0, 0, 0), X=subtraction, Y=subtraction, Z=Slider(100, range=0..200))
_4point_surface = _4PointSurface(CornerA=construct_point, CornerB=construct_point_2, CornerC=construct_point_3, CornerD=construct_point_4)
_4point_surface_2 = _4PointSurface(CornerA=construct_point_5, CornerB=construct_point_6, CornerC=construct_point_7, CornerD=construct_point_8)
deconstruct_brep = DeconstructBrep(Brep=center_box)  # -> Faces, Edges, Vertices
list_item = ListItem(List=deconstruct_brep.Faces, Index=Slider(5, range=0..10), Wrap=True)
area = Area(Geometry=list_item)  # -> Area, Centroid
area_2 = Area(Geometry=_4point_surface)  # -> Area, Centroid
area_3 = Area(Geometry=_4point_surface_2)  # -> Area, Centroid
move_to_point = MoveToPoint(Geometry=_4point_surface, PointA=area_2.Centroid, PointB=area.Centroid)  # -> Moved, Vector, Transform
scale = Scale(Geometry=_4point_surface_2, Center=area_3.Centroid, Factor=Slider(1.5, range=0..10))  # -> Geometry, Transform
unit_z = UnitZ(Factor=Slider(12, range=8..12))
unit_z_2 = UnitZ(Factor=Slider(150, range=8..500))
move = Move(Geometry=move_to_point.Moved, Motion=unit_z)  # -> Geometry, Transform
scale_2 = Scale(Geometry=move_to_point.Moved, Center=area.Centroid, Factor=Slider(1.1, range=0..10))  # -> Geometry, Transform
move_2 = Move(Geometry=scale.Geometry, Motion=unit_z_2)  # -> Geometry, Transform
loft = Loft(
    Curves=[scale_2.Geometry, move.Geometry],
    Options={Adjust=False, Closed=False, LoftEnds=0, LoftSimp=0, LoftType=0, Rebuild=10, Refit=0.01})
loft_2 = Loft(
    Curves=[_4point_surface_2, move_2.Geometry],
    Options={Adjust=False, Closed=False, LoftEnds=0, LoftSimp=0, LoftType=0, Rebuild=10, Refit=0.01})
cap_holes_ex = CapHolesEx(Brep=loft)  # -> Brep, Caps, Solid
cap_holes_ex_2 = CapHolesEx(Brep=loft_2)  # -> Brep, Caps, Solid
deconstruct_brep_2 = DeconstructBrep(Brep=center_box)  # -> Faces, Edges, Vertices
deconstruct_brep_3 = DeconstructBrep(Brep=cap_holes_ex.Brep)  # -> Faces, Edges, Vertices
deconstruct_brep_4 = DeconstructBrep(Brep=center_box_2)  # -> Faces, Edges, Vertices
deconstruct_brep_5 = DeconstructBrep(Brep=cap_holes_ex_2.Brep)  # -> Faces, Edges, Vertices
construct_point_9 = ConstructPoint(XCoordinate="0.5", YCoordinate="0.5", ZCoordinate=0)
construct_point_10 = ConstructPoint(XCoordinate="0.5", YCoordinate="0.5", ZCoordinate=0)
construct_point_11 = ConstructPoint(XCoordinate="0.5", YCoordinate="0.5", ZCoordinate=0)
construct_point_12 = ConstructPoint(XCoordinate="0.5", YCoordinate="0.5", ZCoordinate=0)
list_item_2 = ListItem(List=deconstruct_brep_2.Faces, Index=Slider(5, range=0..10), Wrap=True)
list_item_3 = ListItem(List=deconstruct_brep_3.Faces, Index=Slider(5, range=0..20), Wrap=True)
list_item_4 = ListItem(List=deconstruct_brep_4.Faces, Index=Slider(4, range=0..10), Wrap=True)
list_item_5 = ListItem(List=deconstruct_brep_5.Faces, Index=Slider(4, range=0..20), Wrap=True)
evaluate_surface = EvaluateSurface(Surface=reparameterize(list_item_2), Point=construct_point_9)  # -> Point, Normal, UDirection, VDirection, Frame
evaluate_surface_2 = EvaluateSurface(Surface=reparameterize(list_item_3), Point=construct_point_10)  # -> Point, Normal, UDirection, VDirection, Frame
evaluate_surface_3 = EvaluateSurface(Surface=reparameterize(list_item_4), Point=construct_point_11)  # -> Point, Normal, UDirection, VDirection, Frame
evaluate_surface_4 = EvaluateSurface(Surface=reparameterize(list_item_5), Point=construct_point_12)  # -> Point, Normal, UDirection, VDirection, Frame
orient = Orient(Geometry=cap_holes_ex.Brep, Source=evaluate_surface_2.Point, Target=evaluate_surface.Point)  # -> Geometry, Transform
orient_2 = Orient(Geometry=cap_holes_ex_2.Brep, Source=evaluate_surface_4.Point, Target=evaluate_surface_3.Point)  # -> Geometry, Transform
solid_union = SolidUnion(Breps=flatten([center_box, orient.Geometry]))
solid_union_2 = SolidUnion(Breps=flatten([center_box_2, orient_2.Geometry]))
deconstruct_brep_6 = DeconstructBrep(Brep=solid_union)  # -> Faces, Edges, Vertices
deconstruct_brep_7 = DeconstructBrep(Brep=solid_union_2)  # -> Faces, Edges, Vertices
construct_point_13 = ConstructPoint(XCoordinate="0.5", YCoordinate="0.5", ZCoordinate=0)
construct_point_14 = ConstructPoint(XCoordinate="0.5", YCoordinate="0.5", ZCoordinate=0)
list_item_6 = ListItem(List=deconstruct_brep_6.Faces, Index=Slider(4, range=0..10), Wrap=True)
list_item_7 = ListItem(List=deconstruct_brep_7.Faces, Index=Slider(9, range=0..20), Wrap=True)
number_slider_2 = Slider(10, range=0..10)
evaluate_surface_5 = EvaluateSurface(Surface=reparameterize(list_item_6), Point=construct_point_13)  # -> Point, Normal, UDirection, VDirection, Frame
evaluate_surface_6 = EvaluateSurface(Surface=reparameterize(list_item_7), Point=construct_point_14)  # -> Point, Normal, UDirection, VDirection, Frame
orient_3 = Orient(Geometry=solid_union_2, Source=evaluate_surface_6.Point, Target=evaluate_surface_5.Point)  # -> Geometry, Transform
center_box_3 = CenterBox(Base=PlaneXY(0, 0, 0), X=number_slider_2, Y=number_slider_2, Z=Slider(200, range=0..1000))
solid_difference = SolidDifference(BrepsA=solid_union, BrepsB=orient_3.Geometry)
deconstruct_brep_8 = DeconstructBrep(Brep=center_box_3)  # -> Faces, Edges, Vertices
deconstruct_brep_9 = DeconstructBrep(Brep=orient_3.Geometry)  # -> Faces, Edges, Vertices
panel = Panel("""0
1
2
3""")
panel_2 = Panel("""8
9
10
11""")
list_item_8 = ListItem(List=deconstruct_brep_8.Vertices, Index=panel, Wrap=True)
list_item_9 = ListItem(List=deconstruct_brep_9.Vertices, Index=panel_2, Wrap=True)
explode_tree = ExplodeTree(Data=simplify(graft(list_item_9)))  # -> Branch0, Branch1, Branch2, Branch3
explode_tree_2 = ExplodeTree(Data=simplify(graft(list_item_8)))  # -> Branch0, Branch1, Branch2, Branch3
move_to_point_2 = MoveToPoint(Geometry=center_box_3, PointA=explode_tree_2.Branch0, PointB=explode_tree.Branch0)  # -> Moved, Vector, Transform
move_to_point_3 = MoveToPoint(Geometry=center_box_3, PointA=explode_tree_2.Branch1, PointB=explode_tree.Branch1)  # -> Moved, Vector, Transform
move_to_point_4 = MoveToPoint(Geometry=center_box_3, PointA=explode_tree_2.Branch2, PointB=explode_tree.Branch2)  # -> Moved, Vector, Transform
move_to_point_5 = MoveToPoint(Geometry=center_box_3, PointA=explode_tree_2.Branch3, PointB=explode_tree.Branch3)  # -> Moved, Vector, Transform
solid_difference_2 = SolidDifference(
    BrepsA=orient_3.Geometry,
    BrepsB=flatten([move_to_point_2.Moved, move_to_point_3.Moved, move_to_point_4.Moved, move_to_point_5.Moved]))

deconstruct_brep_10 = DeconstructBrep(Brep=[solid_difference, solid_difference_2])  # -> Faces, Edges, Vertices
custom_preview_lineweights = CustomPreviewLineweights(
    Geometry=deconstruct_brep_10.Edges,
    Shader=ColourSwatch(SwatchColor=RGB(0, 0, 0)),
    Thickness=Slider(5, range=0..5),
    Absolute=False)
custom_preview = CustomPreview(Geometry=solid_difference, Material=ColourSwatch(SwatchColor=RGBA(255, 112, 112, 200)))
custom_preview_2 = CustomPreview(Geometry=solid_difference_2, Material=ColourSwatch(SwatchColor=RGBA(112, 193, 255, 200)))
custom_preview_3 = CustomPreview(Material=ColourSwatch(SwatchColor=RGBA(136, 255, 112, 200)))
custom_preview_4 = CustomPreview(Material=ColourSwatch(SwatchColor=RGBA(200, 112, 255, 200)))
custom_preview_5 = CustomPreview(Material=ColourSwatch(SwatchColor=RGBA(255, 255, 112, 200)))
custom_preview_6 = CustomPreview(Material=ColourSwatch(SwatchColor=RGB(135, 68, 42)))
