# Grasshopper definition 勾頭搭掌榫.gh (Grasshopper 1.0.7)
# plug-ins: Pufferfish, Human

number_slider = Slider(30, range=0..100)
# 勾頭搭掌榫
number_slider_2 = Slider(150, range=0..400)
center_box = CenterBox(Base=PlaneXY(0, 0, 0), X=number_slider_2, Y=number_slider, Z=number_slider)
deconstruct_brep = DeconstructBrep(Brep=center_box)  # -> Faces, Edges, Vertices
number_slider_3 = Slider(3, range=0..10)
list_item = ListItem(List=deconstruct_brep.Edges, Index=Slider(9, range=0..10), Wrap=True)
divide_curve = DivideCurve(Curve=list_item, Count=number_slider_3, Kinks=False)  # -> Points, Tangents, Parameters
list_item_2 = ListItem(List=divide_curve.Points, Index=number_slider_3, Wrap=True)
list_item_3 = ListItem(List=divide_curve.Points, Index=Slider(1, range=0..10), Wrap=True)
xz_plane = XZPlane(Origin=list_item_2)
rotate = Rotate(Geometry=divide_curve.Points, Angle=expr("-x", degrees(Slider(90, range=0..100))), Plane=xz_plane)  # -> Geometry, Transform
list_item_4 = ListItem(List=rotate.Geometry, Index=Slider(1, range=0..10), Wrap=True)
move_to_point = MoveToPoint(Geometry=divide_curve.Points, PointA=list_item_2, PointB=list_item_4)  # -> Moved, Vector, Transform
multiplication = Multiplication(A=number_slider, B=Slider(2, range=0..10))
list_item_5 = ListItem(List=move_to_point.Moved, Index=Slider(2, range=0..10), Wrap=True)
list_item_6 = ListItem(List=move_to_point.Moved, Index=Slider(1, range=0..10), Wrap=True)
unit_y = UnitY(Factor=multiplication)
line = Line(StartPoint=list_item_3, EndPoint=list_item_5)
move = Move(Geometry=line, Motion=unit_y)  # -> Geometry, Transform
unit_z = UnitZ(Factor=Slider(100, range=0..100))
edge_surface = EdgeSurface(CurveA=line, CurveB=move.Geometry)
extrude = Extrude(Base=edge_surface, Direction=unit_z)
deconstruct_brep_2 = DeconstructBrep(Brep=extrude)  # -> Faces, Edges, Vertices
list_item_7 = ListItem(List=deconstruct_brep_2.Vertices, Index=0, Wrap=True)
move_to_point_2 = MoveToPoint(Geometry=extrude, PointA=list_item_7, PointB=list_item_6)  # -> Moved, Vector, Transform
solid_difference = SolidDifference(BrepsA=center_box, BrepsB=flatten([extrude, move_to_point_2.Moved]))
deconstruct_brep_3 = DeconstructBrep(Brep=solid_difference)  # -> Faces, Edges, Vertices
list_item_8 = ListItem(List=deconstruct_brep_3.Faces, Index=Slider(9, range=0..10), Wrap=True)
area = Area(Geometry=list_item_8)  # -> Area, Centroid
yz_plane = YZPlane(Origin=area.Centroid)
mirror = Mirror(Geometry=solid_difference, Plane=yz_plane)  # -> Geometry, Transform
number_slider_4 = Slider(5, range=0..100)
rotate_2 = Rotate(Geometry=mirror.Geometry, Angle=degrees(Slider(180, range=0..1000)), Plane=yz_plane)  # -> Geometry, Transform
center_box_2 = CenterBox(Base=area.Centroid, X=number_slider_4, Y=number_slider_4, Z=Slider(40, range=0..100))
solid_difference_2 = SolidDifference(BrepsA=solid_difference, BrepsB=center_box_2)
solid_difference_3 = SolidDifference(BrepsA=rotate_2.Geometry, BrepsB=center_box_2)

deconstruct_brep_4 = DeconstructBrep(Brep=[solid_difference_2, solid_difference_3, center_box_2])  # -> Faces, Edges, Vertices
custom_preview_lineweights = CustomPreviewLineweights(
    Geometry=deconstruct_brep_4.Edges,
    Shader=ColourSwatch(SwatchColor=RGB(0, 0, 0)),
    Thickness=Slider(5, range=0..5),
    Absolute=False)
custom_preview = CustomPreview(Geometry=solid_difference_2, Material=ColourSwatch(SwatchColor=RGBA(255, 112, 112, 200)))
custom_preview_2 = CustomPreview(Geometry=solid_difference_3, Material=ColourSwatch(SwatchColor=RGBA(112, 193, 255, 200)))
custom_preview_3 = CustomPreview(Geometry=center_box_2, Material=ColourSwatch(SwatchColor=RGBA(136, 255, 112, 200)))
custom_preview_4 = CustomPreview(Material=ColourSwatch(SwatchColor=RGBA(200, 112, 255, 200)))
custom_preview_5 = CustomPreview(Material=ColourSwatch(SwatchColor=RGBA(255, 255, 112, 200)))
custom_preview_6 = CustomPreview(Material=ColourSwatch(SwatchColor=RGB(135, 68, 42)))
