# Grasshopper definition 十字刻半榫.gh (Grasshopper 1.0.7)
# plug-ins: Human

# 十字刻半榫
number_slider = Slider(100, range=0..100)
center_box = CenterBox(Base=PlaneXY(0, 0, 0), X=number_slider, Y=Slider(25, range=0..100), Z=Slider(15, range=0..100))
deconstruct_brep = DeconstructBrep(Brep=center_box)  # -> Faces, Edges, Vertices
panel = Panel("""1
2""")

# ----
# Angle
angle = Slider(45, range=15..45)

list_item = ListItem(List=deconstruct_brep.Vertices, Index=panel, Wrap=True)
unit_x = UnitX(Factor=1)
unit_z = UnitZ(Factor=1)
explode_tree = ExplodeTree(Data=graft(list_item))  # -> Branch0, Branch1
number_slider_2 = Slider(10, range=0..100)
rotate = Rotate(Vector=unit_x, Axis=unit_z, Angle=expr("-x", degrees(angle)))
rotate_2 = Rotate(Vector=unit_x, Axis=unit_z, Angle=degrees(angle))
line_sdl = LineSDL(Start=explode_tree.Branch0, Direction=rotate_2, Length=number_slider_2)
line_sdl_2 = LineSDL(Start=explode_tree.Branch1, Direction=rotate, Length=number_slider_2)
unit_z_2 = UnitZ(Factor=Slider(30, range=0..100))
edge_surface = EdgeSurface(CurveA=line_sdl, CurveB=line_sdl_2)
extrude = Extrude(Base=edge_surface, Direction=unit_z_2)
deconstruct_brep_2 = DeconstructBrep(Brep=extrude)  # -> Faces, Edges, Vertices
unit_x_2 = UnitX(Factor=Slider(36, range=0..100))
list_item_2 = ListItem(List=deconstruct_brep_2.Faces, Index=Slider(3, range=0..10), Wrap=True)
extrude_2 = Extrude(Base=list_item_2, Direction=unit_x_2)
deconstruct_brep_3 = DeconstructBrep(Brep=extrude_2)  # -> Faces, Edges, Vertices
panel_2 = Panel("""4
5""")
unit_z_3 = UnitZ(Factor=Slider(15, range=0..100))
list_item_3 = ListItem(List=deconstruct_brep_3.Faces, Index=Slider(1, range=0..10), Wrap=True)
list_item_4 = ListItem(List=deconstruct_brep_3.Vertices, Index=panel_2, Wrap=True)
extrude_3 = Extrude(Base=list_item_3, Direction=unit_z_3)
unit_x_3 = UnitX(Factor=1)
unit_z_4 = UnitZ(Factor=1)
explode_tree_2 = ExplodeTree(Data=simplify(graft(list_item_4)))  # -> Branch0, Branch1
rotate_3 = Rotate(Vector=unit_x_3, Axis=unit_z_4, Angle=expr("-x", degrees(angle)))
rotate_4 = Rotate(Vector=unit_x_3, Axis=unit_z_4, Angle=degrees(angle))
line_sdl_3 = LineSDL(Start=explode_tree_2.Branch0, Direction=rotate_4, Length=number_slider_2)
line_sdl_4 = LineSDL(Start=explode_tree_2.Branch1, Direction=rotate_3, Length=number_slider_2)
edge_surface_2 = EdgeSurface(CurveA=line_sdl_3, CurveB=line_sdl_4)
extrude_4 = Extrude(Base=edge_surface_2, Direction=unit_z_2)
deconstruct_brep_4 = DeconstructBrep(Brep=extrude_4)  # -> Faces, Edges, Vertices
unit_x_4 = UnitX(Factor=Slider(53, range=0..100))
list_item_5 = ListItem(List=deconstruct_brep_4.Faces, Index=Slider(7, range=0..10), Wrap=True)
extrude_5 = Extrude(Base=list_item_5, Direction=unit_x_4)
solid_union = SolidUnion(Breps=flatten([center_box, extrude, extrude_2, extrude_4, extrude_5]))
area = Area(Geometry=extrude_2)  # -> Area, Centroid
solid_difference = SolidDifference(BrepsA=solid_union, BrepsB=extrude_3)
rotate_5 = Rotate(Geometry=solid_difference, Angle=1.570796327, Plane=area.Centroid)  # -> Geometry, Transform
mirror = Mirror(Geometry=rotate_5.Geometry, Plane=area.Centroid)  # -> Geometry, Transform

deconstruct_brep_5 = DeconstructBrep(Brep=[solid_difference, mirror.Geometry])  # -> Faces, Edges, Vertices
custom_preview_lineweights = CustomPreviewLineweights(
    Geometry=deconstruct_brep_5.Edges,
    Shader=ColourSwatch(SwatchColor=RGB(0, 0, 0)),
    Thickness=Slider(5, range=0..5),
    Absolute=False)
custom_preview = CustomPreview(Geometry=solid_difference, Material=ColourSwatch(SwatchColor=RGBA(255, 112, 112, 200)))
custom_preview_2 = CustomPreview(Geometry=mirror.Geometry, Material=ColourSwatch(SwatchColor=RGBA(112, 193, 255, 200)))
custom_preview_3 = CustomPreview(Material=ColourSwatch(SwatchColor=RGBA(136, 255, 112, 200)))
custom_preview_4 = CustomPreview(Material=ColourSwatch(SwatchColor=RGBA(200, 112, 255, 200)))
custom_preview_5 = CustomPreview(Material=ColourSwatch(SwatchColor=RGBA(255, 255, 112, 200)))
custom_preview_6 = CustomPreview(Material=ColourSwatch(SwatchColor=RGB(135, 68, 42)))
