# Grasshopper definition 十字卡腰榫.gh (Grasshopper 1.0.7)
# plug-ins: Pufferfish, Human

# ----
# Angle
angle = Slider(45, range=15..45)

# ----
# 十字卡腰榫
construct_point = ConstructPoint(XCoordinate=0, YCoordinate=0, ZCoordinate=0)
construct_point_2 = ConstructPoint(XCoordinate=0, YCoordinate=Slider(50, range=0..100), ZCoordinate=0)
number_slider = Slider(25, range=0..100)
unit_x = UnitX(Factor=1)
unit_z = UnitZ(Factor=1)
number_slider_2 = Slider(18, range=0..100)
rotate = Rotate(Vector=unit_x, Axis=unit_z, Angle=expr("-x", degrees(angle)))
rotate_2 = Rotate(Vector=unit_x, Axis=unit_z, Angle=degrees(angle))
cylinder = Cylinder(Base=PlaneXY(0, 0, 0), Radius=number_slider, Length=Slider(300, range=0..1000))
xz_plane = XZPlane(Origin=Point(0, 0, 0))
rotate_3 = Rotate(Geometry=cylinder, Angle=degrees(Slider(90, range=0..1000)), Plane=xz_plane)  # -> Geometry, Transform
line_sdl = LineSDL(Start=construct_point, Direction=rotate_2, Length=number_slider_2)
line_sdl_2 = LineSDL(Start=construct_point_2, Direction=rotate, Length=number_slider_2)
multiplication = Multiplication(A=number_slider, B=Slider(2, range=0..10))
unit_z_2 = UnitZ(Factor=multiplication)
edge_surface = EdgeSurface(CurveA=line_sdl, CurveB=line_sdl_2)
cap_holes_ex = CapHolesEx(Brep=rotate_3.Geometry)  # -> Brep, Caps, Solid
extrude = Extrude(Base=edge_surface, Direction=unit_z_2)
deconstruct_brep = DeconstructBrep(Brep=cap_holes_ex.Brep)  # -> Faces, Edges, Vertices
deconstruct_brep_2 = DeconstructBrep(Brep=extrude)  # -> Faces, Edges, Vertices
list_item = ListItem(List=deconstruct_brep.Edges, Index="1", Wrap=True)
divide_length = DivideLength(Curve=list_item, Length=Slider(10, range=0..10))  # -> Points, Tangents, Parameters
unit_x_2 = UnitX(Factor=Slider(25, range=0..100))
list_item_2 = ListItem(List=deconstruct_brep_2.Faces, Index=Slider(3, range=0..10), Wrap=True)
list_item_3 = ListItem(List=divide_length.Points, Index="7", Wrap=True)
extrude_2 = Extrude(Base=list_item_2, Direction=unit_x_2)
deconstruct_brep_3 = DeconstructBrep(Brep=extrude_2)  # -> Faces, Edges, Vertices
panel = Panel("""4
5""")
division = Division(A=multiplication, B=Slider(2, range=0..100))
list_item_4 = ListItem(List=deconstruct_brep_3.Faces, Index=Slider(1, range=0..10), Wrap=True)
list_item_5 = ListItem(List=deconstruct_brep_3.Vertices, Index=panel, Wrap=True)
unit_z_3 = UnitZ(Factor=division)
unit_x_3 = UnitX(Factor=1)
unit_z_4 = UnitZ(Factor=1)
explode_tree = ExplodeTree(Data=simplify(graft(list_item_5)))  # -> Branch0, Branch1
rotate_4 = Rotate(Vector=unit_x_3, Axis=unit_z_4, Angle=expr("-x", degrees(angle)))
extrude_3 = Extrude(Base=list_item_4, Direction=unit_z_3)
rotate_5 = Rotate(Vector=unit_x_3, Axis=unit_z_4, Angle=degrees(angle))
line_sdl_3 = LineSDL(Start=explode_tree.Branch0, Direction=rotate_5, Length=number_slider_2)
line_sdl_4 = LineSDL(Start=explode_tree.Branch1, Direction=rotate_4, Length=number_slider_2)
edge_surface_2 = EdgeSurface(CurveA=line_sdl_3, CurveB=line_sdl_4)
extrude_4 = Extrude(Base=edge_surface_2, Direction=unit_z_2)
solid_union = SolidUnion(Breps=flatten([extrude, extrude_2, extrude_4]))
solid_difference = SolidDifference(BrepsA=solid_union, BrepsB=extrude_3)
rotate_6 = Rotate(Geometry=solid_difference, Angle=1.570796327, Plane=PlaneXY(0, 0, 0))  # -> Geometry, Transform
deconstruct_brep_4 = DeconstructBrep(Brep=rotate_6.Geometry)  # -> Faces, Edges, Vertices
list_item_6 = ListItem(List=deconstruct_brep_4.Faces, Index=Slider(5, range=0..10), Wrap=True)
area = Area(Geometry=list_item_6)  # -> Area, Centroid
move_to_point = MoveToPoint(Geometry=rotate_6.Geometry, PointA=area.Centroid, PointB=list_item_3)  # -> Moved, Vector, Transform
solid_difference_2 = SolidDifference(BrepsA=cap_holes_ex.Brep, BrepsB=move_to_point.Moved)
deconstruct_brep_5 = DeconstructBrep(Brep=solid_difference_2)  # -> Faces, Edges, Vertices
list_item_7 = ListItem(List=deconstruct_brep_5.Faces, Index=Slider(9, range=0..10), Wrap=True)
area_2 = Area(Geometry=list_item_7)  # -> Area, Centroid
rotate_7 = Rotate(Geometry=solid_difference_2, Angle=1.570796327, Plane=area_2.Centroid)  # -> Geometry, Transform
mirror = Mirror(Geometry=rotate_7.Geometry, Plane=area_2.Centroid)  # -> Geometry, Transform

deconstruct_brep_6 = DeconstructBrep(Brep=[solid_difference_2, mirror.Geometry])  # -> Faces, Edges, Vertices
custom_preview_lineweights = CustomPreviewLineweights(
    Geometry=deconstruct_brep_6.Edges,
    Shader=ColourSwatch(SwatchColor=RGB(0, 0, 0)),
    Thickness=Slider(5, range=0..5),
    Absolute=False)
custom_preview = CustomPreview(Geometry=solid_difference_2, Material=ColourSwatch(SwatchColor=RGBA(255, 112, 112, 200)))
custom_preview_2 = CustomPreview(Geometry=mirror.Geometry, Material=ColourSwatch(SwatchColor=RGBA(112, 193, 255, 200)))
custom_preview_3 = CustomPreview(Material=ColourSwatch(SwatchColor=RGBA(136, 255, 112, 200)))
custom_preview_4 = CustomPreview(Material=ColourSwatch(SwatchColor=RGBA(200, 112, 255, 200)))
custom_preview_5 = CustomPreview(Material=ColourSwatch(SwatchColor=RGBA(255, 255, 112, 200)))
custom_preview_6 = CustomPreview(Material=ColourSwatch(SwatchColor=RGB(135, 68, 42)))
