# Grasshopper definition 半榫.gh (Grasshopper 1.0.7)
# plug-ins: Pufferfish, Human

number_slider = Slider(40, range=0..100)
L = Slider(200, range=0..1000)
number_slider_2 = Slider(2, range=0..10)
# 半榫
cylinder = Cylinder(Base=PlaneXY(0, 0, 0), Radius=number_slider, Length=L)
number_slider_3 = Slider(3, range=0..10)
multiplication = Multiplication(A=number_slider, B=number_slider_2)
division = Division(A=multiplication, B=number_slider_3)
division_2 = Division(A=division, B=number_slider_2)

number_slider_4 = Slider(15, range=0..100)
center_box = CenterBox(Base=PlaneXY(0, 0, 0), X=Slider(150, range=0..200), Y=Slider(10, range=0..100), Z=number_slider_4)
center_box_2 = CenterBox(Base=PlaneXY(0, 0, 0), X=Slider(40, range=0..100), Y=Slider(5, range=0..100), Z=number_slider_4)
center_box_3 = CenterBox(Base=PlaneXY(0, 0, 0), X=Slider(7, range=0..10), Y=Slider(3, range=0..10), Z=Slider(2, range=0..10))

cap_holes_ex = CapHolesEx(Brep=cylinder)  # -> Brep, Caps, Solid
deconstruct_brep = DeconstructBrep(Brep=cap_holes_ex.Brep)  # -> Faces, Edges, Vertices
deconstruct_brep_2 = DeconstructBrep(Brep=center_box)  # -> Faces, Edges, Vertices
construct_point = ConstructPoint(XCoordinate="0.5", YCoordinate="0.5", ZCoordinate=0)
construct_point_2 = ConstructPoint(XCoordinate="0.5", YCoordinate="0.5", ZCoordinate=0)
construct_point_3 = ConstructPoint(XCoordinate="0.5", YCoordinate="0.5", ZCoordinate=0)
list_item = ListItem(List=deconstruct_brep.Faces, Index=Slider(2, range=0..10), Wrap=True)
list_item_2 = ListItem(List=deconstruct_brep_2.Faces, Index=Slider(5, range=0..20), Wrap=True)
evaluate_surface = EvaluateSurface(Surface=reparameterize(list_item), Point=construct_point)  # -> Point, Normal, UDirection, VDirection, Frame
evaluate_surface_2 = EvaluateSurface(Surface=reparameterize(list_item_2), Point=construct_point_2)  # -> Point, Normal, UDirection, VDirection, Frame
orient = Orient(Geometry=center_box, Source=evaluate_surface_2.Point, Target=evaluate_surface.Point)  # -> Geometry, Transform
solid_difference = SolidDifference(BrepsA=orient.Geometry, BrepsB=cap_holes_ex.Brep)
explode_tree = ExplodeTree(Data=simplify(graft(solid_difference)))  # -> Branch0, Branch1
construct_point_4 = ConstructPoint(XCoordinate="1", YCoordinate="1", ZCoordinate=0)
construct_point_5 = ConstructPoint(XCoordinate="0.5", YCoordinate="1", ZCoordinate=0)
deconstruct_brep_3 = DeconstructBrep(Brep=explode_tree.Branch1)  # -> Faces, Edges, Vertices
deconstruct_brep_4 = DeconstructBrep(Brep=center_box_2)  # -> Faces, Edges, Vertices
deconstruct_brep_5 = DeconstructBrep(Brep=explode_tree.Branch0)  # -> Faces, Edges, Vertices
deconstruct_brep_6 = DeconstructBrep(Brep=center_box_3)  # -> Faces, Edges, Vertices
deconstruct_brep_7 = DeconstructBrep(Brep=explode_tree.Branch1)  # -> Faces, Edges, Vertices
construct_point_6 = ConstructPoint(XCoordinate=Slider(0.5, range=0..1), YCoordinate=Slider(0.925, range=0..1), ZCoordinate=0)
construct_point_7 = ConstructPoint(XCoordinate="0.5", YCoordinate="0.5", ZCoordinate=0)
construct_point_8 = ConstructPoint(XCoordinate=Slider(0.95, range=0..1), YCoordinate=Slider(0.5, range=0..1), ZCoordinate=0)
construct_point_9 = ConstructPoint(XCoordinate="0.5", YCoordinate="0.5", ZCoordinate=0)
construct_point_10 = ConstructPoint(XCoordinate=Slider(0.05, range=0..1), YCoordinate=Slider(0.5, range=0..1), ZCoordinate=0)
list_item_3 = ListItem(List=deconstruct_brep_3.Faces, Index=Slider(5, range=0..10), Wrap=True)
list_item_4 = ListItem(List=deconstruct_brep_4.Faces, Index=Slider(3, range=0..20), Wrap=True)
list_item_5 = ListItem(List=deconstruct_brep_5.Faces, Index=Slider(5, range=0..10), Wrap=True)
list_item_6 = ListItem(List=deconstruct_brep_6.Faces, Index=Slider(4, range=0..20), Wrap=True)
list_item_7 = ListItem(List=deconstruct_brep_7.Faces, Index=Slider(2, range=0..20), Wrap=True)
evaluate_surface_3 = EvaluateSurface(Surface=reparameterize(list_item_3), Point=construct_point_6)  # -> Point, Normal, UDirection, VDirection, Frame
evaluate_surface_4 = EvaluateSurface(Surface=reparameterize(list_item_4), Point=construct_point_7)  # -> Point, Normal, UDirection, VDirection, Frame
evaluate_surface_5 = EvaluateSurface(Surface=reparameterize(list_item_5), Point=construct_point_8)  # -> Point, Normal, UDirection, VDirection, Frame
evaluate_surface_6 = EvaluateSurface(Surface=reparameterize(list_item_6), Point=construct_point_9)  # -> Point, Normal, UDirection, VDirection, Frame
evaluate_surface_7 = EvaluateSurface(Surface=reparameterize(list_item_7), Point=construct_point_10)  # -> Point, Normal, UDirection, VDirection, Frame
construct_point_11 = ConstructPoint(XCoordinate="0.5", YCoordinate="1", ZCoordinate=0)
construct_point_12 = ConstructPoint(XCoordinate="0.5", YCoordinate="1", ZCoordinate=0)
orient_2 = Orient(Geometry=center_box_2, Source=evaluate_surface_4.Point, Target=evaluate_surface_3.Point)  # -> Geometry, Transform
orient_3 = Orient(Geometry=center_box_3, Source=evaluate_surface_6.Point, Target=evaluate_surface_5.Point)  # -> Geometry, Transform
orient_4 = Orient(Geometry=center_box_3, Source=evaluate_surface_6.Point, Target=evaluate_surface_7.Point)  # -> Geometry, Transform
solid_union = SolidUnion(Breps=flatten([solid_difference, orient_2.Geometry, orient_3.Geometry, orient_4.Geometry]))
deconstruct_brep_8 = DeconstructBrep(Brep=solid_union)  # -> Faces, Edges, Vertices
unit_z = UnitZ(Factor=Slider(20, range=0..100))
list_item_8 = ListItem(List=deconstruct_brep_8.Faces, Index=Slider(24, range=0..100), Wrap=True)
area = Area(Geometry=list_item_8)  # -> Area, Centroid
construct_point_13 = ConstructPoint(XCoordinate="0.5", YCoordinate="1", ZCoordinate=0)
construct_point_14 = ConstructPoint(XCoordinate="0.5", YCoordinate="0", ZCoordinate=0)
construct_point_15 = ConstructPoint(XCoordinate="0.5", YCoordinate="0.5", ZCoordinate=0)
center_box_4 = CenterBox(Base=PlaneXY(0, 0, 0), X=Slider(50, range=0..200), Y=Slider(5, range=0..100), Z=Slider(5, range=0..100))
deconstruct_brep_9 = DeconstructBrep(Brep=center_box_4)  # -> Faces, Edges, Vertices
list_item_9 = ListItem(List=deconstruct_brep_9.Faces, Index=Slider(5, range=0..10), Wrap=True)
area_2 = Area(Geometry=list_item_9)  # -> Area, Centroid

# ----
# Beam
number_slider_5 = Slider(200, range=0..200)
number_slider_6 = Slider(25, range=0..100)
number_slider_7 = Slider(40, range=0..100)
number_slider_8 = Slider(10, range=0..100)
center_box_5 = CenterBox(Base=PlaneXY(0, 0, 0), X=number_slider_5, Y=number_slider_6, Z=number_slider_7)

division_3 = Division(A=number_slider_6, B=number_slider_3)

center_box_6 = CenterBox(Base=PlaneXY(0, 0, 0), X=division_2, Y=division_3, Z=number_slider_7)
center_box_7 = CenterBox(Base=PlaneXY(0, 0, 0), X=division_2, Y=division_3, Z=Slider(20, range=0..100))

deconstruct_brep_10 = DeconstructBrep(Brep=center_box_5)  # -> Faces, Edges, Vertices
list_item_10 = ListItem(List=deconstruct_brep_10.Faces, Index=Slider(5, range=0..20), Wrap=True)
evaluate_surface_8 = EvaluateSurface(Surface=reparameterize(list_item_10), Point=construct_point_3)  # -> Point, Normal, UDirection, VDirection, Frame
orient_5 = Orient(Geometry=center_box_5, Source=evaluate_surface_8.Point, Target=evaluate_surface.Point)  # -> Geometry, Transform
solid_difference_2 = SolidDifference(BrepsA=orient_5.Geometry, BrepsB=cap_holes_ex.Brep)
explode_tree_2 = ExplodeTree(Data=simplify(graft(solid_difference_2)))  # -> Branch0, Branch1
deconstruct_brep_11 = DeconstructBrep(Brep=explode_tree_2.Branch0)  # -> Faces, Edges, Vertices
deconstruct_brep_12 = DeconstructBrep(Brep=center_box_6)  # -> Faces, Edges, Vertices
list_item_11 = ListItem(List=deconstruct_brep_11.Faces, Index=Slider(3, range=0..10), Wrap=True)
list_item_12 = ListItem(List=deconstruct_brep_12.Faces, Index=Slider(1, range=0..20), Wrap=True)
evaluate_surface_9 = EvaluateSurface(Surface=reparameterize(list_item_11), Point=construct_point_4)  # -> Point, Normal, UDirection, VDirection, Frame
evaluate_surface_10 = EvaluateSurface(Surface=reparameterize(list_item_12), Point=construct_point_5)  # -> Point, Normal, UDirection, VDirection, Frame
orient_6 = Orient(Geometry=center_box_6, Source=evaluate_surface_10.Point, Target=evaluate_surface_9.Point)  # -> Geometry, Transform
deconstruct_brep_13 = DeconstructBrep(Brep=orient_6.Geometry)  # -> Faces, Edges, Vertices
deconstruct_brep_14 = DeconstructBrep(Brep=center_box_7)  # -> Faces, Edges, Vertices
list_item_13 = ListItem(List=deconstruct_brep_13.Faces, Index=Slider(3, range=0..10), Wrap=True)
list_item_14 = ListItem(List=deconstruct_brep_14.Faces, Index=Slider(1, range=0..20), Wrap=True)
evaluate_surface_11 = EvaluateSurface(Surface=reparameterize(list_item_13), Point=construct_point_11)  # -> Point, Normal, UDirection, VDirection, Frame
evaluate_surface_12 = EvaluateSurface(Surface=reparameterize(list_item_14), Point=construct_point_12)  # -> Point, Normal, UDirection, VDirection, Frame
orient_7 = Orient(Geometry=center_box_7, Source=evaluate_surface_12.Point, Target=evaluate_surface_11.Point)  # -> Geometry, Transform
solid_union_2 = SolidUnion(Breps=flatten([explode_tree_2.Branch0, orient_6.Geometry, orient_7.Geometry]))
move = Move(Geometry=solid_union_2, Motion=expr("-x", unit_z))  # -> Geometry, Transform
mirror = Mirror(Geometry=move.Geometry, Plane=PlaneYZ(0, 0, 0))  # -> Geometry, Transform
area_3 = Area(Geometry=mirror.Geometry)  # -> Area, Centroid
yz_plane = YZPlane(Origin=area_3.Centroid)
rotate = Rotate(Geometry=mirror.Geometry, Angle=degrees(Slider(180, range=0..1000)), Plane=yz_plane)  # -> Geometry, Transform
deconstruct_brep_15 = DeconstructBrep(Brep=move.Geometry)  # -> Faces, Edges, Vertices
deconstruct_brep_16 = DeconstructBrep(Brep=rotate.Geometry)  # -> Faces, Edges, Vertices
list_item_15 = ListItem(List=deconstruct_brep_15.Faces, Index=Slider(3, range=0..10), Wrap=True)
list_item_16 = ListItem(List=deconstruct_brep_16.Faces, Index=Slider(3, range=0..20), Wrap=True)
evaluate_surface_13 = EvaluateSurface(Surface=reparameterize(list_item_15), Point=construct_point_13)  # -> Point, Normal, UDirection, VDirection, Frame
evaluate_surface_14 = EvaluateSurface(Surface=reparameterize(list_item_16), Point=construct_point_14)  # -> Point, Normal, UDirection, VDirection, Frame
orient_8 = Orient(Geometry=rotate.Geometry, Source=evaluate_surface_14.Point, Target=evaluate_surface_13.Point)  # -> Geometry, Transform
deconstruct_brep_17 = DeconstructBrep(Brep=orient_8.Geometry)  # -> Faces, Edges, Vertices
list_item_17 = ListItem(List=deconstruct_brep_17.Faces, Index=Slider(4, range=0..10), Wrap=True)
evaluate_surface_15 = EvaluateSurface(Surface=reparameterize(list_item_17), Point=construct_point_15)  # -> Point, Normal, UDirection, VDirection, Frame
orient_9 = Orient(Geometry=solid_union, Source=area.Centroid, Target=evaluate_surface_15.Point)  # -> Geometry, Transform
deconstruct_brep_18 = DeconstructBrep(Brep=orient_9.Geometry)  # -> Faces, Edges, Vertices
list_item_18 = ListItem(List=deconstruct_brep_18.Faces, Index=Slider(23, range=0..50), Wrap=True)
area_4 = Area(Geometry=list_item_18)  # -> Area, Centroid
move_to_point = MoveToPoint(Geometry=center_box_4, PointA=area_2.Centroid, PointB=area_4.Centroid)  # -> Moved, Vector, Transform
solid_difference_3 = SolidDifference(BrepsA=cap_holes_ex.Brep, BrepsB=flatten([move_to_point.Moved, orient_9.Geometry, orient_8.Geometry, move.Geometry]))
solid_difference_4 = SolidDifference(BrepsA=move.Geometry, BrepsB=orient_9.Geometry)
solid_difference_5 = SolidDifference(BrepsA=orient_8.Geometry, BrepsB=orient_9.Geometry)

deconstruct_brep_19 = DeconstructBrep(Brep=[solid_difference_3, solid_difference_4, solid_difference_5, orient_9.Geometry, move_to_point.Moved])  # -> Faces, Edges, Vertices
custom_preview_lineweights = CustomPreviewLineweights(
    Geometry=deconstruct_brep_19.Edges,
    Shader=ColourSwatch(SwatchColor=RGB(0, 0, 0)),
    Thickness=Slider(5, range=0..5),
    Absolute=False)
custom_preview = CustomPreview(Geometry=solid_difference_3, Material=ColourSwatch(SwatchColor=RGBA(255, 112, 112, 200)))
custom_preview_2 = CustomPreview(Geometry=solid_difference_4, Material=ColourSwatch(SwatchColor=RGBA(112, 193, 255, 200)))
custom_preview_3 = CustomPreview(Geometry=solid_difference_5, Material=ColourSwatch(SwatchColor=RGBA(136, 255, 112, 200)))
custom_preview_4 = CustomPreview(Geometry=orient_9.Geometry, Material=ColourSwatch(SwatchColor=RGBA(200, 112, 255, 200)))
custom_preview_5 = CustomPreview(Geometry=move_to_point.Moved, Material=ColourSwatch(SwatchColor=RGBA(255, 255, 112, 200)))
custom_preview_6 = CustomPreview(Material=ColourSwatch(SwatchColor=RGB(135, 68, 42)))
