# Grasshopper definition 斗.gh (Grasshopper 1.0.7)
# plug-ins: Pufferfish, Human

W = Slider(24, range=0..1000)
W_2 = Slider(32, range=0..1000)
# 斗
construct_point = ConstructPoint(XCoordinate=0, YCoordinate=0, ZCoordinate=0)
construct_point_2 = ConstructPoint(XCoordinate=0, YCoordinate=W, ZCoordinate=0)
construct_point_3 = ConstructPoint(XCoordinate=W, YCoordinate=W, ZCoordinate=0)
construct_point_4 = ConstructPoint(XCoordinate=W, YCoordinate=0, ZCoordinate=0)
construct_point_5 = ConstructPoint(XCoordinate=0, YCoordinate=0, ZCoordinate=0)
construct_point_6 = ConstructPoint(XCoordinate=0, YCoordinate=W_2, ZCoordinate=0)
construct_point_7 = ConstructPoint(XCoordinate=W_2, YCoordinate=W_2, ZCoordinate=0)
construct_point_8 = ConstructPoint(XCoordinate=W_2, YCoordinate=0, ZCoordinate=0)
_4point_surface = _4PointSurface(CornerA=construct_point, CornerB=construct_point_2, CornerC=construct_point_3, CornerD=construct_point_4)
_4point_surface_2 = _4PointSurface(CornerA=construct_point_5, CornerB=construct_point_6, CornerC=construct_point_7, CornerD=construct_point_8)
area = Area(Geometry=_4point_surface)  # -> Area, Centroid
area_2 = Area(Geometry=_4point_surface_2)  # -> Area, Centroid
unit_z = UnitZ(Factor=Slider(8, range=0..10))
move = Move(Geometry=area.Centroid, Motion=unit_z)  # -> Geometry, Transform
number_slider = Slider(2, range=0..10)
number_slider_2 = Slider(3, range=0..10)
number_slider_3 = Slider(50, range=0..50)
move_to_point = MoveToPoint(Geometry=_4point_surface_2, PointA=area_2.Centroid, PointB=move.Geometry)  # -> Moved, Vector, Transform
unit_z_2 = UnitZ(Factor=Slider(12, range=0..100))
unit_z_3 = UnitZ(Factor=number_slider_2)
unit_z_4 = UnitZ(Factor=number_slider_3)
cylinder = Cylinder(Base=area.Centroid, Radius=Slider(20, range=0..100), Length=number_slider_3)
center_box = CenterBox(Base=area.Centroid, X=number_slider, Y=number_slider, Z=number_slider_2)
curve = Curve(_4point_surface)
curve_2 = Curve(move_to_point.Moved)
extrude = Extrude(Base=move_to_point.Moved, Direction=unit_z_2)
cap_holes_ex = CapHolesEx(Brep=cylinder)  # -> Brep, Caps, Solid
loft = Loft(
    Curves=flatten([curve, curve_2]),
    Options={Adjust=False, Closed=False, LoftEnds=0, LoftSimp=0, LoftType=0, Rebuild=10, Refit=0.01})
move_2 = Move(Geometry=center_box, Motion=unit_z_3)  # -> Geometry, Transform
move_3 = Move(Geometry=cap_holes_ex.Brep, Motion=expr("-x", unit_z_4))  # -> Geometry, Transform
cap_holes_ex_2 = CapHolesEx(Brep=loft)  # -> Brep, Caps, Solid
solid_union = SolidUnion(Breps=flatten([cap_holes_ex_2.Brep, extrude]))
solid_union_2 = SolidUnion(Breps=flatten([move_3.Geometry, move_2.Geometry]))
deconstruct_brep = DeconstructBrep(Brep=solid_union)  # -> Faces, Edges, Vertices
list_item = ListItem(List=deconstruct_brep.Faces, Index=Slider(4, range=0..10), Wrap=True)
number_slider_4 = Slider(4, range=0..10)
number_slider_5 = Slider(2, range=0..10)
area_3 = Area(Geometry=list_item)  # -> Area, Centroid
unit_z_5 = UnitZ(Factor=number_slider_4)
center_box_2 = CenterBox(Base=area_3.Centroid, X=Slider(5, range=0..10), Y=Slider(16, range=0..100), Z=number_slider_4)
center_box_3 = CenterBox(Base=area_3.Centroid, X=Slider(16, range=0..100), Y=Slider(5, range=0..10), Z=Slider(4, range=0..10))
center_box_4 = CenterBox(Base=area_3.Centroid, X=Slider(16, range=0..100), Y=Slider(8, range=0..10), Z=number_slider_5)
addition = Addition(A=number_slider_4, B=number_slider_5)
move_4 = Move(Geometry=center_box_2, Motion=expr("-x", unit_z_5))  # -> Geometry, Transform
move_5 = Move(Geometry=center_box_3, Motion=expr("-x", unit_z_5))  # -> Geometry, Transform
unit_z_6 = UnitZ(Factor=addition)
move_6 = Move(Geometry=center_box_4, Motion=expr("-x", unit_z_6))  # -> Geometry, Transform
solid_difference = SolidDifference(BrepsA=solid_union, BrepsB=flatten(move_4.Geometry))
solid_union_3 = SolidUnion(Breps=flatten([solid_difference, move_6.Geometry]))
solid_difference_2 = SolidDifference(BrepsA=solid_union_3, BrepsB=flatten([move_5.Geometry, solid_union_2]))
deconstruct_brep_2 = DeconstructBrep(Brep=solid_difference_2)  # -> Faces, Edges, Vertices
list_item_2 = ListItem(List=deconstruct_brep_2.Faces, Index=Slider(22, range=0..30), Wrap=True)
area_4 = Area(Geometry=list_item_2)  # -> Area, Centroid

deconstruct_brep_3 = DeconstructBrep(Brep=[solid_union_2, solid_difference_2])  # -> Faces, Edges, Vertices
custom_preview_lineweights = CustomPreviewLineweights(
    Geometry=deconstruct_brep_3.Edges,
    Shader=ColourSwatch(SwatchColor=RGB(0, 0, 0)),
    Thickness=Slider(5, range=0..5),
    Absolute=False)
custom_preview = CustomPreview(Geometry=solid_union_2, Material=ColourSwatch(SwatchColor=RGBA(255, 112, 112, 200)))
custom_preview_2 = CustomPreview(Geometry=solid_difference_2, Material=ColourSwatch(SwatchColor=RGBA(112, 193, 255, 200)))
custom_preview_3 = CustomPreview(Material=ColourSwatch(SwatchColor=RGBA(136, 255, 112, 200)))
custom_preview_4 = CustomPreview(Material=ColourSwatch(SwatchColor=RGBA(200, 112, 255, 200)))
custom_preview_5 = CustomPreview(Material=ColourSwatch(SwatchColor=RGBA(255, 255, 112, 200)))
custom_preview_6 = CustomPreview(Material=ColourSwatch(SwatchColor=RGB(135, 68, 42)))
