# Grasshopper definition 斗栱.gh (Grasshopper 1.0.7)
# plug-ins: Pufferfish, Human

W = Slider(10, range=0..1000)
W_2 = Slider(14, range=0..1000)
W_3 = Slider(24, range=0..1000)
W_4 = Slider(32, range=0..1000)
W_5 = Slider(8, range=0..1000)
W_6 = Slider(12, range=0..1000)
number_slider = Slider(5, range=0..10)
number_slider_2 = Slider(5, range=0..10)
number_slider_3 = Slider(3.5, range=0..10)
number_slider_4 = Slider(7, range=0..10)
number_slider_5 = Slider(3.5, range=0..10)
# 斗
construct_point = ConstructPoint(XCoordinate=0, YCoordinate=0, ZCoordinate=0)
construct_point_2 = ConstructPoint(XCoordinate=0, YCoordinate=W_3, ZCoordinate=0)
construct_point_3 = ConstructPoint(XCoordinate=W_3, YCoordinate=W_3, ZCoordinate=0)
construct_point_4 = ConstructPoint(XCoordinate=W_3, YCoordinate=0, ZCoordinate=0)
construct_point_5 = ConstructPoint(XCoordinate=0, YCoordinate=0, ZCoordinate=0)
construct_point_6 = ConstructPoint(XCoordinate=0, YCoordinate=W_4, ZCoordinate=0)
construct_point_7 = ConstructPoint(XCoordinate=W_4, YCoordinate=W_4, ZCoordinate=0)
construct_point_8 = ConstructPoint(XCoordinate=W_4, YCoordinate=0, ZCoordinate=0)
# 散斗
construct_point_9 = ConstructPoint(XCoordinate=0, YCoordinate=0, ZCoordinate=0)
construct_point_10 = ConstructPoint(XCoordinate=0, YCoordinate=W_5, ZCoordinate=0)
construct_point_11 = ConstructPoint(XCoordinate=W_5, YCoordinate=W_5, ZCoordinate=0)
construct_point_12 = ConstructPoint(XCoordinate=W_5, YCoordinate=0, ZCoordinate=0)
construct_point_13 = ConstructPoint(XCoordinate=0, YCoordinate=0, ZCoordinate=0)
construct_point_14 = ConstructPoint(XCoordinate=0, YCoordinate=W_6, ZCoordinate=0)
construct_point_15 = ConstructPoint(XCoordinate=W_6, YCoordinate=W_6, ZCoordinate=0)
construct_point_16 = ConstructPoint(XCoordinate=W_6, YCoordinate=0, ZCoordinate=0)
number_slider_6 = Slider(3, range=0..10)
number_slider_7 = Slider(4, range=0..10)
number_slider_8 = Slider(3, range=0..10)
unit_z = UnitZ(Factor=Slider(2.5, range=0..10))
center_box = CenterBox(Base=PlaneXY(0, 0, 0), X=Slider(4, range=0..36), Y=Slider(5, range=0..10), Z=Slider(6, range=0..10))
center_box_2 = CenterBox(Base=PlaneXY(0, 0, 0), X=Slider(31, range=0..36), Y=number_slider, Z=Slider(7.5, range=0..10))
center_box_3 = CenterBox(Base=PlaneXY(0, 0, 0), X=Slider(36, range=0..36), Y=number_slider_2, Z=Slider(7.5, range=0..10))
center_box_4 = CenterBox(Base=PlaneXY(0, 0, 0), X=number_slider_4, Y=Slider(4, range=0..10), Z=number_slider_3)
# 泥道栱
number_slider_9 = Slider(1, range=0..10)
number_slider_10 = Slider(4, range=0..10)
center_box_5 = CenterBox(Base=PlaneXY(0, 0, 0), X=number_slider_4, Y=number_slider_2, Z=number_slider_5)
# 华栱
number_slider_11 = Slider(1, range=0..10)
center_box_6 = CenterBox(Base=PlaneXY(0, 0, 0), X=Slider(5, range=0..10), Y=Slider(0.5, range=0..1), Z=Slider(10, range=0..10))
_4point_surface = _4PointSurface(CornerA=construct_point, CornerB=construct_point_2, CornerC=construct_point_3, CornerD=construct_point_4)
_4point_surface_2 = _4PointSurface(CornerA=construct_point_5, CornerB=construct_point_6, CornerC=construct_point_7, CornerD=construct_point_8)
_4point_surface_3 = _4PointSurface(CornerA=construct_point_9, CornerB=construct_point_10, CornerC=construct_point_11, CornerD=construct_point_12)
_4point_surface_4 = _4PointSurface(CornerA=construct_point_13, CornerB=construct_point_14, CornerC=construct_point_15, CornerD=construct_point_16)
deconstruct_brep = DeconstructBrep(Brep=center_box_2)  # -> Faces, Edges, Vertices
deconstruct_brep_2 = DeconstructBrep(Brep=center_box_3)  # -> Faces, Edges, Vertices
move = Move(Geometry=center_box, Motion=unit_z)  # -> Geometry, Transform
deconstruct_brep_3 = DeconstructBrep(Brep=center_box_5)  # -> Faces, Edges, Vertices
deconstruct_brep_4 = DeconstructBrep(Brep=center_box_4)  # -> Faces, Edges, Vertices
center_box_7 = CenterBox(Base=PlaneXY(0, 0, 0), X=number_slider_7, Y=Slider(4, range=0..10), Z=number_slider_6)
center_box_8 = CenterBox(Base=PlaneXY(0, 0, 0), X=number_slider_7, Y=number_slider, Z=number_slider_8)
deconstruct_brep_5 = DeconstructBrep(Brep=center_box_6)  # -> Faces, Edges, Vertices
panel = Panel("""10
11""")
panel_2 = Panel("""10
11""")
area = Area(Geometry=_4point_surface)  # -> Area, Centroid
area_2 = Area(Geometry=_4point_surface_2)  # -> Area, Centroid
area_3 = Area(Geometry=_4point_surface_3)  # -> Area, Centroid
area_4 = Area(Geometry=_4point_surface_4)  # -> Area, Centroid
list_item = ListItem(List=deconstruct_brep.Vertices, Index=number_slider_9, Wrap=True)
list_item_2 = ListItem(List=deconstruct_brep_2.Vertices, Index=number_slider_11, Wrap=True)
list_item_3 = ListItem(List=deconstruct_brep_2.Edges, Index=Slider(4, range=0..10), Wrap=True)
list_item_4 = ListItem(List=deconstruct_brep_2.Faces, Index=Slider(4, range=0..10), Wrap=True)
unit_z_2 = UnitZ(Factor=Slider(3, range=0..10))
deconstruct_brep_6 = DeconstructBrep(Brep=center_box_8)  # -> Faces, Edges, Vertices
deconstruct_brep_7 = DeconstructBrep(Brep=center_box_7)  # -> Faces, Edges, Vertices
list_item_5 = ListItem(List=deconstruct_brep_3.Edges, Index=panel, Wrap=True)
list_item_6 = ListItem(List=deconstruct_brep_5.Edges, Index=0, Wrap=True)
list_item_7 = ListItem(List=deconstruct_brep_4.Edges, Index=panel_2, Wrap=True)
list_item_8 = ListItem(List=deconstruct_brep_5.Edges, Index=Slider(2, range=0..10), Wrap=True)
list_item_9 = ListItem(List=deconstruct_brep_4.Faces, Index="5", Wrap=True)
deconstruct = Deconstruct(Point=list_item)  # -> XComponent, YComponent, ZComponent
number_slider_12 = Slider(5, range=0..10)
number_slider_13 = Slider(2, range=0..10)
panel_3 = Panel("""10
11""")
panel_4 = Panel("""10
11""")
deconstruct_2 = Deconstruct(Point=list_item_2)  # -> XComponent, YComponent, ZComponent
curve_middle = CurveMiddle(Curve=list_item_3)
unit_x = UnitX(Factor=Slider(6, range=0..10))
area_5 = Area(Geometry=list_item_4)  # -> Area, Centroid
unit_z_3 = UnitZ(Factor=Slider(8, range=0..10))
unit_z_4 = UnitZ(Factor=Slider(4, range=0..10))
list_item_10 = ListItem(List=deconstruct_brep.Edges, Index=Slider(6, range=0..10), Wrap=True)
curve_middle_2 = CurveMiddle(Curve=list_item_5)
curve_middle_3 = CurveMiddle(Curve=list_item_7)
curve_middle_4 = CurveMiddle(Curve=list_item_6)
extrude = Extrude(Base=list_item_9, Direction=unit_z_2)
curve_middle_5 = CurveMiddle(Curve=list_item_8)
list_item_11 = ListItem(List=deconstruct_brep_6.Edges, Index=panel_3, Wrap=True)
list_item_12 = ListItem(List=deconstruct_brep_7.Edges, Index=panel_4, Wrap=True)
curve_middle_6 = CurveMiddle(Curve=list_item_10)
move_2 = Move(Geometry=curve_middle, Motion=expr("-x", unit_x))  # -> Geometry, Transform
unit_x_2 = UnitX(Factor=Slider(5, range=0..10))
move_3 = Move(Geometry=curve_middle, Motion=unit_x)  # -> Geometry, Transform
move_4 = Move(Geometry=area.Centroid, Motion=unit_z_3)  # -> Geometry, Transform
move_5 = Move(Geometry=area_3.Centroid, Motion=unit_z_4)  # -> Geometry, Transform
curve_middle_7 = CurveMiddle(Curve=list_item_11)
xz_plane = XZPlane(Origin=curve_middle_2)
curve_middle_8 = CurveMiddle(Curve=list_item_12)
xz_plane_2 = XZPlane(Origin=curve_middle_3)
center_box_9 = CenterBox(Base=area_5.Centroid, X=Slider(8, range=0..10), Y=number_slider_2, Z=number_slider_13)
unit_z_5 = UnitZ(Factor=number_slider_13)
number_slider_14 = Slider(2, range=0..10)
number_slider_15 = Slider(3, range=0..10)
number_slider_16 = Slider(50, range=0..50)
move_6 = Move(Geometry=curve_middle_6, Motion=expr("-x", unit_x_2))  # -> Geometry, Transform
move_7 = Move(Geometry=curve_middle_6, Motion=unit_x_2)  # -> Geometry, Transform
cylinder = Cylinder(Base=xz_plane, Radius=number_slider_5, Length=Slider(10, range=0..10))
cylinder_2 = Cylinder(Base=xz_plane_2, Radius=number_slider_3, Length=Slider(8, range=0..10))

# ----
# Angle
angle = Slider(10, range=0..45)

xz_plane_3 = XZPlane(Origin=curve_middle_7)

# ----
# Angle
angle_2 = Slider(10, range=0..45)

xz_plane_4 = XZPlane(Origin=curve_middle_8)
move_to_point = MoveToPoint(Geometry=_4point_surface_2, PointA=area_2.Centroid, PointB=move_4.Geometry)  # -> Moved, Vector, Transform
move_to_point_2 = MoveToPoint(Geometry=_4point_surface_4, PointA=area_4.Centroid, PointB=move_5.Geometry)  # -> Moved, Vector, Transform
unit_z_6 = UnitZ(Factor=Slider(12, range=0..100))
unit_z_7 = UnitZ(Factor=Slider(6, range=0..100))
move_8 = Move(Geometry=center_box_9, Motion=unit_z_5)  # -> Geometry, Transform
unit_x_3 = UnitX(Factor=1)
unit_y = UnitY(Factor=1)
unit_x_4 = UnitX(Factor=1)
unit_y_2 = UnitY(Factor=1)
unit_z_8 = UnitZ(Factor=number_slider_15)
unit_z_9 = UnitZ(Factor=number_slider_16)
deconstruct_brep_8 = DeconstructBrep(Brep=move_8.Geometry)  # -> Faces, Edges, Vertices
cap_holes_ex = CapHolesEx(Brep=cylinder)  # -> Brep, Caps, Solid
cylinder_3 = Cylinder(Base=area.Centroid, Radius=Slider(20, range=0..100), Length=number_slider_16)
cap_holes_ex_2 = CapHolesEx(Brep=cylinder_2)  # -> Brep, Caps, Solid
cylinder_4 = Cylinder(Base=xz_plane_3, Radius=number_slider_8, Length=Slider(10, range=0..10))
cylinder_5 = Cylinder(Base=xz_plane_4, Radius=number_slider_6, Length=Slider(8, range=0..10))
center_box_10 = CenterBox(Base=area.Centroid, X=number_slider_14, Y=number_slider_14, Z=number_slider_15)
curve = Curve(_4point_surface)
curve_2 = Curve(move_to_point.Moved)
curve_3 = Curve(_4point_surface_3)
curve_4 = Curve(move_to_point_2.Moved)
number_slider_17 = Slider(3.5, range=0..10)
number_slider_18 = Slider(4, range=0..10)
rotate = Rotate(Vector=unit_x_3, Axis=unit_y, Angle=expr("-x", degrees(angle)))
extrude_2 = Extrude(Base=move_to_point.Moved, Direction=unit_z_6)
list_item_13 = ListItem(List=deconstruct_brep_8.Edges, Index=Slider(4, range=0..10), Wrap=True)
list_item_14 = ListItem(List=deconstruct_brep_8.Edges, Index=Slider(6, range=0..10), Wrap=True)
extrude_3 = Extrude(Base=move_to_point_2.Moved, Direction=unit_z_7)
cap_holes_ex_3 = CapHolesEx(Brep=cylinder_3)  # -> Brep, Caps, Solid
cap_holes_ex_4 = CapHolesEx(Brep=cylinder_4)  # -> Brep, Caps, Solid
rotate_2 = Rotate(Vector=unit_x_4, Axis=unit_y_2, Angle=expr("-x", degrees(angle_2)))
cap_holes_ex_5 = CapHolesEx(Brep=cylinder_5)  # -> Brep, Caps, Solid
loft = Loft(
    Curves=flatten([curve, curve_2]),
    Options={Adjust=False, Closed=False, LoftEnds=0, LoftSimp=0, LoftType=0, Rebuild=10, Refit=0.01})
loft_2 = Loft(
    Curves=flatten([curve_3, curve_4]),
    Options={Adjust=False, Closed=False, LoftEnds=0, LoftSimp=0, LoftType=0, Rebuild=10, Refit=0.01})
solid_union = SolidUnion(Breps=flatten([center_box_5, cap_holes_ex.Brep]))
solid_union_2 = SolidUnion(Breps=flatten([cap_holes_ex_2.Brep, extrude, center_box_4]))
move_9 = Move(Geometry=center_box_10, Motion=unit_z_8)  # -> Geometry, Transform
curve_middle_9 = CurveMiddle(Curve=list_item_13)
move_10 = Move(Geometry=cap_holes_ex_3.Brep, Motion=expr("-x", unit_z_9))  # -> Geometry, Transform
curve_middle_10 = CurveMiddle(Curve=list_item_14)
line_sdl = LineSDL(Start=list_item, Direction=expr("-x", rotate), Length=expr("-x", number_slider_17))
cap_holes_ex_6 = CapHolesEx(Brep=loft)  # -> Brep, Caps, Solid
cap_holes_ex_7 = CapHolesEx(Brep=loft_2)  # -> Brep, Caps, Solid
deconstruct_brep_9 = DeconstructBrep(Brep=solid_union)  # -> Faces, Edges, Vertices
deconstruct_brep_10 = DeconstructBrep(Brep=solid_union_2)  # -> Faces, Edges, Vertices
solid_union_3 = SolidUnion(Breps=flatten([center_box_8, cap_holes_ex_4.Brep]))
solid_union_4 = SolidUnion(Breps=flatten([cap_holes_ex_5.Brep, center_box_7]))
line_sdl_2 = LineSDL(Start=list_item_2, Direction=expr("-x", rotate_2), Length=expr("-x", number_slider_18))
addition = Addition(A=angle, B=Slider(10, range=0..10))
addition_2 = Addition(A=angle_2, B=Slider(10, range=0..10))
solid_union_5 = SolidUnion(Breps=flatten([cap_holes_ex_6.Brep, extrude_2]))
solid_union_6 = SolidUnion(Breps=flatten([move_10.Geometry, move_9.Geometry]))
solid_union_7 = SolidUnion(Breps=flatten([cap_holes_ex_7.Brep, extrude_3]))
move_to_point_3 = MoveToPoint(Geometry=center_box_6, PointA=curve_middle_4, PointB=curve_middle_9)  # -> Moved, Vector, Transform
number_slider_19 = Slider(20, range=0..20)
move_to_point_4 = MoveToPoint(Geometry=center_box_6, PointA=curve_middle_5, PointB=curve_middle_10)  # -> Moved, Vector, Transform
list_item_15 = ListItem(List=deconstruct_brep_9.Edges, Index=Slider(2, range=0..15), Wrap=True)
list_item_16 = ListItem(List=deconstruct_brep_9.Edges, Index=Slider(18, range=0..26), Wrap=True)
end_points = EndPoints(Curve=line_sdl)  # -> Start, End
number_slider_20 = Slider(20, range=0..20)
rotate_3 = Rotate(Vector=unit_x_3, Axis=unit_y, Angle=expr("-x", degrees(addition)))
deconstruct_brep_11 = DeconstructBrep(Brep=solid_union_3)  # -> Faces, Edges, Vertices
deconstruct_brep_12 = DeconstructBrep(Brep=solid_union_4)  # -> Faces, Edges, Vertices
end_points_2 = EndPoints(Curve=line_sdl_2)  # -> Start, End
rotate_4 = Rotate(Vector=unit_x_4, Axis=unit_y_2, Angle=expr("-x", degrees(addition_2)))
curve_middle_11 = CurveMiddle(Curve=list_item_16)
end_points_3 = EndPoints(Curve=list_item_15)  # -> Start, End
deconstruct_brep_13 = DeconstructBrep(Brep=solid_union_5)  # -> Faces, Edges, Vertices
deconstruct_brep_14 = DeconstructBrep(Brep=solid_union_7)  # -> Faces, Edges, Vertices
list_item_17 = ListItem(List=deconstruct_brep_11.Edges, Index=Slider(17, range=0..30), Wrap=True)
list_item_18 = ListItem(List=deconstruct_brep_11.Edges, Index=Slider(0, range=0..26), Wrap=True)
line_sdl_3 = LineSDL(Start=end_points.End, Direction=expr("-x", rotate_3), Length=expr("-x", number_slider_17))
line_sdl_4 = LineSDL(Start=end_points_2.End, Direction=expr("-x", rotate_4), Length=expr("-x", number_slider_18))
addition_3 = Addition(A=addition, B=number_slider_19)
addition_4 = Addition(A=addition_2, B=number_slider_20)
curve_middle_12 = CurveMiddle(Curve=list_item_17)
end_points_4 = EndPoints(Curve=list_item_18)  # -> Start, End
move_to_point_5 = MoveToPoint(Geometry=solid_union, PointA=end_points_3.Start, PointB=move_2.Geometry)  # -> Moved, Vector, Transform
list_item_19 = ListItem(List=deconstruct_brep_13.Faces, Index=Slider(4, range=0..10), Wrap=True)
move_to_point_6 = MoveToPoint(Geometry=solid_union, PointA=curve_middle_11, PointB=move_3.Geometry)  # -> Moved, Vector, Transform
list_item_20 = ListItem(List=deconstruct_brep_14.Faces, Index=Slider(4, range=0..10), Wrap=True)
deconstruct_brep_15 = DeconstructBrep(Brep=solid_union_2)  # -> Faces, Edges, Vertices
rotate_5 = Rotate(Vector=unit_x_3, Axis=unit_y, Angle=expr("-x", degrees(addition_3)))
rotate_6 = Rotate(Vector=unit_x_4, Axis=unit_y_2, Angle=expr("-x", degrees(addition_4)))
end_points_5 = EndPoints(Curve=line_sdl_3)  # -> Start, End
number_slider_21 = Slider(4, range=0..10)
number_slider_22 = Slider(2, range=0..10)
end_points_6 = EndPoints(Curve=line_sdl_4)  # -> Start, End
addition_5 = Addition(A=addition_3, B=number_slider_19)
addition_6 = Addition(A=addition_4, B=number_slider_20)
area_6 = Area(Geometry=list_item_19)  # -> Area, Centroid
area_7 = Area(Geometry=list_item_20)  # -> Area, Centroid
move_to_point_7 = MoveToPoint(Geometry=solid_union_3, PointA=curve_middle_12, PointB=move_7.Geometry)  # -> Moved, Vector, Transform
number_slider_23 = Slider(3, range=0..100)
move_to_point_8 = MoveToPoint(Geometry=solid_union_3, PointA=end_points_4.Start, PointB=move_6.Geometry)  # -> Moved, Vector, Transform
deconstruct_brep_16 = DeconstructBrep(Brep=solid_union_4)  # -> Faces, Edges, Vertices
deconstruct_brep_17 = DeconstructBrep(Brep=move_to_point_5.Moved)  # -> Faces, Edges, Vertices
deconstruct_brep_18 = DeconstructBrep(Brep=move_to_point_6.Moved)  # -> Faces, Edges, Vertices
list_item_21 = ListItem(List=deconstruct_brep_15.Faces, Index=Slider(8, range=0..100), Wrap=True)
rotate_7 = Rotate(Vector=unit_x_3, Axis=unit_y, Angle=expr("-x", degrees(addition_5)))
line_sdl_5 = LineSDL(Start=end_points_5.End, Direction=expr("-x", rotate_5), Length=expr("-x", number_slider_17))
rotate_8 = Rotate(Vector=unit_x_4, Axis=unit_y_2, Angle=expr("-x", degrees(addition_6)))
line_sdl_6 = LineSDL(Start=end_points_6.End, Direction=expr("-x", rotate_6), Length=expr("-x", number_slider_18))
unit_z_10 = UnitZ(Factor=number_slider_21)
unit_z_11 = UnitZ(Factor=Slider(2, range=0..10))
number_slider_24 = Slider(3, range=0..100)
center_box_11 = CenterBox(Base=area_6.Centroid, X=Slider(5, range=0..10), Y=Slider(16, range=0..100), Z=number_slider_21)
center_box_12 = CenterBox(Base=area_6.Centroid, X=Slider(16, range=0..100), Y=Slider(5, range=0..10), Z=Slider(4, range=0..10))
center_box_13 = CenterBox(Base=area_6.Centroid, X=Slider(16, range=0..100), Y=Slider(8, range=0..10), Z=number_slider_22)
center_box_14 = CenterBox(Base=area_7.Centroid, X=Slider(4, range=0..10), Y=Slider(16, range=0..100), Z=Slider(3, range=0..10))
addition_7 = Addition(A=number_slider_21, B=number_slider_22)
area_8 = Area(Geometry=list_item_21)  # -> Area, Centroid
deconstruct_brep_19 = DeconstructBrep(Brep=move_to_point_7.Moved)  # -> Faces, Edges, Vertices
deconstruct_brep_20 = DeconstructBrep(Brep=move_to_point_8.Moved)  # -> Faces, Edges, Vertices
list_item_22 = ListItem(List=deconstruct_brep_16.Faces, Index=Slider(3, range=0..100), Wrap=True)
list_item_23 = ListItem(List=deconstruct_brep_17.Faces, Index=number_slider_23, Wrap=True)
list_item_24 = ListItem(List=deconstruct_brep_18.Faces, Index=number_slider_23, Wrap=True)
end_points_7 = EndPoints(Curve=line_sdl_5)  # -> Start, End
line_sdl_7 = LineSDL(Start=end_points_7.End, Direction=expr("-x", rotate_7), Length=expr("-x", number_slider_17))
end_points_8 = EndPoints(Curve=line_sdl_6)  # -> Start, End
line_sdl_8 = LineSDL(Start=end_points_8.End, Direction=expr("-x", rotate_8), Length=expr("-x", number_slider_18))
move_11 = Move(Geometry=center_box_11, Motion=expr("-x", unit_z_10))  # -> Geometry, Transform
move_12 = Move(Geometry=center_box_12, Motion=expr("-x", unit_z_10))  # -> Geometry, Transform
move_13 = Move(Geometry=center_box_14, Motion=expr("-x", unit_z_11))  # -> Geometry, Transform
unit_z_12 = UnitZ(Factor=addition_7)
area_9 = Area(Geometry=list_item_24)  # -> Area, Centroid
area_10 = Area(Geometry=list_item_22)  # -> Area, Centroid
area_11 = Area(Geometry=list_item_23)  # -> Area, Centroid
list_item_25 = ListItem(List=deconstruct_brep_19.Faces, Index=number_slider_24, Wrap=True)
list_item_26 = ListItem(List=deconstruct_brep_20.Faces, Index=number_slider_24, Wrap=True)
end_points_9 = EndPoints(Curve=line_sdl_7)  # -> Start, End
end_points_10 = EndPoints(Curve=line_sdl_8)  # -> Start, End
move_14 = Move(Geometry=center_box_13, Motion=expr("-x", unit_z_12))  # -> Geometry, Transform
solid_difference = SolidDifference(BrepsA=solid_union_5, BrepsB=flatten(move_11.Geometry))
solid_difference_2 = SolidDifference(BrepsA=solid_union_7, BrepsB=flatten(move_13.Geometry))
area_12 = Area(Geometry=list_item_26)  # -> Area, Centroid
area_13 = Area(Geometry=list_item_25)  # -> Area, Centroid
deconstruct_3 = Deconstruct(Point=end_points_9.End)  # -> XComponent, YComponent, ZComponent
move_to_point_9 = MoveToPoint(Geometry=solid_union_2, PointA=area_8.Centroid, PointB=area_11.Centroid)  # -> Moved, Vector, Transform
move_to_point_10 = MoveToPoint(Geometry=solid_union_2, PointA=area_8.Centroid, PointB=area_9.Centroid)  # -> Moved, Vector, Transform
deconstruct_4 = Deconstruct(Point=end_points_10.End)  # -> XComponent, YComponent, ZComponent
solid_union_8 = SolidUnion(Breps=flatten([solid_difference, move_14.Geometry]))
solid_union_9 = SolidUnion(Breps=flatten(solid_difference_2))
move_to_point_11 = MoveToPoint(Geometry=solid_union_4, PointA=area_10.Centroid, PointB=area_13.Centroid)  # -> Moved, Vector, Transform
move_to_point_12 = MoveToPoint(Geometry=solid_union_4, PointA=area_10.Centroid, PointB=area_12.Centroid)  # -> Moved, Vector, Transform
construct_point_17 = ConstructPoint(XCoordinate=deconstruct_3.XComponent, YCoordinate=deconstruct_3.YComponent, ZCoordinate=deconstruct.ZComponent)
construct_point_18 = ConstructPoint(XCoordinate=deconstruct_4.XComponent, YCoordinate=deconstruct_4.YComponent, ZCoordinate=deconstruct_2.ZComponent)
solid_difference_3 = SolidDifference(BrepsA=solid_union_8, BrepsB=flatten([move_12.Geometry, solid_union_6]))
line = Line(StartPoint=end_points_9.End, EndPoint=construct_point_17)
line_2 = Line(StartPoint=construct_point_17, EndPoint=list_item)
line_3 = Line(StartPoint=end_points_10.End, EndPoint=construct_point_18)
line_4 = Line(StartPoint=construct_point_18, EndPoint=list_item_2)
solid_intersection = SolidIntersection(BrepsA=move_to_point_11.Moved, BrepsB=center_box_2)
solid_intersection_2 = SolidIntersection(BrepsA=move_to_point_12.Moved, BrepsB=center_box_2)
deconstruct_brep_21 = DeconstructBrep(Brep=solid_difference_3)  # -> Faces, Edges, Vertices
deconstruct_brep_22 = DeconstructBrep(Brep=solid_union_9)  # -> Faces, Edges, Vertices
list_item_27 = ListItem(List=deconstruct_brep_21.Faces, Index=Slider(22, range=0..30), Wrap=True)
list_item_28 = ListItem(List=deconstruct_brep_22.Faces, Index=Slider(9, range=0..30), Wrap=True)
unit_y_3 = UnitY(Factor=Slider(10, range=0..10))
boundary_surfaces = BoundarySurfaces(Edges=[line_sdl, line, line_sdl_3, line_2, line_sdl_5, line_sdl_7])
unit_y_4 = UnitY(Factor=Slider(10, range=0..10))
boundary_surfaces_2 = BoundarySurfaces(Edges=[line_sdl_2, line_3, line_sdl_4, line_4, line_sdl_6, line_sdl_8])
area_14 = Area(Geometry=list_item_27)  # -> Area, Centroid
area_15 = Area(Geometry=list_item_28)  # -> Area, Centroid
merge = Merge(Data1=solid_intersection, Data2=solid_intersection_2)
extrude_4 = Extrude(Base=boundary_surfaces, Direction=unit_y_3)
extrude_5 = Extrude(Base=boundary_surfaces_2, Direction=unit_y_4)
move_to_point_13 = MoveToPoint(Geometry=extrude_4, PointA=construct_point_17, PointB=list_item)  # -> Moved, Vector, Transform
move_to_point_14 = MoveToPoint(Geometry=extrude_5, PointA=construct_point_18, PointB=list_item_2)  # -> Moved, Vector, Transform
mirror = Mirror(Geometry=move_to_point_13.Moved, Plane=PlaneYZ(0, 0, 0))  # -> Geometry, Transform
merge_2 = Merge(Data1=move_to_point_9.Moved, Data2=move_to_point_10.Moved)
mirror_2 = Mirror(Geometry=move_to_point_14.Moved, Plane=PlaneYZ(0, 0, 0))  # -> Geometry, Transform
merge_3 = Merge(
    Data1=move_to_point_14.Moved,
    Data2=mirror_2.Geometry,
    Data3=move_8.Geometry,
    Data4=move_to_point_5.Moved,
    Data5=move_to_point_6.Moved,
    Data6=move_to_point_3.Moved,
    Data7=move_to_point_4.Moved)
merge_4 = Merge(
    Data1=move_to_point_13.Moved,
    Data2=mirror.Geometry,
    Data3=move.Geometry,
    Data4=move_to_point_7.Moved,
    Data5=move_to_point_8.Moved)
solid_difference_4 = SolidDifference(BrepsA=center_box_3, BrepsB=flatten(merge_3))
solid_difference_5 = SolidDifference(BrepsA=center_box_2, BrepsB=flatten(merge_4))
solid_union_10 = SolidUnion(Breps=flatten([solid_difference_4, merge_2]))
deconstruct_brep_23 = DeconstructBrep(Brep=solid_union_10)  # -> Faces, Edges, Vertices
panel_5 = Panel("""25
42""")
list_item_29 = ListItem(List=deconstruct_brep_23.Faces, Index=panel_5, Wrap=True)
solid_union_11 = SolidUnion(Breps=flatten([solid_difference_5, merge]))
number_slider_25 = Slider(1, range=0..10)
area_16 = Area(Geometry=list_item_29)  # -> Area, Centroid
deconstruct_brep_24 = DeconstructBrep(Brep=solid_union_11)  # -> Faces, Edges, Vertices
panel_6 = Panel("""19
31""")
unit_z_13 = UnitZ(Factor=number_slider_25)
center_box_15 = CenterBox(Base=area_16.Centroid, X=number_slider_25, Y=number_slider_25, Z=number_slider_25)
list_item_30 = ListItem(List=deconstruct_brep_24.Faces, Index=panel_6, Wrap=True)
move_15 = Move(Geometry=center_box_15, Motion=unit_z_13)  # -> Geometry, Transform
number_slider_26 = Slider(1, range=0..10)
area_17 = Area(Geometry=list_item_30)  # -> Area, Centroid
solid_union_12 = SolidUnion(Breps=flatten([solid_union_10, move_15.Geometry]))
unit_z_14 = UnitZ(Factor=number_slider_26)
center_box_16 = CenterBox(Base=area_17.Centroid, X=number_slider_26, Y=number_slider_26, Z=number_slider_26)
deconstruct_brep_25 = DeconstructBrep(Brep=solid_union_12)  # -> Faces, Edges, Vertices
move_16 = Move(Geometry=center_box_16, Motion=unit_z_14)  # -> Geometry, Transform
list_item_31 = ListItem(List=deconstruct_brep_25.Faces, Index=Slider(63, range=0..100), Wrap=True)
solid_union_13 = SolidUnion(Breps=flatten([solid_union_11, move_16.Geometry]))
area_18 = Area(Geometry=list_item_31)  # -> Area, Centroid
deconstruct_brep_26 = DeconstructBrep(Brep=solid_union_13)  # -> Faces, Edges, Vertices
rotate_9 = Rotate(Geometry=solid_union_12, Angle=1.570796327, Plane=area_18.Centroid)  # -> Geometry, Transform
list_item_32 = ListItem(List=deconstruct_brep_26.Faces, Index=Slider(39, range=0..100), Wrap=True)
area_19 = Area(Geometry=list_item_32)  # -> Area, Centroid
move_to_point_15 = MoveToPoint(Geometry=rotate_9.Geometry, PointA=area_18.Centroid, PointB=area_14.Centroid)  # -> Moved, Vector, Transform
unit_z_15 = UnitZ(Factor=Slider(4, range=0..10))
move_17 = Move(Geometry=move_to_point_15.Moved, Motion=unit_z_15)  # -> Geometry, Transform
move_to_point_16 = MoveToPoint(Geometry=solid_union_13, PointA=area_19.Centroid, PointB=area_14.Centroid)  # -> Moved, Vector, Transform
unit_z_16 = UnitZ(Factor=Slider(0, range=0..10))
deconstruct_brep_27 = DeconstructBrep(Brep=move_17.Geometry)  # -> Faces, Edges, Vertices
list_item_33 = ListItem(List=deconstruct_brep_27.Faces, Index=Slider(52, range=0..100), Wrap=True)
list_item_34 = ListItem(List=deconstruct_brep_27.Faces, Index=Slider(35, range=0..100), Wrap=True)
move_18 = Move(Geometry=move_to_point_16.Moved, Motion=unit_z_16)  # -> Geometry, Transform
area_20 = Area(Geometry=list_item_33)  # -> Area, Centroid
area_21 = Area(Geometry=list_item_34)  # -> Area, Centroid
move_to_point_17 = MoveToPoint(Geometry=solid_union_9, PointA=area_15.Centroid, PointB=area_20.Centroid)  # -> Moved, Vector, Transform
move_to_point_18 = MoveToPoint(Geometry=solid_union_9, PointA=area_15.Centroid, PointB=area_21.Centroid)  # -> Moved, Vector, Transform
deconstruct_brep_28 = DeconstructBrep(Brep=move_18.Geometry)  # -> Faces, Edges, Vertices
rotate_10 = Rotate(Geometry=move_to_point_17.Moved, Angle=1.570796327, Plane=area_20.Centroid)  # -> Geometry, Transform
rotate_11 = Rotate(Geometry=move_to_point_18.Moved, Angle=1.570796327, Plane=area_21.Centroid)  # -> Geometry, Transform
list_item_35 = ListItem(List=deconstruct_brep_28.Faces, Index=Slider(29, range=0..100), Wrap=True)
list_item_36 = ListItem(List=deconstruct_brep_28.Faces, Index=Slider(41, range=0..100), Wrap=True)
area_22 = Area(Geometry=list_item_35)  # -> Area, Centroid
area_23 = Area(Geometry=list_item_36)  # -> Area, Centroid
move_to_point_19 = MoveToPoint(Geometry=solid_union_9, PointA=area_15.Centroid, PointB=area_22.Centroid)  # -> Moved, Vector, Transform
move_to_point_20 = MoveToPoint(Geometry=solid_union_9, PointA=area_15.Centroid, PointB=area_23.Centroid)  # -> Moved, Vector, Transform
rotate_12 = Rotate(Geometry=move_to_point_19.Moved, Angle=1.570796327, Plane=area_22.Centroid)  # -> Geometry, Transform
rotate_13 = Rotate(Geometry=move_to_point_20.Moved, Angle=1.570796327, Plane=area_23.Centroid)  # -> Geometry, Transform
merge_5 = Merge(Data1=rotate_10.Geometry, Data2=rotate_11.Geometry, Data3=rotate_12.Geometry, Data4=rotate_13.Geometry)

deconstruct_brep_29 = DeconstructBrep(Brep=[solid_union_6, solid_difference_3, move_17.Geometry, move_18.Geometry, merge_5])  # -> Faces, Edges, Vertices
custom_preview_lineweights = CustomPreviewLineweights(
    Geometry=deconstruct_brep_29.Edges,
    Shader=ColourSwatch(SwatchColor=RGB(0, 0, 0)),
    Thickness=Slider(5, range=0..5),
    Absolute=False)
custom_preview = CustomPreview(Geometry=solid_union_6, Material=ColourSwatch(SwatchColor=RGBA(255, 112, 112, 200)))
custom_preview_2 = CustomPreview(Geometry=solid_difference_3, Material=ColourSwatch(SwatchColor=RGBA(112, 193, 255, 200)))
custom_preview_3 = CustomPreview(Geometry=move_17.Geometry, Material=ColourSwatch(SwatchColor=RGBA(136, 255, 112, 200)))
custom_preview_4 = CustomPreview(Geometry=move_18.Geometry, Material=ColourSwatch(SwatchColor=RGBA(200, 112, 255, 200)))
custom_preview_5 = CustomPreview(Geometry=merge_5, Material=ColourSwatch(SwatchColor=RGBA(255, 255, 112, 200)))
custom_preview_6 = CustomPreview(Material=ColourSwatch(SwatchColor=RGB(135, 68, 42)))
