# Grasshopper definition 桁椀.gh (Grasshopper 1.0.7)
# plug-ins: Human, Pufferfish

# ----
# Angle
angle = Slider(45, range=15..45)

number_slider = Slider(35, range=0..100)
# 桁椀
number_slider_2 = Slider(300, range=0..400)
center_box = CenterBox(Base=PlaneXY(0, 0, 0), X=number_slider_2, Y=Slider(25, range=0..100), Z=number_slider)
center_box_2 = CenterBox(Base=PlaneXY(0, 0, 0), X=Slider(10, range=0..10), Y=Slider(5, range=0..10), Z=Slider(5, range=0..10))

construct_point = ConstructPoint(XCoordinate=0, YCoordinate=0, ZCoordinate=0)
construct_point_2 = ConstructPoint(XCoordinate=0, YCoordinate=Slider(50, range=0..100), ZCoordinate=0)
number_slider_3 = Slider(25, range=0..100)
unit_x = UnitX(Factor=1)
unit_z = UnitZ(Factor=1)
number_slider_4 = Slider(18, range=0..100)
rotate = Rotate(Vector=unit_x, Axis=unit_z, Angle=expr("-x", degrees(angle)))
rotate_2 = Rotate(Vector=unit_x, Axis=unit_z, Angle=degrees(angle))
cylinder = Cylinder(Base=PlaneXY(0, 0, 0), Radius=number_slider_3, Length=Slider(300, range=0..1000))
xz_plane = XZPlane(Origin=Point(0, 0, 0))
deconstruct_brep = DeconstructBrep(Brep=center_box)  # -> Faces, Edges, Vertices
number_slider_5 = Slider(15, range=0..100)
rotate_3 = Rotate(Geometry=cylinder, Angle=degrees(Slider(90, range=0..1000)), Plane=xz_plane)  # -> Geometry, Transform
division = Division(A=number_slider, B=Slider(3, range=0..10))
line_sdl = LineSDL(Start=construct_point, Direction=rotate_2, Length=number_slider_4)
line_sdl_2 = LineSDL(Start=construct_point_2, Direction=rotate, Length=number_slider_4)
list_item = ListItem(List=deconstruct_brep.Edges, Index=Slider(4, range=0..10), Wrap=True)
list_item_2 = ListItem(List=deconstruct_brep.Edges, Index=Slider(0, range=0..10), Wrap=True)
multiplication = Multiplication(A=number_slider_3, B=Slider(2, range=0..10))
multiplication_2 = Multiplication(A=division, B=Slider(4, range=0..8))
multiplication_3 = Multiplication(A=division, B=Slider(2, range=0..8))
divide_length = DivideLength(Curve=list_item, Length=number_slider_5)  # -> Points, Tangents, Parameters
divide_length_2 = DivideLength(Curve=list_item_2, Length=number_slider_5)  # -> Points, Tangents, Parameters
unit_z_2 = UnitZ(Factor=multiplication)
edge_surface = EdgeSurface(CurveA=line_sdl, CurveB=line_sdl_2)
cap_holes_ex = CapHolesEx(Brep=rotate_3.Geometry)  # -> Brep, Caps, Solid
unit_z_3 = UnitZ(Factor=multiplication_2)
unit_z_4 = UnitZ(Factor=multiplication_3)
extrude = Extrude(Base=edge_surface, Direction=unit_z_2)
deconstruct_brep_2 = DeconstructBrep(Brep=cap_holes_ex.Brep)  # -> Faces, Edges, Vertices
list_item_3 = ListItem(List=divide_length.Points, Index=Slider(2, range=0..50), Wrap=True)
list_item_4 = ListItem(List=divide_length_2.Points, Index=Slider(36, range=0..50), Wrap=True)
list_item_5 = ListItem(List=divide_length_2.Points, Index=Slider(39, range=0..50), Wrap=True)
list_item_6 = ListItem(List=divide_length_2.Points, Index=Slider(40, range=0..50), Wrap=True)
move = Move(Geometry=list_item_5, Motion=unit_z_4)  # -> Geometry, Transform
deconstruct_brep_3 = DeconstructBrep(Brep=extrude)  # -> Faces, Edges, Vertices
move_2 = Move(Geometry=list_item_6, Motion=unit_z_3)  # -> Geometry, Transform
list_item_7 = ListItem(List=deconstruct_brep_2.Edges, Index="1", Wrap=True)
divide_length_3 = DivideLength(Curve=list_item_7, Length=Slider(10, range=0..10))  # -> Points, Tangents, Parameters
unit_x_2 = UnitX(Factor=Slider(25, range=0..100))
list_item_8 = ListItem(List=deconstruct_brep_3.Faces, Index=Slider(3, range=0..10), Wrap=True)
line = Line(StartPoint=list_item_4, EndPoint=move.Geometry)
line_2 = Line(StartPoint=move.Geometry, EndPoint=move_2.Geometry)
line_3 = Line(StartPoint=move_2.Geometry, EndPoint=list_item_3)
list_item_9 = ListItem(List=divide_length_3.Points, Index="7", Wrap=True)
extrude_2 = Extrude(Base=list_item_8, Direction=unit_x_2)
deconstruct_brep_4 = DeconstructBrep(Brep=extrude_2)  # -> Faces, Edges, Vertices
panel = Panel("""4
5""")
number_slider_6 = Slider(50, range=0..100)
division_2 = Division(A=multiplication, B=Slider(2, range=0..100))
list_item_10 = ListItem(List=deconstruct_brep_4.Faces, Index=Slider(1, range=0..10), Wrap=True)
list_item_11 = ListItem(List=deconstruct_brep_4.Vertices, Index=panel, Wrap=True)
join_curves = JoinCurves(Curves=flatten([line, line_2, line_3]), Preserve=False)
xz_plane_2 = XZPlane(Origin=Point(0, 0, 0))
unit_z_5 = UnitZ(Factor=division_2)
unit_x_3 = UnitX(Factor=1)
unit_z_6 = UnitZ(Factor=1)
explode_tree = ExplodeTree(Data=simplify(graft(list_item_11)))  # -> Branch0, Branch1
unit_y = UnitY(Factor=number_slider_6)
offset_curve = OffsetCurve(Curve=join_curves, Plane=xz_plane_2, Distance=number_slider_6, BothSides=0, Kinks=0, CapType=1)
rotate_4 = Rotate(Vector=unit_x_3, Axis=unit_z_6, Angle=expr("-x", degrees(angle)))
extrude_3 = Extrude(Base=list_item_10, Direction=unit_z_5)
rotate_5 = Rotate(Vector=unit_x_3, Axis=unit_z_6, Angle=degrees(angle))
extrude_4 = Extrude(Base=offset_curve, Direction=unit_y)
line_sdl_3 = LineSDL(Start=explode_tree.Branch0, Direction=rotate_5, Length=number_slider_4)
line_sdl_4 = LineSDL(Start=explode_tree.Branch1, Direction=rotate_4, Length=number_slider_4)
cap_holes_ex_2 = CapHolesEx(Brep=extrude_4)  # -> Brep, Caps, Solid
edge_surface_2 = EdgeSurface(CurveA=line_sdl_3, CurveB=line_sdl_4)
solid_difference = SolidDifference(BrepsA=center_box, BrepsB=cap_holes_ex_2.Brep)
extrude_5 = Extrude(Base=edge_surface_2, Direction=unit_z_2)
deconstruct_brep_5 = DeconstructBrep(Brep=solid_difference)  # -> Faces, Edges, Vertices
panel_2 = Panel("""3
15""")
solid_union = SolidUnion(Breps=flatten([extrude, extrude_2, extrude_5]))
list_item_12 = ListItem(List=deconstruct_brep_5.Edges, Index=panel_2, Wrap=True)
solid_difference_2 = SolidDifference(BrepsA=solid_union, BrepsB=extrude_3)
explode_tree_2 = ExplodeTree(Data=simplify(graft(list_item_12)))  # -> Branch0, Branch1
rotate_6 = Rotate(Geometry=solid_difference_2, Angle=1.570796327, Plane=PlaneXY(0, 0, 0))  # -> Geometry, Transform
curve_middle = CurveMiddle(Curve=explode_tree_2.Branch0)
curve_middle_2 = CurveMiddle(Curve=explode_tree_2.Branch1)
line_4 = Line(StartPoint=curve_middle_2, EndPoint=curve_middle)
deconstruct_brep_6 = DeconstructBrep(Brep=rotate_6.Geometry)  # -> Faces, Edges, Vertices
number_slider_7 = Slider(7, range=0..10)
list_item_13 = ListItem(List=deconstruct_brep_6.Faces, Index=Slider(5, range=0..10), Wrap=True)
divide_curve = DivideCurve(Curve=line_4, Count=Slider(30, range=0..100), Kinks=False)  # -> Points, Tangents, Parameters
addition = Addition(A=number_slider_7, B=Slider(10, range=0..15))
area = Area(Geometry=list_item_13)  # -> Area, Centroid
deconstruct_brep_7 = DeconstructBrep(Brep=center_box_2)  # -> Faces, Edges, Vertices
list_item_14 = ListItem(List=divide_curve.Points, Index=number_slider_7, Wrap=True)
list_item_15 = ListItem(List=divide_curve.Points, Index=addition, Wrap=True)
list_item_16 = ListItem(List=divide_curve.Points, Index=Slider(5, range=0..10), Wrap=True)
move_to_point = MoveToPoint(Geometry=rotate_6.Geometry, PointA=area.Centroid, PointB=list_item_9)  # -> Moved, Vector, Transform
construct_point_3 = ConstructPoint(XCoordinate="0.5", YCoordinate="0.5", ZCoordinate=0)
list_item_17 = ListItem(List=deconstruct_brep_7.Faces, Index=Slider(4, range=0..20), Wrap=True)
solid_difference_3 = SolidDifference(BrepsA=cap_holes_ex.Brep, BrepsB=move_to_point.Moved)
evaluate_surface = EvaluateSurface(Surface=reparameterize(list_item_17), Point=construct_point_3)  # -> Point, Normal, UDirection, VDirection, Frame
deconstruct_brep_8 = DeconstructBrep(Brep=solid_difference_3)  # -> Faces, Edges, Vertices
orient = Orient(Geometry=center_box_2, Source=evaluate_surface.Point, Target=list_item_15)  # -> Geometry, Transform
list_item_18 = ListItem(List=deconstruct_brep_8.Faces, Index=Slider(9, range=0..10), Wrap=True)
area_2 = Area(Geometry=list_item_18)  # -> Area, Centroid
center_box_3 = CenterBox(Base=PlaneXY(0, 0, 0), X=Slider(225, range=0..400), Y=Slider(25, range=0..100), Z=Slider(35, range=0..100))
center_box_4 = CenterBox(Base=PlaneXY(0, 0, 0), X=Slider(25, range=0..400), Y=Slider(25, range=0..100), Z=Slider(12, range=0..100))
rotate_7 = Rotate(Geometry=solid_difference_3, Angle=1.570796327, Plane=area_2.Centroid)  # -> Geometry, Transform
deconstruct_brep_9 = DeconstructBrep(Brep=center_box_3)  # -> Faces, Edges, Vertices
mirror = Mirror(Geometry=rotate_7.Geometry, Plane=area_2.Centroid)  # -> Geometry, Transform
construct_point_4 = ConstructPoint(XCoordinate="0.5", YCoordinate="1", ZCoordinate=0)
list_item_19 = ListItem(List=deconstruct_brep_9.Faces, Index=Slider(10, range=1..20), Wrap=True)
evaluate_surface_2 = EvaluateSurface(Surface=reparameterize(list_item_19), Point=construct_point_4)  # -> Point, Normal, UDirection, VDirection, Frame
orient_2 = Orient(Geometry=center_box_3, Source=evaluate_surface_2.Point, Target=list_item_16)  # -> Geometry, Transform
deconstruct_brep_10 = DeconstructBrep(Brep=orient_2.Geometry)  # -> Faces, Edges, Vertices
deconstruct_brep_11 = DeconstructBrep(Brep=center_box_4)  # -> Faces, Edges, Vertices
rotate_8 = Rotate(Geometry=solid_difference_3, Angle=degrees(Slider(45, range=0..100)), Plane=area_2.Centroid)  # -> Geometry, Transform
rotate_9 = Rotate(Geometry=mirror.Geometry, Angle=degrees(Slider(225, range=0..360)), Plane=area_2.Centroid)  # -> Geometry, Transform
construct_point_5 = ConstructPoint(XCoordinate="1", YCoordinate="0.5", ZCoordinate=0)
construct_point_6 = ConstructPoint(XCoordinate="1", YCoordinate="0.5", ZCoordinate=0)
list_item_20 = ListItem(List=deconstruct_brep_10.Faces, Index=Slider(5, range=0..10), Wrap=True)
list_item_21 = ListItem(List=deconstruct_brep_11.Faces, Index=Slider(5, range=1..20), Wrap=True)
evaluate_surface_3 = EvaluateSurface(Surface=reparameterize(list_item_20), Point=construct_point_5)  # -> Point, Normal, UDirection, VDirection, Frame
evaluate_surface_4 = EvaluateSurface(Surface=reparameterize(list_item_21), Point=construct_point_6)  # -> Point, Normal, UDirection, VDirection, Frame
move_to_point_2 = MoveToPoint(Geometry=rotate_8.Geometry, PointA=area_2.Centroid, PointB=list_item_14)  # -> Moved, Vector, Transform
move_to_point_3 = MoveToPoint(Geometry=rotate_9.Geometry, PointA=area_2.Centroid, PointB=list_item_14)  # -> Moved, Vector, Transform
orient_3 = Orient(Geometry=center_box_4, Source=evaluate_surface_4.Point, Target=evaluate_surface_3.Point)  # -> Geometry, Transform
solid_difference_4 = SolidDifference(BrepsA=solid_difference, BrepsB=flatten([move_to_point_2.Moved, move_to_point_3.Moved]))
solid_difference_5 = SolidDifference(
    BrepsA=orient_2.Geometry,
    BrepsB=flatten([orient_3.Geometry, move_to_point_2.Moved, move_to_point_3.Moved, orient.Geometry]))
solid_union_2 = SolidUnion(Breps=flatten([solid_difference_4, orient.Geometry]))

deconstruct_brep_12 = DeconstructBrep(Brep=[solid_difference_5, solid_union_2, move_to_point_2.Moved, move_to_point_3.Moved])  # -> Faces, Edges, Vertices
custom_preview_lineweights = CustomPreviewLineweights(
    Geometry=deconstruct_brep_12.Edges,
    Shader=ColourSwatch(SwatchColor=RGB(0, 0, 0)),
    Thickness=Slider(5, range=0..5),
    Absolute=False)
custom_preview = CustomPreview(Geometry=solid_difference_5, Material=ColourSwatch(SwatchColor=RGBA(255, 112, 112, 200)))
custom_preview_2 = CustomPreview(Geometry=solid_union_2, Material=ColourSwatch(SwatchColor=RGBA(112, 193, 255, 200)))
custom_preview_3 = CustomPreview(Geometry=move_to_point_2.Moved, Material=ColourSwatch(SwatchColor=RGBA(136, 255, 112, 200)))
custom_preview_4 = CustomPreview(Geometry=move_to_point_3.Moved, Material=ColourSwatch(SwatchColor=RGBA(200, 112, 255, 200)))
custom_preview_5 = CustomPreview(Material=ColourSwatch(SwatchColor=RGBA(255, 255, 112, 200)))
custom_preview_6 = CustomPreview(Material=ColourSwatch(SwatchColor=RGB(135, 68, 42)))
