# Grasshopper definition 箍頭榫.gh (Grasshopper 1.0.7)
# plug-ins: Human

# 箍頭榫
number_slider = Slider(40, range=0..100)
L = Slider(200, range=0..1000)

# ----
# Beam
number_slider_2 = Slider(125, range=0..200)
number_slider_3 = Slider(40, range=0..100)
center_box = CenterBox(Base=PlaneXY(0, 0, 0), X=number_slider_2, Y=Slider(25, range=0..100), Z=number_slider_3)
center_box_2 = CenterBox(Base=PlaneXY(0, 0, 0), X=Slider(40, range=0..100), Y=Slider(23, range=0..100), Z=number_slider_3)

cylinder = Cylinder(Base=PlaneXY(0, 0, 0), Radius=number_slider, Length=L)
cap_holes_ex = CapHolesEx(Brep=cylinder)  # -> Brep, Caps, Solid
deconstruct_brep = DeconstructBrep(Brep=cap_holes_ex.Brep)  # -> Faces, Edges, Vertices
deconstruct_brep_2 = DeconstructBrep(Brep=center_box)  # -> Faces, Edges, Vertices
construct_point = ConstructPoint(XCoordinate="1", YCoordinate="0.5", ZCoordinate=0)
construct_point_2 = ConstructPoint(XCoordinate="0.5", YCoordinate="0.5", ZCoordinate=0)
list_item = ListItem(List=deconstruct_brep.Faces, Index=Slider(2, range=0..10), Wrap=True)
list_item_2 = ListItem(List=deconstruct_brep_2.Faces, Index=Slider(5, range=0..20), Wrap=True)
evaluate_surface = EvaluateSurface(Surface=reparameterize(list_item), Point=construct_point)  # -> Point, Normal, UDirection, VDirection, Frame
evaluate_surface_2 = EvaluateSurface(Surface=reparameterize(list_item_2), Point=construct_point_2)  # -> Point, Normal, UDirection, VDirection, Frame
orient = Orient(Geometry=center_box, Source=evaluate_surface_2.Point, Target=evaluate_surface.Point)  # -> Geometry, Transform
solid_difference = SolidDifference(BrepsA=orient.Geometry, BrepsB=cap_holes_ex.Brep)
explode_tree = ExplodeTree(Data=simplify(graft(solid_difference)))  # -> Branch0, Branch1
deconstruct_brep_3 = DeconstructBrep(Brep=explode_tree.Branch0)  # -> Faces, Edges, Vertices
deconstruct_brep_4 = DeconstructBrep(Brep=center_box_2)  # -> Faces, Edges, Vertices
construct_point_3 = ConstructPoint(XCoordinate="1", YCoordinate="1", ZCoordinate=0)
construct_point_4 = ConstructPoint(XCoordinate="0.5", YCoordinate="1", ZCoordinate=0)
list_item_3 = ListItem(List=deconstruct_brep_3.Faces, Index=Slider(3, range=0..10), Wrap=True)
list_item_4 = ListItem(List=deconstruct_brep_4.Faces, Index=Slider(1, range=0..20), Wrap=True)
evaluate_surface_3 = EvaluateSurface(Surface=reparameterize(list_item_3), Point=construct_point_3)  # -> Point, Normal, UDirection, VDirection, Frame
evaluate_surface_4 = EvaluateSurface(Surface=reparameterize(list_item_4), Point=construct_point_4)  # -> Point, Normal, UDirection, VDirection, Frame
orient_2 = Orient(Geometry=center_box_2, Source=evaluate_surface_4.Point, Target=evaluate_surface_3.Point)  # -> Geometry, Transform
number_slider_4 = Slider(20, range=0..100)
area = Area(Geometry=orient_2.Geometry)  # -> Area, Centroid
unit_z = UnitZ(Factor=number_slider_4)
center_box_3 = CenterBox(Base=area.Centroid, X=Slider(15, range=0..100), Y=Slider(25, range=0..100), Z=number_slider_4)
move = Move(Geometry=center_box_3, Motion=unit_z)  # -> Geometry, Transform
solid_union = SolidUnion(Breps=flatten([orient_2.Geometry, solid_difference]))
rotate = Rotate(Geometry=solid_union, Angle=1.570796327, Plane=area.Centroid)  # -> Geometry, Transform
solid_difference_2 = SolidDifference(BrepsA=solid_union, BrepsB=move.Geometry)
solid_difference_3 = SolidDifference(BrepsA=rotate.Geometry, BrepsB=solid_difference_2)
solid_difference_4 = SolidDifference(BrepsA=cap_holes_ex.Brep, BrepsB=flatten([solid_difference_2, solid_difference_3]))

deconstruct_brep_5 = DeconstructBrep(Brep=[solid_difference_4, solid_difference_3, solid_difference_2])  # -> Faces, Edges, Vertices
custom_preview_lineweights = CustomPreviewLineweights(
    Geometry=deconstruct_brep_5.Edges,
    Shader=ColourSwatch(SwatchColor=RGB(0, 0, 0)),
    Thickness=Slider(5, range=0..5),
    Absolute=False)
custom_preview = CustomPreview(Geometry=solid_difference_4, Material=ColourSwatch(SwatchColor=RGBA(255, 112, 112, 200)))
custom_preview_2 = CustomPreview(Geometry=solid_difference_2, Material=ColourSwatch(SwatchColor=RGBA(112, 193, 255, 200)))
custom_preview_3 = CustomPreview(Geometry=solid_difference_3, Material=ColourSwatch(SwatchColor=RGBA(136, 255, 112, 200)))
custom_preview_4 = CustomPreview(Material=ColourSwatch(SwatchColor=RGBA(200, 112, 255, 200)))
custom_preview_5 = CustomPreview(Material=ColourSwatch(SwatchColor=RGBA(255, 255, 112, 200)))
custom_preview_6 = CustomPreview(Material=ColourSwatch(SwatchColor=RGB(135, 68, 42)))
