# Grasshopper definition 趴梁阶梯榫.gh (Grasshopper 1.0.7)
# plug-ins: Pufferfish, Human

# 趴梁阶梯榫
number_slider = Slider(25, range=0..100)
cylinder = Cylinder(Base=PlaneXY(0, 0, 0), Radius=number_slider, Length=Slider(300, range=0..1000))
xz_plane = XZPlane(Origin=Point(0, 0, 0))
number_slider_2 = Slider(2, range=0..10)
rotate = Rotate(Geometry=cylinder, Angle=expr("-x", degrees(Slider(90, range=0..1000))), Plane=xz_plane)  # -> Geometry, Transform
division = Division(A=number_slider, B=number_slider_2)
division_2 = Division(A=number_slider, B=Slider(2, range=0..10))

# ----
# Angle
angle = Slider(20, range=0..45)

cap_holes_ex = CapHolesEx(Brep=rotate.Geometry)  # -> Brep, Caps, Solid
division_3 = Division(A=division, B=Slider(3, range=0..10))
division_4 = Division(A=division_2, B=Slider(6, range=0..10))
number_slider_3 = Slider(25, range=0..100)
construct_point = ConstructPoint(XCoordinate=0, YCoordinate=0, ZCoordinate=0)
construct_point_2 = ConstructPoint(XCoordinate=Slider(50, range=0..100), YCoordinate=0, ZCoordinate=0)
unit_y = UnitY(Factor=1)
unit_x = UnitX(Factor=1)
division_5 = Division(A=number_slider_3, B=Slider(4, range=0..10))
multiplication = Multiplication(A=division_3, B=number_slider_2)
multiplication_2 = Multiplication(A=division_4, B=Slider(2, range=0..10))
multiplication_3 = Multiplication(A=division_4, B=Slider(3, range=0..10))
number_slider_4 = Slider(62, range=0..100)
rotate_2 = Rotate(Vector=unit_y, Axis=unit_x, Angle=expr("-x", degrees(angle)))
rotate_3 = Rotate(Vector=unit_y, Axis=unit_x, Angle=expr("-x", degrees(angle)))
center_box = CenterBox(Base=PlaneXY(0, 0, 0), X=Slider(150, range=0..1000), Y=number_slider_3, Z=number_slider_3)
multiplication_4 = Multiplication(A=division_5, B=Slider(2, range=0..10))
rotate_4 = Rotate(Geometry=center_box, Angle=expr("-x", degrees(Slider(90, range=0..1000))), Plane=PlaneXY(0, 0, 0))  # -> Geometry, Transform
line_sdl = LineSDL(Start=construct_point, Direction=expr("-x", rotate_2), Length=number_slider_4)
line_sdl_2 = LineSDL(Start=construct_point_2, Direction=expr("-x", rotate_3), Length=number_slider_4)
center_box_2 = CenterBox(Base=PlaneXY(0, 0, 0), X=multiplication_4, Y=division_4, Z=division_3)
center_box_3 = CenterBox(Base=PlaneXY(0, 0, 0), X=multiplication_4, Y=multiplication_2, Z=multiplication)
unit_z = UnitZ(Factor=Slider(93, range=0..100))
edge_surface = EdgeSurface(CurveA=line_sdl, CurveB=line_sdl_2)
deconstruct_brep = DeconstructBrep(Brep=rotate_4.Geometry)  # -> Faces, Edges, Vertices
deconstruct_brep_2 = DeconstructBrep(Brep=center_box_3)  # -> Faces, Edges, Vertices
extrude = Extrude(Base=edge_surface, Direction=unit_z)
list_item = ListItem(List=deconstruct_brep.Edges, Index="8", Wrap=True)
list_item_2 = ListItem(List=deconstruct_brep_2.Edges, Index=Slider(6, range=0..10), Wrap=True)
divide_curve = DivideCurve(Curve=list_item, Count=10, Kinks=False)  # -> Points, Tangents, Parameters
divide_curve_2 = DivideCurve(Curve=list_item_2, Count=Slider(6, range=0..10), Kinks=False)  # -> Points, Tangents, Parameters
deconstruct_brep_3 = DeconstructBrep(Brep=extrude)  # -> Faces, Edges, Vertices
panel = Panel("""2
4""")
list_item_3 = ListItem(List=divide_curve.Points, Index="4", Wrap=True)
list_item_4 = ListItem(List=deconstruct_brep_3.Vertices, Index=0, Wrap=True)
list_item_5 = ListItem(List=divide_curve_2.Points, Index=panel, Wrap=True)
move_to_point = MoveToPoint(Geometry=extrude, PointA=list_item_4, PointB=list_item_3)  # -> Moved, Vector, Transform
explode_tree = ExplodeTree(Data=simplify(graft(list_item_5)))  # -> Branch0, Branch1

# ----
# Angle
angle_2 = Slider(20, range=0..45)

unit_y_2 = UnitY(Factor=1)
unit_z_2 = UnitZ(Factor=1)
solid_difference = SolidDifference(BrepsA=rotate_4.Geometry, BrepsB=move_to_point.Moved)
rotate_5 = Rotate(Vector=unit_y_2, Axis=unit_z_2, Angle=expr("-x", degrees(angle_2)))
rotate_6 = Rotate(Vector=unit_y_2, Axis=unit_z_2, Angle=degrees(angle_2))
deconstruct_brep_4 = DeconstructBrep(Brep=solid_difference)  # -> Faces, Edges, Vertices
line_sdl_3 = LineSDL(Start=explode_tree.Branch0, Direction=expr("-x", rotate_6), Length=expr("-x", multiplication_3))
line_sdl_4 = LineSDL(Start=explode_tree.Branch1, Direction=expr("-x", rotate_5), Length=expr("-x", multiplication_3))
list_item_6 = ListItem(List=deconstruct_brep_4.Edges, Index=Slider(3, range=0..10), Wrap=True)
area = Area(Geometry=cap_holes_ex.Brep)  # -> Area, Centroid
unit_z_3 = UnitZ(Factor=multiplication)
edge_surface_2 = EdgeSurface(CurveA=line_sdl_3, CurveB=line_sdl_4)
curve_middle = CurveMiddle(Curve=list_item_6)
extrude_2 = Extrude(Base=edge_surface_2, Direction=expr("-x", unit_z_3))
move_to_point_2 = MoveToPoint(Geometry=solid_difference, PointA=curve_middle, PointB=area.Centroid)  # -> Moved, Vector, Transform
solid_difference_2 = SolidDifference(BrepsA=move_to_point_2.Moved, BrepsB=cap_holes_ex.Brep)
solid_union = SolidUnion(Breps=flatten([extrude_2, center_box_3]))
deconstruct_brep_5 = DeconstructBrep(Brep=solid_difference_2)  # -> Faces, Edges, Vertices
deconstruct_brep_6 = DeconstructBrep(Brep=solid_union)  # -> Faces, Edges, Vertices
deconstruct_brep_7 = DeconstructBrep(Brep=center_box_2)  # -> Faces, Edges, Vertices
list_item_7 = ListItem(List=deconstruct_brep_5.Edges, Index=Slider(14, range=0..20), Wrap=True)
construct_point_3 = ConstructPoint(XCoordinate="0.5", YCoordinate="0", ZCoordinate=0)
construct_point_4 = ConstructPoint(XCoordinate="0.5", YCoordinate="0", ZCoordinate=0)
list_item_8 = ListItem(List=deconstruct_brep_6.Faces, Index=Slider(5, range=0..10), Wrap=True)
list_item_9 = ListItem(List=deconstruct_brep_7.Faces, Index=Slider(5, range=1..20), Wrap=True)
evaluate_surface = EvaluateSurface(Surface=reparameterize(list_item_8), Point=construct_point_3)  # -> Point, Normal, UDirection, VDirection, Frame
evaluate_surface_2 = EvaluateSurface(Surface=reparameterize(list_item_9), Point=construct_point_4)  # -> Point, Normal, UDirection, VDirection, Frame
orient = Orient(Geometry=center_box_2, Source=evaluate_surface_2.Point, Target=evaluate_surface.Point)  # -> Geometry, Transform
curve_middle_2 = CurveMiddle(Curve=list_item_7)
solid_union_2 = SolidUnion(Breps=flatten([solid_union, orient.Geometry]))
deconstruct_brep_8 = DeconstructBrep(Brep=solid_union_2)  # -> Faces, Edges, Vertices
list_item_10 = ListItem(List=deconstruct_brep_8.Edges, Index=Slider(0, range=0..20), Wrap=True)
curve_middle_3 = CurveMiddle(Curve=list_item_10)
move_to_point_3 = MoveToPoint(Geometry=solid_union_2, PointA=curve_middle_3, PointB=curve_middle_2)  # -> Moved, Vector, Transform
solid_union_3 = SolidUnion(Breps=flatten([solid_difference_2, move_to_point_3.Moved]))
solid_difference_3 = SolidDifference(BrepsA=cap_holes_ex.Brep, BrepsB=solid_union_3)

deconstruct_brep_9 = DeconstructBrep(Brep=[solid_difference_3, solid_union_3])  # -> Faces, Edges, Vertices
custom_preview_lineweights = CustomPreviewLineweights(
    Geometry=deconstruct_brep_9.Edges,
    Shader=ColourSwatch(SwatchColor=RGB(0, 0, 0)),
    Thickness=Slider(5, range=0..5),
    Absolute=False)
custom_preview = CustomPreview(Geometry=solid_difference_3, Material=ColourSwatch(SwatchColor=RGBA(255, 112, 112, 200)))
custom_preview_2 = CustomPreview(Geometry=solid_union_3, Material=ColourSwatch(SwatchColor=RGBA(112, 193, 255, 200)))
custom_preview_3 = CustomPreview(Material=ColourSwatch(SwatchColor=RGBA(136, 255, 112, 200)))
custom_preview_4 = CustomPreview(Material=ColourSwatch(SwatchColor=RGBA(200, 112, 255, 200)))
custom_preview_5 = CustomPreview(Material=ColourSwatch(SwatchColor=RGBA(255, 255, 112, 200)))
custom_preview_6 = CustomPreview(Material=ColourSwatch(SwatchColor=RGB(135, 68, 42)))
