# Grasshopper definition 透榫.gh (Grasshopper 1.0.7)
# plug-ins: Human

# 透榫
number_slider = Slider(40, range=0..100)
L = Slider(200, range=0..1000)

# ----
# Beam
number_slider_2 = Slider(20, range=0..100)
number_slider_3 = Slider(40, range=0..100)
number_slider_4 = Slider(10, range=0..100)
center_box = CenterBox(Base=PlaneXY(0, 0, 0), X=Slider(125, range=0..200), Y=Slider(25, range=0..100), Z=number_slider_3)
center_box_2 = CenterBox(Base=PlaneXY(0, 0, 0), X=Slider(10, range=0..100), Y=number_slider_4, Z=number_slider_3)
center_box_3 = CenterBox(Base=PlaneXY(0, 0, 0), X=Slider(40, range=0..100), Y=number_slider_4, Z=number_slider_2)

cylinder = Cylinder(Base=PlaneXY(0, 0, 0), Radius=number_slider, Length=L)
cap_holes_ex = CapHolesEx(Brep=cylinder)  # -> Brep, Caps, Solid
deconstruct_brep = DeconstructBrep(Brep=cap_holes_ex.Brep)  # -> Faces, Edges, Vertices
deconstruct_brep_2 = DeconstructBrep(Brep=center_box)  # -> Faces, Edges, Vertices
construct_point = ConstructPoint(XCoordinate="1", YCoordinate="0.9", ZCoordinate=0)
construct_point_2 = ConstructPoint(XCoordinate="0.5", YCoordinate="0.5", ZCoordinate=0)
list_item = ListItem(List=deconstruct_brep.Faces, Index=Slider(3, range=0..10), Wrap=True)
list_item_2 = ListItem(List=deconstruct_brep_2.Faces, Index=Slider(5, range=0..20), Wrap=True)
evaluate_surface = EvaluateSurface(Surface=reparameterize(list_item), Point=construct_point)  # -> Point, Normal, UDirection, VDirection, Frame
evaluate_surface_2 = EvaluateSurface(Surface=reparameterize(list_item_2), Point=construct_point_2)  # -> Point, Normal, UDirection, VDirection, Frame
orient = Orient(Geometry=center_box, Source=evaluate_surface_2.Point, Target=evaluate_surface.Point)  # -> Geometry, Transform
solid_difference = SolidDifference(BrepsA=orient.Geometry, BrepsB=cap_holes_ex.Brep)
explode_tree = ExplodeTree(Data=simplify(graft(solid_difference)))  # -> Branch0, Branch1
deconstruct_brep_3 = DeconstructBrep(Brep=explode_tree.Branch0)  # -> Faces, Edges, Vertices
deconstruct_brep_4 = DeconstructBrep(Brep=center_box_2)  # -> Faces, Edges, Vertices
construct_point_3 = ConstructPoint(XCoordinate="1", YCoordinate="0.9", ZCoordinate=0)
construct_point_4 = ConstructPoint(XCoordinate="0.5", YCoordinate="1", ZCoordinate=0)
list_item_3 = ListItem(List=deconstruct_brep_3.Faces, Index=Slider(3, range=0..10), Wrap=True)
list_item_4 = ListItem(List=deconstruct_brep_4.Faces, Index=Slider(1, range=0..20), Wrap=True)
evaluate_surface_3 = EvaluateSurface(Surface=reparameterize(list_item_3), Point=construct_point_3)  # -> Point, Normal, UDirection, VDirection, Frame
evaluate_surface_4 = EvaluateSurface(Surface=reparameterize(list_item_4), Point=construct_point_4)  # -> Point, Normal, UDirection, VDirection, Frame
orient_2 = Orient(Geometry=center_box_2, Source=evaluate_surface_4.Point, Target=evaluate_surface_3.Point)  # -> Geometry, Transform
deconstruct_brep_5 = DeconstructBrep(Brep=orient_2.Geometry)  # -> Faces, Edges, Vertices
deconstruct_brep_6 = DeconstructBrep(Brep=center_box_3)  # -> Faces, Edges, Vertices
construct_point_5 = ConstructPoint(XCoordinate="0.5", YCoordinate="1", ZCoordinate=0)
construct_point_6 = ConstructPoint(XCoordinate="0.5", YCoordinate="1", ZCoordinate=0)
list_item_5 = ListItem(List=deconstruct_brep_5.Faces, Index=Slider(3, range=0..10), Wrap=True)
list_item_6 = ListItem(List=deconstruct_brep_6.Faces, Index=Slider(1, range=0..20), Wrap=True)
evaluate_surface_5 = EvaluateSurface(Surface=reparameterize(list_item_5), Point=construct_point_5)  # -> Point, Normal, UDirection, VDirection, Frame
evaluate_surface_6 = EvaluateSurface(Surface=reparameterize(list_item_6), Point=construct_point_6)  # -> Point, Normal, UDirection, VDirection, Frame
orient_3 = Orient(Geometry=center_box_3, Source=evaluate_surface_6.Point, Target=evaluate_surface_5.Point)  # -> Geometry, Transform
solid_union = SolidUnion(Breps=flatten([explode_tree.Branch0, orient_2.Geometry, orient_3.Geometry]))
rotate = Rotate(Geometry=solid_union, Angle=1.570796327, Plane=PlaneXY(0, 0, 0))  # -> Geometry, Transform
deconstruct_brep_7 = DeconstructBrep(Brep=rotate.Geometry)  # -> Faces, Edges, Vertices
list_item_7 = ListItem(List=deconstruct_brep_7.Faces, Index=Slider(7, range=0..10), Wrap=True)
area = Area(Geometry=list_item_7)  # -> Area, Centroid
xz_plane = XZPlane(Origin=area.Centroid)
rotate_2 = Rotate(Geometry=rotate.Geometry, Angle=degrees(Slider(180, range=0..1000)), Plane=xz_plane)  # -> Geometry, Transform
solid_difference_2 = SolidDifference(BrepsA=cap_holes_ex.Brep, BrepsB=flatten([solid_union, rotate_2.Geometry]))

deconstruct_brep_8 = DeconstructBrep(Brep=[solid_difference_2, solid_union, rotate_2.Geometry])  # -> Faces, Edges, Vertices
custom_preview_lineweights = CustomPreviewLineweights(
    Geometry=deconstruct_brep_8.Edges,
    Shader=ColourSwatch(SwatchColor=RGB(0, 0, 0)),
    Thickness=Slider(5, range=0..5),
    Absolute=False)
custom_preview = CustomPreview(Geometry=solid_difference_2, Material=ColourSwatch(SwatchColor=RGBA(255, 112, 112, 200)))
custom_preview_2 = CustomPreview(Geometry=solid_union, Material=ColourSwatch(SwatchColor=RGBA(112, 193, 255, 200)))
custom_preview_3 = CustomPreview(Geometry=rotate_2.Geometry, Material=ColourSwatch(SwatchColor=RGBA(136, 255, 112, 200)))
custom_preview_4 = CustomPreview(Material=ColourSwatch(SwatchColor=RGBA(200, 112, 255, 200)))
custom_preview_5 = CustomPreview(Material=ColourSwatch(SwatchColor=RGBA(255, 255, 112, 200)))
custom_preview_6 = CustomPreview(Material=ColourSwatch(SwatchColor=RGB(135, 68, 42)))
