# Grasshopper definition 饅頭榫&燕尾榫.gh (Grasshopper 1.0.7)
# plug-ins: Human

W = Slider(20, range=20..25)
# 饅頭榫&燕尾榫
construct_point = ConstructPoint(XCoordinate=0, YCoordinate=0, ZCoordinate=0)
construct_point_2 = ConstructPoint(XCoordinate=0, YCoordinate=W, ZCoordinate=0)
construct_point_3 = ConstructPoint(XCoordinate=W, YCoordinate=W, ZCoordinate=0)
construct_point_4 = ConstructPoint(XCoordinate=W, YCoordinate=0, ZCoordinate=0)
_4point_surface = _4PointSurface(CornerA=construct_point, CornerB=construct_point_2, CornerC=construct_point_3, CornerD=construct_point_4)
area = Area(Geometry=_4point_surface)  # -> Area, Centroid
scale = Scale(Geometry=_4point_surface, Center=area.Centroid, Factor=Slider(1.5, range=0..10))  # -> Geometry, Transform
unit_z = UnitZ(Factor=Slider(12, range=8..12))
L = Slider(200, range=0..1000)
move = Move(Geometry=scale.Geometry, Motion=expr("-x", unit_z))  # -> Geometry, Transform

# ----
# Angle
angle = Slider(15, range=7..15)

cylinder = Cylinder(Base=PlaneXY(0, 0, 0), Radius=Slider(40, range=0..100), Length=L)
loft = Loft(
    Curves=[_4point_surface, move.Geometry],
    Options={Adjust=False, Closed=False, LoftEnds=0, LoftSimp=0, LoftType=0, Rebuild=10, Refit=0.01})

# ----
# Beam
L_2 = Slider(200, range=0..200)
W_2 = Slider(50, range=0..200)
W_3 = Slider(80, range=0..200)
construct_point_5 = ConstructPoint(XCoordinate=0, YCoordinate=0, ZCoordinate=0)
construct_point_6 = ConstructPoint(XCoordinate=0, YCoordinate=W_2, ZCoordinate=0)
construct_point_7 = ConstructPoint(XCoordinate=L_2, YCoordinate=W_2, ZCoordinate=0)
construct_point_8 = ConstructPoint(XCoordinate=L_2, YCoordinate=0, ZCoordinate=0)
unit_z_2 = UnitZ(Factor=W_3)
_4point_surface_2 = _4PointSurface(CornerA=construct_point_5, CornerB=construct_point_6, CornerC=construct_point_7, CornerD=construct_point_8)
extrude = Extrude(Base=_4point_surface_2, Direction=unit_z_2)

construct_point_9 = ConstructPoint(XCoordinate=0, YCoordinate=0, ZCoordinate=0)
construct_point_10 = ConstructPoint(XCoordinate=0, YCoordinate=Slider(15, range=0..30), ZCoordinate=0)
cap_holes_ex = CapHolesEx(Brep=cylinder)  # -> Brep, Caps, Solid
cap_holes_ex_2 = CapHolesEx(Brep=loft)  # -> Brep, Caps, Solid
unit_x = UnitX(Factor=1)
unit_z_3 = UnitZ(Factor=1)
deconstruct_brep = DeconstructBrep(Brep=cap_holes_ex.Brep)  # -> Faces, Edges, Vertices
deconstruct_brep_2 = DeconstructBrep(Brep=cap_holes_ex_2.Brep)  # -> Faces, Edges, Vertices
number_slider = Slider(20, range=0..100)
rotate = Rotate(Vector=unit_x, Axis=unit_z_3, Angle=expr("-x", degrees(angle)))
construct_point_11 = ConstructPoint(XCoordinate="0.5", YCoordinate="0.5", ZCoordinate=0)
construct_point_12 = ConstructPoint(XCoordinate="0.5", YCoordinate="0.5", ZCoordinate=0)
rotate_2 = Rotate(Vector=unit_x, Axis=unit_z_3, Angle=degrees(angle))
list_item = ListItem(List=deconstruct_brep.Faces, Index=Slider(2, range=0..10), Wrap=True)
list_item_2 = ListItem(List=deconstruct_brep_2.Faces, Index=Slider(4, range=0..20), Wrap=True)
evaluate_surface = EvaluateSurface(Surface=reparameterize(list_item), Point=construct_point_11)  # -> Point, Normal, UDirection, VDirection, Frame
evaluate_surface_2 = EvaluateSurface(Surface=reparameterize(list_item_2), Point=construct_point_12)  # -> Point, Normal, UDirection, VDirection, Frame
unit_z_4 = UnitZ(Factor=W_3)
line_sdl = LineSDL(Start=construct_point_9, Direction=rotate_2, Length=expr("-x", number_slider))
line_sdl_2 = LineSDL(Start=construct_point_10, Direction=rotate, Length=expr("-x", number_slider))
orient = Orient(Geometry=cap_holes_ex_2.Brep, Source=evaluate_surface_2.Point, Target=evaluate_surface.Point)  # -> Geometry, Transform
edge_surface = EdgeSurface(CurveA=line_sdl, CurveB=line_sdl_2)
extrude_2 = Extrude(Base=edge_surface, Direction=unit_z_4)
solid_union = SolidUnion(Breps=flatten([cap_holes_ex.Brep, orient.Geometry]))
deconstruct_brep_3 = DeconstructBrep(Brep=solid_union)  # -> Faces, Edges, Vertices
deconstruct_brep_4 = DeconstructBrep(Brep=extrude)  # -> Faces, Edges, Vertices
construct_point_13 = ConstructPoint(XCoordinate="0", YCoordinate="0.5", ZCoordinate=0)
construct_point_14 = ConstructPoint(XCoordinate="0.5", YCoordinate="0.5", ZCoordinate=0)
list_item_3 = ListItem(List=deconstruct_brep_3.Faces, Index=Slider(5, range=0..10), Wrap=True)
list_item_4 = ListItem(List=deconstruct_brep_4.Faces, Index=Slider(1, range=0..20), Wrap=True)
evaluate_surface_3 = EvaluateSurface(Surface=reparameterize(list_item_3), Point=construct_point_13)  # -> Point, Normal, UDirection, VDirection, Frame
evaluate_surface_4 = EvaluateSurface(Surface=reparameterize(list_item_4), Point=construct_point_14)  # -> Point, Normal, UDirection, VDirection, Frame
orient_2 = Orient(Geometry=extrude, Source=evaluate_surface_4.Point, Target=evaluate_surface_3.Point)  # -> Geometry, Transform
unit_x_2 = UnitX(Factor=Slider(10, range=0..10))
move_2 = Move(Geometry=orient_2.Geometry, Motion=expr("-x", unit_x_2))  # -> Geometry, Transform
solid_difference = SolidDifference(BrepsA=move_2.Geometry, BrepsB=solid_union)
deconstruct_brep_5 = DeconstructBrep(Brep=solid_difference)  # -> Faces, Edges, Vertices
deconstruct_brep_6 = DeconstructBrep(Brep=extrude_2)  # -> Faces, Edges, Vertices
construct_point_15 = ConstructPoint(XCoordinate="0", YCoordinate="0.5", ZCoordinate=0)
construct_point_16 = ConstructPoint(XCoordinate="0.5", YCoordinate="0.5", ZCoordinate=0)
list_item_5 = ListItem(List=deconstruct_brep_5.Faces, Index=Slider(6, range=0..10), Wrap=True)
list_item_6 = ListItem(List=deconstruct_brep_6.Faces, Index=Slider(3, range=0..20), Wrap=True)
evaluate_surface_5 = EvaluateSurface(Surface=reparameterize(list_item_5), Point=construct_point_15)  # -> Point, Normal, UDirection, VDirection, Frame
evaluate_surface_6 = EvaluateSurface(Surface=reparameterize(list_item_6), Point=construct_point_16)  # -> Point, Normal, UDirection, VDirection, Frame
orient_3 = Orient(Geometry=extrude_2, Source=evaluate_surface_6.Point, Target=evaluate_surface_5.Point)  # -> Geometry, Transform
unit_z_5 = UnitZ(Factor=Slider(60, range=0..100))
solid_union_2 = SolidUnion(Breps=flatten([solid_difference, orient_3.Geometry]))
move_3 = Move(Geometry=solid_union_2, Motion=unit_z_5)  # -> Geometry, Transform
mirror = Mirror(Geometry=move_3.Geometry, Plane=PlaneYZ(0, 0, 0))  # -> Geometry, Transform
solid_difference_2 = SolidDifference(BrepsA=solid_union, BrepsB=flatten([move_3.Geometry, mirror.Geometry]))

deconstruct_brep_7 = DeconstructBrep(Brep=[solid_difference_2, move_3.Geometry, mirror.Geometry])  # -> Faces, Edges, Vertices
custom_preview_lineweights = CustomPreviewLineweights(
    Geometry=deconstruct_brep_7.Edges,
    Shader=ColourSwatch(SwatchColor=RGB(0, 0, 0)),
    Thickness=Slider(5, range=0..5),
    Absolute=False)
custom_preview = CustomPreview(Geometry=solid_difference_2, Material=ColourSwatch(SwatchColor=RGBA(255, 112, 112, 200)))
custom_preview_2 = CustomPreview(Geometry=move_3.Geometry, Material=ColourSwatch(SwatchColor=RGBA(112, 193, 255, 200)))
custom_preview_3 = CustomPreview(Geometry=mirror.Geometry, Material=ColourSwatch(SwatchColor=RGBA(136, 255, 112, 200)))
custom_preview_4 = CustomPreview(Material=ColourSwatch(SwatchColor=RGBA(200, 112, 255, 200)))
custom_preview_5 = CustomPreview(Material=ColourSwatch(SwatchColor=RGBA(255, 255, 112, 200)))
custom_preview_6 = CustomPreview(Material=ColourSwatch(SwatchColor=RGB(135, 68, 42)))
