# Grasshopper definition 鼻子榫.gh (Grasshopper 1.0.7)
# plug-ins: Human

# 鼻子榫
number_slider = Slider(25, range=0..100)
cylinder = Cylinder(Base=PlaneXY(0, 0, 0), Radius=number_slider, Length=Slider(100, range=0..100))
yz_plane = YZPlane(Origin=Point(0, 0, 0))
rotate = Rotate(Geometry=cylinder, Angle=degrees(Slider(90, range=0..100)), Plane=yz_plane)  # -> Geometry, Transform
cap_holes_ex = CapHolesEx(Brep=rotate.Geometry)  # -> Brep, Caps, Solid
deconstruct_brep = DeconstructBrep(Brep=cap_holes_ex.Brep)  # -> Faces, Edges, Vertices
list_item = ListItem(List=deconstruct_brep.Edges, Index=Slider(0, range=0..10), Wrap=True)
area = Area(Geometry=list_item)  # -> Area, Centroid
curve_middle = CurveMiddle(Curve=list_item)
end_points = EndPoints(Curve=list_item)  # -> Start, End

# ----
# Angle
angle = Slider(20, range=0..45)

line = Line(StartPoint=end_points.Start, EndPoint=curve_middle)
xz_plane = XZPlane(Origin=area.Centroid)
number_slider_2 = Slider(30, range=0..100)
number_slider_3 = Slider(40, range=0..100)
mirror = Mirror(Geometry=cap_holes_ex.Brep, Plane=xz_plane)  # -> Geometry, Transform
divide_curve = DivideCurve(Curve=line, Count=Slider(3, range=0..10), Kinks=False)  # -> Points, Tangents, Parameters
unit_y = UnitY(Factor=1)
unit_z = UnitZ(Factor=1)
number_slider_4 = Slider(16, range=0..100)
rotate_2 = Rotate(Vector=unit_y, Axis=unit_z, Angle=expr("-x", degrees(angle)))
rotate_3 = Rotate(Vector=unit_y, Axis=unit_z, Angle=degrees(angle))
explode_tree = ExplodeTree(Data=simplify(graft(divide_curve.Points)))  # -> Branch0, Branch1, Branch2, Branch3
center_box = CenterBox(Base=PlaneXY(0, 0, 0), X=Slider(150, range=0..400), Y=number_slider_2, Z=number_slider_3)
curve_middle_2 = CurveMiddle(Curve=line)
division = Division(A=number_slider_2, B=Slider(2, range=0..10))
division_2 = Division(A=number_slider_2, B=Slider(4, range=0..10))
line_sdl = LineSDL(Start=explode_tree.Branch1, Direction=expr("-x", rotate_2), Length=expr("-x", number_slider_4))
line_sdl_2 = LineSDL(Start=explode_tree.Branch2, Direction=expr("-x", rotate_3), Length=expr("-x", number_slider_4))
center_box_2 = CenterBox(Base=curve_middle_2, X=Slider(30, range=0..100), Y=division, Z=division)
multiplication = Multiplication(A=division_2, B=Slider(2, range=0..10))
unit_z_2 = UnitZ(Factor=number_slider)
unit_z_3 = UnitZ(Factor=division)
unit_z_4 = UnitZ(Factor=number_slider_3)
edge_surface = EdgeSurface(CurveA=line_sdl, CurveB=line_sdl_2)
move = Move(Geometry=center_box_2, Motion=expr("-x", unit_z_3))  # -> Geometry, Transform
move_2 = Move(Geometry=center_box, Motion=expr("-x", unit_z_4))  # -> Geometry, Transform
extrude = Extrude(Base=edge_surface, Direction=unit_z_2)
solid_difference = SolidDifference(BrepsA=move_2.Geometry, BrepsB=flatten([cap_holes_ex.Brep, mirror.Geometry]))
deconstruct_brep_2 = DeconstructBrep(Brep=solid_difference)  # -> Faces, Edges, Vertices
list_item_2 = ListItem(List=deconstruct_brep_2.Edges, Index=Slider(16, range=0..20), Wrap=True)
solid_difference_2 = SolidDifference(BrepsA=cap_holes_ex.Brep, BrepsB=flatten(move.Geometry))
curve_middle_3 = CurveMiddle(Curve=list_item_2)
solid_intersection = SolidIntersection(BrepsA=mirror.Geometry, BrepsB=extrude)
solid_union = SolidUnion(Breps=flatten([solid_difference_2, solid_intersection]))
center_box_3 = CenterBox(Base=curve_middle_3, X=number_slider, Y=multiplication, Z=Slider(25, range=0..100))
solid_difference_3 = SolidDifference(BrepsA=mirror.Geometry, BrepsB=flatten([solid_union, center_box_3]))
solid_union_2 = SolidUnion(Breps=flatten([solid_difference, center_box_3]))

deconstruct_brep_3 = DeconstructBrep(Brep=[solid_difference_3, solid_union, solid_union_2])  # -> Faces, Edges, Vertices
custom_preview_lineweights = CustomPreviewLineweights(
    Geometry=deconstruct_brep_3.Edges,
    Shader=ColourSwatch(SwatchColor=RGB(0, 0, 0)),
    Thickness=Slider(5, range=0..5),
    Absolute=False)
custom_preview = CustomPreview(Geometry=solid_difference_3, Material=ColourSwatch(SwatchColor=RGBA(255, 112, 112, 200)))
custom_preview_2 = CustomPreview(Geometry=solid_union, Material=ColourSwatch(SwatchColor=RGBA(112, 193, 255, 200)))
custom_preview_3 = CustomPreview(Geometry=solid_union_2, Material=ColourSwatch(SwatchColor=RGBA(136, 255, 112, 200)))
custom_preview_4 = CustomPreview(Material=ColourSwatch(SwatchColor=RGBA(200, 112, 255, 200)))
custom_preview_5 = CustomPreview(Material=ColourSwatch(SwatchColor=RGBA(255, 255, 112, 200)))
custom_preview_6 = CustomPreview(Material=ColourSwatch(SwatchColor=RGB(135, 68, 42)))
