# Grasshopper definition Half Dovetailed Notch (Coner).gh (Grasshopper 1.0.7)

# ----
# House Corner
# Beam
W = Slider(200, range=0..1000)
L = Slider(1000, range=0..1000)
# Half Dovetailed Notch (Coner)
construct_point = ConstructPoint(XCoordinate=0, YCoordinate=0, ZCoordinate=0)
construct_point_2 = ConstructPoint(XCoordinate=0, YCoordinate=W, ZCoordinate=0)
construct_point_3 = ConstructPoint(XCoordinate=L, YCoordinate=W, ZCoordinate=0)
construct_point_4 = ConstructPoint(XCoordinate=L, YCoordinate=0, ZCoordinate=0)
unit_z = UnitZ(Factor=W)
_4point_surface = _4PointSurface(CornerA=construct_point, CornerB=construct_point_2, CornerC=construct_point_3, CornerD=construct_point_4)
extrude = Extrude(Base=_4point_surface, Direction=unit_z)
deconstruct_brep = DeconstructBrep(Brep=extrude)  # -> Faces, Edges, Vertices

list_item = ListItem(List=deconstruct_brep.Edges, Index=Slider(6, range=0..10), Wrap=True)
list_item_2 = ListItem(List=deconstruct_brep.Edges, Index=Slider(4, range=0..10), Wrap=True)
flip_curve = FlipCurve(Curve=list_item_2)  # -> Curve, Flag
number_slider = Slider(6, range=0..10)
number_slider_2 = Slider(5, range=0..10)
divide_curve = DivideCurve(Curve=list_item, Count=Slider(8, range=0..10), Kinks=False)  # -> Points, Tangents, Parameters
unit_x = UnitX(Factor=W)
divide_curve_2 = DivideCurve(Curve=flip_curve.Curve, Count=Slider(8, range=0..10), Kinks=False)  # -> Points, Tangents, Parameters
unit_x_2 = UnitX(Factor=W)
number_slider_3 = Slider(2, range=0..10)
number_slider_4 = Slider(1, range=0..10)
move = Move(Geometry=divide_curve.Points, Motion=expr("-x", unit_x))  # -> Geometry, Transform
move_2 = Move(Geometry=divide_curve_2.Points, Motion=expr("-x", unit_x_2))  # -> Geometry, Transform
list_item_3 = ListItem(List=move.Geometry, Index=number_slider_3, Wrap=True)
list_item_4 = ListItem(List=move.Geometry, Index=number_slider, Wrap=True)
list_item_5 = ListItem(List=divide_curve.Points, Index=number_slider_3, Wrap=True)
list_item_6 = ListItem(List=divide_curve.Points, Index=number_slider_2, Wrap=True)
list_item_7 = ListItem(List=move_2.Geometry, Index=number_slider_4, Wrap=True)
list_item_8 = ListItem(List=move_2.Geometry, Index=number_slider, Wrap=True)
list_item_9 = ListItem(List=divide_curve_2.Points, Index=number_slider_4, Wrap=True)
list_item_10 = ListItem(List=divide_curve_2.Points, Index=number_slider_2, Wrap=True)
number_slider_5 = Slider(0, range=0..100)
number_slider_6 = Slider(40, range=0..100)
line = Line(StartPoint=list_item_5, EndPoint=list_item_3)
line_2 = Line(StartPoint=list_item_6, EndPoint=list_item_4)
line_3 = Line(StartPoint=list_item_9, EndPoint=list_item_7)
line_4 = Line(StartPoint=list_item_10, EndPoint=list_item_8)
extend_curve = ExtendCurve(Curve=line, Type=0, Start=number_slider_5, End=number_slider_6)
extend_curve_2 = ExtendCurve(Curve=line_2, Type=0, Start=number_slider_5, End=number_slider_6)
extend_curve_3 = ExtendCurve(Curve=line_3, Type=0, Start=number_slider_5, End=number_slider_6)
extend_curve_4 = ExtendCurve(Curve=line_4, Type=0, Start=number_slider_5, End=number_slider_6)
edge_surface = EdgeSurface(CurveA=extend_curve, CurveB=extend_curve_2)
edge_surface_2 = EdgeSurface(CurveA=extend_curve_3, CurveB=extend_curve_4)
loft = Loft(
    Curves=[edge_surface, edge_surface_2],
    Options={Adjust=False, Closed=False, LoftEnds=0, LoftSimp=0, LoftType=0, Rebuild=10, Refit=0.01})
cap_holes_ex = CapHolesEx(Brep=loft)  # -> Brep, Caps, Solid
solid_union = SolidUnion(Breps=flatten([extrude, cap_holes_ex.Brep]))
xz_plane = XZPlane(Origin=Point(0, 0, 0))

mirror = Mirror(Geometry=solid_union, Plane=xz_plane)  # -> Geometry, Transform

rotate_3d = Rotate3D(Geometry=mirror.Geometry, Angle=expr("-x", 1.570796327), Center=Point(0, 0, 0), Axis=Vector(0, 0, 1))  # -> Geometry, Transform
unit_z_2 = UnitZ(Factor=Slider(100, range=0..1000))
number_slider_7 = Slider(200, range=0..1000)
move_3 = Move(Geometry=rotate_3d.Geometry, Motion=unit_z_2)  # -> Geometry, Transform
number_slider_8 = Slider(1000, range=0..1000)
number_slider_9 = Slider(100, range=0..100)
series = Series(Start=Slider(0, range=0..100), Step=number_slider_7, Count=Slider(3, range=0..10))
unit_z_3 = UnitZ(Factor=number_slider_9)
unit_z_4 = UnitZ(Factor=number_slider_7)
unit_z_5 = UnitZ(Factor=series)
center_box = CenterBox(Base=PlaneXY(0, 0, 0), X=number_slider_8, Y=number_slider_8, Z=number_slider_9)
move_4 = Move(Geometry=move_3.Geometry, Motion=expr("-x", unit_z_4))  # -> Geometry, Transform
move_5 = Move(Geometry=center_box, Motion=expr("-x", unit_z_3))  # -> Geometry, Transform
move_6 = Move(Geometry=solid_union, Motion=unit_z_5)  # -> Geometry, Transform
move_7 = Move(Geometry=move_3.Geometry, Motion=unit_z_5)  # -> Geometry, Transform
solid_difference = SolidDifference(BrepsA=move_4.Geometry, BrepsB=move_5.Geometry)

# ---- group: Joint
custom_preview = CustomPreview(Geometry=move_6.Geometry, Material=ColourSwatch(SwatchColor=RGBA(255, 112, 112, 200)))
custom_preview_2 = CustomPreview(Geometry=move_7.Geometry, Material=ColourSwatch(SwatchColor=RGBA(112, 193, 255, 200)))
custom_preview_3 = CustomPreview(Geometry=solid_difference, Material=ColourSwatch(SwatchColor=RGBA(136, 255, 112, 200)))
custom_preview_4 = CustomPreview(Material=ColourSwatch(SwatchColor=RGBA(200, 112, 255, 200)))
custom_preview_5 = CustomPreview(Material=ColourSwatch(SwatchColor=RGBA(255, 255, 112, 200)))
