# Grasshopper definition Saddle Notch (Coner).gh (Grasshopper 1.0.7)
# plug-ins: Human

# Saddle Notch (Coner)
L = Slider(1000, range=0..1000)
construct_point = ConstructPoint(XCoordinate=0, YCoordinate=0, ZCoordinate=0)
construct_point_2 = ConstructPoint(XCoordinate=0, YCoordinate=L, ZCoordinate=0)
number_slider = Slider(100, range=0..1000)
number_slider_2 = Slider(180, range=0..500)
line = Line(StartPoint=construct_point, EndPoint=construct_point_2)
unit_z = UnitZ(Factor=number_slider_2)
extend_curve = ExtendCurve(Curve=line, Type=0, Start=Slider(200, range=0..200), End=Slider(0, range=0..100))
move = Move(Geometry=extend_curve, Motion=expr("-x", unit_z))  # -> Geometry, Transform
pipe = Pipe(Curve=extend_curve, Radius=number_slider, Caps=1)
pipe_2 = Pipe(Curve=move.Geometry, Radius=number_slider, Caps=1)
number_slider_3 = Slider(1000, range=0..1000)
number_slider_4 = Slider(100, range=0..100)
solid_difference = SolidDifference(BrepsA=pipe, BrepsB=pipe_2)
rotate = Rotate(Geometry=solid_difference, Angle=1.570796327, Plane=PlaneXY(0, 0, 0))  # -> Geometry, Transform
unit_z_2 = UnitZ(Factor=Slider(90, range=0..1000))
unit_z_3 = UnitZ(Factor=number_slider_4)
center_box = CenterBox(Base=PlaneXY(0, 0, 0), X=number_slider_3, Y=number_slider_3, Z=number_slider_4)
move_2 = Move(Geometry=rotate.Geometry, Motion=unit_z_2)  # -> Geometry, Transform
move_3 = Move(Geometry=solid_difference, Motion=unit_z)  # -> Geometry, Transform
move_4 = Move(Geometry=center_box, Motion=expr("-x", unit_z_3))  # -> Geometry, Transform
number_slider_5 = Slider(90, range=0..1000)
solid_difference_2 = SolidDifference(BrepsA=move_2.Geometry, BrepsB=solid_difference)
series = Series(Start=Slider(0, range=0..100), Step=number_slider_2, Count=Slider(3, range=0..10))
unit_z_4 = UnitZ(Factor=series)
solid_difference_3 = SolidDifference(BrepsA=move_3.Geometry, BrepsB=solid_difference_2)
solid_difference_4 = SolidDifference(BrepsA=solid_difference, BrepsB=move_4.Geometry)
move_5 = Move(Geometry=solid_difference_2, Motion=unit_z_4)  # -> Geometry, Transform
move_6 = Move(Geometry=solid_difference_3, Motion=unit_z_4)  # -> Geometry, Transform

deconstruct_brep = DeconstructBrep(Brep=[move_5.Geometry, move_6.Geometry, solid_difference_4])  # -> Faces, Edges, Vertices
custom_preview_lineweights = CustomPreviewLineweights(
    Geometry=deconstruct_brep.Edges,
    Shader=ColourSwatch(SwatchColor=RGB(0, 0, 0)),
    Thickness=Slider(5, range=0..5),
    Absolute=False)
custom_preview = CustomPreview(Geometry=move_5.Geometry, Material=ColourSwatch(SwatchColor=RGBA(255, 112, 112, 200)))
custom_preview_2 = CustomPreview(Geometry=move_6.Geometry, Material=ColourSwatch(SwatchColor=RGBA(112, 193, 255, 200)))
custom_preview_3 = CustomPreview(Geometry=solid_difference_4, Material=ColourSwatch(SwatchColor=RGBA(136, 255, 112, 200)))
custom_preview_4 = CustomPreview(Material=ColourSwatch(SwatchColor=RGBA(200, 112, 255, 200)))
custom_preview_5 = CustomPreview(Material=ColourSwatch(SwatchColor=RGBA(255, 255, 112, 200)))
custom_preview_6 = CustomPreview(Material=ColourSwatch(SwatchColor=RGB(135, 68, 42)))
