# Grasshopper definition V Notch (Coner).gh (Grasshopper 1.0.7)
# plug-ins: Human, Pufferfish

L = Slider(150, range=0..1000)
W = Slider(200, range=0..1000)
division = Division(A=W, B=Slider(2, range=0..10))
center_box = CenterBox(Base=PlaneXY(0, 0, 0), X=Slider(460, range=0..1000), Y=Slider(80, range=0..100), Z=Slider(75, range=0..100))
# V Notch (Coner)
construct_point = ConstructPoint(XCoordinate=0, YCoordinate=0, ZCoordinate=0)
construct_point_2 = ConstructPoint(XCoordinate=0, YCoordinate=W, ZCoordinate=0)
construct_point_3 = ConstructPoint(XCoordinate=0, YCoordinate=W, ZCoordinate=L)
construct_point_4 = ConstructPoint(XCoordinate=0, YCoordinate=0, ZCoordinate=L)
construct_point_5 = ConstructPoint(XCoordinate=0, YCoordinate=division, ZCoordinate=Slider(250, range=0..1000))
deconstruct_brep = DeconstructBrep(Brep=center_box)  # -> Faces, Edges, Vertices
rotate = Rotate(Geometry=center_box, Angle=1.570796327, Plane=PlaneXY(0, 0, 0))  # -> Geometry, Transform
line = Line(StartPoint=construct_point, EndPoint=construct_point_2)
line_2 = Line(StartPoint=construct_point_2, EndPoint=construct_point_3)
line_3 = Line(StartPoint=construct_point_3, EndPoint=construct_point_5)
line_4 = Line(StartPoint=construct_point_5, EndPoint=construct_point_4)
line_5 = Line(StartPoint=construct_point_4, EndPoint=construct_point)
deconstruct_brep_2 = DeconstructBrep(Brep=rotate.Geometry)  # -> Faces, Edges, Vertices
boundary_surfaces = BoundarySurfaces(Edges=[line, line_2, line_3, line_4, line_5])
list_item = ListItem(List=deconstruct_brep_2.Edges, Index=Slider(5, range=0..10), Wrap=True)
list_item_2 = ListItem(List=deconstruct_brep.Edges, Index=Slider(5, range=0..10), Wrap=True)
curve_middle = CurveMiddle(Curve=list_item)
unit_x = UnitX(Factor=Slider(1000, range=0..1000))
curve_middle_2 = CurveMiddle(Curve=list_item_2)
extrude = Extrude(Base=boundary_surfaces, Direction=unit_x)
rotate_3d = Rotate3D(Geometry=extrude, Angle=1.570796327, Center=Point(0, 0, 0), Axis=Vector(0, 0, 1))  # -> Geometry, Transform
construct_point_6 = ConstructPoint(XCoordinate=Slider(250, range=0..1000), YCoordinate=0, ZCoordinate=L)
unit_z = UnitZ(Factor=Slider(300, range=0..1000))
move = Move(Geometry=rotate_3d.Geometry, Motion=construct_point_6)  # -> Geometry, Transform
move_2 = Move(Geometry=extrude, Motion=unit_z)  # -> Geometry, Transform
deconstruct_brep_3 = DeconstructBrep(Brep=move.Geometry)  # -> Faces, Edges, Vertices
deconstruct_brep_4 = DeconstructBrep(Brep=move_2.Geometry)  # -> Faces, Edges, Vertices
solid_difference = SolidDifference(BrepsA=move.Geometry, BrepsB=extrude)
solid_difference_2 = SolidDifference(BrepsA=move_2.Geometry, BrepsB=solid_difference)
list_item_3 = ListItem(List=deconstruct_brep_3.Edges, Index=Slider(6, range=0..10), Wrap=True)
list_item_4 = ListItem(List=deconstruct_brep_4.Edges, Index=Slider(6, range=0..10), Wrap=True)
curve_middle_3 = CurveMiddle(Curve=list_item_3)
curve_middle_4 = CurveMiddle(Curve=list_item_4)
move_to_point = MoveToPoint(Geometry=rotate.Geometry, PointA=curve_middle, PointB=curve_middle_3)  # -> Moved, Vector, Transform
move_to_point_2 = MoveToPoint(Geometry=center_box, PointA=curve_middle_2, PointB=curve_middle_4)  # -> Moved, Vector, Transform
solid_difference_3 = SolidDifference(BrepsA=move_to_point.Moved, BrepsB=flatten([move.Geometry, extrude]))
solid_difference_4 = SolidDifference(BrepsA=move_to_point_2.Moved, BrepsB=move.Geometry)
merge = Merge(Data1=solid_difference_3, Data2=solid_difference_4)

deconstruct_brep_5 = DeconstructBrep(Brep=[extrude, solid_difference, solid_difference_2, merge])  # -> Faces, Edges, Vertices
custom_preview_lineweights = CustomPreviewLineweights(
    Geometry=deconstruct_brep_5.Edges,
    Shader=ColourSwatch(SwatchColor=RGB(0, 0, 0)),
    Thickness=Slider(5, range=0..5),
    Absolute=False)
custom_preview = CustomPreview(Geometry=extrude, Material=ColourSwatch(SwatchColor=RGBA(255, 112, 112, 200)))
custom_preview_2 = CustomPreview(Geometry=solid_difference, Material=ColourSwatch(SwatchColor=RGBA(112, 193, 255, 200)))
custom_preview_3 = CustomPreview(Geometry=solid_difference_2, Material=ColourSwatch(SwatchColor=RGBA(136, 255, 112, 200)))
custom_preview_4 = CustomPreview(Geometry=merge, Material=ColourSwatch(SwatchColor=RGBA(200, 112, 255, 200)))
custom_preview_5 = CustomPreview(Material=ColourSwatch(SwatchColor=RGBA(255, 255, 112, 200)))
custom_preview_6 = CustomPreview(Material=ColourSwatch(SwatchColor=RGB(135, 68, 42)))
