# Grasshopper definition Full Dovetailed Notch (Coner).gh (Grasshopper 1.0.7)
# plug-ins: Human

L = Slider(1000, range=0..1000)
W = Slider(200, range=0..1000)
# Full Dovetailed Notch (Coner)
construct_point = ConstructPoint(XCoordinate=0, YCoordinate=0, ZCoordinate=0)
construct_point_2 = ConstructPoint(XCoordinate=0, YCoordinate=W, ZCoordinate=0)
construct_point_3 = ConstructPoint(XCoordinate=L, YCoordinate=W, ZCoordinate=0)
construct_point_4 = ConstructPoint(XCoordinate=L, YCoordinate=0, ZCoordinate=0)
unit_z = UnitZ(Factor=W)
_4point_surface = _4PointSurface(CornerA=construct_point, CornerB=construct_point_2, CornerC=construct_point_3, CornerD=construct_point_4)
extrude = Extrude(Base=_4point_surface, Direction=unit_z)

deconstruct_brep = DeconstructBrep(Brep=extrude)  # -> Faces, Edges, Vertices
list_item = ListItem(List=deconstruct_brep.Edges, Index=Slider(6, range=0..10), Wrap=True)
list_item_2 = ListItem(List=deconstruct_brep.Edges, Index=Slider(4, range=0..10), Wrap=True)
divide_curve = DivideCurve(Curve=list_item, Count=Slider(8, range=0..10), Kinks=False)  # -> Points, Tangents, Parameters
flip_curve = FlipCurve(Curve=list_item_2)  # -> Curve, Flag
angle = Slider(7, range=7..15)
unit_x = UnitX(Factor=1)
unit_y = UnitY(Factor=1)
divide_curve_2 = DivideCurve(Curve=flip_curve.Curve, Count=Slider(8, range=0..10), Kinks=False)  # -> Points, Tangents, Parameters
list_item_3 = ListItem(List=divide_curve.Points, Index=Slider(3, range=0..10), Wrap=True)
list_item_4 = ListItem(List=divide_curve.Points, Index=Slider(5, range=0..10), Wrap=True)
number_slider = Slider(200, range=0..1000)
rotate = Rotate(Vector=unit_x, Axis=unit_y, Angle=expr("-x", degrees(angle)))
rotate_2 = Rotate(Vector=unit_x, Axis=unit_y, Angle=degrees(angle))
list_item_5 = ListItem(List=divide_curve_2.Points, Index=Slider(2, range=0..10), Wrap=True)
list_item_6 = ListItem(List=divide_curve_2.Points, Index=Slider(6, range=0..10), Wrap=True)
line_sdl = LineSDL(Start=list_item_3, Direction=rotate_2, Length=expr("-x", number_slider))
line_sdl_2 = LineSDL(Start=list_item_4, Direction=rotate, Length=expr("-x", number_slider))
number_slider_2 = Slider(0, range=0..100)
number_slider_3 = Slider(40, range=0..100)
line_sdl_3 = LineSDL(Start=list_item_5, Direction=rotate_2, Length=expr("-x", number_slider))
line_sdl_4 = LineSDL(Start=list_item_6, Direction=rotate, Length=expr("-x", number_slider))
extend_curve = ExtendCurve(Curve=line_sdl, Type=0, Start=number_slider_2, End=number_slider_3)
extend_curve_2 = ExtendCurve(Curve=line_sdl_2, Type=0, Start=number_slider_2, End=number_slider_3)
extend_curve_3 = ExtendCurve(Curve=line_sdl_3, Type=0, Start=number_slider_2, End=number_slider_3)
extend_curve_4 = ExtendCurve(Curve=line_sdl_4, Type=0, Start=number_slider_2, End=number_slider_3)
edge_surface = EdgeSurface(CurveA=extend_curve, CurveB=extend_curve_2)
edge_surface_2 = EdgeSurface(CurveA=extend_curve_3, CurveB=extend_curve_4)
loft = Loft(
    Curves=[edge_surface, edge_surface_2],
    Options={Adjust=False, Closed=False, LoftEnds=0, LoftSimp=0, LoftType=0, Rebuild=10, Refit=0.01})
cap_holes_ex = CapHolesEx(Brep=loft)  # -> Brep, Caps, Solid
solid_union = SolidUnion(Breps=flatten([extrude, cap_holes_ex.Brep]))
xz_plane = XZPlane(Origin=Point(0, 0, 0))
mirror = Mirror(Geometry=solid_union, Plane=xz_plane)  # -> Geometry, Transform
rotate_3d = Rotate3D(Geometry=mirror.Geometry, Angle=expr("-x", 1.570796327), Center=Point(0, 0, 0), Axis=Vector(0, 0, 1))  # -> Geometry, Transform
unit_z_2 = UnitZ(Factor=Slider(100, range=0..1000))
number_slider_4 = Slider(1000, range=0..1000)
number_slider_5 = Slider(100, range=0..100)
move = Move(Geometry=rotate_3d.Geometry, Motion=unit_z_2)  # -> Geometry, Transform
series = Series(Start=Slider(0, range=0..100), Step=Slider(200, range=0..1000), Count=Slider(3, range=0..10))
unit_z_3 = UnitZ(Factor=series)
unit_z_4 = UnitZ(Factor=Slider(200, range=0..1000))
unit_z_5 = UnitZ(Factor=number_slider_5)
center_box = CenterBox(Base=PlaneXY(0, 0, 0), X=number_slider_4, Y=number_slider_4, Z=number_slider_5)
move_2 = Move(Geometry=move.Geometry, Motion=expr("-x", unit_z_4))  # -> Geometry, Transform
move_3 = Move(Geometry=center_box, Motion=expr("-x", unit_z_5))  # -> Geometry, Transform
move_4 = Move(Geometry=solid_union, Motion=unit_z_3)  # -> Geometry, Transform
move_5 = Move(Geometry=move.Geometry, Motion=unit_z_3)  # -> Geometry, Transform
solid_difference = SolidDifference(BrepsA=move_2.Geometry, BrepsB=move_3.Geometry)

deconstruct_brep_2 = DeconstructBrep(Brep=[move_4.Geometry, move_5.Geometry, solid_difference])  # -> Faces, Edges, Vertices
custom_preview_lineweights = CustomPreviewLineweights(
    Geometry=deconstruct_brep_2.Edges,
    Shader=ColourSwatch(SwatchColor=RGB(0, 0, 0)),
    Thickness=Slider(5, range=0..5),
    Absolute=False)
custom_preview = CustomPreview(Geometry=move_4.Geometry, Material=ColourSwatch(SwatchColor=RGBA(255, 112, 112, 200)))
custom_preview_2 = CustomPreview(Geometry=move_5.Geometry, Material=ColourSwatch(SwatchColor=RGBA(112, 193, 255, 200)))
custom_preview_3 = CustomPreview(Geometry=solid_difference, Material=ColourSwatch(SwatchColor=RGBA(136, 255, 112, 200)))
custom_preview_4 = CustomPreview(Material=ColourSwatch(SwatchColor=RGBA(200, 112, 255, 200)))
custom_preview_5 = CustomPreview(Material=ColourSwatch(SwatchColor=RGBA(255, 255, 112, 200)))
custom_preview_6 = CustomPreview(Material=ColourSwatch(SwatchColor=RGB(135, 68, 42)))
