# Grasshopper definition Double Plug.gh (Grasshopper 1.0.7)
# plug-ins: Pufferfish

# ---- group: Beam
L = Slider(200, range=0..1000)
# Double Plug
W = Slider(105, range=0..1000)
construct_point = ConstructPoint(XCoordinate=0, YCoordinate=0, ZCoordinate=0)
construct_point_2 = ConstructPoint(XCoordinate=0, YCoordinate=W, ZCoordinate=0)
construct_point_3 = ConstructPoint(XCoordinate=L, YCoordinate=W, ZCoordinate=0)
construct_point_4 = ConstructPoint(XCoordinate=L, YCoordinate=0, ZCoordinate=0)
unit_z = UnitZ(Factor=W)
_4point_surface = _4PointSurface(CornerA=construct_point, CornerB=construct_point_2, CornerC=construct_point_3, CornerD=construct_point_4)
extrude = Extrude(Base=_4point_surface, Direction=unit_z)
deconstruct_brep = DeconstructBrep(Brep=extrude)  # -> Faces, Edges, Vertices
list_item = ListItem(List=deconstruct_brep.Faces, Index="1", Wrap=True)

# ----
number_slider = Slider(2, range=0..10)
number_slider_2 = Slider(7.5, range=0..10)
area = Area(Geometry=list_item)  # -> Area, Centroid
division = Division(A=W, B=number_slider)
unit_x = UnitX(Factor=number_slider_2)
center_box = CenterBox(Base=area.Centroid, X=number_slider_2, Y=Slider(30, range=0..100), Z=division)
division_2 = Division(A=division, B=number_slider)
center_box_2 = CenterBox(Base=area.Centroid, X=division_2, Y=Slider(15, range=0..100), Z=division)
center_box_3 = CenterBox(Base=PlaneXY(0, 0, 0), X=Slider(10, range=0..10), Y=Slider(2, range=0..10), Z=Slider(26.25, range=0..100))
number_slider_3 = Slider(11.3, range=0..100)
move = Move(Geometry=center_box, Motion=unit_x)  # -> Geometry, Transform
area_2 = Area(Geometry=center_box_3)  # -> Area, Centroid
deconstruct_brep_2 = DeconstructBrep(Brep=center_box_2)  # -> Faces, Edges, Vertices
panel = Panel("""4
7""")
division_3 = Division(A=W, B="2")
multiplication = Multiplication(A=W, B="1.3")
list_item_2 = ListItem(List=deconstruct_brep_2.Vertices, Index=panel, Wrap=True)
list_item_3 = ListItem(List=deconstruct_brep_2.Edges, Index="7", Wrap=True)
rotate = Rotate(Geometry=center_box_3, Angle=expr("-x", degrees(number_slider_3)), Plane=area_2.Centroid)  # -> Geometry, Transform
rotate_2 = Rotate(Geometry=center_box_3, Angle=degrees(number_slider_3), Plane=area_2.Centroid)  # -> Geometry, Transform
solid_difference = SolidDifference(BrepsA=extrude, BrepsB=move.Geometry)
curve_middle = CurveMiddle(Curve=list_item_3)
addition = Addition(A=division_3, B=multiplication)
unit_x_2 = UnitX(Factor=addition)
explode_tree = ExplodeTree(Data=simplify(graft(list_item_2)))  # -> Branch0, Branch1
deconstruct_brep_3 = DeconstructBrep(Brep=solid_difference)  # -> Faces, Edges, Vertices
deconstruct_brep_4 = DeconstructBrep(Brep=rotate_2.Geometry)  # -> Faces, Edges, Vertices
deconstruct_brep_5 = DeconstructBrep(Brep=rotate.Geometry)  # -> Faces, Edges, Vertices
move_2 = Move(Geometry=list_item_2, Motion=expr("-x", unit_x_2))  # -> Geometry, Transform
list_item_4 = ListItem(List=deconstruct_brep_3.Faces, Index=Slider(7, range=0..10), Wrap=True)
list_item_5 = ListItem(List=deconstruct_brep_5.Vertices, Index=Slider(4, range=0..10), Wrap=True)
list_item_6 = ListItem(List=deconstruct_brep_4.Vertices, Index=Slider(5, range=0..10), Wrap=True)
number_slider_4 = Slider(52.5, range=0..100)
area_3 = Area(Geometry=list_item_4)  # -> Area, Centroid
explode_tree_2 = ExplodeTree(Data=simplify(graft(move_2.Geometry)))  # -> Branch0, Branch1
unit_x_3 = UnitX(Factor=number_slider_4)
unit_z_2 = UnitZ(Factor=division)
_4point_surface_2 = _4PointSurface(
    CornerA=explode_tree.Branch0,
    CornerB=explode_tree_2.Branch0,
    CornerC=explode_tree_2.Branch1,
    CornerD=explode_tree.Branch1)
center_box_4 = CenterBox(Base=area_3.Centroid, X=number_slider_4, Y=number_slider_4, Z=Slider(200, range=0..200))
move_3 = Move(Geometry=center_box_4, Motion=expr("-x", unit_x_3))  # -> Geometry, Transform
extrude_2 = Extrude(Base=_4point_surface_2, Direction=expr("-x", unit_z_2))
area_4 = Area(Geometry=move_3.Geometry)  # -> Area, Centroid
solid_union = SolidUnion(Breps=flatten([center_box_2, extrude_2]))
deconstruct_brep_6 = DeconstructBrep(Brep=solid_difference)  # -> Faces, Edges, Vertices
deconstruct_brep_7 = DeconstructBrep(Brep=solid_union)  # -> Faces, Edges, Vertices
construct_point_5 = ConstructPoint(XCoordinate="0.5", YCoordinate="1", ZCoordinate=0)
construct_point_6 = ConstructPoint(XCoordinate="0.5", YCoordinate="1", ZCoordinate=0)
list_item_7 = ListItem(List=deconstruct_brep_6.Faces, Index=Slider(7, range=0..10), Wrap=True)
list_item_8 = ListItem(List=deconstruct_brep_7.Faces, Index=Slider(6, range=1..20), Wrap=True)
evaluate_surface = EvaluateSurface(Surface=reparameterize(list_item_7), Point=construct_point_5)  # -> Point, Normal, UDirection, VDirection, Frame
evaluate_surface_2 = EvaluateSurface(Surface=reparameterize(list_item_8), Point=construct_point_6)  # -> Point, Normal, UDirection, VDirection, Frame
orient = Orient(Geometry=solid_union, Source=evaluate_surface_2.Point, Target=evaluate_surface.Point)  # -> Geometry, Transform
deconstruct_brep_8 = DeconstructBrep(Brep=orient.Geometry)  # -> Faces, Edges, Vertices
panel_2 = Panel("""0
2""")
list_item_9 = ListItem(List=deconstruct_brep_8.Edges, Index=panel_2, Wrap=True)
explode_tree_3 = ExplodeTree(Data=simplify(graft(list_item_9)))  # -> Branch0, Branch1
flip_curve = FlipCurve(Curve=explode_tree_3.Branch1)  # -> Curve, Flag
multiplication_2 = Multiplication(A=W, B="0.66")
number_slider_5 = Slider(1, range=0..1)
divide_length = DivideLength(Curve=explode_tree_3.Branch0, Length=multiplication_2)  # -> Points, Tangents, Parameters
divide_length_2 = DivideLength(Curve=flip_curve.Curve, Length=multiplication_2)  # -> Points, Tangents, Parameters
yz_plane = YZPlane(Origin=area_4.Centroid)
list_item_10 = ListItem(List=divide_length.Points, Index=number_slider_5, Wrap=True)
list_item_11 = ListItem(List=divide_length_2.Points, Index=number_slider_5, Wrap=True)
mirror = Mirror(Geometry=solid_difference, Plane=yz_plane)  # -> Geometry, Transform
move_to_point = MoveToPoint(Geometry=rotate_2.Geometry, PointA=list_item_6, PointB=list_item_11)  # -> Moved, Vector, Transform
move_to_point_2 = MoveToPoint(Geometry=rotate.Geometry, PointA=list_item_5, PointB=list_item_10)  # -> Moved, Vector, Transform
line = Line(StartPoint=list_item_10, EndPoint=list_item_11)
unit_z_3 = UnitZ(Factor=Slider(26.25, range=0..100))
curve_middle_2 = CurveMiddle(Curve=line)
deconstruct_brep_9 = DeconstructBrep(Brep=mirror.Geometry)  # -> Faces, Edges, Vertices
merge = Merge(Data1=move_to_point_2.Moved, Data2=move_to_point.Moved)
number_slider_6 = Slider(7.5, range=0..10)
move_4 = Move(Geometry=curve_middle_2, Motion=expr("-x", unit_z_3))  # -> Geometry, Transform
list_item_12 = ListItem(List=deconstruct_brep_9.Edges, Index=Slider(20, range=0..100), Wrap=True)
curve_middle_3 = CurveMiddle(Curve=list_item_12)
center_box_5 = CenterBox(Base=move_4.Geometry, X=number_slider_6, Y=Slider(52.5, range=0..100), Z=number_slider_6)
move_to_point_3 = MoveToPoint(Geometry=center_box_2, PointA=curve_middle, PointB=curve_middle_3)  # -> Moved, Vector, Transform
solid_difference_2 = SolidDifference(BrepsA=orient.Geometry, BrepsB=flatten([merge, center_box_5]))
solid_union_2 = SolidUnion(Breps=flatten([move_to_point_3.Moved, mirror.Geometry]))
solid_union_3 = SolidUnion(Breps=flatten([solid_difference_2, solid_difference]))
solid_difference_3 = SolidDifference(BrepsA=solid_union_2, BrepsB=flatten([solid_union_3, center_box_5, merge]))
merge_2 = Merge(Data1=solid_union_3, Data2=solid_difference_3)
solid_difference_4 = SolidDifference(BrepsA=move_3.Geometry, BrepsB=flatten(merge_2))

# ---- group: Joint
custom_preview = CustomPreview(Geometry=solid_difference_4, Material=ColourSwatch(SwatchColor=RGBA(255, 112, 112, 130)))
custom_preview_2 = CustomPreview(Geometry=solid_union_3, Material=ColourSwatch(SwatchColor=RGBA(112, 193, 255, 130)))
custom_preview_3 = CustomPreview(Geometry=solid_difference_3, Material=ColourSwatch(SwatchColor=RGBA(136, 255, 112, 130)))
custom_preview_4 = CustomPreview(Geometry=merge, Material=ColourSwatch(SwatchColor=RGBA(200, 112, 255, 130)))
custom_preview_5 = CustomPreview(Geometry=center_box_5, Material=ColourSwatch(SwatchColor=RGBA(255, 255, 112, 130)))
