# Grasshopper definition Gooseneck Splice 2.gh (Grasshopper 1.0.7)
# plug-ins: Human

# ---- group: Beam
L = Slider(200, range=0..1000)
# Gooseneck Splice 2
W = Slider(105, range=0..1000)
construct_point = ConstructPoint(XCoordinate=0, YCoordinate=0, ZCoordinate=0)
construct_point_2 = ConstructPoint(XCoordinate=0, YCoordinate=W, ZCoordinate=0)
construct_point_3 = ConstructPoint(XCoordinate=L, YCoordinate=W, ZCoordinate=0)
construct_point_4 = ConstructPoint(XCoordinate=L, YCoordinate=0, ZCoordinate=0)
unit_z = UnitZ(Factor=W)
_4point_surface = _4PointSurface(CornerA=construct_point, CornerB=construct_point_2, CornerC=construct_point_3, CornerD=construct_point_4)
extrude = Extrude(Base=_4point_surface, Direction=unit_z)
mirror = Mirror(Geometry=extrude, Plane=PlaneYZ(0, 0, 0))  # -> Geometry, Transform
deconstruct_brep = DeconstructBrep(Brep=extrude)  # -> Faces, Edges, Vertices

# ----
L_2 = Slider(150, range=0..150)
number_slider = Slider(105, range=0..105)
L_3 = Slider(15, range=0..150)
W_2 = Slider(30, range=30..31)
construct_point_5 = ConstructPoint(XCoordinate=0, YCoordinate=0, ZCoordinate=0)
construct_point_6 = ConstructPoint(XCoordinate=0, YCoordinate=W_2, ZCoordinate=0)
construct_point_7 = ConstructPoint(XCoordinate=L_2, YCoordinate=W_2, ZCoordinate=0)
construct_point_8 = ConstructPoint(XCoordinate=L_2, YCoordinate=0, ZCoordinate=0)
construct_point_9 = ConstructPoint(XCoordinate=0, YCoordinate=0, ZCoordinate=0)
construct_point_10 = ConstructPoint(XCoordinate=0, YCoordinate=number_slider, ZCoordinate=0)
construct_point_11 = ConstructPoint(XCoordinate=L_3, YCoordinate=number_slider, ZCoordinate=0)
construct_point_12 = ConstructPoint(XCoordinate=L_3, YCoordinate=0, ZCoordinate=0)
division = Division(A=W, B=Slider(2, range=0..10))
division_2 = Division(A=W, B=Slider(2, range=0..10))
unit_z_2 = UnitZ(Factor=division)
unit_z_3 = UnitZ(Factor=division_2)
_4point_surface_2 = _4PointSurface(CornerA=construct_point_5, CornerB=construct_point_6, CornerC=construct_point_7, CornerD=construct_point_8)
_4point_surface_3 = _4PointSurface(CornerA=construct_point_9, CornerB=construct_point_10, CornerC=construct_point_11, CornerD=construct_point_12)
extrude_2 = Extrude(Base=_4point_surface_2, Direction=unit_z_2)
extrude_3 = Extrude(Base=_4point_surface_3, Direction=unit_z_3)
panel = Panel("""0
1
2""")
deconstruct_brep_2 = DeconstructBrep(Brep=extrude_2)  # -> Faces, Edges, Vertices
list_item = ListItem(List=deconstruct_brep_2.Vertices, Index=panel, Wrap=True)  # -> graft(Item)
list_item_2 = ListItem(List=deconstruct_brep_2.Edges, Index=Slider(0, range=0..10), Wrap=True)
explode_tree = ExplodeTree(Data=simplify(list_item))  # -> Branch0, Branch1, Branch2
curve_middle = CurveMiddle(Curve=list_item_2)
line = Line(StartPoint=curve_middle, EndPoint=explode_tree.Branch2)
offset_curve = OffsetCurve(Curve=line, Distance=expr("-x", Slider(15, range=0..100)), Corners=1)
xz_plane = XZPlane(Origin=curve_middle)
mirror_2 = Mirror(Geometry=offset_curve, Plane=xz_plane)  # -> Geometry, Transform
curve_middle_2 = CurveMiddle(Curve=offset_curve)
curve_middle_3 = CurveMiddle(Curve=mirror_2.Geometry)
_4point_surface_4 = _4PointSurface(CornerA=explode_tree.Branch0, CornerB=explode_tree.Branch1, CornerC=curve_middle_2, CornerD=curve_middle_3)
deconstruct_brep_3 = DeconstructBrep(Brep=extrude)  # -> Faces, Edges, Vertices
deconstruct_brep_4 = DeconstructBrep(Brep=extrude_2)  # -> Faces, Edges, Vertices
extrude_4 = Extrude(Base=_4point_surface_4, Direction=unit_z_2)
construct_point_13 = ConstructPoint(XCoordinate="1", YCoordinate="0.5", ZCoordinate=0)
construct_point_14 = ConstructPoint(XCoordinate="1", YCoordinate="0.5", ZCoordinate=0)
solid_union = SolidUnion(Breps=flatten([mirror.Geometry, extrude_3]))
list_item_3 = ListItem(List=deconstruct_brep_3.Faces, Index=Slider(1, range=0..10), Wrap=True)
list_item_4 = ListItem(List=deconstruct_brep_4.Faces, Index=Slider(3, range=1..20), Wrap=True)
evaluate_surface = EvaluateSurface(Surface=reparameterize(list_item_3), Point=construct_point_13)  # -> Point, Normal, UDirection, VDirection, Frame
evaluate_surface_2 = EvaluateSurface(Surface=reparameterize(list_item_4), Point=construct_point_14)  # -> Point, Normal, UDirection, VDirection, Frame
solid_union_2 = SolidUnion(Breps=flatten([extrude_4, extrude_2]))
orient = Orient(Geometry=solid_union_2, Source=evaluate_surface_2.Point, Target=evaluate_surface.Point)  # -> Geometry, Transform
solid_union_3 = SolidUnion(Breps=flatten([extrude, orient.Geometry]))
solid_difference = SolidDifference(BrepsA=solid_union_3, BrepsB=flatten(extrude_3))
solid_difference_2 = SolidDifference(BrepsA=solid_union, BrepsB=solid_difference)

deconstruct_brep_5 = DeconstructBrep(Brep=[solid_difference_2, solid_difference])  # -> Faces, Edges, Vertices
custom_preview_lineweights = CustomPreviewLineweights(
    Geometry=deconstruct_brep_5.Edges,
    Shader=ColourSwatch(SwatchColor=RGB(0, 0, 0)),
    Thickness=Slider(5, range=0..5),
    Absolute=False)
custom_preview = CustomPreview(Geometry=solid_difference_2, Material=ColourSwatch(SwatchColor=RGBA(255, 112, 112, 200)))
custom_preview_2 = CustomPreview(Geometry=solid_difference, Material=ColourSwatch(SwatchColor=RGBA(112, 193, 255, 200)))
custom_preview_3 = CustomPreview(Material=ColourSwatch(SwatchColor=RGBA(136, 255, 112, 200)))
custom_preview_4 = CustomPreview(Material=ColourSwatch(SwatchColor=RGBA(200, 112, 255, 200)))
custom_preview_5 = CustomPreview(Material=ColourSwatch(SwatchColor=RGBA(255, 255, 112, 200)))
custom_preview_6 = CustomPreview(Material=ColourSwatch(SwatchColor=RGB(135, 68, 42)))
