# Grasshopper definition Groundsill Connections.gh (Grasshopper 1.0.7)

# ----
# Beam
# Description:
# - These dovetailed joints use on the connection of the raft concrete foundtion, and the structure column.
# - The number of dovetailed joints depends of the section of thestructure column,
# - These dovetailed joints will be shorter than usual to avoid collisions between dovetailed joints.
# 
# Combination:
# 1. Raft foundation
# 2. Series of dovetailed joints
# 2. Structure column
# 
# Example of building:
# Common Japanese Residential Building
# 
# Ref:
# https://blog.goo.ne.jp/gooogami/c/a659e603846ea1347499b841c505895c
# 
# https://www.aisf.or.jp/~jaanus/deta/a/arikake.htm
L = Slider(200, range=0..1000)
# Groundsill Connections (Dodai shiguchi)
# 蟻落とし Dovetailed Joint (In general)
W = Slider(105, range=0..1000)
construct_point = ConstructPoint(XCoordinate=0, YCoordinate=0, ZCoordinate=0)
construct_point_2 = ConstructPoint(XCoordinate=0, YCoordinate=W, ZCoordinate=0)
construct_point_3 = ConstructPoint(XCoordinate=L, YCoordinate=W, ZCoordinate=0)
construct_point_4 = ConstructPoint(XCoordinate=L, YCoordinate=0, ZCoordinate=0)
unit_z = UnitZ(Factor=W)
_4point_surface = _4PointSurface(CornerA=construct_point, CornerB=construct_point_2, CornerC=construct_point_3, CornerD=construct_point_4)
extrude = Extrude(Base=_4point_surface, Direction=unit_z)

deconstruct_brep = DeconstructBrep(Brep=extrude)  # -> Faces, Edges, Vertices
list_item = ListItem(List=deconstruct_brep.Faces, Index=Slider(1, range=0..10), Wrap=True)
number_slider = Slider(85, range=0..100)
area = Area(Geometry=list_item)  # -> Area, Centroid
center_box = CenterBox(Base=area.Centroid, X=Slider(4, range=0..10), Y=Slider(44.5, range=0..100), Z=Slider(52.5, range=0..100))
center_box_2 = CenterBox(Base=area.Centroid, X=number_slider, Y=number_slider, Z=Slider(150, range=0..200))
construct_point_5 = ConstructPoint(XCoordinate=expr("-x", Slider(42.5, range=0..100)), YCoordinate=0, ZCoordinate=Slider(97.5, range=0..1000))
move = Move(Geometry=center_box_2, Motion=construct_point_5)  # -> Geometry, Transform
deconstruct_brep_2 = DeconstructBrep(Brep=center_box)  # -> Faces, Edges, Vertices
area_2 = Area(Geometry=move.Geometry)  # -> Area, Centroid
construct_point_6 = ConstructPoint(XCoordinate="0.5", YCoordinate="0.5", ZCoordinate=0)
construct_point_7 = ConstructPoint(XCoordinate="0.5", YCoordinate="0.5", ZCoordinate=0)
list_item_2 = ListItem(List=deconstruct_brep.Faces, Index=Slider(1, range=0..10), Wrap=True)
list_item_3 = ListItem(List=deconstruct_brep_2.Faces, Index=Slider(1, range=1..20), Wrap=True)
evaluate_surface = EvaluateSurface(Surface=reparameterize(list_item_2), Point=construct_point_6)  # -> Point, Normal, UDirection, VDirection, Frame
evaluate_surface_2 = EvaluateSurface(Surface=reparameterize(list_item_3), Point=construct_point_7)  # -> Point, Normal, UDirection, VDirection, Frame
orient = Orient(Geometry=center_box, Source=evaluate_surface_2.Point, Target=evaluate_surface.Point)  # -> Geometry, Transform
deconstruct_brep_3 = DeconstructBrep(Brep=orient.Geometry)  # -> Faces, Edges, Vertices
list_item_4 = ListItem(List=deconstruct_brep_3.Edges, Index=Slider(7, range=0..10), Wrap=True)

# ----
# Angle
angle = Slider(12, range=7..15)

unit_y = UnitY(Factor=Slider(15, range=0..100))
curve_middle = CurveMiddle(Curve=list_item_4)
move_2 = Move(Geometry=curve_middle, Motion=expr("-x", unit_y))  # -> Geometry, Transform
move_3 = Move(Geometry=curve_middle, Motion=unit_y)  # -> Geometry, Transform
unit_x = UnitX(Factor=1)
unit_z_2 = UnitZ(Factor=1)
number_slider_2 = Slider(24, range=0..100)
rotate = Rotate(Vector=unit_x, Axis=unit_z_2, Angle=expr("-x", degrees(angle)))
rotate_2 = Rotate(Vector=unit_x, Axis=unit_z_2, Angle=degrees(angle))
line_sdl = LineSDL(Start=move_3.Geometry, Direction=rotate, Length=expr("-x", number_slider_2))
line_sdl_2 = LineSDL(Start=move_2.Geometry, Direction=rotate_2, Length=expr("-x", number_slider_2))
unit_z_3 = UnitZ(Factor=Slider(105, range=0..1000))
edge_surface = EdgeSurface(CurveA=line_sdl, CurveB=line_sdl_2)
extrude_2 = Extrude(Base=edge_surface, Direction=expr("-x", unit_z_3))
solid_union = SolidUnion(Breps=flatten([extrude, extrude_2, orient.Geometry]))
unit_x_2 = UnitX(Factor=Slider(43, range=0..100))
move_4 = Move(Geometry=solid_union, Motion=unit_x_2)  # -> Geometry, Transform
series = Series(Start=0, Step=Slider(90, range=0..100), Count=Slider(4, range=0..10))
rotate_3 = Rotate(Geometry=move_4.Geometry, Angle=degrees(series), Plane=area_2.Centroid)  # -> Geometry, Transform
solid_difference = SolidDifference(BrepsA=move.Geometry, BrepsB=flatten(rotate_3.Geometry))
explode_tree = ExplodeTree(Data=simplify(graft(rotate_3.Geometry)))  # -> Branch0, Branch1, Branch2, Branch3

# ---- group: Joint
custom_preview = CustomPreview(Geometry=solid_difference, Material=ColourSwatch(SwatchColor=RGBA(255, 112, 112, 200)))
custom_preview_2 = CustomPreview(Geometry=explode_tree.Branch0, Material=ColourSwatch(SwatchColor=RGBA(112, 193, 255, 200)))
custom_preview_3 = CustomPreview(Geometry=explode_tree.Branch1, Material=ColourSwatch(SwatchColor=RGBA(136, 255, 112, 200)))
custom_preview_4 = CustomPreview(Geometry=explode_tree.Branch2, Material=ColourSwatch(SwatchColor=RGBA(200, 112, 255, 200)))
custom_preview_5 = CustomPreview(Geometry=explode_tree.Branch3, Material=ColourSwatch(SwatchColor=RGBA(255, 255, 112, 200)))
