# Grasshopper definition Kawai Tsugite 河合継手.gh (Grasshopper 1.0.7)
# plug-ins: Human

number_slider = Slider(50, range=0..100)
# Kawai Tsugite 河合継手
number_slider_2 = Slider(1, range=0..1)
vector_xyz = VectorXYZ(XComponent=number_slider_2, YComponent=number_slider_2, ZComponent=number_slider_2)  # -> Vector, Length
center_box = CenterBox(Base=PlaneXY(0, 0, 0), X=number_slider, Y=number_slider, Z=number_slider)
box_corners = BoxCorners(Box=center_box)  # -> CornerA, CornerB, CornerC, CornerD, CornerE, CornerF, CornerG, CornerH
deconstruct_brep = DeconstructBrep(Brep=center_box)  # -> Faces, Edges, Vertices
area = Area(Geometry=deconstruct_brep.Faces)  # -> Area, Centroid
plane_normal = PlaneNormal(Origin=box_corners.CornerB, ZAxis=vector_xyz.Vector)
plane_normal_2 = PlaneNormal(Origin=box_corners.CornerC, ZAxis=vector_xyz.Vector)
deconstruct = Deconstruct(Point=area.Centroid)  # -> XComponent, YComponent, ZComponent
sort_list = SortList(Keys=deconstruct.ZComponent, ValuesValuesA=deconstruct_brep.Faces)  # -> Keys, ValuesValuesA
merge = Merge(Data1=plane_normal, Data2=plane_normal_2)
brep_plane = BrepPlane(Brep=center_box, Plane=merge)  # -> simplify(Curves), Points
list_item = ListItem(List=sort_list.ValuesValuesA, Index=0, Wrap=True)
explode_tree = ExplodeTree(Data=brep_plane.Curves)  # -> Branch0, Branch1
explode = Explode(Curve=explode_tree.Branch0, Recursive=True)  # -> Segments, Vertices
area_2 = Area(Geometry=brep_plane.Curves)  # -> Area, Centroid
area_3 = Area(Geometry=explode_tree.Branch0)  # -> Area, Centroid
construct_domain = ConstructDomain(DomainStart=0, DomainEnd=1)
construct_domain_2 = ConstructDomain(DomainStart=2, DomainEnd=3)
scale = Scale(Geometry=brep_plane.Curves, Center=area_2.Centroid, Factor="5")  # -> Geometry, Transform
divide_curve = DivideCurve(Curve=explode.Segments, Count="3", Kinks=False)  # -> Points, Tangents, Parameters
multiplication = Multiplication(A=number_slider, B="5")
amplitude = Amplitude(Vector=vector_xyz.Vector, Amplitude=multiplication)
boundary_surfaces = BoundarySurfaces(Edges=scale.Geometry)
extrude = Extrude(Base=boundary_surfaces, Direction=amplitude)
sub_list = SubList(List=divide_curve.Points, Domain=construct_domain, Wrap=True)  # -> List, Index
sub_list_2 = SubList(List=divide_curve.Points, Domain=construct_domain_2, Wrap=True)  # -> List, Index
polyline = PolyLine(Vertices=sub_list.List, Closed=False)
polyline_2 = PolyLine(Vertices=sub_list_2.List, Closed=False)
solid_difference = SolidDifference(BrepsA=center_box, BrepsB=extrude)
merge_2 = Merge(Data1=polyline, Data2=polyline_2)  # -> flatten(Result)
explode_tree_2 = ExplodeTree(Data=solid_difference)  # -> Branch0, Branch1
join_curves = JoinCurves(Curves=merge_2, Preserve=False)
extrude_point = ExtrudePoint(Base=join_curves, Point=area_3.Centroid)
scale_2 = Scale(Geometry=extrude_point, Center=area_3.Centroid, Factor="5")  # -> Geometry, Transform
extrude_2 = Extrude(Base=scale_2.Geometry, Direction=amplitude)  # -> graft(Extrusion)
unit_z = UnitZ(Factor=Slider(200, range=0..1000))
extrude_3 = Extrude(Base=list_item, Direction=expr("-x", unit_z))
solid_intersection = SolidIntersection(BrepsA=explode_tree_2.Branch1, BrepsB=simplify(extrude_2))
merge_3 = Merge(Data1=explode_tree_2.Branch0, Data2=solid_intersection, Data3=extrude_3)
amplitude_2 = Amplitude(Vector=vector_xyz.Vector, Amplitude=Slider(0, range=0..1000))
solid_union = SolidUnion(Breps=flatten(merge_3))

# ---- group: Move and Rotate
pi = Pi(Factor=Slider(0.5, range=0..1))
pi_2 = Pi(Factor=Slider(1, range=0..10))
xz_plane = XZPlane(Origin=Point(0, 0, 0))
xy_plane = XYPlane(Origin=Point(0, 0, 0))
rotate = Rotate(Geometry=solid_union, Angle=pi, Plane=xz_plane)  # -> Geometry, Transform
rotate_2 = Rotate(Geometry=xy_plane, Angle=pi, Plane=xz_plane)  # -> Geometry, Transform
rotate_3 = Rotate(Geometry=rotate.Geometry, Angle=pi_2, Plane=rotate_2.Geometry)  # -> Geometry, Transform
move = Move(Geometry=rotate_3.Geometry, Motion=amplitude_2)  # -> Geometry, Transform

# ----
deconstruct_brep_2 = DeconstructBrep(Brep=[solid_union, move.Geometry])  # -> Faces, Edges, Vertices
custom_preview_lineweights = CustomPreviewLineweights(
    Geometry=deconstruct_brep_2.Edges,
    Shader=ColourSwatch(SwatchColor=RGB(0, 0, 0)),
    Thickness=Slider(5, range=0..5),
    Absolute=False)
custom_preview = CustomPreview(Geometry=solid_union, Material=ColourSwatch(SwatchColor=RGBA(255, 112, 112, 200)))
custom_preview_2 = CustomPreview(Geometry=move.Geometry, Material=ColourSwatch(SwatchColor=RGBA(112, 193, 255, 200)))
custom_preview_3 = CustomPreview(Material=ColourSwatch(SwatchColor=RGBA(136, 255, 112, 200)))
custom_preview_4 = CustomPreview(Material=ColourSwatch(SwatchColor=RGBA(200, 112, 255, 200)))
custom_preview_5 = CustomPreview(Material=ColourSwatch(SwatchColor=RGBA(255, 255, 112, 200)))
custom_preview_6 = CustomPreview(Material=ColourSwatch(SwatchColor=RGB(135, 68, 42)))
