# Grasshopper definition Pole Tenon (2 pins).gh (Grasshopper 1.0.7)
# plug-ins: Human, Pufferfish

# ----
# Pole Tenon (2 pins)
# Beam
W = Slider(105, range=0..1000)
L = Slider(200, range=0..1000)
construct_point = ConstructPoint(XCoordinate=0, YCoordinate=0, ZCoordinate=0)
construct_point_2 = ConstructPoint(XCoordinate=0, YCoordinate=W, ZCoordinate=0)
construct_point_3 = ConstructPoint(XCoordinate=L, YCoordinate=W, ZCoordinate=0)
construct_point_4 = ConstructPoint(XCoordinate=L, YCoordinate=0, ZCoordinate=0)
unit_z = UnitZ(Factor=W)
_4point_surface = _4PointSurface(CornerA=construct_point, CornerB=construct_point_2, CornerC=construct_point_3, CornerD=construct_point_4)
extrude = Extrude(Base=_4point_surface, Direction=unit_z)
mirror = Mirror(Geometry=extrude, Plane=PlaneYZ(0, 0, 0))  # -> Geometry, Transform

L_2 = Slider(180, range=0..180)
W_2 = Slider(9, range=0..30)
W_3 = Slider(30, range=0..30)
L_3 = Slider(39, range=0..180)
W_4 = Slider(12, range=0..30)
construct_point_5 = ConstructPoint(XCoordinate=0, YCoordinate=0, ZCoordinate=0)
construct_point_6 = ConstructPoint(XCoordinate=0, YCoordinate=W_3, ZCoordinate=0)
construct_point_7 = ConstructPoint(XCoordinate=L_2, YCoordinate=W_3, ZCoordinate=0)
construct_point_8 = ConstructPoint(XCoordinate=L_2, YCoordinate=0, ZCoordinate=0)
construct_point_9 = ConstructPoint(XCoordinate=0, YCoordinate=0, ZCoordinate=0)
construct_point_10 = ConstructPoint(XCoordinate=0, YCoordinate=W_2, ZCoordinate=0)
construct_point_11 = ConstructPoint(XCoordinate=L_3, YCoordinate=W_2, ZCoordinate=0)
construct_point_12 = ConstructPoint(XCoordinate=L_3, YCoordinate=0, ZCoordinate=0)
construct_point_13 = ConstructPoint(XCoordinate=0, YCoordinate=0, ZCoordinate=0)
construct_point_14 = ConstructPoint(XCoordinate=0, YCoordinate=W_4, ZCoordinate=0)
construct_point_15 = ConstructPoint(XCoordinate=W_4, YCoordinate=W_4, ZCoordinate=0)
construct_point_16 = ConstructPoint(XCoordinate=W_4, YCoordinate=0, ZCoordinate=0)
multiplication = Multiplication(A=Slider(0.3, range=0..1), B=L)
multiplication_2 = Multiplication(A=Slider(0.3, range=0..1), B=L)
unit_z_2 = UnitZ(Factor=multiplication)
unit_z_3 = UnitZ(Factor=multiplication_2)
_4point_surface_2 = _4PointSurface(CornerA=construct_point_5, CornerB=construct_point_6, CornerC=construct_point_7, CornerD=construct_point_8)
_4point_surface_3 = _4PointSurface(CornerA=construct_point_9, CornerB=construct_point_10, CornerC=construct_point_11, CornerD=construct_point_12)
_4point_surface_4 = _4PointSurface(CornerA=construct_point_13, CornerB=construct_point_14, CornerC=construct_point_15, CornerD=construct_point_16)
extrude_2 = Extrude(Base=_4point_surface_2, Direction=unit_z_2)
extrude_3 = Extrude(Base=_4point_surface_3, Direction=unit_z_2)
extrude_4 = Extrude(Base=_4point_surface_4, Direction=unit_z_3)
deconstruct_brep = DeconstructBrep(Brep=extrude_2)  # -> Faces, Edges, Vertices
rotate = Rotate(Geometry=extrude_3, Angle=degrees(Slider(13, range=0..100)), Plane=PlaneXY(0, 0, 0))  # -> Geometry, Transform
xz_plane = XZPlane(Origin=Point(0, 0, 0))
mirror_2 = Mirror(Geometry=rotate.Geometry, Plane=xz_plane)  # -> Geometry, Transform
deconstruct_brep_2 = DeconstructBrep(Brep=extrude)  # -> Faces, Edges, Vertices
construct_point_17 = ConstructPoint(XCoordinate="1", YCoordinate="0.5", ZCoordinate=0)
list_item = ListItem(List=deconstruct_brep_2.Faces, Index=Slider(1, range=0..10), Wrap=True)
list_item_2 = ListItem(List=deconstruct_brep.Faces, Index=Slider(3, range=0..10), Wrap=True)
evaluate_surface = EvaluateSurface(Surface=reparameterize(list_item), Point=construct_point_17)  # -> Point, Normal, UDirection, VDirection, Frame
evaluate_surface_2 = EvaluateSurface(Surface=reparameterize(list_item_2), Point=construct_point_17)  # -> Point, Normal, UDirection, VDirection, Frame
orient = Orient(Geometry=extrude_2, Source=evaluate_surface_2.Point, Target=evaluate_surface.Point)  # -> Geometry, Transform
panel = Panel("""4
5""")
deconstruct_brep_3 = DeconstructBrep(Brep=orient.Geometry)  # -> Faces, Edges, Vertices
deconstruct_brep_4 = DeconstructBrep(Brep=rotate.Geometry)  # -> Faces, Edges, Vertices
deconstruct_brep_5 = DeconstructBrep(Brep=mirror_2.Geometry)  # -> Faces, Edges, Vertices
deconstruct_brep_6 = DeconstructBrep(Brep=orient.Geometry)  # -> Faces, Edges, Vertices
deconstruct_brep_7 = DeconstructBrep(Brep=extrude_4)  # -> Faces, Edges, Vertices
panel_2 = Panel("""6
7""")
panel_3 = Panel("1")
construct_point_18 = ConstructPoint(XCoordinate="1", YCoordinate="0.5", ZCoordinate=0)
construct_point_19 = ConstructPoint(XCoordinate="1", YCoordinate="1", ZCoordinate=0)
list_item_3 = ListItem(List=deconstruct_brep_3.Faces, Index=[Slider(2, range=0..10), Slider(4, range=0..10)], Wrap=True)
list_item_4 = ListItem(List=deconstruct_brep_4.Faces, Index=Slider(7, range=0..10), Wrap=True)
list_item_5 = ListItem(List=deconstruct_brep_5.Faces, Index=Slider(3, range=0..10), Wrap=True)
list_item_6 = ListItem(List=deconstruct_brep_6.Vertices, Index=panel_2, Wrap=True)
list_item_7 = ListItem(List=deconstruct_brep_7.Vertices, Index=panel, Wrap=True)
evaluate_surface_3 = EvaluateSurface(Surface=reparameterize(list_item_3), Point=construct_point_18)  # -> graft(Point), Normal, UDirection, VDirection, Frame
evaluate_surface_4 = EvaluateSurface(Surface=reparameterize(list_item_4), Point=construct_point_19)  # -> Point, Normal, UDirection, VDirection, Frame
evaluate_surface_5 = EvaluateSurface(Surface=reparameterize(list_item_5), Point=construct_point_19)  # -> Point, Normal, UDirection, VDirection, Frame
explode_tree = ExplodeTree(Data=simplify(graft(list_item_6)))  # -> Branch0, Branch1
explode_tree_2 = ExplodeTree(Data=simplify(graft(list_item_7)))  # -> Branch0, Branch1
explode_tree_3 = ExplodeTree(Data=evaluate_surface_3.Point)  # -> _0000, _0001
orient_2 = Orient(Geometry=rotate.Geometry, Source=evaluate_surface_4.Point, Target=explode_tree_3._0000)  # -> Geometry, Transform
orient_3 = Orient(Geometry=mirror_2.Geometry, Source=evaluate_surface_5.Point, Target=explode_tree_3._0001)  # -> Geometry, Transform
move_to_point = MoveToPoint(Geometry=extrude_4, PointA=explode_tree_2.Branch0, PointB=explode_tree.Branch0)  # -> Moved, Vector, Transform
move_to_point_2 = MoveToPoint(Geometry=extrude_4, PointA=explode_tree_2.Branch1, PointB=explode_tree.Branch1)  # -> Moved, Vector, Transform
solid_union = SolidUnion(Breps=flatten([extrude, orient.Geometry]))
merge = Merge(Data1=orient_2.Geometry, Data2=orient_3.Geometry)
merge_2 = Merge(Data2=move_to_point.Moved, Data3=move_to_point_2.Moved)
solid_difference = SolidDifference(BrepsA=mirror.Geometry, BrepsB=flatten([orient.Geometry, merge]))
solid_difference_2 = SolidDifference(BrepsA=solid_union, BrepsB=flatten([merge, merge_2]))
solid_union_2 = SolidUnion(Breps=flatten([solid_difference, merge_2]))

deconstruct_brep_8 = DeconstructBrep(Brep=[solid_difference_2, solid_union_2, merge])  # -> Faces, Edges, Vertices
custom_preview_lineweights = CustomPreviewLineweights(
    Geometry=deconstruct_brep_8.Edges,
    Shader=ColourSwatch(SwatchColor=RGB(0, 0, 0)),
    Thickness=Slider(5, range=0..5),
    Absolute=False)
custom_preview = CustomPreview(Geometry=solid_difference_2, Material=ColourSwatch(SwatchColor=RGBA(255, 112, 112, 200)))
custom_preview_2 = CustomPreview(Geometry=solid_union_2, Material=ColourSwatch(SwatchColor=RGBA(112, 193, 255, 200)))
custom_preview_3 = CustomPreview(Geometry=merge, Material=ColourSwatch(SwatchColor=RGBA(136, 255, 112, 200)))
custom_preview_4 = CustomPreview(Material=ColourSwatch(SwatchColor=RGBA(200, 112, 255, 200)))
custom_preview_5 = CustomPreview(Material=ColourSwatch(SwatchColor=RGBA(255, 255, 112, 200)))
custom_preview_6 = CustomPreview(Material=ColourSwatch(SwatchColor=RGB(135, 68, 42)))
