# Grasshopper definition Single Faced Rabbeted Oblique Scarf Splice.gh (Grasshopper 1.0.7)
# plug-ins: Pufferfish, Human

# Top Beam
W = Slider(150, range=0..1000)
L = Slider(105, range=0..1000)

# ---- group: Beam
# Beam Extension - Column Connection
# Single Faced Rabbeted Oblique Scarf Splice
# Column
W_2 = Slider(105, range=0..1000)
construct_point = ConstructPoint(XCoordinate=0, YCoordinate=0, ZCoordinate=0)
construct_point_2 = ConstructPoint(XCoordinate=0, YCoordinate=W_2, ZCoordinate=0)
construct_point_3 = ConstructPoint(XCoordinate=W_2, YCoordinate=W_2, ZCoordinate=0)
construct_point_4 = ConstructPoint(XCoordinate=W_2, YCoordinate=0, ZCoordinate=0)
unit_z = UnitZ(Factor=W_2)
_4point_surface = _4PointSurface(CornerA=construct_point, CornerB=construct_point_2, CornerC=construct_point_3, CornerD=construct_point_4)
extrude = Extrude(Base=_4point_surface, Direction=expr("-x", unit_z))

# ----
W_3 = Slider(40, range=0..1000)
L_2 = Slider(70, range=0..1000)
# Beam
W_4 = Slider(105, range=0..1000)
L_3 = Slider(200, range=0..1000)
multiplication = Multiplication(A=L_3, B=Slider(1.5, range=0..10))
multiplication_2 = Multiplication(A=W, B=Slider(2, range=0..10))
W_5 = Slider(70, range=0..1000)
construct_point_5 = ConstructPoint(XCoordinate=0, YCoordinate=expr("-x", W), ZCoordinate=0)
construct_point_6 = ConstructPoint(XCoordinate=L, YCoordinate=expr("-x", W), ZCoordinate=0)
construct_point_7 = ConstructPoint(XCoordinate=0, YCoordinate=0, ZCoordinate=0)
construct_point_8 = ConstructPoint(XCoordinate=0, YCoordinate=W_3, ZCoordinate=0)
construct_point_9 = ConstructPoint(XCoordinate=L_2, YCoordinate=W_3, ZCoordinate=0)
construct_point_10 = ConstructPoint(XCoordinate=L_2, YCoordinate=0, ZCoordinate=0)
construct_point_11 = ConstructPoint(XCoordinate=0, YCoordinate=0, ZCoordinate=0)
construct_point_12 = ConstructPoint(XCoordinate=0, YCoordinate=W_4, ZCoordinate=0)
construct_point_13 = ConstructPoint(XCoordinate=L_3, YCoordinate=W_4, ZCoordinate=0)
construct_point_14 = ConstructPoint(XCoordinate=L_3, YCoordinate=0, ZCoordinate=0)
construct_point_15 = ConstructPoint(XCoordinate=multiplication, YCoordinate=W_4, ZCoordinate=0)
construct_point_16 = ConstructPoint(XCoordinate=multiplication, YCoordinate=0, ZCoordinate=0)
construct_point_17 = ConstructPoint(XCoordinate=0, YCoordinate=multiplication_2, ZCoordinate=0)
construct_point_18 = ConstructPoint(XCoordinate=L, YCoordinate=multiplication_2, ZCoordinate=0)
unit_z_2 = UnitZ(Factor=W_5)
unit_z_3 = UnitZ(Factor=W_4)
unit_z_4 = UnitZ(Factor=Slider(55, range=0..1000))
_4point_surface_2 = _4PointSurface(CornerA=construct_point_7, CornerB=construct_point_8, CornerC=construct_point_9, CornerD=construct_point_10)
_4point_surface_3 = _4PointSurface(CornerA=construct_point_11, CornerB=construct_point_12, CornerC=construct_point_13, CornerD=construct_point_14)
_4point_surface_4 = _4PointSurface(CornerA=construct_point_11, CornerB=construct_point_12, CornerC=construct_point_15, CornerD=construct_point_16)
_4point_surface_5 = _4PointSurface(CornerA=construct_point_5, CornerB=construct_point_17, CornerC=construct_point_18, CornerD=construct_point_6)
extrude_2 = Extrude(Base=_4point_surface_2, Direction=unit_z_2)
extrude_3 = Extrude(Base=_4point_surface_3, Direction=unit_z_3)
extrude_4 = Extrude(Base=_4point_surface_4, Direction=unit_z_3)
extrude_5 = Extrude(Base=_4point_surface_5, Direction=unit_z_4)
addition = Addition(A=W_5, B=Slider(10, range=0..10))
construct_point_19 = ConstructPoint(XCoordinate=0, YCoordinate=0, ZCoordinate=addition)
unit_x = UnitX(Factor=Slider(205, range=0..1000))
deconstruct_brep = DeconstructBrep(Brep=extrude)  # -> Faces, Edges, Vertices
deconstruct_brep_2 = DeconstructBrep(Brep=extrude_2)  # -> Faces, Edges, Vertices
deconstruct_brep_3 = DeconstructBrep(Brep=extrude_4)  # -> Faces, Edges, Vertices
panel = Panel("""4
10""")
move = Move(Geometry=extrude_3, Motion=unit_x)  # -> Geometry, Transform
move_2 = Move(Geometry=extrude_5, Motion=construct_point_19)  # -> Geometry, Transform
construct_point_20 = ConstructPoint(XCoordinate="0.5", YCoordinate="0.5", ZCoordinate=0)
list_item = ListItem(List=deconstruct_brep.Faces, Index=Slider(6, range=0..10), Wrap=True)
list_item_2 = ListItem(List=deconstruct_brep_2.Faces, Index=Slider(6, range=1..20), Wrap=True)
list_item_3 = ListItem(List=deconstruct_brep_3.Edges, Index=panel, Wrap=True)
evaluate_surface = EvaluateSurface(Surface=reparameterize(list_item), Point=construct_point_20)  # -> Point, Normal, UDirection, VDirection, Frame
evaluate_surface_2 = EvaluateSurface(Surface=reparameterize(list_item_2), Point=construct_point_20)  # -> Point, Normal, UDirection, VDirection, Frame
divide_curve = DivideCurve(Curve=list_item_3, Count=Slider(4, range=0..10), Kinks=False)  # -> Points, Tangents, Parameters
number_slider = Slider(1, range=0..1)
orient = Orient(Geometry=extrude_2, Source=evaluate_surface_2.Point, Target=evaluate_surface.Point)  # -> Geometry, Transform
explode_tree = ExplodeTree(Data=divide_curve.Points)  # -> Branch0, Branch1
solid_union = SolidUnion(Breps=flatten([orient.Geometry, extrude]))
list_item_4 = ListItem(List=explode_tree.Branch0, Index=number_slider, Wrap=True)
list_item_5 = ListItem(List=explode_tree.Branch1, Index=number_slider, Wrap=True)
unit_y = UnitY(Factor=W_4)
_4point_surface_6 = _4PointSurface(CornerA=construct_point_11, CornerB=construct_point_16, CornerC=list_item_5, CornerD=list_item_4)
extrude_6 = Extrude(Base=_4point_surface_6, Direction=unit_y)
deconstruct_brep_4 = DeconstructBrep(Brep=move.Geometry)  # -> Faces, Edges, Vertices
deconstruct_brep_5 = DeconstructBrep(Brep=extrude_6)  # -> Faces, Edges, Vertices
construct_point_21 = ConstructPoint(XCoordinate="0", YCoordinate="0.5", ZCoordinate=0)
construct_point_22 = ConstructPoint(XCoordinate="0.5", YCoordinate="0", ZCoordinate=0)
list_item_6 = ListItem(List=deconstruct_brep_4.Vertices, Index=Slider(4, range=0..10), Wrap=True)
list_item_7 = ListItem(List=deconstruct_brep_4.Faces, Index=Slider(1, range=0..10), Wrap=True)
list_item_8 = ListItem(List=deconstruct_brep_5.Faces, Index=Slider(2, range=1..20), Wrap=True)
evaluate_surface_3 = EvaluateSurface(Surface=reparameterize(list_item_7), Point=construct_point_21)  # -> Point, Normal, UDirection, VDirection, Frame
evaluate_surface_4 = EvaluateSurface(Surface=reparameterize(list_item_8), Point=construct_point_22)  # -> Point, Normal, UDirection, VDirection, Frame
orient_2 = Orient(Geometry=extrude_6, Source=evaluate_surface_4.Point, Target=evaluate_surface_3.Point)  # -> Geometry, Transform
solid_union_2 = SolidUnion(Breps=flatten([move.Geometry, orient_2.Geometry]))
area = Area(Geometry=solid_union_2)  # -> Area, Centroid
xz_plane = XZPlane(Origin=Point(0, 0, 0))
solid_difference = SolidDifference(BrepsA=solid_union_2, BrepsB=solid_union)
rotate_3d = Rotate3D(Geometry=solid_union_2, Angle=degrees("180"), Center=area.Centroid, Axis=xz_plane)  # -> Geometry, Transform
deconstruct_brep_6 = DeconstructBrep(Brep=rotate_3d.Geometry)  # -> Faces, Edges, Vertices
list_item_9 = ListItem(List=deconstruct_brep_6.Vertices, Index=0, Wrap=True)
move_to_point = MoveToPoint(Geometry=rotate_3d.Geometry, PointA=list_item_9, PointB=list_item_6)  # -> Moved, Vector, Transform
solid_difference_2 = SolidDifference(BrepsA=move_to_point.Moved, BrepsB=[solid_union, move_2.Geometry])

deconstruct_brep_7 = DeconstructBrep(Brep=[solid_union, solid_difference, solid_difference_2, move_2.Geometry])  # -> Faces, Edges, Vertices
custom_preview_lineweights = CustomPreviewLineweights(
    Geometry=deconstruct_brep_7.Edges,
    Shader=ColourSwatch(SwatchColor=RGB(0, 0, 0)),
    Thickness=Slider(5, range=0..5),
    Absolute=False)
custom_preview = CustomPreview(Geometry=solid_union, Material=ColourSwatch(SwatchColor=RGBA(255, 112, 112, 200)))
custom_preview_2 = CustomPreview(Geometry=solid_difference, Material=ColourSwatch(SwatchColor=RGBA(112, 193, 255, 200)))
custom_preview_3 = CustomPreview(Geometry=solid_difference_2, Material=ColourSwatch(SwatchColor=RGBA(136, 255, 112, 200)))
custom_preview_4 = CustomPreview(Geometry=move_2.Geometry, Material=ColourSwatch(SwatchColor=RGBA(200, 112, 255, 200)))
custom_preview_5 = CustomPreview(Material=ColourSwatch(SwatchColor=RGBA(255, 255, 112, 200)))
custom_preview_6 = CustomPreview(Material=ColourSwatch(SwatchColor=RGB(135, 68, 42)))
