# Grasshopper definition Small Root Tenon Half Wege Joint, Dovetailed Joint.gh (Grasshopper 1.0.7)

# ----
# Beam
W = Slider(105, range=0..1000)
L = Slider(200, range=0..1000)
# 向う大留(おおど)め（目違(めちが)い付）
# 
# Mukō Ō Tome ( Ō Do ) Me ( Me wéi ( Me Chi Ga ) I Tsuke )
# 
# Small Root Tenon: Half Wege Joint, Dovetailed Joint
construct_point = ConstructPoint(XCoordinate=0, YCoordinate=0, ZCoordinate=0)
construct_point_2 = ConstructPoint(XCoordinate=0, YCoordinate=W, ZCoordinate=0)
construct_point_3 = ConstructPoint(XCoordinate=L, YCoordinate=W, ZCoordinate=0)
construct_point_4 = ConstructPoint(XCoordinate=L, YCoordinate=0, ZCoordinate=0)
unit_z = UnitZ(Factor=W)
_4point_surface = _4PointSurface(CornerA=construct_point, CornerB=construct_point_2, CornerC=construct_point_3, CornerD=construct_point_4)
extrude = Extrude(Base=_4point_surface, Direction=unit_z)

W_2 = Slider(8, range=0..1000)
# Description:
# - This combination of joint uses on base post and beam corner connections, especially on top of foundations.
# - This method has better performance in prevent twisting.
# - It is not suitable for materials that crack easily (such as pine)
# - By law, this joint still requires addtional metal reinforcement (Required by the Japanese Building Code).
# 
# Ref:
# https://blog.goo.ne.jp/gooogami/c/a659e603846ea1347499b841c505895c
L_2 = Slider(105, range=0..1000)
construct_point_5 = ConstructPoint(XCoordinate=0, YCoordinate=0, ZCoordinate=0)
construct_point_6 = ConstructPoint(XCoordinate=W_2, YCoordinate=W_2, ZCoordinate=0)
construct_point_7 = ConstructPoint(XCoordinate=L_2, YCoordinate=W_2, ZCoordinate=0)
construct_point_8 = ConstructPoint(XCoordinate=L_2, YCoordinate=0, ZCoordinate=0)
unit_z_2 = UnitZ(Factor=Slider(105, range=0..1000))
_4point_surface_2 = _4PointSurface(CornerA=construct_point_5, CornerB=construct_point_6, CornerC=construct_point_7, CornerD=construct_point_8)
extrude_2 = Extrude(Base=_4point_surface_2, Direction=unit_z_2)

deconstruct_brep = DeconstructBrep(Brep=extrude)  # -> Faces, Edges, Vertices
list_item = ListItem(List=deconstruct_brep.Faces, Index=Slider(1, range=0..10), Wrap=True)
number_slider = Slider(52.5, range=0..100)
number_slider_2 = Slider(4, range=0..100)
number_slider_3 = Slider(52.5, range=0..100)
area = Area(Geometry=list_item)  # -> Area, Centroid
center_box = CenterBox(Base=area.Centroid, X=number_slider, Y=number_slider, Z=Slider(100, range=0..100))
center_box_2 = CenterBox(Base=area.Centroid, X=number_slider_3, Y=Slider(150, range=0..1000), Z=number_slider_3)
center_box_3 = CenterBox(Base=area.Centroid, X=number_slider_2, Y=number_slider_2, Z=Slider(52.5, range=0..100))
center_box_4 = CenterBox(Base=area.Centroid, X=Slider(55, range=0..100), Y=Slider(26.25, range=0..100), Z=Slider(19, range=0..100))
center_box_5 = CenterBox(Base=area.Centroid, X=Slider(4, range=0..100), Y=Slider(52.5, range=0..100), Z=Slider(19, range=0..100))
deconstruct_brep_2 = DeconstructBrep(Brep=center_box)  # -> Faces, Edges, Vertices
deconstruct_brep_3 = DeconstructBrep(Brep=center_box_2)  # -> Faces, Edges, Vertices
deconstruct_brep_4 = DeconstructBrep(Brep=center_box_3)  # -> Faces, Edges, Vertices
deconstruct_brep_5 = DeconstructBrep(Brep=center_box_4)  # -> Faces, Edges, Vertices
deconstruct_brep_6 = DeconstructBrep(Brep=center_box_5)  # -> Faces, Edges, Vertices
deconstruct_brep_7 = DeconstructBrep(Brep=extrude_2)  # -> Faces, Edges, Vertices
construct_point_9 = ConstructPoint(XCoordinate="0.5", YCoordinate="0", ZCoordinate=0)
construct_point_10 = ConstructPoint(XCoordinate="0", YCoordinate="0.5", ZCoordinate=0)
construct_point_11 = ConstructPoint(XCoordinate="0.5", YCoordinate="0", ZCoordinate=0)
construct_point_12 = ConstructPoint(XCoordinate="0", YCoordinate="0.5", ZCoordinate=0)
construct_point_13 = ConstructPoint(XCoordinate="0.5", YCoordinate="1", ZCoordinate=0)
construct_point_14 = ConstructPoint(XCoordinate="1", YCoordinate="0.5", ZCoordinate=0)
construct_point_15 = ConstructPoint(XCoordinate="1", YCoordinate="0.5", ZCoordinate=0)
construct_point_16 = ConstructPoint(XCoordinate="0", YCoordinate="0.5", ZCoordinate=0)
construct_point_17 = ConstructPoint(XCoordinate="0.5", YCoordinate="1", ZCoordinate=0)
list_item_2 = ListItem(List=deconstruct_brep_2.Faces, Index=Slider(4, range=1..20), Wrap=True)
list_item_3 = ListItem(List=deconstruct_brep.Faces, Index=Slider(1, range=0..10), Wrap=True)
list_item_4 = ListItem(List=deconstruct_brep_3.Faces, Index=Slider(1, range=1..20), Wrap=True)
list_item_5 = ListItem(List=deconstruct_brep.Faces, Index=Slider(1, range=0..10), Wrap=True)
list_item_6 = ListItem(List=deconstruct_brep_4.Faces, Index=Slider(1, range=1..20), Wrap=True)
list_item_7 = ListItem(List=deconstruct_brep_5.Faces, Index=Slider(1, range=1..20), Wrap=True)
list_item_8 = ListItem(List=deconstruct_brep_6.Faces, Index=Slider(1, range=1..20), Wrap=True)
list_item_9 = ListItem(List=deconstruct_brep_7.Faces, Index=Slider(3, range=1..20), Wrap=True)
evaluate_surface = EvaluateSurface(Surface=reparameterize(list_item_2), Point=construct_point_10)  # -> Point, Normal, UDirection, VDirection, Frame
evaluate_surface_2 = EvaluateSurface(Surface=reparameterize(list_item_3), Point=construct_point_11)  # -> Point, Normal, UDirection, VDirection, Frame
evaluate_surface_3 = EvaluateSurface(Surface=reparameterize(list_item_4), Point=construct_point_12)  # -> Point, Normal, UDirection, VDirection, Frame
evaluate_surface_4 = EvaluateSurface(Surface=reparameterize(list_item_5), Point=construct_point_13)  # -> Point, Normal, UDirection, VDirection, Frame
evaluate_surface_5 = EvaluateSurface(Surface=reparameterize(list_item_6), Point=construct_point_14)  # -> Point, Normal, UDirection, VDirection, Frame
evaluate_surface_6 = EvaluateSurface(Surface=reparameterize(list_item_7), Point=construct_point_15)  # -> Point, Normal, UDirection, VDirection, Frame
evaluate_surface_7 = EvaluateSurface(Surface=reparameterize(list_item_8), Point=construct_point_16)  # -> Point, Normal, UDirection, VDirection, Frame
evaluate_surface_8 = EvaluateSurface(Surface=reparameterize(list_item_9), Point=construct_point_17)  # -> Point, Normal, UDirection, VDirection, Frame
orient = Orient(Geometry=center_box_2, Source=evaluate_surface_3.Point, Target=evaluate_surface_2.Point)  # -> Geometry, Transform
deconstruct_brep_8 = DeconstructBrep(Brep=orient.Geometry)  # -> Faces, Edges, Vertices
list_item_10 = ListItem(List=deconstruct_brep_8.Faces, Index=Slider(5, range=0..10), Wrap=True)
evaluate_surface_9 = EvaluateSurface(Surface=reparameterize(list_item_10), Point=construct_point_9)  # -> Point, Normal, UDirection, VDirection, Frame
orient_2 = Orient(Geometry=center_box, Source=evaluate_surface.Point, Target=evaluate_surface_9.Point)  # -> Geometry, Transform
orient_3 = Orient(Geometry=center_box_3, Source=evaluate_surface_5.Point, Target=evaluate_surface_4.Point)  # -> Geometry, Transform
orient_4 = Orient(Geometry=center_box_4, Source=evaluate_surface_6.Point, Target=evaluate_surface_4.Point)  # -> Geometry, Transform
orient_5 = Orient(Geometry=center_box_5, Source=evaluate_surface_7.Point, Target=evaluate_surface_2.Point)  # -> Geometry, Transform
orient_6 = Orient(Geometry=extrude_2, Source=evaluate_surface_8.Point, Target=evaluate_surface_2.Point)  # -> Geometry, Transform
deconstruct_brep_9 = DeconstructBrep(Brep=orient_2.Geometry)  # -> Faces, Edges, Vertices
deconstruct_brep_10 = DeconstructBrep(Brep=orient_4.Geometry)  # -> Faces, Edges, Vertices

# ----
# Angle
angle = Slider(12, range=7..15)

number_slider_4 = Slider(20, range=0..100)
number_slider_5 = Slider(8, range=0..10)
list_item_11 = ListItem(List=deconstruct_brep_9.Edges, Index=Slider(2, range=0..10), Wrap=True)
list_item_12 = ListItem(List=deconstruct_brep_10.Edges, Index=Slider(3, range=0..10), Wrap=True)

# ----
# Angle
angle_2 = Slider(1, range=0..5)

construct_point_18 = ConstructPoint(XCoordinate=number_slider_4, YCoordinate=expr("-x", number_slider_5), ZCoordinate=0)
construct_point_19 = ConstructPoint(XCoordinate=number_slider_4, YCoordinate=number_slider_5, ZCoordinate=0)
divide_curve = DivideCurve(Curve=list_item_12, Count=10, Kinks=False)  # -> Points, Tangents, Parameters
curve_middle = CurveMiddle(Curve=list_item_11)
move = Move(Geometry=curve_middle, Motion=expr("-x", construct_point_19))  # -> Geometry, Transform
move_2 = Move(Geometry=curve_middle, Motion=construct_point_18)  # -> Geometry, Transform
unit_y = UnitY(Factor=1)
unit_z_3 = UnitZ(Factor=1)
unit_x = UnitX(Factor=1)
unit_z_4 = UnitZ(Factor=1)
list_item_13 = ListItem(List=divide_curve.Points, Index="2", Wrap=True)
number_slider_6 = Slider(45.5, range=0..100)
number_slider_7 = Slider(65, range=0..100)
rotate = Rotate(Vector=unit_y, Axis=unit_z_3, Angle=expr("-x", degrees(angle)))
rotate_2 = Rotate(Vector=unit_x, Axis=unit_z_4, Angle=expr("-x", degrees(angle_2)))
rotate_3 = Rotate(Vector=unit_y, Axis=unit_z_3, Angle=degrees(angle))
rotate_4 = Rotate(Vector=unit_x, Axis=unit_z_4, Angle=degrees(angle_2))
line_sdl = LineSDL(Start=move_2.Geometry, Direction=rotate, Length=expr("-x", number_slider_6))
line_sdl_2 = LineSDL(Start=move.Geometry, Direction=rotate_3, Length=expr("-x", number_slider_6))
line_sdl_3 = LineSDL(Start=list_item_13, Direction=rotate_4, Length=expr("-x", number_slider_7))
line_sdl_4 = LineSDL(Start=list_item_13, Direction=rotate_2, Length=expr("-x", number_slider_7))
unit_z_5 = UnitZ(Factor=Slider(33.5, range=0..100))
unit_x_2 = UnitX(Factor=Slider(60, range=0..100))
edge_surface = EdgeSurface(CurveA=line_sdl, CurveB=line_sdl_2)
edge_surface_2 = EdgeSurface(CurveA=line_sdl_3, CurveB=line_sdl_4)
extrude_3 = Extrude(Base=edge_surface, Direction=expr("-x", unit_z_5))
move_3 = Move(Geometry=edge_surface_2, Motion=unit_x_2)  # -> Geometry, Transform
area_2 = Area(Geometry=move_3.Geometry)  # -> Area, Centroid
solid_union = SolidUnion(Breps=flatten([orient_2.Geometry, extrude_3]))
rotate_5 = Rotate(Geometry=move_3.Geometry, Angle=expr("-x", degrees(Slider(10, range=0..100))), Plane=area_2.Centroid)  # -> Geometry, Transform
unit_z_6 = UnitZ(Factor=Slider(38, range=0..100))
extrude_4 = Extrude(Base=rotate_5.Geometry, Direction=unit_z_6)
solid_difference = SolidDifference(BrepsA=orient_4.Geometry, BrepsB=extrude_4)
solid_union_2 = SolidUnion(Breps=flatten([extrude, solid_difference, orient_3.Geometry, orient_5.Geometry, orient_6.Geometry]))
solid_difference_2 = SolidDifference(BrepsA=orient.Geometry, BrepsB=flatten([solid_union_2, solid_union, extrude_4]))

# ---- group: Joint
custom_preview = CustomPreview(Geometry=solid_union, Material=ColourSwatch(SwatchColor=RGBA(255, 112, 112, 200)))
custom_preview_2 = CustomPreview(Geometry=solid_difference_2, Material=ColourSwatch(SwatchColor=RGBA(112, 193, 255, 200)))
custom_preview_3 = CustomPreview(Geometry=solid_union_2, Material=ColourSwatch(SwatchColor=RGBA(136, 255, 112, 200)))
custom_preview_4 = CustomPreview(Geometry=extrude_4, Material=ColourSwatch(SwatchColor=RGBA(200, 112, 255, 200)))
