# Grasshopper definition 蟻落とし.gh (Grasshopper 1.0.7)
# plug-ins: Human

# ----
# 蟻落とし
# Beam
W = Slider(105, range=0..1000)
L = Slider(200, range=0..1000)
construct_point = ConstructPoint(XCoordinate=0, YCoordinate=0, ZCoordinate=0)
construct_point_2 = ConstructPoint(XCoordinate=0, YCoordinate=W, ZCoordinate=0)
construct_point_3 = ConstructPoint(XCoordinate=L, YCoordinate=W, ZCoordinate=0)
construct_point_4 = ConstructPoint(XCoordinate=L, YCoordinate=0, ZCoordinate=0)
unit_z = UnitZ(Factor=W)
_4point_surface = _4PointSurface(CornerA=construct_point, CornerB=construct_point_2, CornerC=construct_point_3, CornerD=construct_point_4)
extrude = Extrude(Base=_4point_surface, Direction=unit_z)

deconstruct_brep = DeconstructBrep(Brep=extrude)  # -> Faces, Edges, Vertices
list_item = ListItem(List=deconstruct_brep.Faces, Index=Slider(1, range=0..10), Wrap=True)
list_item_2 = ListItem(List=deconstruct_brep.Faces, Index=Slider(1, range=0..10), Wrap=True)
number_slider = Slider(52.5, range=0..100)
area = Area(Geometry=list_item)  # -> Area, Centroid
area_2 = Area(Geometry=list_item_2)  # -> Area, Centroid
construct_point_5 = ConstructPoint(XCoordinate=expr("-x", Slider(42.5, range=0..100)), YCoordinate=0, ZCoordinate=Slider(147.5, range=0..1000))
center_box = CenterBox(Base=area.Centroid, X=Slider(12.2, range=0..100), Y=Slider(20.2, range=0..100), Z=Slider(52.5, range=0..100))
center_box_2 = CenterBox(Base=area_2.Centroid, X=number_slider, Y=number_slider, Z=Slider(200, range=0..200))
move = Move(Geometry=center_box_2, Motion=construct_point_5)  # -> Geometry, Transform
deconstruct_brep_2 = DeconstructBrep(Brep=center_box)  # -> Faces, Edges, Vertices
construct_point_6 = ConstructPoint(XCoordinate="0.5", YCoordinate="0.5", ZCoordinate=0)
construct_point_7 = ConstructPoint(XCoordinate="0.5", YCoordinate="0.5", ZCoordinate=0)
list_item_3 = ListItem(List=deconstruct_brep.Faces, Index=Slider(1, range=0..10), Wrap=True)
list_item_4 = ListItem(List=deconstruct_brep_2.Faces, Index=Slider(1, range=1..20), Wrap=True)
list_item_5 = ListItem(List=deconstruct_brep.Edges, Index=Slider(5, range=0..10), Wrap=True)
evaluate_surface = EvaluateSurface(Surface=reparameterize(list_item_3), Point=construct_point_6)  # -> Point, Normal, UDirection, VDirection, Frame
evaluate_surface_2 = EvaluateSurface(Surface=reparameterize(list_item_4), Point=construct_point_7)  # -> Point, Normal, UDirection, VDirection, Frame
unit_y = UnitY(Factor=Slider(15, range=0..100))
curve_middle = CurveMiddle(Curve=list_item_5)

# ----
# Angle
angle = Slider(12, range=7..15)

move_2 = Move(Geometry=curve_middle, Motion=expr("-x", unit_y))  # -> Geometry, Transform
orient = Orient(Geometry=center_box, Source=evaluate_surface_2.Point, Target=evaluate_surface.Point)  # -> Geometry, Transform
move_3 = Move(Geometry=curve_middle, Motion=unit_y)  # -> Geometry, Transform
unit_x = UnitX(Factor=1)
unit_z_2 = UnitZ(Factor=1)
solid_union = SolidUnion(Breps=flatten([extrude, orient.Geometry]))
number_slider_2 = Slider(24.8, range=0..100)
rotate = Rotate(Vector=unit_x, Axis=unit_z_2, Angle=expr("-x", degrees(angle)))
construct_point_8 = ConstructPoint(XCoordinate=Slider(10, range=0..10), YCoordinate=0, ZCoordinate=Slider(50, range=0..1000))
unit_z_3 = UnitZ(Factor=Slider(105, range=0..1000))
rotate_2 = Rotate(Vector=unit_x, Axis=unit_z_2, Angle=degrees(angle))
move_4 = Move(Geometry=solid_union, Motion=construct_point_8)  # -> Geometry, Transform
line_sdl = LineSDL(Start=move_3.Geometry, Direction=rotate, Length=expr("-x", number_slider_2))
line_sdl_2 = LineSDL(Start=move_2.Geometry, Direction=rotate_2, Length=expr("-x", number_slider_2))
edge_surface = EdgeSurface(CurveA=line_sdl, CurveB=line_sdl_2)
extrude_2 = Extrude(Base=edge_surface, Direction=expr("-x", unit_z_3))
solid_union_2 = SolidUnion(Breps=flatten([extrude, extrude_2]))
construct_point_9 = ConstructPoint(XCoordinate=Slider(10, range=0..100), YCoordinate=0, ZCoordinate=Slider(155, range=0..200))
move_5 = Move(Geometry=solid_union_2, Motion=construct_point_9)  # -> Geometry, Transform
solid_difference = SolidDifference(BrepsA=move.Geometry, BrepsB=flatten([move_5.Geometry, move_4.Geometry]))

deconstruct_brep_3 = DeconstructBrep(Brep=[solid_difference, move_5.Geometry])  # -> Faces, Edges, Vertices
custom_preview_lineweights = CustomPreviewLineweights(
    Geometry=deconstruct_brep_3.Edges,
    Shader=ColourSwatch(SwatchColor=RGB(0, 0, 0)),
    Thickness=Slider(5, range=0..5),
    Absolute=False)
custom_preview = CustomPreview(Geometry=solid_difference, Material=ColourSwatch(SwatchColor=RGBA(255, 112, 112, 200)))
custom_preview_2 = CustomPreview(Geometry=move_5.Geometry, Material=ColourSwatch(SwatchColor=RGBA(112, 193, 255, 200)))
custom_preview_3 = CustomPreview(Material=ColourSwatch(SwatchColor=RGBA(136, 255, 112, 200)))
custom_preview_4 = CustomPreview(Material=ColourSwatch(SwatchColor=RGBA(200, 112, 255, 200)))
custom_preview_5 = CustomPreview(Material=ColourSwatch(SwatchColor=RGBA(255, 255, 112, 200)))
custom_preview_6 = CustomPreview(Material=ColourSwatch(SwatchColor=RGB(135, 68, 42)))
