# Grasshopper definition Butterfly Joint (Corner).gh (Grasshopper 1.0.7)
# plug-ins: Human

angle = Slider(12, range=7..15)

# ----
# Butterfly Joint (Corner)
# Beam
W = Slider(105, range=0..1000)
L = Slider(200, range=0..1000)
construct_point = ConstructPoint(XCoordinate=0, YCoordinate=0, ZCoordinate=0)
construct_point_2 = ConstructPoint(XCoordinate=W, YCoordinate=W, ZCoordinate=0)
construct_point_3 = ConstructPoint(XCoordinate=L, YCoordinate=W, ZCoordinate=0)
construct_point_4 = ConstructPoint(XCoordinate=L, YCoordinate=0, ZCoordinate=0)
unit_z = UnitZ(Factor=W)
_4point_surface = _4PointSurface(CornerA=construct_point, CornerB=construct_point_2, CornerC=construct_point_3, CornerD=construct_point_4)
extrude = Extrude(Base=_4point_surface, Direction=unit_z)
rotate_3d = Rotate3D(Geometry=extrude, Angle=1.570796327, Center=construct_point_2, Axis=Vector(0, 0, 1))  # -> Geometry, Transform
yz_plane = YZPlane(Origin=construct_point_2)
mirror = Mirror(Geometry=rotate_3d.Geometry, Plane=yz_plane)  # -> Geometry, Transform

construct_point_5 = ConstructPoint(XCoordinate=0, YCoordinate=0, ZCoordinate=0)
construct_point_6 = ConstructPoint(XCoordinate=0, YCoordinate=Slider(30, range=0..30), ZCoordinate=0)
unit_x = UnitX(Factor=1)
unit_z_2 = UnitZ(Factor=1)
number_slider = Slider(50, range=0..100)
rotate = Rotate(Vector=unit_x, Axis=unit_z_2, Angle=expr("-x", degrees(angle)))
rotate_2 = Rotate(Vector=unit_x, Axis=unit_z_2, Angle=degrees(angle))
division = Division(A=W, B=Slider(2, range=0..10))
unit_z_3 = UnitZ(Factor=division)
line_sdl = LineSDL(Start=construct_point_5, Direction=rotate_2, Length=expr("-x", number_slider))
line_sdl_2 = LineSDL(Start=construct_point_6, Direction=rotate, Length=expr("-x", number_slider))
edge_surface = EdgeSurface(CurveA=line_sdl, CurveB=line_sdl_2)
extrude_2 = Extrude(Base=edge_surface, Direction=unit_z_3)
deconstruct_brep = DeconstructBrep(Brep=extrude)  # -> Faces, Edges, Vertices
deconstruct_brep_2 = DeconstructBrep(Brep=extrude_2)  # -> Faces, Edges, Vertices
mirror_2 = Mirror(Geometry=extrude_2, Plane=PlaneYZ(0, 0, 0))  # -> Geometry, Transform
construct_point_7 = ConstructPoint(XCoordinate="1", YCoordinate="0.75", ZCoordinate=0)
construct_point_8 = ConstructPoint(XCoordinate="1", YCoordinate="0.5", ZCoordinate=0)
list_item = ListItem(List=deconstruct_brep.Faces, Index=Slider(1, range=0..10), Wrap=True)
list_item_2 = ListItem(List=deconstruct_brep_2.Faces, Index=Slider(3, range=0..10), Wrap=True)
evaluate_surface = EvaluateSurface(Surface=reparameterize(list_item), Point=construct_point_7)  # -> Point, Normal, UDirection, VDirection, Frame
evaluate_surface_2 = EvaluateSurface(Surface=reparameterize(list_item_2), Point=construct_point_8)  # -> Point, Normal, UDirection, VDirection, Frame
solid_union = SolidUnion(Breps=flatten([extrude_2, mirror_2.Geometry]))
orient = Orient(Geometry=solid_union, Source=evaluate_surface_2.Point, Target=evaluate_surface.Point)  # -> Geometry, Transform
area = Area(Geometry=orient.Geometry)  # -> Area, Centroid
rotate_3d_2 = Rotate3D(
    Geometry=orient.Geometry,
    Angle=expr("-x", degrees(Slider(45, range=0..100))),
    Center=area.Centroid,
    Axis=Vector(0, 0, 1))  # -> Geometry, Transform
solid_difference = SolidDifference(BrepsA=extrude, BrepsB=rotate_3d_2.Geometry)
solid_difference_2 = SolidDifference(BrepsA=mirror.Geometry, BrepsB=rotate_3d_2.Geometry)

deconstruct_brep_3 = DeconstructBrep(Brep=[solid_difference, solid_difference_2, rotate_3d_2.Geometry])  # -> Faces, Edges, Vertices
custom_preview_lineweights = CustomPreviewLineweights(
    Geometry=deconstruct_brep_3.Edges,
    Shader=ColourSwatch(SwatchColor=RGB(0, 0, 0)),
    Thickness=Slider(5, range=0..5),
    Absolute=False)
custom_preview = CustomPreview(Geometry=solid_difference, Material=ColourSwatch(SwatchColor=RGBA(255, 112, 112, 200)))
custom_preview_2 = CustomPreview(Geometry=solid_difference_2, Material=ColourSwatch(SwatchColor=RGBA(112, 193, 255, 200)))
custom_preview_3 = CustomPreview(Geometry=rotate_3d_2.Geometry, Material=ColourSwatch(SwatchColor=RGBA(136, 255, 112, 200)))
custom_preview_4 = CustomPreview(Material=ColourSwatch(SwatchColor=RGBA(200, 112, 255, 200)))
custom_preview_5 = CustomPreview(Material=ColourSwatch(SwatchColor=RGBA(255, 255, 112, 200)))
custom_preview_6 = CustomPreview(Material=ColourSwatch(SwatchColor=RGB(135, 68, 42)))
