# Grasshopper definition Dovetailed Joint (T Shape).gh (Grasshopper 1.0.7)
# plug-ins: Pufferfish, Human

# ----
# Beam
L = Slider(200, range=0..1000)
W = Slider(105, range=0..1000)
# Dovetailed Joint (T Shape)
construct_point = ConstructPoint(XCoordinate=0, YCoordinate=0, ZCoordinate=0)
construct_point_2 = ConstructPoint(XCoordinate=0, YCoordinate=W, ZCoordinate=0)
construct_point_3 = ConstructPoint(XCoordinate=L, YCoordinate=W, ZCoordinate=0)
construct_point_4 = ConstructPoint(XCoordinate=L, YCoordinate=0, ZCoordinate=0)
unit_z = UnitZ(Factor=W)
_4point_surface = _4PointSurface(CornerA=construct_point, CornerB=construct_point_2, CornerC=construct_point_3, CornerD=construct_point_4)
extrude = Extrude(Base=_4point_surface, Direction=unit_z)
rotate_3d = Rotate3D(Geometry=extrude, Angle=degrees(Slider(90, range=0..100)), Center=Point(0, 0, 0), Axis=Vector(0, 0, 1))  # -> Geometry, Transform
unit_y = UnitY(Factor=Slider(50, range=0..100))
move = Move(Geometry=rotate_3d.Geometry, Motion=expr("-x", unit_y))  # -> Geometry, Transform

# ----
# Angle
angle = Slider(12, range=7..15)

L_2 = Slider(15, range=-1..15)
construct_point_5 = ConstructPoint(XCoordinate=0, YCoordinate=0, ZCoordinate=0)
construct_point_6 = ConstructPoint(XCoordinate=0, YCoordinate=W, ZCoordinate=0)
construct_point_7 = ConstructPoint(XCoordinate=L_2, YCoordinate=W, ZCoordinate=0)
construct_point_8 = ConstructPoint(XCoordinate=L_2, YCoordinate=0, ZCoordinate=0)
construct_point_9 = ConstructPoint(XCoordinate=0, YCoordinate=0, ZCoordinate=0)
construct_point_10 = ConstructPoint(XCoordinate=0, YCoordinate=Slider(30, range=0..30), ZCoordinate=0)
unit_x = UnitX(Factor=1)
unit_z_2 = UnitZ(Factor=1)
_4point_surface_2 = _4PointSurface(CornerA=construct_point_5, CornerB=construct_point_6, CornerC=construct_point_7, CornerD=construct_point_8)
number_slider = Slider(75, range=0..100)
division = Division(A=W, B=Slider(2, range=0..10))
rotate = Rotate(Vector=unit_x, Axis=unit_z_2, Angle=expr("-x", degrees(angle)))
rotate_2 = Rotate(Vector=unit_x, Axis=unit_z_2, Angle=degrees(angle))
unit_z_3 = UnitZ(Factor=division)
extrude_2 = Extrude(Base=_4point_surface_2, Direction=unit_z_3)
line_sdl = LineSDL(Start=construct_point_9, Direction=rotate_2, Length=expr("-x", number_slider))
line_sdl_2 = LineSDL(Start=construct_point_10, Direction=rotate, Length=expr("-x", number_slider))
deconstruct_brep = DeconstructBrep(Brep=extrude_2)  # -> Faces, Edges, Vertices
edge_surface = EdgeSurface(CurveA=line_sdl, CurveB=line_sdl_2)
list_item = ListItem(List=deconstruct_brep.Edges, Index=Slider(5, range=0..10), Wrap=True)
extrude_3 = Extrude(Base=edge_surface, Direction=unit_z_3)
deconstruct_brep_2 = DeconstructBrep(Brep=extrude_3)  # -> Faces, Edges, Vertices
list_item_2 = ListItem(List=deconstruct_brep_2.Edges, Index=Slider(9, range=0..10), Wrap=True)
curve_middle = CurveMiddle(Curve=list_item)
curve_middle_2 = CurveMiddle(Curve=list_item_2)
move_to_point = MoveToPoint(Geometry=extrude_3, PointA=curve_middle_2, PointB=curve_middle)  # -> Moved, Vector, Transform
solid_union = SolidUnion(Breps=flatten([move_to_point.Moved, extrude_2]))
deconstruct_brep_3 = DeconstructBrep(Brep=extrude)  # -> Faces, Edges, Vertices
deconstruct_brep_4 = DeconstructBrep(Brep=solid_union)  # -> Faces, Edges, Vertices
construct_point_11 = ConstructPoint(XCoordinate="1", YCoordinate="0.5", ZCoordinate=0)
list_item_3 = ListItem(List=deconstruct_brep_3.Faces, Index=Slider(1, range=0..10), Wrap=True)
list_item_4 = ListItem(List=deconstruct_brep_4.Faces, Index=Slider(8, range=0..10), Wrap=True)
evaluate_surface = EvaluateSurface(Surface=reparameterize(list_item_3), Point=construct_point_11)  # -> Point, Normal, UDirection, VDirection, Frame
evaluate_surface_2 = EvaluateSurface(Surface=reparameterize(list_item_4), Point=construct_point_11)  # -> Point, Normal, UDirection, VDirection, Frame
orient = Orient(Geometry=solid_union, Source=evaluate_surface_2.Point, Target=evaluate_surface.Point)  # -> Geometry, Transform
solid_union_2 = SolidUnion(Breps=flatten([orient.Geometry, extrude]))
solid_difference = SolidDifference(BrepsA=move.Geometry, BrepsB=orient.Geometry)

deconstruct_brep_5 = DeconstructBrep(Brep=[solid_difference, solid_union_2])  # -> Faces, Edges, Vertices
custom_preview_lineweights = CustomPreviewLineweights(
    Geometry=deconstruct_brep_5.Edges,
    Shader=ColourSwatch(SwatchColor=RGB(0, 0, 0)),
    Thickness=Slider(5, range=0..5),
    Absolute=False)
custom_preview = CustomPreview(Geometry=solid_difference, Material=ColourSwatch(SwatchColor=RGBA(255, 112, 112, 200)))
custom_preview_2 = CustomPreview(Geometry=solid_union_2, Material=ColourSwatch(SwatchColor=RGBA(112, 193, 255, 200)))
custom_preview_3 = CustomPreview(Material=ColourSwatch(SwatchColor=RGBA(136, 255, 112, 200)))
custom_preview_4 = CustomPreview(Material=ColourSwatch(SwatchColor=RGBA(200, 112, 255, 200)))
custom_preview_5 = CustomPreview(Material=ColourSwatch(SwatchColor=RGBA(255, 255, 112, 200)))
custom_preview_6 = CustomPreview(Material=ColourSwatch(SwatchColor=RGB(135, 68, 42)))
